# Dynamo graph script.dyn "Primera Capa - Barra Empotrada Pata Derecha" (Dynamo 2.3.2.15696)
# packages: Quasar 2.1.3, Clockwork for Dynamo 2.x 2.3.0, Data-Shapes 2021.2.93, MEPover 2020.6.2, Orchid 204.1.4.7501, Genius Loci 2021.4.13, WombatDynamo 2.3.4, Rhythm 2021.4.2, Orchid 206.3.0.8161, Orchid 200.4.0.7938

activeView = Orchid.RevitProject.Common.Document.ActiveView()
code_block = CodeBlock { "Primera Capa - Barra Empotrada Pata Derecha"; }
file_path = Filename("..\00_IMAGENES\editable Arainco-cmyk-01.png")
code_block_2 = CodeBlock { 150; "INICIAR"; "CANCELAR"; }
code_block_3 = CodeBlock { "Diametro de Barras"; }
code_block_4 = CodeBlock { "EST_D_VIGA_BARRA HORIZONTAL_INFERIOR_EMPOTRADA_PATA DERECHA"; }
byName = Family.ByName(name=code_block_4)
family_types_of_family = Custom[Family types of family](family=byName)  # package MEPover; Returns every family type of the given Family
sortNatural = Orchid.Common.List.SortNatural(list=family_types_of_family)
name = Element.Name(element=sortNatural)
code_block_5 = CodeBlock { 4; }
code_block_6 = CodeBlock { false; }
dropdown_data = Custom[DropDown Data](InputName=code_block_3, Keys=name, Values=sortNatural, DefaultValueIndex=code_block_5, Sorted_optional=code_block_6)  # package Data-Shapes; Create data for DropDown input in UI.MultiInputForm ++ . Check out www.data-shapes.net for more infos.
code_block_7 = CodeBlock { "Cantidad de Barras"; }
code_block_8 = CodeBlock { 1..10..1; 1; }
code_block_9 = CodeBlock { false; }
dropdown_data_2 = Custom[DropDown Data](InputName=code_block_7, Keys=code_block_8.out0, Values=code_block_8.out0, DefaultValueIndex=code_block_8.out1, Sorted_optional=code_block_9)
code_block_10 = CodeBlock { "Selecciona un punto de Inserción"; "SELECCIONAR"; }
selectpointsonface_data = Custom[SelectPointsOnFace data](InputName=code_block_10.out0, ButtonText=code_block_10.out1)  # package Data-Shapes; Creates a UI.MultipleInputForm++ input that allows point on face selection
list_create = List.Create(item0=dropdown_data, item1=dropdown_data_2, item2=selectpointsonface_data)
boolean = BoolSelector(true)
multipleinputform = Custom[MultipleInputForm ++](Description_optional=code_block, Logo_optional=file_path, ButtonText_optional=code_block_2.out1, Inputs=list_create, Toggle=boolean, CancelButtonText_optional=code_block_2.out2, LabelWidth_optional=code_block_2.out0)  # package Data-Shapes; Create a form with multiple inputs. see www.data-shapes.net for tutorials and infos!
nullItem = WombatDynamo.List.NullItem()
if_ = If(test=multipleinputform.Was_Cancelled, true=nullItem, false=multipleinputform.User_Inputs)
code_block_11 = CodeBlock(l=if_) { l[2]; }
code_block_12 = CodeBlock(l=if_) { l[0]; }
activeView_2 = Quasar.ViewUtility.ActiveView()
byPointInView = Custom[FamilyInstance.ByPointInView](point=code_block_11, familyType=code_block_12, view=activeView_2)  # package Clockwork for Dynamo 2.x; Places a family instance at a given point in a given view (e.g. a detail component).
code_block_13 = CodeBlock { "Cantidad de Barras"; }
code_block_14 = CodeBlock(l=if_) { l[1]; }
setParameterByName = Element.SetParameterByName(element=byPointInView, parameterName=code_block_13, value=code_block_14)
end = Revit.Transaction.Transaction.End(input=setParameterByName)
familyinstance_2d_geometry = Custom[FamilyInstance 2D Geometry](element=end)  # package Genius Loci; Gets the curves of the family instance. Works only with the family categories : Generic Annotation and Detail Item.
code_block_15 = CodeBlock { 1; }
getItemAtIndex = List.GetItemAtIndex(list=familyinstance_2d_geometry@L2, index=code_block_15)
code_block_16 = CodeBlock { 0.5; }
pointAtParameter = Curve.PointAtParameter(curve=getItemAtIndex, param=code_block_16)
code_block_17 = CodeBlock { "EST_A_TAG BARRA"; }
o_family_byname = Orchid.RevitProject.Elements.Family.ByName(name=code_block_17)
code_block_18 = CodeBlock { "Barra Horizontal Pata Derecha"; }
byFamilyAndName = FamilyType.ByFamilyAndName(family=o_family_byname, name=code_block_18)
boolean_2 = BoolSelector(true)
create_tag = Custom[Create Tag](view=activeView@L1, element=end@L1, TagLocation=pointAtParameter@L1, TagType=byFamilyAndName@L1, RunIt=boolean_2@L1)  # package Genius Loci; Works only in Revit 2018 and later. Creates a tag at a given location, of given type and in a supplied view. The node also works with Linked Elements (except space and area), Multi Category tag and Material Tag. Based on an archilab node
tag_getlocation = Custom[Tag GetLocation](tag=create_tag@L1)  # package Genius Loci; Retrieves the position of the head of tag.
code_block_19 = CodeBlock { -190; }
translate = Geometry.Translate(geometry=tag_getlocation, zTranslation=code_block_19)
tag_setlocation = Custom[Tag SetLocation](tag=create_tag@L1, location=translate@L1)  # package Genius Loci; Moves the head of the tag to the given location point.
activeView_3 = Orchid.RevitProject.Common.Document.ActiveView()
converted_from_dropdown_with = CodeBlock { DSCore.Types.FindTypeByNameInAssembly("DimensionType", "RevitAPI"); }  # "Converted from Dropdown with Monocle™"
all_elements_of_type = ElementsOfType(element_type=converted_from_dropdown_with)
name_2 = Element.Name(element=all_elements_of_type)
code_block_20 = CodeBlock { "EST_EMPALME"; }
eq = name_2 == code_block_20
filterByBoolMask = List.FilterByBoolMask(list=all_elements_of_type, mask=eq)

# group: EMPALMES
familyinstance_2d_geometry_2 = Custom[FamilyInstance 2D Geometry](element=end)
code_block_21 = CodeBlock { 2; }
getItemAtIndex_2 = List.GetItemAtIndex(list=familyinstance_2d_geometry_2@L2, index=code_block_21)
familyinstance_references = Custom[FamilyInstance References](familyInstance=end)  # package Genius Loci; Returns all references and references names.
code_block_22 = CodeBlock { "Empalme"; }
contains = Orchid.Common.String.Contains(string=familyinstance_references.ReferenceName, searchFor=code_block_22)
filterByBoolMask_2 = List.FilterByBoolMask(list=familyinstance_references.Reference, mask=contains)
dimension_byreferences = Custom[Dimension ByReferences](view=activeView_3, line=getItemAtIndex_2, references=filterByBoolMask_2.in, dimensionType=filterByBoolMask.in, lacing=Longest)  # package Genius Loci; Creates a new linear dimension from at least two geometric references of an object.

ʳʰʸᵗʰᵐ_dimensions_getcurve = Rhythm.Revit.Elements.Dimensions.GetCurve(dimension=dimension_byreferences)
code_block_23 = CodeBlock { 0.5; }
pointAtParameter_2 = Curve.PointAtParameter(curve=ʳʰʸᵗʰᵐ_dimensions_getcurve, param=code_block_23)
code_block_24 = CodeBlock { -200; }
translate_2 = Geometry.Translate(geometry=pointAtParameter_2, zTranslation=code_block_24)
element_setlocation = Custom[Element SetLocation](element=dimension_byreferences, location=translate_2)  # package Genius Loci; Modify the location of the given element. (Same as the Move command in Revit.) Works for point/ line/ sketch based elements, view-specific elements, groups and link instances.
