# Dynamo graph etiquetado_script.dyn (Dynamo 2.3.2.15696)
# packages: Orchid 200.4.0.7938, Clockwork for Dynamo 2.x 2.4.0, Crumple 2022.2.13, Genius Loci 2021.11.10

activeView = Orchid.RevitProject.Common.Document.ActiveView()
code_block = CodeBlock(x=activeView) { x; x; }

# group: Columnas Metalicas Rectangulares
code_block_2 = CodeBlock { "Structural Columns"; }
byName = Category.ByName(name=code_block_2)
code_block_3 = CodeBlock(x=code_block.out1) { x; }
code_block_4 = CodeBlock(x=code_block_3) { x; }
all_elements_of_category_in_view = ElementsOfCategoryInView(Category=byName, View=code_block_4)
familyName = Orchid.RevitProject.Elements.Element.FamilyName(element=all_elements_of_category_in_view)
code_block_5 = CodeBlock()
# ---------- code_block_5.designscript (11 lines) ----------
[
"EST_M_STRUCTURAL COLUMN_SOLDADA_IN",
"EST_M_STRUCTURAL COLUMN_LAMINADA_L",
"EST_M_STRUCTURAL COLUMN_PLEGADA_C",
"EST_M_STRUCTURAL COLUMN_PLEGADA_CA",
"EST_M_STRUCTURAL COLUMN_PLEGADA_HSS",
"EST_M_STRUCTURAL COLUMN_PLEGADA_IC",
"EST_M_STRUCTURAL COLUMN_PLEGADA_L",
"EST_M_STRUCTURAL COLUMN_SOLDADA_HN",
"EST_M_STRUCTURAL COLUMN_SOLDADA_T"
];
# ----------------------------------------
eq = familyName@L1 == code_block_5
anyTrue = Orchid.Common.List.AnyTrue(list=eq)
filterByBoolMask = List.FilterByBoolMask(list=all_elements_of_category_in_view, mask=anyTrue)
name = Material.Name()  # unwired: material
getMaterials = Element.GetMaterials(element=filterByBoolMask.in)
flatten = List.Flatten(list=getMaterials)
function_apply = ApplyFunction(func=name, arg1=flatten)
code_block_6 = CodeBlock { "Steel"; }
eq_2 = function_apply == code_block_6
filterByBoolMask_2 = List.FilterByBoolMask(list=filterByBoolMask.in, mask=eq_2)
element_taggedstatus = Custom[Element TaggedStatus](element=filterByBoolMask_2.in)  # package Genius Loci; Identify the tagged and untagged elements. Please note : This doesn't work with areas and spaces.
code_block_7 = CodeBlock { "Column Style"; 1; }
setParameterByName = Element.SetParameterByName(element=element_taggedstatus.NotTagged, parameterName=code_block_7.out0, value=code_block_7.out1)
location = Custom[Element.Location+](element=setParameterByName)  # package Clockwork for Dynamo 2.x; Returns the location of an element as point, curve or curve loop, along with some booleans to help filtering the results. Unlike the OOTB Element.GetLocation node, it also retunrs sketch lines of sketch-based elements like floor slabs as well as the element's rotation property.
code_block_8 = CodeBlock(x=location.curves)
# ---------- code_block_8.designscript (12 lines) ----------
x;
[Imperative]
{
	if(x == null)
	{
		return = [];
	}
	else
	{
		return = x;
	}
};
# ----------------------------------------
await_ = Orchid.Common.DataStream.Await(pass=setParameterByName, waitFor=code_block_8.out1)
code_block_9 = CodeBlock { "Column Style"; 0; }
setParameterByName_2 = Element.SetParameterByName(element=await_, parameterName=code_block_9.out0, value=code_block_9.out1)
elementcentroid = Custom[© ElementCentroid](element=await_)  # package Crumple; Returns the centroid of the element's axis-aligned bounding box.
code_block_10 = CodeBlock { 0.5; }
planeAtParameter = Curve.PlaneAtParameter(curve=code_block_8.out1, param=code_block_10)
code_block_11 = CodeBlock { 0.5; }
pointAtParameter = Curve.PointAtParameter(curve=code_block_8.out1, param=code_block_11)
code_block_12 = CodeBlock(x=code_block_3) { x; }
plane = Custom[View.Plane](view=code_block_12)  # package Clockwork for Dynamo 2.x; Retrieves the plane of a given view
normal = Plane.Normal(plane=plane)
code_block_13 = CodeBlock { 90; }
rotate = Geometry.Rotate(geometry=planeAtParameter, origin=pointAtParameter, axis=normal, degrees=code_block_13)
normal_2 = Plane.Normal(plane=rotate)
code_block_14 = CodeBlock(z=normal_2) { z.Z; }
code_block_15 = CodeBlock { 0; }
gt = code_block_14 > code_block_15
code_block_16 = CodeBlock { -1; }
ne = code_block_14 != code_block_16
and_ = gt && ne
reverse = Vector.Reverse(vector=normal_2)
scopeIf = Custom[ScopeIf+](test=and_, True=normal_2, False=reverse, lacing=Shortest)  # package Clockwork for Dynamo 2.x; A (hopefully) more robust implementation of ScopeIf. Tests a single boolean and returns a value accordingly.
code_block_17 = CodeBlock(x=await_) { Revit.Elements.Element.GetParameterValueByName(Revit.Elements.Element.GetParameterValueByName(x,"Type"),"Width")/2; }
translate = Geometry.Translate(geometry=elementcentroid, direction=scopeIf, distance=code_block_17)
code_block_18 = CodeBlock()
# ---------- code_block_18.designscript (2 lines) ----------
//horizontal
false;
# ----------------------------------------
byElementAndLocation = Tag.ByElementAndLocation(view=code_block_4, element=await_, location=translate, horizontal=code_block_18)
code_block_19 = CodeBlock { "Type"; }
code_block_20 = CodeBlock { "EST_A_STRUCTURAL COLUMN TAG_ELEVACION_DIMENSIONES"; }
byName_2 = Orchid.RevitProject.Elements.Family.ByName(name=code_block_20)
code_block_21 = CodeBlock { "Pilar Hormigon"; }
byFamilyAndName = FamilyType.ByFamilyAndName(family=byName_2, name=code_block_21)
setParameterByName_3 = Element.SetParameterByName(element=byElementAndLocation, parameterName=code_block_19, value=byFamilyAndName)

await_2 = Orchid.Common.DataStream.Await(pass=code_block.out1, waitFor=setParameterByName_3)

# group: Etiqueta Vigas Metalicas
code_block_22 = CodeBlock { "Structural Framing"; }
byName_3 = Category.ByName(name=code_block_22)
code_block_23 = CodeBlock(x=await_2) { x; }
all_elements_of_category_in_view_2 = ElementsOfCategoryInView(Category=byName_3, View=code_block_23)
familyName_2 = Orchid.RevitProject.Elements.Element.FamilyName(element=all_elements_of_category_in_view_2)
code_block_24 = CodeBlock()
# ---------- code_block_24.designscript (13 lines) ----------
[
"EST_M_STRUCTURAL FRAMING_VIGA LAMINADA_L",
"EST_M_STRUCTURAL FRAMING_VIGA OHM",
"EST_M_STRUCTURAL FRAMING_VIGA PLEGADA_C",
"EST_M_STRUCTURAL FRAMING_VIGA PLEGADA_CA",
"EST_M_STRUCTURAL FRAMING_VIGA PLEGADA_HSS",
"EST_M_STRUCTURAL FRAMING_VIGA PLEGADA_HSSE",
"EST_M_STRUCTURAL FRAMING_VIGA PLEGADA_L",
"EST_M_STRUCTURAL FRAMING_VIGA SOLDADA_HN",
"EST_M_STRUCTURAL FRAMING_VIGA SOLDADA_IN",
"EST_M_STRUCTURAL FRAMING_VIGA SOLDADA_IE",
"EST_M_STRUCTURAL FRAMING_VIGA SOLDADA_T"
];
# ----------------------------------------
eq_3 = familyName_2@L1 == code_block_24
anyTrue_2 = Orchid.Common.List.AnyTrue(list=eq_3)
filterByBoolMask_3 = List.FilterByBoolMask(list=all_elements_of_category_in_view_2, mask=anyTrue_2)
name_2 = Material.Name()  # unwired: material
getMaterials_2 = Element.GetMaterials(element=filterByBoolMask_3.in)
flatten_2 = List.Flatten(list=getMaterials_2)
function_apply_2 = ApplyFunction(func=name_2, arg1=flatten_2)
code_block_25 = CodeBlock { "Concrete, Cast-in-Place gray"; }
eq_4 = function_apply_2 == code_block_25
filterByBoolMask_4 = List.FilterByBoolMask(list=filterByBoolMask_3.in, mask=eq_4)
activeView_2 = Orchid.RevitProject.Common.Document.ActiveView()
location_2 = Custom[Element.Location+](element=filterByBoolMask_3.in)
code_block_26 = CodeBlock(x=location_2.curves)  # same code as code_block_8
direction = Line.Direction(line=code_block_26.out1)
activeView_3 = Orchid.RevitProject.Common.Document.ActiveView()
plane_2 = Custom[View.Plane](view=activeView_3)
isParallelToPlane = Custom[Vector.IsParallelToPlane](vector=direction, plane=plane_2)  # package Clockwork for Dynamo 2.x; Checks if a given vector is parallel to a given plane
filterByBoolMask_5 = List.FilterByBoolMask(list=filterByBoolMask_3.in, mask=isParallelToPlane)
element_taggedstatus_2 = Custom[Element TaggedStatus](element=filterByBoolMask_5.in)
elementcentroid_2 = Custom[© ElementCentroid](element=element_taggedstatus_2.NotTagged)
location_3 = Custom[Element.Location+](element=element_taggedstatus_2.NotTagged)
code_block_27 = CodeBlock(x=location_3.curves)  # same code as code_block_8
code_block_28 = CodeBlock { 0.5; }
planeAtParameter_2 = Curve.PlaneAtParameter(curve=code_block_27.out1, param=code_block_28)
code_block_29 = CodeBlock { 0.5; }
pointAtParameter_2 = Curve.PointAtParameter(curve=code_block_27.out1, param=code_block_29)
activeView_4 = Orchid.RevitProject.Common.Document.ActiveView()
plane_3 = Custom[View.Plane](view=activeView_4)
normal_3 = Plane.Normal(plane=plane_3)
code_block_30 = CodeBlock { 90; }
rotate_2 = Geometry.Rotate(geometry=planeAtParameter_2, origin=pointAtParameter_2, axis=normal_3, degrees=code_block_30)
normal_4 = Plane.Normal(plane=rotate_2)
code_block_31 = CodeBlock(z=normal_4) { z.Z; }
code_block_32 = CodeBlock { 0; }
gt_2 = code_block_31 > code_block_32
code_block_33 = CodeBlock { -1; }
ne_2 = code_block_31 != code_block_33
and_2 = gt_2 && ne_2
reverse_2 = Vector.Reverse(vector=normal_4)
scopeIf_2 = Custom[ScopeIf+](test=and_2, True=normal_4, False=reverse_2, lacing=Shortest)
code_block_34 = CodeBlock(x=element_taggedstatus_2.NotTagged) { Revit.Elements.Element.GetParameterValueByName(Revit.Elements.Element.GetParameterValueByName(x,"Type"),"Height")/2; }
translate_2 = Geometry.Translate(geometry=elementcentroid_2, direction=scopeIf_2, distance=code_block_34)
byElementAndLocation_2 = Tag.ByElementAndLocation(view=activeView_2, element=element_taggedstatus_2.NotTagged, location=translate_2)
code_block_35 = CodeBlock { "Type"; }
code_block_36 = CodeBlock { "EST_A_STRUCTURAL FRAMING TAG_ELEVACION"; }
byName_4 = Orchid.RevitProject.Elements.Family.ByName(name=code_block_36)
code_block_37 = CodeBlock { "Tag Viga"; }
byFamilyAndName_2 = FamilyType.ByFamilyAndName(family=byName_4, name=code_block_37)
setParameterByName_4 = Element.SetParameterByName(element=byElementAndLocation_2, parameterName=code_block_35, value=byFamilyAndName_2)

flatten_3 = List.Flatten(list=setParameterByName_4)
await_3 = Orchid.Common.DataStream.Await(pass=code_block.out1, waitFor=flatten_3)
openView = Orchid.RevitProject.Common.Document.OpenView(view=await_3)
