# Dynamo graph updateBoundary_script.dyn (Dynamo 2.3.2.15696)
# packages: Orchid 200.4.0.7938, archi-lab.net 2022.210.2419, Clockwork for Dynamo 2.x 2.4.0, Genius Loci 2021.11.10

activeView = Orchid.RevitProject.Common.Document.ActiveView()
code_block = CodeBlock { "Lines"; }
byName = Category.ByName(name=code_block)
activeView_2 = Orchid.RevitProject.Common.Document.ActiveView()
code_block_2 = CodeBlock { "Detail Items"; }
byName_2 = Category.ByName(name=code_block_2)
activeView_3 = Orchid.RevitProject.Common.Document.ActiveView()
code_block_3 = CodeBlock { "Lines"; }
byName_3 = Category.ByName(name=code_block_3)
activeView_4 = Orchid.RevitProject.Common.Document.ActiveView()
all_elements_of_category_in_view = ElementsOfCategoryInView(Category=byName_3, View=activeView_4)
flatten = List.Flatten(list=all_elements_of_category_in_view)
name = Element.Name()  # unwired: element
code_block_4 = CodeBlock { "Line Style"; }
getParameterValueByName = Element.GetParameterValueByName(element=flatten, parameterName=code_block_4)
function_apply = ApplyFunction(func=name, arg1=getParameterValueByName)
code_block_5 = CodeBlock { "Wide Lines"; }
eq = function_apply == code_block_5
filterByBoolMask = List.FilterByBoolMask(list=flatten, mask=eq)
delete = Element.Delete(element=filterByBoolMask.in)
flatten_2 = List.Flatten(list=delete)
await_ = Orchid.Common.DataStream.Await(pass=activeView_3, waitFor=flatten_2)
all_elements_of_category_in_view_2 = ElementsOfCategoryInView(Category=byName_2, View=await_)
name_2 = Element.Name(element=all_elements_of_category_in_view_2)
code_block_6 = CodeBlock { "EST_D_BREAKLINE"; }
eq_2 = name_2 == code_block_6
filterByBoolMask_2 = List.FilterByBoolMask(list=all_elements_of_category_in_view_2, mask=eq_2)
delete_2 = Element.Delete(element=filterByBoolMask_2.in)
flatten_3 = List.Flatten(list=delete_2)
await_2 = Orchid.Common.DataStream.Await(pass=activeView_2, waitFor=flatten_3)
all_elements_of_category_in_view_3 = ElementsOfCategoryInView(Category=byName, View=await_2)
flatten_4 = List.Flatten(list=all_elements_of_category_in_view_3)
name_3 = Element.Name()  # unwired: element
code_block_7 = CodeBlock { "Line Style"; }
getParameterValueByName_2 = Element.GetParameterValueByName(element=flatten_4, parameterName=code_block_7)
function_apply_2 = ApplyFunction(func=name_3, arg1=getParameterValueByName_2)
code_block_8 = CodeBlock { "C-VACIO"; }
eq_3 = function_apply_2 == code_block_8
filterByBoolMask_3 = List.FilterByBoolMask(list=flatten_4, mask=eq_3)
geometry = Element.Geometry(element=filterByBoolMask_3.in)
flatten_5 = List.Flatten(list=geometry)
length = Curve.Length(curve=flatten_5)
round = Math.Round(number=length)
groupByKey = List.GroupByKey(list=filterByBoolMask_3.in, keys=round)
count = List.Count(list=groupByKey.groups@L2)
code_block_9 = CodeBlock { 1; }
eq_4 = count == code_block_9
filterByBoolMask_4 = List.FilterByBoolMask(list=groupByKey.groups, mask=eq_4)
flatten_6 = List.Flatten(list=filterByBoolMask_4.out)
delete_3 = Element.Delete(element=flatten_6)
flatten_7 = List.Flatten(list=delete_3)
await_3 = Orchid.Common.DataStream.Await(pass=activeView, waitFor=flatten_7)
code_block_10 = CodeBlock(x=await_3) { x; }
code_block_11 = CodeBlock(x=code_block_10) { x; }
code_block_12 = CodeBlock(x=code_block_10) { x; }

# group: Redibujar Contorno
plane = Custom[View.Plane](view=code_block_11)  # package Clockwork for Dynamo 2.x; Retrieves the plane of a given view
normal = Plane.Normal(plane=plane)
code_block_13 = CodeBlock(t2=code_block_11) { t1 = Revit.Elements.Element.GetParameterValueByName(t2, "Far Clip Offset"); t3 = t1 / 2; t4 = t3 * -1; }
translate = Geometry.Translate(geometry=plane, direction=normal, distance=code_block_13.t4)
byUnion = Solid.ByUnion()  # unwired: solids
code_block_14 = CodeBlock()
# ---------- code_block_14.designscript (7 lines) ----------
[
"Floors",
"Structural Framing",
"Walls",
"Structural Foundations",
"Structural Columns"
];
# ----------------------------------------
byName_4 = Category.ByName(name=code_block_14)
all_elements_of_category_in_view_4 = ElementsOfCategoryInView(Category=byName_4, View=code_block_10)
flatten_8 = List.Flatten(list=all_elements_of_category_in_view_4)
solids = Element.Solids(element=flatten_8)
flatten_9 = List.Flatten(list=solids)
function_apply_3 = ApplyFunction(func=byUnion, arg1=flatten_9)
intersect = Geometry.Intersect(geometry=translate, other=function_apply_3)
perimeterCurves = Surface.PerimeterCurves(surface=intersect)
flatten_10 = List.Flatten(list=perimeterCurves)
byCurve = Custom[DetailCurve.ByCurve+](curve=flatten_10, view=code_block_12)  # package Clockwork for Dynamo 2.x; Creates a detail line based on a given curve. Unlike the OOTB node it can also draw circles.
code_block_15 = CodeBlock { "Line Style"; }
code_block_16 = CodeBlock { "Wide Lines"; }
get_line_style_by_name = Custom[Get Line Style by Name](name=code_block_16)  # package archi-lab.net; This node will return a line style object by its name. Line styles can be either Drafting or Model Line Property.
setParameterByName = Element.SetParameterByName(element=byCurve, parameterName=code_block_15, value=get_line_style_by_name, lacing=Longest)

code_block_17 = CodeBlock(x=await_3) { x; }

# group: Breaklines
code_block_18 = CodeBlock()
# ---------- code_block_18.designscript (3 lines) ----------
element1 = RevitProject.Document.ActiveView(null);
t1 = Revit.Elements.Element.GetParameterValueByName(element1, "Subclasificacion");
t2 = t1 == "03_VH";
# ----------------------------------------
byLoft = Surface.ByLoft()  # unwired: crossSections
translate_2 = Geometry.Translate(lacing=Longest)  # unwired: geometry, direction, distance
byJoinedCurves = PolyCurve.ByJoinedCurves()  # unwired: curves
code_block_19 = CodeBlock(x=code_block_17) { x; }
getCropBox = Orchid.RevitProject.Views.View.GetCropBox(view=code_block_19)
function_apply_4 = ApplyFunction(func=byJoinedCurves, arg1=getCropBox.Curve)
code_block_20 = CodeBlock(x=function_apply_4)
# ---------- code_block_20.designscript (13 lines) ----------
x;

[Imperative]
{
	if(x == null)
	{
		return = [];
	}
	else
	{
		return = x;
	}
};
# ----------------------------------------
code_block_21 = CodeBlock { -690; false; }
offset = PolyCurve.Offset(polyCurve=code_block_20.out1, signedDistance=code_block_21.out0, extendCircular=code_block_21.out1)
plane_2 = Custom[View.Plane](view=code_block_19)
normal_2 = Plane.Normal(plane=plane_2)
reverse = Vector.Reverse(vector=normal_2)
list_create = List.Create(item0=normal_2, item1=reverse)
code_block_22 = CodeBlock { 1000; }
function_apply_5 = ApplyFunction(func=translate_2, arg1=offset, arg2=list_create, arg3=code_block_22)
function_apply_6 = ApplyFunction(func=byLoft, arg1=function_apply_5)
byUnion_2 = Solid.ByUnion()  # unwired: solids
code_block_23 = CodeBlock()
# ---------- code_block_23.designscript (6 lines) ----------
[
"Walls",
"Structural Columns",
"Structural Framing",
"Floors"
];
# ----------------------------------------
byName_5 = Category.ByName(name=code_block_23)
all_elements_of_category_in_view_5 = ElementsOfCategoryInView(Category=byName_5, View=code_block_19)
geometry_2 = Element.Geometry(element=all_elements_of_category_in_view_5)
flatten_11 = List.Flatten(list=geometry_2)
function_apply_7 = ApplyFunction(func=byUnion_2, arg1=flatten_11)
code_block_24 = CodeBlock(x=function_apply_7)  # same code as code_block_20
intersect_2 = Geometry.Intersect(geometry=function_apply_6, other=code_block_24.out1)
code_block_25 = CodeBlock { [0.5,0.5]; [0,1]; }
pointAtParameter = Surface.PointAtParameter(surface=intersect_2@L1, u=code_block_25.out1@L2, v=code_block_25.out0@L2, lacing=Longest)
transpose = List.Transpose(lists=pointAtParameter)
code_block_26 = CodeBlock { null; }
replaceEmptyLists = Custom[List.ReplaceEmptyLists](seq=transpose, Replacement=code_block_26)  # package Clockwork for Dynamo 2.x; Replaces all empty lists within a given list with a substitute
code_block_27 = CodeBlock(x=replaceEmptyLists)
# ---------- code_block_27.designscript (13 lines) ----------
x;

[Imperative]
{
	if(x == null)
	{
		return = [[],[]];
	}
	else
	{
		return = x;
	}
};
# ----------------------------------------
code_block_28 = CodeBlock(x=code_block_27.out1) { x[0]; x[1]; }
byStartPointEndPoint = Line.ByStartPointEndPoint(startPoint=code_block_28.out0, endPoint=code_block_28.out1)
reverse_2 = Curve.Reverse(curve=byStartPointEndPoint)
if_ = If(test=code_block_18.t2, true=byStartPointEndPoint, false=reverse_2)
code_block_29 = CodeBlock(x=code_block_17) { x; }
plane_3 = Custom[View.Plane](view=code_block_29)
pullOntoPlane = Curve.PullOntoPlane(curve=if_, plane=plane_3)
code_block_30 = CodeBlock { "EST_D_BREAKLINE"; }
byName_6 = FamilyType.ByName(name=code_block_30)
byCurve_2 = Custom[DetailComponent.ByCurve](curve=pullOntoPlane, familyType=byName_6, view=code_block_29, lacing=Longest)  # package Clockwork for Dynamo 2.x; Places a line-based detail component in a given view
code_block_31 = CodeBlock { "Length of masking region"; 900; }
setParameterByName_2 = Element.SetParameterByName(element=byCurve_2, parameterName=code_block_31.out0, value=code_block_31.out1)

code_block_32 = CodeBlock(x=code_block_10) { x; }

# group: Marca Vacio
byBestFitThroughPoints = Line.ByBestFitThroughPoints()  # unwired: bestFitPoints
code_block_33 = CodeBlock { null; }
replaceEmptyLists_2 = Custom[List.ReplaceEmptyLists](seq=intersect, Replacement=code_block_33)
code_block_34 = CodeBlock(x=replaceEmptyLists_2)
# ---------- code_block_34.designscript (12 lines) ----------
x;
[Imperative]
{
	if(x == null)
	{
		return = [];
	}
	else
	{
		return = x[0];
	}
};
# ----------------------------------------
perimeterCurves_2 = Surface.PerimeterCurves(surface=code_block_34.out1)
group_curves = Custom[Group Curves](curves=perimeterCurves_2)  # package archi-lab.net; This node will take any input of flat list of curves and group them into sublists containing "joinable" curves that is continous curves. They might form closed curves or open curves. Use PolyCurve.ByJoinedCurves to convert output groups of curves into single PolyCurves
count_2 = List.Count(list=group_curves, lacing=Longest)
code_block_35 = CodeBlock { 4; }
eq_5 = count_2 == code_block_35
filterByBoolMask_5 = List.FilterByBoolMask(list=group_curves, mask=eq_5)
endPoint = Curve.EndPoint(curve=filterByBoolMask_5.in)
code_block_36 = CodeBlock { [0,2,1,3]; }
reorder = List.Reorder(list=endPoint@L2, indices=code_block_36)
code_block_37 = CodeBlock { 2; }
chop = List.Chop(list=reorder@L2, lengths=code_block_37)
function_apply_8 = ApplyFunction(func=byBestFitThroughPoints, arg1=chop)
byCurve_3 = Custom[DetailCurve.ByCurve+](curve=function_apply_8, view=code_block_32)
code_block_38 = CodeBlock(x=byCurve_3)
# ---------- code_block_38.designscript (12 lines) ----------
x;
[Imperative]
{
	if(x == null)
	{
		return = [];
	}
	else
	{
		return = x;
	}
};
# ----------------------------------------
code_block_39 = CodeBlock { "Line Style"; }
code_block_40 = CodeBlock { "C-VACIO"; }
get_line_style_by_name_2 = Custom[Get Line Style by Name](name=code_block_40)
setParameterByName_3 = Element.SetParameterByName(element=code_block_38.out1, parameterName=code_block_39, value=get_line_style_by_name_2, lacing=Longest)

# group: Overrides Fundaciones (Hidden)
code_block_41 = CodeBlock(x=code_block_10) { x; }
code_block_42 = CodeBlock(x=code_block_41) { x; }
code_block_43 = CodeBlock { "Structural Foundations"; }
byName_7 = Category.ByName(name=code_block_43)
all_elements_of_category_in_view_6 = ElementsOfCategoryInView(Category=byName_7, View=code_block_42)
kind = Custom[StructuralFoundation.Kind](structuralFoundation=all_elements_of_category_in_view_6)  # package Clockwork for Dynamo 2.x; Retrieves the kind of a given structural foundation (isolated, wall, slab).
code_block_44 = CodeBlock { "Slab"; }
eq_6 = kind == code_block_44
filterByBoolMask_6 = List.FilterByBoolMask(list=all_elements_of_category_in_view_6, mask=eq_6)
code_block_45 = CodeBlock(x=code_block_41) { x; }
code_block_46 = CodeBlock { null; }
replaceEmptyLists_3 = Custom[List.ReplaceEmptyLists](seq=code_block_45, Replacement=code_block_46)
code_block_47 = CodeBlock(x=replaceEmptyLists_3)
# ---------- code_block_47.designscript (12 lines) ----------
x;
[Imperative]
{
	if(x == null)
	{
		return = [];
	}
	else
	{
		return = "Hidden";
	}
};
# ----------------------------------------
getByName = LinePatternElement.GetByName(name=code_block_47.out1)
color_palette = ColorPalette({R: 0, G: 0, B: 0, A: 255})
code_block_48 = CodeBlock { 1; }
create_overridegraphicsettings = Custom[Create OverrideGraphicSettings](ProjectionLinePattern=getByName, ProjectionLineColor=color_palette, ProjectionLineWeight=code_block_48, CutLinePattern=getByName, CutLineColor=color_palette, CutLineWeight=code_block_48)  # package Genius Loci; Create a OverrideGraphicSettings (All graphic inputs are optional). Unlike the OOTB OverrideGraphicSettings.ByProperties node, the Foreground and background patterns are available. Note : Prior to Revit 2019, the materials have only one surface pattern and one cut pattern.
view_setelementoverrides = Custom[View SetElementOverrides](view=code_block_42, elements=filterByBoolMask_6.out, overrides=create_overridegraphicsettings)  # package Genius Loci; Overrides element graphics settings in the given view. For use with the Create OverrideGraphicSettings node. Can also be used to hide or unhide elements.
