# Dynamo graph PlantasPG_script.dyn (Dynamo 2.3.2.15696)
# packages: Data-Shapes 2022.2.96, WombatDynamo 2.3.4, Orchid 200.4.0.7938, Data-Shapes 2021.2.94, Clockwork for Dynamo 2.x 2.4.0, Genius Loci 2020.8.3, archi-lab.net 2022.210.2419, Crumple 2022.2.13, Genius Loci 2021.11.10

code_block = CodeBlock { "Plantas Generales - PG"; }
code_block_2 = CodeBlock { "OK"; 450; }
code_block_3 = CodeBlock { "Error"; }
code_block_4 = CodeBlock { "Las vistas de esta Zona ya fueron generadas. Para vistas adicionales, duplicar de las ya existentes."; }
textnote_data = Custom[TextNote Data](Title=code_block_3, TextNote=code_block_4)  # package Data-Shapes; Create Data for TextNote input in UI.MultipleInputForm ++ . Check out www.data-shapes.net for more informations
all = Orchid.RevitProject.Views.View.All()
code_block_5 = CodeBlock { "Subclasificacion"; }
getParameterValueByName = Element.GetParameterValueByName(element=all, parameterName=code_block_5)
code_block_6 = CodeBlock { "07_DE"; }
eq = getParameterValueByName == code_block_6
filterByBoolMask = List.FilterByBoolMask(list=all, mask=eq)
code_block_7 = CodeBlock { "Plantas Generales - PG"; }
code_block_8 = CodeBlock()
# ---------- code_block_8.designscript (6 lines) ----------
"INICIAR";
"CANCELAR";
//Label
120;
//Width
450;
# ----------------------------------------
code_block_9 = CodeBlock { "Escala:"; }
code_block_10 = CodeBlock()
# ---------- code_block_10.designscript (10 lines) ----------
[
"1:50",
"1:75",
"1:100",
"1:125",
"1:150",
"1:175",
"1:200"
];
":";
# ----------------------------------------
split = String.Split(str=code_block_10.out0, separator0=code_block_10.out1)
code_block_11 = CodeBlock { 1; }
getItemAtIndex = List.GetItemAtIndex(list=split@L2, index=code_block_11)
toNumber = String.ToNumber(str=getItemAtIndex)
code_block_12 = CodeBlock { 0; false; }
dropdown_data = Custom[DropDown Data](InputName=code_block_9, Keys=code_block_10.out0, Values=toNumber, DefaultValueIndex=code_block_12.out0, Sorted_optional=code_block_12.out1)  # package Data-Shapes; Create data for DropDown input in UI.MultiInputForm ++ . Check out www.data-shapes.net for more infos.
code_block_13 = CodeBlock { "Nombre de la Zona:"; "GENERAL"; }
textbox_data = Custom[TextBox Data](InputName=code_block_13.out0, DefaultText=code_block_13.out1)  # package Data-Shapes; Create Data for TextBox input in UI.MultipleInputForm ++ . Check out www.data-shapes.net for more informations
code_block_14 = CodeBlock()
# ---------- code_block_14.designscript (2 lines) ----------
"Importante:";
"Si el proyecto no esta dividido en Zonas, usar el valor por defecto General, de lo contrario, asignar una Zona.";
# ----------------------------------------
textnote_data_2 = Custom[TextNote Data](Title=code_block_14.out0, TextNote=code_block_14.out1)
list_create = List.Create(item0=textbox_data, item1=textnote_data_2)
inputgroup_data = Custom[InputGroup Data](Inputs=list_create)  # package Data-Shapes; Creates a group of inputs for UI.MultipleInputForm ++ . Check out www.data-shapes.net for more infos !
list_create_2 = List.Create(item0=dropdown_data, item1=inputgroup_data)
boolean = BoolSelector(true)
multipleinputform = Custom[MultipleInputForm ++](Description_optional=code_block_7, ButtonText_optional=code_block_8.out0, Inputs=list_create_2, Toggle=boolean, CancelButtonText_optional=code_block_8.out1, Width_optional=code_block_8.out3, LabelWidth_optional=code_block_8.out2)  # package Data-Shapes; Create a form with multiple inputs. see www.data-shapes.net for tutorials and infos!
code_block_15 = CodeBlock { "Levels"; }
byName = Category.ByName(name=code_block_15)
all_elements_of_category = ElementsOfCategory(Category=byName)
code_block_16 = CodeBlock(l=multipleinputform.User_Inputs, levels=all_elements_of_category)
# ---------- code_block_16.designscript (13 lines) ----------
l;
levels;
[Imperative]
{
	if (l == null)
		{
		return = [];
		}
	else
		{
		return = levels;
		}
};
# ----------------------------------------
code_block_17 = CodeBlock(l=multipleinputform.User_Inputs)
# ---------- code_block_17.designscript (12 lines) ----------
l;
[Imperative]
{
	if (l == null)
		{
		return = [[],[],[]];
		}
	else
		{
		return = l;
		}
};
# ----------------------------------------
addItemToFront = List.AddItemToFront(item=code_block_16.out2, list=code_block_17.out1)
code_block_18 = CodeBlock(l=addItemToFront) { DSCore.String.ToUpper(DSCore.List.Flatten(([l[2]]),1)); }
code_block_19 = CodeBlock { "Zona"; }
getParameterValueByName_2 = Element.GetParameterValueByName(element=filterByBoolMask.in, parameterName=code_block_19)
uniqueItems = List.UniqueItems(list=getParameterValueByName_2)
eq_2 = code_block_18 == uniqueItems
filterByBoolMask_2 = List.FilterByBoolMask(list=filterByBoolMask.in, mask=eq_2)
code_block_20 = CodeBlock { null; }
replaceEmptyLists = Custom[List.ReplaceEmptyLists](seq=filterByBoolMask_2.in, Replacement=code_block_20)  # package Clockwork for Dynamo 2.x; Replaces all empty lists within a given list with a substitute
isNull = Object.IsNull(obj=replaceEmptyLists)
code_block_21 = CodeBlock { true; false; }
scopeIf = Custom[ScopeIf+](test=isNull, True=code_block_21.out1, False=code_block_21.out0)  # package Clockwork for Dynamo 2.x; A (hopefully) more robust implementation of ScopeIf. Tests a single boolean and returns a value accordingly.
multipleinputform_2 = Custom[MultipleInputForm ++](Description_optional=code_block, ButtonText_optional=code_block_2.out0, Inputs=textnote_data, Toggle=scopeIf, Width_optional=code_block_2.out1)
code_block_22 = CodeBlock { "Building Section"; }
byName_2 = Orchid.RevitProject.Views.ViewType.ByName(name=code_block_22)
code_block_23 = CodeBlock(l=replaceEmptyLists, lst=addItemToFront)
# ---------- code_block_23.designscript (14 lines) ----------
l;
lst;

[Imperative]
{
	if (l == null)
		{
		return = lst;
		}
	else
		{
		return = [[],[],[]];
		}
};
# ----------------------------------------
code_block_24 = CodeBlock(l=code_block_23.out2) { DSCore.List.Flatten(([l[0]]),1); }
nullToEmptyList = WombatDynamo.List.NullToEmptyList(data=code_block_24)
byLevel = StructuralPlanView.ByLevel(level=nullToEmptyList)
code_block_25 = CodeBlock { "Zona"; }
code_block_26 = CodeBlock(l=code_block_23.out2) { DSCore.String.ToUpper(DSCore.List.Flatten(([l[2]]),1)); }
setParameterByName = Element.SetParameterByName(element=byLevel, parameterName=code_block_25, value=code_block_26, lacing=Longest)
code_block_27 = CodeBlock { "Structural Plan (Piso)"; "Type"; }
byName_3 = Orchid.RevitProject.Views.ViewType.ByName(name=code_block_27.out0)
setParameterByName_2 = Element.SetParameterByName(element=setParameterByName, parameterName=code_block_27.out1, value=byName_3)
code_block_28 = CodeBlock(l=code_block_23.out2) { DSCore.List.Flatten(([l[1]]),1); }
nullToEmptyList_2 = WombatDynamo.List.NullToEmptyList(data=code_block_28)
setScale = View.SetScale(view=setParameterByName_2, scale=nullToEmptyList_2, lacing=Longest)
code_block_29 = CodeBlock { null; }
replaceEmptyLists_2 = Custom[List.ReplaceEmptyLists](seq=setScale, Replacement=code_block_29)
all_2 = Orchid.RevitProject.Views.ViewTemplate.All()
name = Element.Name(element=all_2)
code_block_30 = CodeBlock { "Structural Foundation Plan"; }
eq_3 = name == code_block_30
filterByBoolMask_3 = List.FilterByBoolMask(list=all_2, mask=eq_3)
code_block_31 = CodeBlock(x=replaceEmptyLists_2, y=filterByBoolMask_3.in)
# ---------- code_block_31.designscript (14 lines) ----------
x;
y;

[Imperative]
{
	if (x == null)
		{
		return = [];
		}
	else
		{
		return = y;
		}
};
# ----------------------------------------
code_block_32 = CodeBlock(x=setScale) { esc = DSCore.List.UniqueItems(x.GetParameterValueByName("Zona")); "01_ENTREGABLE_00_PG_STRUCTURAL PLAN (PISO)_"+esc; }
duplicate = Orchid.RevitProject.Views.ViewTemplate.Duplicate(viewTemplate=code_block_31.out2, name=code_block_32.out1)
code_block_33 = CodeBlock(esc=code_block_32.esc)
# ---------- code_block_33.designscript (13 lines) ----------
DSCore.List.Flatten(
[
"Clasificacion",
"Subclasificacion",
"Zona"
]);

DSCore.List.Flatten(
[
"01_ENTREGABLE",
"00_PG",
esc
]);
# ----------------------------------------
setParameterByName_3 = Element.SetParameterByName(element=duplicate, parameterName=code_block_33.out0, value=code_block_33.out1, lacing=Longest)
uniqueItems_2 = List.UniqueItems(list=setParameterByName_3)
code_block_34 = CodeBlock { null; }
replaceEmptyLists_3 = Custom[List.ReplaceEmptyLists](seq=uniqueItems_2, Replacement=code_block_34)
code_block_35 = CodeBlock { null; }
replaceEmptyLists_4 = Custom[List.ReplaceEmptyLists](seq=setParameterByName_3, Replacement=code_block_35)
code_block_36 = CodeBlock(x=replaceEmptyLists_4)
# ---------- code_block_36.designscript (13 lines) ----------
x;

[Imperative]
{
	if (x == null)
		{
		return = [[]];
		}
	else
		{
		return = x;
		}
};
# ----------------------------------------
code_block_37 = CodeBlock(a=code_block_36.out1)
# ---------- code_block_37.designscript (6 lines) ----------
esc = DSCore.List.UniqueItems(a.GetParameterValueByName("Zona"))[0];

"Subclasificacion";
"NotEquals";
"00_PG";
"00_PG_"+esc;
# ----------------------------------------
code_block_38 = CodeBlock(x=replaceEmptyLists_3, y=code_block_37.out4)  # same code as code_block_31
create = Orchid.RevitProject.Filters.FilterRule.Create(parameter=code_block_37.out1, ruleType=code_block_37.out2, value=code_block_37.out3)
code_block_39 = CodeBlock { "Sections"; }
byName_4 = Category.ByName(name=code_block_39)
byRule = Orchid.RevitProject.Filters.ParameterFilter.ByRule(name=code_block_38.out2, filterRule=create, category=byName_4, lacing=Longest)
code_block_40 = CodeBlock { false; }
addFilter = Orchid.RevitProject.Views.View.AddFilter(view=uniqueItems_2, parameterFilter=byRule, visibility=code_block_40, lacing=Longest)
set = Orchid.RevitProject.Views.ViewTemplate.Set(view=setScale, viewTemplate=addFilter, lacing=Longest)
code_block_41 = CodeBlock { "View Name"; }
identity = Object.Identity(obj=set)
code_block_42 = CodeBlock()
# ---------- code_block_42.designscript (4 lines) ----------
[
"Type",
"Subclasificacion"
];
# ----------------------------------------
getParameterValueByName_3 = Element.GetParameterValueByName(element=identity@L1, parameterName=code_block_42@L2, lacing=Longest)
code_block_43 = CodeBlock { null; }
replaceEmptyLists_5 = Custom[List.ReplaceEmptyLists](seq=getParameterValueByName_3, Replacement=code_block_43)
code_block_44 = CodeBlock(x=replaceEmptyLists_5, y=getParameterValueByName_3)
# ---------- code_block_44.designscript (14 lines) ----------
x;
y;

[Imperative]
{
	if (x == null)
		{
		return = [null,null];
		}
	else
		{
		return = y;
		}
};
# ----------------------------------------
code_block_45 = CodeBlock { 1; }
getItemAtIndex_2 = List.GetItemAtIndex(list=code_block_44.out2@L2, index=code_block_45)
code_block_46 = CodeBlock { "_"; }
code_block_47 = CodeBlock { 0; }
getItemAtIndex_3 = List.GetItemAtIndex(list=code_block_44.out2@L2, index=code_block_47)
nullToEmptyList_3 = WombatDynamo.List.NullToEmptyList(data=getItemAtIndex_3)
name_2 = Element.Name(element=nullToEmptyList_3)
code_block_48 = CodeBlock { 0; 17; }
remove = String.Remove(str=name_2, startIndex=code_block_48.out0, count=code_block_48.out1)
code_block_49 = CodeBlock { ")"; ""; }
replace = String.Replace(str=remove, searchFor=code_block_49.out0, replaceWith=code_block_49.out1)
toUpper = String.ToUpper(str=replace)
name_3 = Element.Name(element=identity)
code_block_50 = CodeBlock { "Zona"; }
getParameterValueByName_4 = Element.GetParameterValueByName(element=identity, parameterName=code_block_50)
list_create_3 = List.Create(item0=getItemAtIndex_2, item1=toUpper, item2=name_3, item3=getParameterValueByName_4)
transpose = List.Transpose(lists=list_create_3)
join = String.Join(separator=code_block_46, string0=transpose@L2)
code_block_51 = CodeBlock(x=getItemAtIndex_2, y=join)
# ---------- code_block_51.designscript (14 lines) ----------
x;
y;

[Imperative]
{
	if (x[0] == null)
		{
		return = [];
		}
	else
		{
		return = y;
		}
};
# ----------------------------------------
code_block_52 = CodeBlock { 0; 3; }
remove_2 = String.Remove(str=code_block_51.out2, startIndex=code_block_52.out0, count=code_block_52.out1)
setParameterByName_4 = Element.SetParameterByName(element=set, parameterName=code_block_41, value=remove_2)
element_level = Custom[Element Level](element=setParameterByName_4)  # package Genius Loci; Gets an element's level. Based on a Clockwork's node
code_block_53 = CodeBlock { 750; -1500; }
set_viewrange = Custom[Set ViewRange](view=setParameterByName_4, TopLevel=element_level, Top=code_block_53.out0, CutLevel=element_level, CutPlane=code_block_53.out0, BottomLevel=element_level, Bottom=code_block_53.out1, DepthLevel=element_level, ViewDepth=code_block_53.out1, lacing=Longest)  # package Genius Loci; Set the view range of the given plan view.
code_block_54 = CodeBlock { "Title on Sheet"; }
name_4 = Element.Name(element=set_viewrange)
code_block_55 = CodeBlock { "_"; }
split_2 = String.Split(str=name_4, separator0=code_block_55)
code_block_56 = CodeBlock { null; }
replaceEmptyLists_6 = Custom[List.ReplaceEmptyLists](seq=split_2, Replacement=code_block_56)
code_block_57 = CodeBlock(x=replaceEmptyLists_6, y=split_2)
# ---------- code_block_57.designscript (14 lines) ----------
x;
y;

[Imperative]
{
	if (x == null)
		{
		return = [null,null,null,null];
		}
	else
		{
		return = y;
		}
};
# ----------------------------------------
code_block_58 = CodeBlock { 2; }
getItemAtIndex_4 = List.GetItemAtIndex(list=code_block_57.out2@L2, index=code_block_58)
code_block_59 = CodeBlock(nivel=getItemAtIndex_4) { title = "PLANTA FUNDACION "+nivel; }
setParameterByName_5 = Element.SetParameterByName(element=set_viewrange, parameterName=code_block_54, value=code_block_59)
viewlevel = Custom[© ViewLevel](views=setParameterByName_5)  # package Crumple; Returns the associated level of a view (if it has one), as well as a boolean mask to remove views without levels after.
byLevel_2 = StructuralPlanView.ByLevel(level=viewlevel.lvls)
code_block_60 = CodeBlock { "Zona"; }
code_block_61 = CodeBlock { null; }
replaceEmptyLists_7 = Custom[List.ReplaceEmptyLists](seq=setParameterByName_5, Replacement=code_block_61)
code_block_62 = CodeBlock(x=replaceEmptyLists_7)  # same code as code_block_36
code_block_63 = CodeBlock(x=code_block_62.out1) { DSCore.List.UniqueItems(x.GetParameterValueByName("Zona"))[0]; }
setParameterByName_6 = Element.SetParameterByName(element=byLevel_2, parameterName=code_block_60, value=code_block_63, lacing=Longest)
code_block_64 = CodeBlock { "Structural Plan (Cielo)"; "Type"; }
byName_5 = Orchid.RevitProject.Views.ViewType.ByName(name=code_block_64.out0)
setParameterByName_7 = Element.SetParameterByName(element=setParameterByName_6, parameterName=code_block_64.out1, value=byName_5, lacing=Longest)
scale = Custom[View.Scale](view=setParameterByName_5)  # package Clockwork for Dynamo 2.x; Returns the scale of a given view
code_block_65 = CodeBlock(l=scale)
# ---------- code_block_65.designscript (13 lines) ----------
l;

[Imperative]
{
	if (l == [])
		{
		return = [[]];
		}
	else
		{
		return = l[0];
		}
};
# ----------------------------------------
setScale_2 = View.SetScale(view=setParameterByName_7, scale=code_block_65.out1)
code_block_66 = CodeBlock { null; }
replaceEmptyLists_8 = Custom[List.ReplaceEmptyLists](seq=setParameterByName_7, Replacement=code_block_66)
all_3 = Orchid.RevitProject.Views.ViewTemplate.All()
name_5 = Element.Name(element=all_3)
code_block_67 = CodeBlock { "Architectural Reflected Ceiling Plan"; }
eq_4 = name_5 == code_block_67
filterByBoolMask_4 = List.FilterByBoolMask(list=all_3, mask=eq_4)
code_block_68 = CodeBlock(x=replaceEmptyLists_8, y=filterByBoolMask_4.in)  # same code as code_block_31
code_block_69 = CodeBlock(x=replaceEmptyLists_8)  # same code as code_block_36
code_block_70 = CodeBlock(x=code_block_69.out1) { "00_PG_"+DSCore.List.UniqueItems(x.GetParameterValueByName("Zona"))[0]; }
code_block_71 = CodeBlock(esc=code_block_70) { "01_ENTREGABLE_00_PG_STRUCTURAL PLAN (CIELO)_"+esc; }
duplicate_2 = Orchid.RevitProject.Views.ViewTemplate.Duplicate(viewTemplate=code_block_68.out2, name=code_block_71)
code_block_72 = CodeBlock(esc=code_block_70)  # same code as code_block_33
setParameterByName_8 = Element.SetParameterByName(element=duplicate_2, parameterName=code_block_72.out0, value=code_block_72.out1, lacing=Longest)
uniqueItems_3 = List.UniqueItems(list=setParameterByName_8)
await_ = Orchid.Common.DataStream.Await(pass=code_block_70, waitFor=setScale_2)
byName_6 = Orchid.RevitProject.Filters.ParameterFilter.ByName(name=await_)
code_block_73 = CodeBlock { false; }
addFilter_2 = Orchid.RevitProject.Views.View.AddFilter(view=uniqueItems_3, parameterFilter=byName_6, visibility=code_block_73, lacing=Longest)
set_2 = Orchid.RevitProject.Views.ViewTemplate.Set(view=setScale_2, viewTemplate=addFilter_2, lacing=Longest)
element_level_2 = Custom[Element Level](element=set_2)
levelAbove = Custom[Level.LevelAbove](level=element_level_2)  # package archi-lab.net; This node takes an input of level and returns level above it.
empty = List.Empty()
replacenulls = Custom[© ReplaceNulls](lst=levelAbove, replace=empty)  # package Crumple; Replaces all nulls with a given substitute.
code_block_74 = CodeBlock { 1000; 300; }
set_viewrange_2 = Custom[Set ViewRange](view=set_2, TopLevel=replacenulls, Top=code_block_74.out1, CutLevel=element_level_2, CutPlane=code_block_74.out0, BottomLevel=element_level_2, Bottom=code_block_74.out0, DepthLevel=replacenulls, ViewDepth=code_block_74.out1, lacing=Longest)
code_block_75 = CodeBlock { "View Name"; }
identity_2 = Object.Identity(obj=set_viewrange_2)
code_block_76 = CodeBlock()  # same code as code_block_42
getParameterValueByName_5 = Element.GetParameterValueByName(element=identity_2@L1, parameterName=code_block_76@L2, lacing=Longest)
code_block_77 = CodeBlock { null; }
replaceEmptyLists_9 = Custom[List.ReplaceEmptyLists](seq=getParameterValueByName_5, Replacement=code_block_77)
code_block_78 = CodeBlock(x=replaceEmptyLists_9, y=getParameterValueByName_5)  # same code as code_block_44
code_block_79 = CodeBlock { 1; }
getItemAtIndex_5 = List.GetItemAtIndex(list=code_block_78.out2@L2, index=code_block_79)
code_block_80 = CodeBlock { "_"; }
code_block_81 = CodeBlock { 0; }
getItemAtIndex_6 = List.GetItemAtIndex(list=code_block_78.out2@L2, index=code_block_81)
nullToEmptyList_4 = WombatDynamo.List.NullToEmptyList(data=getItemAtIndex_6)
name_6 = Element.Name(element=nullToEmptyList_4)
code_block_82 = CodeBlock { 0; 17; }
remove_3 = String.Remove(str=name_6, startIndex=code_block_82.out0, count=code_block_82.out1)
code_block_83 = CodeBlock { ")"; ""; }
replace_2 = String.Replace(str=remove_3, searchFor=code_block_83.out0, replaceWith=code_block_83.out1)
toUpper_2 = String.ToUpper(str=replace_2)
name_7 = Element.Name(element=identity_2)
code_block_84 = CodeBlock { "Zona"; }
getParameterValueByName_6 = Element.GetParameterValueByName(element=identity_2, parameterName=code_block_84)
list_create_4 = List.Create(item0=getItemAtIndex_5, item1=toUpper_2, item2=name_7, item3=getParameterValueByName_6)
transpose_2 = List.Transpose(lists=list_create_4)
join_2 = String.Join(separator=code_block_80, string0=transpose_2@L2)
code_block_85 = CodeBlock(x=getItemAtIndex_5, y=join_2)  # same code as code_block_51
code_block_86 = CodeBlock { 0; 3; }
remove_4 = String.Remove(str=code_block_85.out2, startIndex=code_block_86.out0, count=code_block_86.out1)
code_block_87 = CodeBlock { null; }
replaceEmptyLists_10 = Custom[List.ReplaceEmptyLists](seq=remove_4, Replacement=code_block_87)
code_block_88 = CodeBlock(l=replaceEmptyLists_10)
# ---------- code_block_88.designscript (13 lines) ----------
l;

[Imperative]
{
	if (l == null)
		{
		return = null;
		}
	else
		{
		return = l;
		}
};
# ----------------------------------------
setParameterByName_9 = Element.SetParameterByName(element=set_viewrange_2, parameterName=code_block_75, value=code_block_88.out1, lacing=Longest)
code_block_89 = CodeBlock { "Title on Sheet"; }
code_block_90 = CodeBlock { "PLANTA ESTRUCTURA CIELO "; }
name_8 = Element.Name(element=setParameterByName_9)
code_block_91 = CodeBlock { "_"; }
split_3 = String.Split(str=name_8, separator0=code_block_91)
code_block_92 = CodeBlock { null; }
replaceEmptyLists_11 = Custom[List.ReplaceEmptyLists](seq=split_3, Replacement=code_block_92)
code_block_93 = CodeBlock { 2; }
getItemAtIndex_7 = List.GetItemAtIndex(list=replaceEmptyLists_11@L2, index=code_block_93)
add = code_block_90 + getItemAtIndex_7  # lacing=Longest
setParameterByName_10 = Element.SetParameterByName(element=setParameterByName_9, parameterName=code_block_89, value=add)
code_block_94 = CodeBlock()
# ---------- code_block_94.designscript (4 lines) ----------
[
"Subclasificacion",
"Zona"
];
# ----------------------------------------
getParameterValueByName_7 = Element.GetParameterValueByName(element=setParameterByName_10, parameterName=code_block_94)
uniqueItems_4 = List.UniqueItems(list=getParameterValueByName_7)
code_block_95 = CodeBlock { null; }
replaceEmptyLists_12 = Custom[List.ReplaceEmptyLists](seq=uniqueItems_4, Replacement=code_block_95)
code_block_96 = CodeBlock(x=replaceEmptyLists_12)
# ---------- code_block_96.designscript (13 lines) ----------
x;

[Imperative]
{
	if (x == null)
		{
		return = [[],[]];
		}
	else
		{
		return = x;
		}
};
# ----------------------------------------
all_4 = Orchid.RevitProject.Views.ViewTemplate.All()
name_9 = Element.Name(element=all_4)
code_block_97 = CodeBlock { "Architectural Section"; }
eq_5 = name_9 == code_block_97
filterByBoolMask_5 = List.FilterByBoolMask(list=all_4, mask=eq_5)
code_block_98 = CodeBlock(x=code_block_96.out1, y=filterByBoolMask_5.in)
# ---------- code_block_98.designscript (15 lines) ----------
x[0];
x[1];
y;

[Imperative]
{
	if (x == null)
		{
		return = [];
		}
	else
		{
		return = y;
		}
};
# ----------------------------------------
code_block_99 = CodeBlock(esc=code_block_98.out1) { "01_ENTREGABLE_00_PG_BUILDING SECTION_"+esc; }
duplicate_3 = Orchid.RevitProject.Views.ViewTemplate.Duplicate(viewTemplate=code_block_98.out3, name=code_block_99)
code_block_100 = CodeBlock(x=code_block_96.out1)
# ---------- code_block_100.designscript (13 lines) ----------
x;

[Imperative]
{
	if (x == null)
		{
		return = [];
		}
	else
		{
		return = x;
		}
};
# ----------------------------------------
code_block_101 = CodeBlock(lst=code_block_100.out1)
# ---------- code_block_101.designscript (15 lines) ----------
lst;

[
"Clasificacion",
"Subclasificacion",
"Zona",
"Discipline"
];

[
"01_ENTREGABLE",
lst[0],
lst[1],
2
];
# ----------------------------------------
setParameterByName_11 = Element.SetParameterByName(element=duplicate_3, parameterName=code_block_101.out1, value=code_block_101.out2, lacing=Longest)
uniqueItems_5 = List.UniqueItems(list=setParameterByName_11)
code_block_102 = CodeBlock(esc=code_block_98.out1) { "00_PG_"+esc; }
await_2 = Orchid.Common.DataStream.Await(pass=code_block_102, waitFor=uniqueItems_5)
byName_7 = Orchid.RevitProject.Filters.ParameterFilter.ByName(name=await_2)
code_block_103 = CodeBlock { false; }
addFilter_3 = Orchid.RevitProject.Views.View.AddFilter(view=uniqueItems_5, parameterFilter=byName_7, visibility=code_block_103, lacing=Longest)
end = Revit.Transaction.Transaction.End(input=addFilter_3)
await_3 = Orchid.Common.DataStream.Await(pass=code_block_98.out1, waitFor=end)
code_block_104 = CodeBlock(esc=await_3) { "Building Section (00_PG_"+esc+")"; }
duplicate_4 = archilab.Revit.Elements.ElementTypes.Duplicate(element=byName_2, name=code_block_104)
code_block_105 = CodeBlock { "View Template applied to new views"; }
setParameterByName_12 = Element.SetParameterByName(element=duplicate_4, parameterName=code_block_105, value=end)
code_block_106 = CodeBlock { "Detail"; }
byName_8 = Orchid.RevitProject.Views.ViewType.ByName(name=code_block_106)
all_5 = Orchid.RevitProject.Views.ViewTemplate.All()
name_10 = Element.Name(element=all_5)
code_block_107 = CodeBlock { "Architectural Detail"; }
eq_6 = name_10 == code_block_107
filterByBoolMask_6 = List.FilterByBoolMask(list=all_5, mask=eq_6)
code_block_108 = CodeBlock(x=code_block_96.out1, y=filterByBoolMask_6.in)  # same code as code_block_98
code_block_109 = CodeBlock(esc=code_block_108.out1) { "01_ENTREGABLE_00_PG_DETAIL_"+esc; }
duplicate_5 = Orchid.RevitProject.Views.ViewTemplate.Duplicate(viewTemplate=code_block_108.out3, name=code_block_109)
code_block_110 = CodeBlock(x=code_block_96.out1)  # same code as code_block_100
code_block_111 = CodeBlock(lst=code_block_110.out1)  # same code as code_block_101
setParameterByName_13 = Element.SetParameterByName(element=duplicate_5, parameterName=code_block_111.out1, value=code_block_111.out2, lacing=Longest)
uniqueItems_6 = List.UniqueItems(list=setParameterByName_13)
code_block_112 = CodeBlock(esc=code_block_108.out1) { "00_PG_"+esc; }
await_4 = Orchid.Common.DataStream.Await(pass=code_block_112, waitFor=uniqueItems_6)
byName_9 = Orchid.RevitProject.Filters.ParameterFilter.ByName(name=await_4)
code_block_113 = CodeBlock { false; }
addFilter_4 = Orchid.RevitProject.Views.View.AddFilter(view=uniqueItems_6, parameterFilter=byName_9, visibility=code_block_113, lacing=Longest)
end_2 = Revit.Transaction.Transaction.End(input=addFilter_4)
await_5 = Orchid.Common.DataStream.Await(pass=code_block_108.out1, waitFor=end_2)
code_block_114 = CodeBlock(esc=await_5) { "Detail (00_PG_"+esc+")"; }
duplicate_6 = archilab.Revit.Elements.ElementTypes.Duplicate(element=byName_8, name=code_block_114)
code_block_115 = CodeBlock { "View Template applied to new views"; }
setParameterByName_14 = Element.SetParameterByName(element=duplicate_6, parameterName=code_block_115, value=end_2)
code_block_116 = CodeBlock(x=setParameterByName_5) { x; }
await_6 = Orchid.Common.DataStream.Await(pass=code_block_116, waitFor=byLevel_2)
view_level = Custom[View Level](view=await_6)  # package Genius Loci; Returns the level to which a view is associated.
elevation = Level.Elevation(level=view_level)
minimumItem = List.MinimumItem(list=elevation)
eq_7 = elevation == minimumItem
filterByBoolMask_7 = List.FilterByBoolMask(list=await_6, mask=eq_7)
delete = archilab.Revit.Elements.Elements.Delete(element=filterByBoolMask_7.out)
name_11 = Element.Name(element=filterByBoolMask_7.in)
code_block_117 = CodeBlock { ["_FUNDACION","_RADIER"]; }
add_2 = name_11 + code_block_117  # lacing=Longest
element_duplicate = Custom[Element Duplicate](element=filterByBoolMask_7.in, name=add_2, lacing=Longest)  # package Genius Loci; Duplicates the given element (view, element type).
code_block_118 = CodeBlock { "Title on Sheet"; }
code_block_119 = CodeBlock { "PLANTA "; }
code_block_120 = CodeBlock { "_"; }
split_4 = String.Split(str=add_2, separator0=code_block_120)
code_block_121 = CodeBlock { null; }
replaceEmptyLists_13 = Custom[List.ReplaceEmptyLists](seq=split_4, Replacement=code_block_121)
lastItem = List.LastItem(list=replaceEmptyLists_13@L2)
add_3 = code_block_119 + lastItem  # lacing=Longest
setParameterByName_15 = Element.SetParameterByName(element=element_duplicate, parameterName=code_block_118, value=add_3)
get = Orchid.RevitProject.Views.ViewTemplate.Get(view=filterByBoolMask_7.in)
set_3 = Orchid.RevitProject.Views.ViewTemplate.Set(view=setParameterByName_15, viewTemplate=get, lacing=Longest)
