# Dynamo graph etiquetado_script.dyn (Dynamo 2.3.2.15696)
# packages: Orchid 200.4.0.7938, Clockwork for Dynamo 2.x 2.4.0, Crumple 2022.2.13, Genius Loci 2021.11.10, Rhythm 2020.7.25

activeView = Orchid.RevitProject.Common.Document.ActiveView()
code_block = CodeBlock(x=activeView) { x; x; }

# group: Etiqueta Columna Rectangular hormigon
code_block_2 = CodeBlock { "Structural Columns"; }
byName = Category.ByName(name=code_block_2)
code_block_3 = CodeBlock(x=code_block.out1) { x; }
code_block_4 = CodeBlock(x=code_block_3) { x; }
all_elements_of_category_in_view = ElementsOfCategoryInView(Category=byName, View=code_block_4)
familyName = Orchid.RevitProject.Elements.Element.FamilyName(element=all_elements_of_category_in_view)
code_block_5 = CodeBlock { "EST_M_STRUCTURAL COLUMN_RECTANGULAR"; }
eq = familyName == code_block_5
filterByBoolMask = List.FilterByBoolMask(list=all_elements_of_category_in_view, mask=eq)
name = Material.Name()  # unwired: material
getMaterials = Element.GetMaterials(element=filterByBoolMask.in)
flatten = List.Flatten(list=getMaterials)
function_apply = ApplyFunction(func=name, arg1=flatten)
code_block_6 = CodeBlock { "Concrete, Cast-in-Place gray"; }
eq_2 = function_apply == code_block_6
filterByBoolMask_2 = List.FilterByBoolMask(list=filterByBoolMask.in, mask=eq_2)
element_taggedstatus = Custom[Element TaggedStatus](element=filterByBoolMask_2.in)  # package Genius Loci; Identify the tagged and untagged elements. Please note : This doesn't work with areas and spaces.
code_block_7 = CodeBlock { "Column Style"; 1; }
setParameterByName = Element.SetParameterByName(element=element_taggedstatus.NotTagged, parameterName=code_block_7.out0, value=code_block_7.out1)
location = Custom[Element.Location+](element=setParameterByName)  # package Clockwork for Dynamo 2.x; Returns the location of an element as point, curve or curve loop, along with some booleans to help filtering the results. Unlike the OOTB Element.GetLocation node, it also retunrs sketch lines of sketch-based elements like floor slabs as well as the element's rotation property.
code_block_8 = CodeBlock(x=location.curves)
# ---------- code_block_8.designscript (12 lines) ----------
x;
[Imperative]
{
	if(x == null)
	{
		return = [];
	}
	else
	{
		return = x;
	}
};
# ----------------------------------------
await_ = Orchid.Common.DataStream.Await(pass=setParameterByName, waitFor=code_block_8.out1)
code_block_9 = CodeBlock { "Column Style"; 0; }
setParameterByName_2 = Element.SetParameterByName(element=await_, parameterName=code_block_9.out0, value=code_block_9.out1)
elementcentroid = Custom[© ElementCentroid](element=await_)  # package Crumple; Returns the centroid of the element's axis-aligned bounding box.
code_block_10 = CodeBlock { 0.5; }
planeAtParameter = Curve.PlaneAtParameter(curve=code_block_8.out1, param=code_block_10)
code_block_11 = CodeBlock { 0.5; }
pointAtParameter = Curve.PointAtParameter(curve=code_block_8.out1, param=code_block_11)
code_block_12 = CodeBlock(x=code_block_3) { x; }
plane = Custom[View.Plane](view=code_block_12)  # package Clockwork for Dynamo 2.x; Retrieves the plane of a given view
normal = Plane.Normal(plane=plane)
code_block_13 = CodeBlock { 90; }
rotate = Geometry.Rotate(geometry=planeAtParameter, origin=pointAtParameter, axis=normal, degrees=code_block_13)
normal_2 = Plane.Normal(plane=rotate)
code_block_14 = CodeBlock(z=normal_2) { z.Z; }
code_block_15 = CodeBlock { 0; }
gt = code_block_14 > code_block_15
code_block_16 = CodeBlock { -1; }
ne = code_block_14 != code_block_16
and_ = gt && ne
reverse = Vector.Reverse(vector=normal_2)
scopeIf = Custom[ScopeIf+](test=and_, True=normal_2, False=reverse, lacing=Shortest)  # package Clockwork for Dynamo 2.x; A (hopefully) more robust implementation of ScopeIf. Tests a single boolean and returns a value accordingly.
code_block_17 = CodeBlock(x=await_) { Revit.Elements.Element.GetParameterValueByName(Revit.Elements.Element.GetParameterValueByName(x,"Type"),"Width")/2; }
translate = Geometry.Translate(geometry=elementcentroid, direction=scopeIf, distance=code_block_17)
code_block_18 = CodeBlock()
# ---------- code_block_18.designscript (2 lines) ----------
//horizontal
false;
# ----------------------------------------
byElementAndLocation = Tag.ByElementAndLocation(view=code_block_4, element=await_, location=translate, horizontal=code_block_18)
code_block_19 = CodeBlock { "Type"; }
code_block_20 = CodeBlock { "EST_A_STRUCTURAL COLUMN TAG_ELEVACION_DIMENSIONES"; }
byName_2 = Orchid.RevitProject.Elements.Family.ByName(name=code_block_20)
code_block_21 = CodeBlock { "Pilar Hormigon"; }
byFamilyAndName = FamilyType.ByFamilyAndName(family=byName_2, name=code_block_21)
setParameterByName_3 = Element.SetParameterByName(element=byElementAndLocation, parameterName=code_block_19, value=byFamilyAndName)

await_2 = Orchid.Common.DataStream.Await(pass=code_block.out1, waitFor=setParameterByName_3)

# group: Etiqueta Columna Circular Hormigon
code_block_22 = CodeBlock { "Structural Columns"; }
byName_3 = Category.ByName(name=code_block_22)
code_block_23 = CodeBlock(x=await_2) { x; }
code_block_24 = CodeBlock(x=code_block_23) { x; }
all_elements_of_category_in_view_2 = ElementsOfCategoryInView(Category=byName_3, View=code_block_24)
familyName_2 = Orchid.RevitProject.Elements.Element.FamilyName(element=all_elements_of_category_in_view_2)
code_block_25 = CodeBlock { "EST_M_STRUCTURAL COLUMN_CIRCULAR"; }
eq_3 = familyName_2 == code_block_25
filterByBoolMask_3 = List.FilterByBoolMask(list=all_elements_of_category_in_view_2, mask=eq_3)
name_2 = Material.Name()  # unwired: material
getMaterials_2 = Element.GetMaterials(element=filterByBoolMask_3.in)
flatten_2 = List.Flatten(list=getMaterials_2)
function_apply_2 = ApplyFunction(func=name_2, arg1=flatten_2)
code_block_26 = CodeBlock { "Concrete, Cast-in-Place gray"; }
eq_4 = function_apply_2 == code_block_26
filterByBoolMask_4 = List.FilterByBoolMask(list=filterByBoolMask_3.in, mask=eq_4)
element_taggedstatus_2 = Custom[Element TaggedStatus](element=filterByBoolMask_4.in)
code_block_27 = CodeBlock { "Column Style"; 1; }
setParameterByName_4 = Element.SetParameterByName(element=element_taggedstatus_2.NotTagged, parameterName=code_block_27.out0, value=code_block_27.out1)
location_2 = Custom[Element.Location+](element=setParameterByName_4)
code_block_28 = CodeBlock(x=location_2.curves)  # same code as code_block_8
await_3 = Orchid.Common.DataStream.Await(pass=setParameterByName_4, waitFor=code_block_28.out1)
code_block_29 = CodeBlock { "Column Style"; 0; }
setParameterByName_5 = Element.SetParameterByName(element=await_3, parameterName=code_block_29.out0, value=code_block_29.out1)
elementcentroid_2 = Custom[© ElementCentroid](element=await_3)
code_block_30 = CodeBlock { 0.5; }
planeAtParameter_2 = Curve.PlaneAtParameter(curve=code_block_28.out1, param=code_block_30)
code_block_31 = CodeBlock { 0.5; }
pointAtParameter_2 = Curve.PointAtParameter(curve=code_block_28.out1, param=code_block_31)
code_block_32 = CodeBlock(x=code_block_23) { x; }
plane_2 = Custom[View.Plane](view=code_block_32)
normal_3 = Plane.Normal(plane=plane_2)
code_block_33 = CodeBlock { 90; }
rotate_2 = Geometry.Rotate(geometry=planeAtParameter_2, origin=pointAtParameter_2, axis=normal_3, degrees=code_block_33)
normal_4 = Plane.Normal(plane=rotate_2)
code_block_34 = CodeBlock(z=normal_4) { z.Z; }
code_block_35 = CodeBlock { 0; }
gt_2 = code_block_34 > code_block_35
code_block_36 = CodeBlock { -1; }
ne_2 = code_block_34 != code_block_36
and_2 = gt_2 && ne_2
reverse_2 = Vector.Reverse(vector=normal_4)
scopeIf_2 = Custom[ScopeIf+](test=and_2, True=normal_4, False=reverse_2, lacing=Shortest)
code_block_37 = CodeBlock(x=await_3) { Revit.Elements.Element.GetParameterValueByName(Revit.Elements.Element.GetParameterValueByName(x,"Type"),"Diameter")/2; }
translate_2 = Geometry.Translate(geometry=elementcentroid_2, direction=scopeIf_2, distance=code_block_37)
code_block_38 = CodeBlock()  # same code as code_block_18
byElementAndLocation_2 = Tag.ByElementAndLocation(view=code_block_24, element=await_3, location=translate_2, horizontal=code_block_38)
code_block_39 = CodeBlock { "Type"; }
code_block_40 = CodeBlock { "EST_A_STRUCTURAL COLUMN TAG_ELEVACION_DIMENSIONES"; }
byName_4 = Orchid.RevitProject.Elements.Family.ByName(name=code_block_40)
code_block_41 = CodeBlock { "Pilar Hormigon"; }
byFamilyAndName_2 = FamilyType.ByFamilyAndName(family=byName_4, name=code_block_41)
setParameterByName_6 = Element.SetParameterByName(element=byElementAndLocation_2, parameterName=code_block_39, value=byFamilyAndName_2)

await_4 = Orchid.Common.DataStream.Await(pass=code_block.out1, waitFor=setParameterByName_6)

# group: Etiqueta Emplantillado
ʳʰʸᵗʰᵐ_tags = Rhythm.Revit.Elements.Tags.SetLeaderElbowPosition()  # unwired: tag, location
code_block_42 = CodeBlock { "Type"; }
code_block_43 = CodeBlock { "EST_A_STRUCTURAL FOUNDATION TAG_ELEVACION_EMPLANTILLADO"; }
byName_5 = Orchid.RevitProject.Elements.Family.ByName(name=code_block_43)
code_block_44 = CodeBlock { "Emplantillado"; }
byFamilyAndName_3 = FamilyType.ByFamilyAndName(family=byName_5, name=code_block_44)
setParameterByName_7 = Element.SetParameterByName(parameterName=code_block_42, value=byFamilyAndName_3)  # unwired: element
code_block_45 = CodeBlock { "Leader Line"; 1; }
setParameterByName_8 = Element.SetParameterByName(parameterName=code_block_45.out0, value=code_block_45.out1)  # unwired: element
code_block_46 = CodeBlock(x=await_4) { x; }
code_block_47 = CodeBlock(x=code_block_46) { x; }
code_block_48 = CodeBlock { "Structural Foundations"; }
byName_6 = Category.ByName(name=code_block_48)
all_elements_of_category_in_view_3 = ElementsOfCategoryInView(Category=byName_6, View=code_block_47)
kind = Custom[StructuralFoundation.Kind](structuralFoundation=all_elements_of_category_in_view_3)  # package Clockwork for Dynamo 2.x; Retrieves the kind of a given structural foundation (isolated, wall, slab).
code_block_49 = CodeBlock { "Slab"; }
eq_5 = kind == code_block_49
name_3 = Element.Name(element=all_elements_of_category_in_view_3)
code_block_50 = CodeBlock { "EMPLANTILLADO"; }
contains = String.Contains(str=name_3, searchFor=code_block_50)
and_3 = eq_5 && contains
filterByBoolMask_5 = List.FilterByBoolMask(list=all_elements_of_category_in_view_3, mask=and_3)
code_block_51 = CodeBlock { null; }
replaceEmptyLists = Custom[List.ReplaceEmptyLists](seq=filterByBoolMask_5.in, Replacement=code_block_51)  # package Clockwork for Dynamo 2.x; Replaces all empty lists within a given list with a substitute
code_block_52 = CodeBlock { 0; }
getItemAtIndex = List.GetItemAtIndex(index=code_block_52)  # unwired: list
ZAxis = Vector.ZAxis()
code_block_53 = CodeBlock { -300; }
translate_3 = Geometry.Translate(direction=ZAxis@L1, distance=code_block_53@L1, lacing=Longest)  # unwired: geometry
code_block_54 = CodeBlock { 0.5; }
pointAtParameter_3 = Surface.PointAtParameter(u=code_block_54, v=code_block_54)  # unwired: surface
element_surfaces_references = Custom[Element Surfaces References](element=replaceEmptyLists)  # package Genius Loci; Retrieve the top, bottom, side surfaces and their associated references of the system family. This doesn't work with cylindrical system families (pipe...)
code_block_55 = CodeBlock(x=element_surfaces_references.Bottom_Surface)
# ---------- code_block_55.designscript (12 lines) ----------
x;
[Imperative]
{
	if(x == null)
	{
		return = [];
	}
	else
	{
		return = DSCore.List.Flatten(x,1);
	}
};
# ----------------------------------------
function_apply_3 = ApplyFunction(func=pointAtParameter_3, arg1=code_block_55.out1)
function_apply_4 = ApplyFunction(func=translate_3, arg1=function_apply_3)
code_block_56 = CodeBlock { null; }
replaceEmptyLists_2 = Custom[List.ReplaceEmptyLists](seq=function_apply_4, Replacement=code_block_56)
code_block_57 = CodeBlock(x=code_block_46) { x; }
plane_3 = Custom[View.Plane](view=code_block_57)
byBestFitThroughPoints = Line.ByBestFitThroughPoints()  # unwired: bestFitPoints
code_block_58 = CodeBlock { 0.5; }
pointAtParameter_4 = Curve.PointAtParameter(param=code_block_58)  # unwired: curve
code_block_59 = CodeBlock { [1,3]; }
getItemAtIndex_2 = List.GetItemAtIndex(index=code_block_59@L2)  # unwired: list
getCropBox = Orchid.RevitProject.Views.View.GetCropBox(view=code_block_57)
function_apply_5 = ApplyFunction(func=getItemAtIndex_2, arg1=getCropBox.Curve)
function_apply_6 = ApplyFunction(func=pointAtParameter_4, arg1=function_apply_5)
function_apply_7 = ApplyFunction(func=byBestFitThroughPoints, arg1=function_apply_6)
code_block_60 = CodeBlock(x=function_apply_7)  # same code as code_block_8
code_block_61 = CodeBlock { 0.5; }
pointAtParameter_5 = Curve.PointAtParameter(curve=code_block_60.out1, param=code_block_61)
direction = Line.Direction(line=code_block_60.out1)
code_block_62 = CodeBlock { -90; }
rotate_3 = Geometry.Rotate(geometry=plane_3, origin=pointAtParameter_5, axis=direction, degrees=code_block_62)
normal_5 = Plane.Normal(plane=rotate_3)
code_block_63 = CodeBlock { 50; }
translate_4 = Geometry.Translate(geometry=replaceEmptyLists_2@L2, direction=normal_5@L1, distance=code_block_63@L1, lacing=Longest)
function_apply_8 = ApplyFunction(func=getItemAtIndex, arg1=translate_4)
byElementAndLocation_3 = Tag.ByElementAndLocation(view=code_block_47@L1, element=replaceEmptyLists@L2, location=function_apply_8@L2, lacing=Longest)
flatten_3 = List.Flatten(list=byElementAndLocation_3)
function_apply_9 = ApplyFunction(func=setParameterByName_8, arg1=flatten_3)
function_apply_10 = ApplyFunction(func=setParameterByName_7, arg1=function_apply_9)
function_apply_11 = ApplyFunction(func=ʳʰʸᵗʰᵐ_tags, arg1=function_apply_10, arg2=replaceEmptyLists_2)

flatten_4 = List.Flatten(list=function_apply_11)
await_5 = Orchid.Common.DataStream.Await(pass=code_block.out1, waitFor=flatten_4)
openView = Orchid.RevitProject.Common.Document.OpenView(view=await_5)
