# Dynamo graph elevacionEje_script.dyn (Dynamo 2.3.2.15696)
# packages: Data-Shapes 2021.2.94, Orchid 200.4.0.7938, Clockwork for Dynamo 2.x 2.4.0, archi-lab.net 2022.210.2419, Genius Loci 2021.11.10

hideElements = archilab.Revit.Views.Views.HideElements()  # unwired: view, elements
code_block = CodeBlock { "Elevación por Eje (Estanque)"; }
code_block_2 = CodeBlock()
# ---------- code_block_2.designscript (9 lines) ----------
//buttonText
"INICIAR";
//buttonCancel
"CANCELAR";
//maxHeight
850;
//width
440;
//label
# ----------------------------------------
code_block_3 = CodeBlock { "(Categoria DE)"; }
code_block_4 = CodeBlock { "Estanque"; }
code_block_5 = CodeBlock { ""; }
getAllViewTypes = archilab.Revit.Views.Views.GetAllViewTypes(except=code_block_5)
code_block_6 = CodeBlock(x=getAllViewTypes) { x == "CeilingPlan"; }
filterByBoolMask = List.FilterByBoolMask(list=getAllViewTypes, mask=code_block_6)
getByType = archilab.Revit.Views.Views.GetByType(viewType=filterByBoolMask.in)
flatten = List.Flatten(list=getByType)
code_block_7 = CodeBlock { "Subclasificacion"; }
getParameterValueByName = Element.GetParameterValueByName(element=flatten, parameterName=code_block_7)
code_block_8 = CodeBlock(x=getParameterValueByName) { x == "07_DE"; }
filterByBoolMask_2 = List.FilterByBoolMask(list=flatten, mask=code_block_8)
code_block_9 = CodeBlock { "Zona"; }
getParameterValueByName_2 = Element.GetParameterValueByName(element=filterByBoolMask_2.in, parameterName=code_block_9)
groupByKey = List.GroupByKey(list=filterByBoolMask_2.in, keys=getParameterValueByName_2)
code_block_10 = CodeBlock(x=groupByKey.unique_keys) { "Building Section (07_DE_" + x + ")"; }
radiobuttons_data = Custom[RadioButtons Data](InputName=code_block_4, Keys=groupByKey.unique_keys, Values=code_block_10)  # package Data-Shapes; Create radio buttons input for UI.MultipleInputForm ++ .
code_block_11 = CodeBlock { "Escala:"; }
code_block_12 = CodeBlock()
# ---------- code_block_12.designscript (6 lines) ----------
[
"1:50",
"1:75",
"1:100",
"1:125"
];
# ----------------------------------------
code_block_13 = CodeBlock { ":"; }
split = String.Split(str=code_block_12, separator0=code_block_13)
code_block_14 = CodeBlock { 1; }
getItemAtIndex = List.GetItemAtIndex(list=split@L2, index=code_block_14)
toNumber = String.ToNumber(str=getItemAtIndex)
code_block_15 = CodeBlock { 0; false; }
dropdown_data = Custom[DropDown Data](InputName=code_block_11, Keys=code_block_12, Values=toNumber, DefaultValueIndex=code_block_15.out0, Sorted_optional=code_block_15.out1)  # package Data-Shapes; Create data for DropDown input in UI.MultiInputForm ++ . Check out www.data-shapes.net for more infos.
code_block_16 = CodeBlock { "Grids"; }
byName = Category.ByName(name=code_block_16)
all_elements_of_category = ElementsOfCategory(Category=byName)
code_block_17 = CodeBlock(g=all_elements_of_category) { "DE_ELEVACION EJE "+Revit.Elements.Element.Name(g); }
code_block_18 = CodeBlock { ""; }
getAllViewTypes_2 = archilab.Revit.Views.Views.GetAllViewTypes(except=code_block_18)
code_block_19 = CodeBlock(x=getAllViewTypes_2) { x == "CeilingPlan"; }
filterByBoolMask_3 = List.FilterByBoolMask(list=getAllViewTypes_2, mask=code_block_19)
getByType_2 = archilab.Revit.Views.Views.GetByType(viewType=filterByBoolMask_3.in)
flatten_2 = List.Flatten(list=getByType_2)
code_block_20 = CodeBlock { "Subclasificacion"; }
getParameterValueByName_3 = Element.GetParameterValueByName(element=flatten_2, parameterName=code_block_20)
code_block_21 = CodeBlock(x=getParameterValueByName_3) { x == "07_DE"; }
filterByBoolMask_4 = List.FilterByBoolMask(list=flatten_2, mask=code_block_21)
code_block_22 = CodeBlock { "Zona"; }
getParameterValueByName_4 = Element.GetParameterValueByName(element=filterByBoolMask_4.in, parameterName=code_block_22)
groupByKey_2 = List.GroupByKey(list=filterByBoolMask_4.in, keys=getParameterValueByName_4)
code_block_23 = CodeBlock(x=groupByKey_2.unique_keys) { "Building Section (07_DE_" + x + ")"; }
byName_2 = Orchid.RevitProject.Views.ViewType.ByName(name=code_block_23)
byType = Orchid.RevitProject.Views.View.ByType(viewType=byName_2)
flatten_3 = List.Flatten(list=byType)
code_block_24 = CodeBlock { "Subclasificacion"; }
getParameterValueByName_5 = Element.GetParameterValueByName(element=flatten_3, parameterName=code_block_24)
code_block_25 = CodeBlock { "07_DE"; }
eq = getParameterValueByName_5 == code_block_25
filterByBoolMask_5 = List.FilterByBoolMask(list=flatten_3, mask=eq)
code_block_26 = CodeBlock { "View Name"; }
getParameterValueByName_6 = Element.GetParameterValueByName(element=filterByBoolMask_5.in, parameterName=code_block_26)
code_block_27 = CodeBlock { null; }
replaceEmptyLists = Custom[List.ReplaceEmptyLists](seq=getParameterValueByName_6, Replacement=code_block_27)  # package Clockwork for Dynamo 2.x; Replaces all empty lists within a given list with a substitute
eq_2 = code_block_17@L1 == replaceEmptyLists@L2  # lacing=Longest
anyTrue = Orchid.Common.List.AnyTrue(list=eq_2)
filterByBoolMask_6 = List.FilterByBoolMask(list=all_elements_of_category, mask=anyTrue)
code_block_28 = CodeBlock(g=filterByBoolMask_6.out) { "ELEVACIÓN EJE "+Revit.Elements.Element.Name(g); }
radiobuttons_data_2 = Custom[RadioButtons Data](Keys=code_block_28, Values=filterByBoolMask_6.out)
list_create = List.Create(item0=radiobuttons_data, item1=dropdown_data, item2=radiobuttons_data_2)
inputgroup_data = Custom[InputGroup Data](GroupTitle=code_block_3, Inputs=list_create)  # package Data-Shapes; Creates a group of inputs for UI.MultipleInputForm ++ . Check out www.data-shapes.net for more infos !
boolean = BoolSelector(true)
multipleinputform = Custom[MultipleInputForm ++](Description_optional=code_block, ButtonText_optional=code_block_2.out0, Inputs=inputgroup_data, Toggle=boolean, CancelButtonText_optional=code_block_2.out1, MaxHeight_optional=code_block_2.out2, Width_optional=code_block_2.out3)  # package Data-Shapes; Create a form with multiple inputs. see www.data-shapes.net for tutorials and infos!
code_block_29 = CodeBlock(x=multipleinputform.User_Inputs)
# ---------- code_block_29.designscript (13 lines) ----------
x;

[Imperative]
{
	if(x == null)
	{
		return = [[],[],[]];
	}
	else
	{
		return = x;
	}
};
# ----------------------------------------
code_block_30 = CodeBlock(l=code_block_29.out1) { l[2]; }
curve = Grid.Curve(grid=code_block_30)
direction = Line.Direction(line=curve)
normalized = Vector.Normalized(vector=direction)
code_block_31 = CodeBlock(p=normalized) { p.X; }
code_block_32 = CodeBlock { 2; }
round = Math.Round(number=code_block_31, digits=code_block_32)
code_block_33 = CodeBlock { 0; }
le = round <= code_block_33
reverse = Curve.Reverse(curve=curve)
scopeIf = Custom[ScopeIf+](test=le, True=reverse, False=curve, lacing=Shortest)  # package Clockwork for Dynamo 2.x; A (hopefully) more robust implementation of ScopeIf. Tests a single boolean and returns a value accordingly.
code_block_34 = CodeBlock(x=scopeIf) { x; }
direction_2 = Line.Direction(line=code_block_34)
code_block_35 = CodeBlock(x=direction_2) { x.X; }
code_block_36 = CodeBlock { 0; }
ge = code_block_35 >= code_block_36
reverse_2 = Curve.Reverse(curve=code_block_34)
scopeIf_2 = Custom[ScopeIf+](test=ge, True=reverse_2, False=code_block_34, lacing=Shortest)
direction_3 = Line.Direction(line=scopeIf_2)
normalized_2 = Vector.Normalized(vector=direction_3)
code_block_37 = CodeBlock(x=normalized_2) { x.X; }
code_block_38 = CodeBlock { 0; }
eq_3 = code_block_37 == code_block_38
code_block_39 = CodeBlock(x=normalized_2) { x.Y; }
code_block_40 = CodeBlock { 0; }
gt = code_block_39 > code_block_40
and_ = eq_3 && gt
reverse_3 = Curve.Reverse(curve=scopeIf_2)
scopeIf_3 = Custom[ScopeIf+](test=and_, True=reverse_3, False=scopeIf_2, lacing=Shortest)
code_block_41 = CodeBlock { "Levels"; }
byName_3 = Category.ByName(name=code_block_41)
all_elements_of_category_2 = ElementsOfCategory(Category=byName_3)
elevation = Level.Elevation(level=all_elements_of_category_2)
minimumItem = List.MinimumItem(list=elevation)
eq_4 = elevation == minimumItem
filterByBoolMask_7 = List.FilterByBoolMask(list=all_elements_of_category_2, mask=eq_4)
plane = Custom[Level.Plane](level=filterByBoolMask_7.in)  # package Clockwork for Dynamo 2.x; Retrieves the plane of a given level
pullOntoPlane = Curve.PullOntoPlane(curve=scopeIf_3, plane=plane, lacing=Longest)
ZAxis = Vector.ZAxis()
code_block_42 = CodeBlock { -3000; }
translate = Geometry.Translate(geometry=pullOntoPlane, direction=ZAxis, distance=code_block_42, lacing=Longest)
code_block_43 = CodeBlock(l=code_block_29.out1) { l[0]; }
byName_4 = Orchid.RevitProject.Views.ViewType.ByName(name=code_block_43)
code_block_44 = CodeBlock { 0.5; }
pointAtParameter = Curve.PointAtParameter(curve=translate, param=code_block_44)
code_block_45 = CodeBlock { "Levels"; }
byName_5 = Category.ByName(name=code_block_45)
all_elements_of_category_3 = ElementsOfCategory(Category=byName_5)
elevation_2 = Level.Elevation(level=all_elements_of_category_3)
maximumItem = List.MaximumItem(list=elevation_2)
eq_5 = elevation_2 == maximumItem
filterByBoolMask_8 = List.FilterByBoolMask(list=all_elements_of_category_3, mask=eq_5)
plane_2 = Custom[Level.Plane](level=filterByBoolMask_8.in)
pullOntoPlane_2 = Curve.PullOntoPlane(curve=scopeIf_3, plane=plane_2, lacing=Longest)
ZAxis_2 = Vector.ZAxis()
code_block_46 = CodeBlock { 3000; }
translate_2 = Geometry.Translate(geometry=pullOntoPlane_2, direction=ZAxis_2, distance=code_block_46, lacing=Longest)
code_block_47 = CodeBlock { 0.5; }
pointAtParameter_2 = Curve.PointAtParameter(curve=translate_2, param=code_block_47)
distanceTo = Geometry.DistanceTo(geometry=pointAtParameter, other=pointAtParameter_2)
code_block_48 = CodeBlock { null; }
replaceEmptyLists_2 = Custom[List.ReplaceEmptyLists](seq=distanceTo, Replacement=code_block_48)
code_block_49 = CodeBlock(x=replaceEmptyLists_2)
# ---------- code_block_49.designscript (12 lines) ----------
x;
[Imperative]
{
	if(x == null)
	{
		return = [[]];
	}
	else
	{
		return = x;
	}
};
# ----------------------------------------
code_block_50 = CodeBlock(h=code_block_49.out1)
# ---------- code_block_50.designscript (6 lines) ----------
//height
h[0];
//offset
300;
//depth
300;
# ----------------------------------------
byLine = Custom[ViewSection.ByLine](Curves=translate, ViewFamilyType=byName_4, ViewSectionHeight=code_block_50.out0, OffsetFromLine=code_block_50.out1, Depth=code_block_50.out2)  # package Data-Shapes; Create ViewSections in current document from DS Lines.
code_block_51 = CodeBlock(g=code_block_30) { "View Name"; "DE_ELEVACION EJE "+Revit.Elements.Element.Name(g); }
setParameterByName = Element.SetParameterByName(element=byLine, parameterName=code_block_51.out0, value=code_block_51.out1, lacing=Longest)
code_block_52 = CodeBlock(g=code_block_30) { "Title on Sheet"; "ELEVACIÓN EJE "+Revit.Elements.Element.Name(g); }
setParameterByName_2 = Element.SetParameterByName(element=setParameterByName, parameterName=code_block_52.out0, value=code_block_52.out1, lacing=Longest)
code_block_53 = CodeBlock(l=code_block_29.out1) { l[1]; }
setScale = View.SetScale(view=setParameterByName_2, scale=code_block_53, lacing=Longest)
code_block_54 = CodeBlock()
# ---------- code_block_54.designscript (5 lines) ----------
[
"Crop View",
"Crop Region Visible"
];
[1,0];
# ----------------------------------------
setParameterByName_3 = Element.SetParameterByName(element=setScale@L1, parameterName=code_block_54.out0@L2, value=code_block_54.out1@L2, lacing=Longest)
flatten_4 = List.Flatten(list=setParameterByName_3)
uniqueItems = List.UniqueItems(list=flatten_4)
all_elements_in_view_s = Custom[All Elements In View(s)](Views=uniqueItems)  # package Data-Shapes; Retrieves all visible element in a view or a set of views
code_block_55 = CodeBlock { "View Name"; }
exists = Orchid.RevitProject.Parameters.Parameter.Exists(parameterName=code_block_55, element=all_elements_in_view_s)
filterByBoolMask_9 = List.FilterByBoolMask(list=all_elements_in_view_s, mask=exists)
code_block_56 = CodeBlock { "Type"; }
getParameterValueByName_7 = Element.GetParameterValueByName(element=filterByBoolMask_9.in, parameterName=code_block_56)
name = Orchid.RevitProject.Elements.ElementType.Name(elementType=getParameterValueByName_7)
code_block_57 = CodeBlock { "Building Section (02_MA)"; }
eq_6 = name == code_block_57
filterByBoolMask_10 = List.FilterByBoolMask(list=filterByBoolMask_9.in, mask=eq_6)
function_apply = ApplyFunction(func=hideElements, arg1=uniqueItems, arg2=filterByBoolMask_10.in)
code_block_58 = CodeBlock { null; }
replaceEmptyLists_3 = Custom[List.ReplaceEmptyLists](seq=function_apply, Replacement=code_block_58)
end = Revit.Transaction.Transaction.End(input=replaceEmptyLists_3)
code_block_59 = CodeBlock(x=end)
# ---------- code_block_59.designscript (13 lines) ----------
x;

[Imperative]
{
	if(x == null)
	{
		return = [];
	}
	else
	{
		return = "Section";
	}
};
# ----------------------------------------
getByType_3 = archilab.Revit.Views.Views.GetByType(viewType=code_block_59.out1)
all_elements_in_view_s_2 = Custom[All Elements In View(s)](Views=getByType_3)
code_block_60 = CodeBlock { "View Name"; }
exists_2 = Orchid.RevitProject.Parameters.Parameter.Exists(parameterName=code_block_60, element=all_elements_in_view_s_2)
filterByBoolMask_11 = List.FilterByBoolMask(list=all_elements_in_view_s_2, mask=exists_2)
hideElements_2 = archilab.Revit.Views.Views.HideElements(view=getByType_3, elements=filterByBoolMask_11.in)
end_2 = Revit.Transaction.Transaction.End(input=uniqueItems)
start = Revit.Transaction.Transaction.Start(input=end_2)
code_block_61 = CodeBlock { null; }
replaceEmptyLists_4 = Custom[List.ReplaceEmptyLists](seq=start, Replacement=code_block_61)
code_block_62 = CodeBlock(x=replaceEmptyLists_4)
# ---------- code_block_62.designscript (12 lines) ----------
x;
[Imperative]
{
	if(x == null)
	{
		return = [];
	}
	else
	{
		return = x[0];
	}
};
# ----------------------------------------
code_block_63 = CodeBlock(x=code_block_62.out1) { x; }
byLoft = Surface.ByLoft()  # unwired: crossSections
getCropBox = Orchid.RevitProject.Views.View.GetCropBox(view=code_block_62.out1)
code_block_64 = CodeBlock { null; }
replaceEmptyLists_5 = Custom[List.ReplaceEmptyLists](seq=getCropBox.Curve, Replacement=code_block_64)
code_block_65 = CodeBlock(x=replaceEmptyLists_5)
# ---------- code_block_65.designscript (12 lines) ----------
x;
[Imperative]
{
	if(x == null)
	{
		return = [];
	}
	else
	{
		return = x[1];
	}
};
# ----------------------------------------
code_block_66 = CodeBlock()
# ---------- code_block_66.designscript (6 lines) ----------
[
"Structural Columns",
"Structural Framing",
"Floors",
"Walls"
];
# ----------------------------------------
byName_6 = Category.ByName(name=code_block_66)
all_elements_of_category_in_view = ElementsOfCategoryInView(Category=byName_6, View=code_block_62.out1)
flatten_5 = List.Flatten(list=all_elements_of_category_in_view)
element_level = Custom[Element Level](element=flatten_5)  # package Genius Loci; Gets an element's level. Based on a Clockwork's node
uniqueItems_2 = List.UniqueItems(list=element_level)
elevation_3 = Level.Elevation(level=uniqueItems_2)
maximumItem_2 = List.MaximumItem(list=elevation_3)
eq_7 = elevation_3 == maximumItem_2
filterByBoolMask_12 = List.FilterByBoolMask(list=uniqueItems_2, mask=eq_7)
plane_bylevel = Custom[Plane ByLevel](level=filterByBoolMask_12.in)  # package Genius Loci; Constructs a Plane from a level.
pullOntoPlane_3 = Curve.PullOntoPlane(curve=code_block_65.out1, plane=plane_bylevel)
ZAxis_3 = Vector.ZAxis()
code_block_67 = CodeBlock { 1500; }
translate_3 = Geometry.Translate(geometry=pullOntoPlane_3, direction=ZAxis_3, distance=code_block_67)
code_block_68 = CodeBlock(x=replaceEmptyLists_5)
# ---------- code_block_68.designscript (12 lines) ----------
x;
[Imperative]
{
	if(x == null)
	{
		return = [];
	}
	else
	{
		return = x[3];
	}
};
# ----------------------------------------
list_create_2 = List.Create(item0=translate_3, item1=code_block_68.out1)
flatten_6 = List.Flatten(list=list_create_2)
function_apply_2 = ApplyFunction(func=byLoft, arg1=flatten_6)
code_block_69 = CodeBlock(x=function_apply_2)
# ---------- code_block_69.designscript (12 lines) ----------
x;
[Imperative]
{
	if(x == null)
	{
		return = [];
	}
	else
	{
		return = x;
	}
};
# ----------------------------------------
perimeterCurves = Surface.PerimeterCurves(surface=code_block_69.out1)
setCropBox = Orchid.RevitProject.Views.View.SetCropBox(view=code_block_63, curve=perimeterCurves)
openView = Orchid.RevitProject.Common.Document.OpenView(view=setCropBox)
