# Dynamo graph hideRevisionClouds_script.dyn "hideRevisionClouds" (Dynamo 2.3.2.15696)
# packages: Orchid 200.4.0.7938, archi-lab.net 2022.210.2419

activeView = Orchid.RevitProject.Common.Document.ActiveView()
code_block = CodeBlock { "Revision Clouds"; }
byName = Category.ByName(name=code_block)
all_elements_of_category_in_view = ElementsOfCategoryInView(Category=byName, View=activeView)
hideElements = archilab.Revit.Views.Views.HideElements(view=activeView@L1, elements=all_elements_of_category_in_view@L2, lacing=Longest)
