# Dynamo graph actualizarDescripcion_script.dyn (Dynamo 2.3.2.15696)
# packages: Data-Shapes 2022.2.96, Genius Loci 2021.11.10, Orchid 200.4.0.7938, Data-Shapes 2021.2.94

now = DateTime.Now()
code_block = CodeBlock { "dd.MM.yy"; }
format = DateTime.Format(dateTime=now, format=code_block)
code_block_2 = CodeBlock { "."; }
split = String.Split(str=format, separator0=code_block_2)
toNumber = String.ToNumber(str=split)
code_block_3 = CodeBlock { 2; }
getItemAtIndex = List.GetItemAtIndex(list=toNumber, index=code_block_3)
code_block_4 = CodeBlock { 1; }
getItemAtIndex_2 = List.GetItemAtIndex(list=toNumber, index=code_block_4)
code_block_5 = CodeBlock { 0; }
getItemAtIndex_3 = List.GetItemAtIndex(list=toNumber, index=code_block_5)
daysInMonth = DateTime.DaysInMonth(year=getItemAtIndex, month=getItemAtIndex_2)
code_block_6 = CodeBlock(ini=getItemAtIndex_3, mes=daysInMonth) { ini..mes..1; }
byDate = DateTime.ByDate(year=getItemAtIndex, month=getItemAtIndex_2, day=code_block_6)
code_block_7 = CodeBlock { "dd.MM.yy"; }
format_2 = DateTime.Format(dateTime=byDate, format=code_block_7)
code_block_8 = CodeBlock { "Sheets"; }
byName = Category.ByName(name=code_block_8)
all_elements_of_category = ElementsOfCategory(Category=byName)
code_block_9 = CodeBlock { "Sheets"; }
byName_2 = Category.ByName(name=code_block_9)
all_elements_of_category_2 = ElementsOfCategory(Category=byName_2)
parameters = Element.Parameters(element=all_elements_of_category_2)
group = Parameter.Group(parameter=parameters)
code_block_10 = CodeBlock { "PG_DATA"; }
eq = group == code_block_10
filterByBoolMask = List.FilterByBoolMask(list=parameters, mask=eq)
string_from_object = FromObject(obj=filterByBoolMask.in)
code_block_11 = CodeBlock { " : "; }
split_2 = String.Split(str=string_from_object@L2, separator0=code_block_11, lacing=Longest)
code_block_12 = CodeBlock { 0; }
getItemAtIndex_4 = List.GetItemAtIndex(list=split_2@L2, index=code_block_12)
uniqueItems = List.UniqueItems(list=getItemAtIndex_4)
code_block_13 = CodeBlock { "DES"; }
contains = String.Contains(str=uniqueItems, searchFor=code_block_13)
filterByBoolMask_2 = List.FilterByBoolMask(list=uniqueItems, mask=contains)
uniqueItems_2 = List.UniqueItems(list=filterByBoolMask_2.in)
trimTrailingWhitespace = String.TrimTrailingWhitespace(str=uniqueItems_2)
getParameterValueByName = Element.GetParameterValueByName(element=all_elements_of_category_2@L1, parameterName=trimTrailingWhitespace@L2, lacing=Longest)
code_block_14 = CodeBlock { "Actualizar Fecha Ultima Revisión"; }
code_block_15 = CodeBlock { "INICIAR"; "CANCELAR"; 160; 430; }
code_block_16 = CodeBlock { "Fecha de Revisión"; }
code_block_17 = CodeBlock { "Selecciona un a Fecha"; }
code_block_18 = CodeBlock { "Sheets"; }
byName_3 = Category.ByName(name=code_block_18)
all_elements_of_category_3 = ElementsOfCategory(Category=byName_3)
parameters_2 = Element.Parameters(element=all_elements_of_category_3)
group_2 = Parameter.Group(parameter=parameters_2)
code_block_19 = CodeBlock { "PG_DATA"; }
eq_2 = group_2 == code_block_19
filterByBoolMask_3 = List.FilterByBoolMask(list=parameters_2, mask=eq_2)
name = Parameter.Name(parameter=filterByBoolMask_3.in)
flatten = List.Flatten(list=name)
uniqueItems_3 = List.UniqueItems(list=flatten)
code_block_20 = CodeBlock { "FCH"; }
contains_2 = String.Contains(str=uniqueItems_3, searchFor=code_block_20)
filterByBoolMask_4 = List.FilterByBoolMask(list=uniqueItems_3, mask=contains_2)
getParameterValueByName_2 = Element.GetParameterValueByName(element=all_elements_of_category_3@L1, parameterName=filterByBoolMask_4.in@L2, lacing=Longest)
flatten_2 = List.Flatten(list=getParameterValueByName_2)
uniqueItems_4 = List.UniqueItems(list=flatten_2)
list_clean = Custom[List Clean](list=uniqueItems_4)  # package Genius Loci; Removes all Null, Empty and Blank from a list or nested list of lists.
boolean = BoolSelector(false)
dropdown_data = Custom[DropDown Data](InputName=code_block_17, Keys=list_clean, Values=list_clean, Sorted_optional=boolean)  # package Data-Shapes; Create data for DropDown input in UI.MultiInputForm ++ . Check out www.data-shapes.net for more infos.
code_block_21 = CodeBlock { "Nueva Fecha de Revisión"; }
code_block_22 = CodeBlock { "PARA APROBACION"; }
code_block_23 = CodeBlock { 0; }
dropdown_data_2 = Custom[DropDown Data](InputName=code_block_21, Keys=code_block_22, Values=code_block_22, DefaultValueIndex=code_block_23)
list_create = List.Create(item0=dropdown_data, item1=dropdown_data_2)
inputgroup_data = Custom[InputGroup Data](GroupTitle=code_block_16, Inputs=list_create)  # package Data-Shapes; Creates a group of inputs for UI.MultipleInputForm ++ . Check out www.data-shapes.net for more infos !
boolean_2 = BoolSelector(true)
multipleinputform = Custom[MultipleInputForm ++](Description_optional=code_block_14, ButtonText_optional=code_block_15.out0, Inputs=inputgroup_data, Toggle=boolean_2, CancelButtonText_optional=code_block_15.out1, Width_optional=code_block_15.out3, LabelWidth_optional=code_block_15.out2)  # package Data-Shapes; Create a form with multiple inputs. see www.data-shapes.net for tutorials and infos!
code_block_24 = CodeBlock(x=multipleinputform.User_Inputs)
# ---------- code_block_24.designscript (12 lines) ----------
x;
[Imperative]
{
	if(x == null)
	{
		return = [[],[]];
	}
	else
	{
		return = x;
	}
};
# ----------------------------------------
code_block_25 = CodeBlock(x=code_block_24.out1) { x[0]; }
eq_3 = getParameterValueByName@L2 == code_block_25@L1  # lacing=Longest
anyTrue = Orchid.Common.List.AnyTrue(list=eq_3@L2)
filterByBoolMask_5 = List.FilterByBoolMask(list=all_elements_of_category, mask=anyTrue)
parameters_3 = Element.Parameters(element=filterByBoolMask_5.in)
group_3 = Parameter.Group(parameter=parameters_3)
code_block_26 = CodeBlock { "PG_DATA"; }
eq_4 = group_3 == code_block_26
filterByBoolMask_6 = List.FilterByBoolMask(list=parameters_3, mask=eq_4)
code_block_27 = CodeBlock { null; }
value = Parameter.Value(parameter=filterByBoolMask_6.in)
ne = code_block_27 != value
code_block_28 = CodeBlock { ""; }
ne_2 = value != code_block_28
xor = Math.Xor(a=ne, b=ne_2)
filterByBoolMask_7 = List.FilterByBoolMask(list=filterByBoolMask_6.in, mask=xor)
isEmpty = List.IsEmpty(list=filterByBoolMask_7.out)
code_block_29 = CodeBlock(x=isEmpty)
# ---------- code_block_29.designscript (13 lines) ----------
x;
lst = 1..5;
res = [Imperative]
{
	if (x == false)
	{
		return = 5;
	}
	else
	{
		return = [];
	}
};
# ----------------------------------------
name_2 = Parameter.Name()  # unwired: parameter
code_block_30 = CodeBlock(x=isEmpty, y=filterByBoolMask_7.out)
# ---------- code_block_30.designscript (13 lines) ----------
x;
y;
res = [Imperative]
{
	if (x == false)
	{
		return = y;
	}
	else
	{
		return = null;
	}
};
# ----------------------------------------
lastItem = List.LastItem(list=code_block_30.out2@L2)
function_apply = ApplyFunction(func=name_2, arg1=lastItem)
code_block_31 = CodeBlock(x=code_block_24.out1) { x[1]; }
setParameterByName = Element.SetParameterByName(element=filterByBoolMask_5.in, parameterName=function_apply, value=code_block_31@L1, lacing=Longest)
