# Dynamo graph transferViewTemplates_script.dyn "viewTemplates" (Dynamo 2.3.1.11775)
# packages: Rhythm 2020.7.25, Orchid 200.4.0.7938, Data-Shapes 2021.2.94, Clockwork for Dynamo 2.x 2.4.0

code_block = CodeBlock { "Transferir View Templates"; }
code_block_2 = CodeBlock()
# ---------- code_block_2.designscript (10 lines) ----------
//buttonText
"INICIAR";
//buttonCancel
"CANCELAR";
//maxHeight

//width
440;
//label
180;
# ----------------------------------------
code_block_3 = CodeBlock { "Seleccionar el Proyecto"; }
file_path = Filename("D:\OneDrive\06_pyRevit\template\proyectoTemplate.rte")
code_block_4 = CodeBlock { "BUSCAR"; }
filepath_data = Custom[FilePath Data](DefaulPath=file_path, ButtonText=code_block_4)  # package Data-Shapes; Create filepath input for UI.MultipleInputForm ++ . Check out www.data-shapes.net for more infos !
inputgroup_data = Custom[InputGroup Data](GroupTitle=code_block_3, Inputs=filepath_data)  # package Data-Shapes; Creates a group of inputs for UI.MultipleInputForm ++ . Check out www.data-shapes.net for more infos !
boolean = BoolSelector(true)
multipleinputform = Custom[MultipleInputForm ++](Description_optional=code_block, ButtonText_optional=code_block_2.out0, Inputs=inputgroup_data, Toggle=boolean, CancelButtonText_optional=code_block_2.out1, Width_optional=code_block_2.out2, LabelWidth_optional=code_block_2.out3)  # package Data-Shapes; Create a form with multiple inputs. see www.data-shapes.net for tutorials and infos!
code_block_5 = CodeBlock(x=multipleinputform.User_Inputs)
# ---------- code_block_5.designscript (13 lines) ----------
x;

[Imperative]
{
	if(x == null)
	{
		return = [[],[]];
	}
	else
	{
		return = x;
	}
};
# ----------------------------------------
code_block_6 = CodeBlock(x=code_block_5.out1) { x[0]; }
ʳʰʸᵗʰᵐ_applications = Rhythm.Revit.Application.Applications.OpenDocumentFile(filePath=code_block_6)
code_block_7 = CodeBlock(x=ʳʰʸᵗʰᵐ_applications) { x; }
ʳʰʸᵗʰᵐ_documents = Rhythm.Revit.Application.Documents.CopyElementsFromDocument(sourceDocument=code_block_7)  # unwired: elements
code_block_8 = CodeBlock { "Transferir View Templates"; }
code_block_9 = CodeBlock()  # same code as code_block_2
toOrchidType = Orchid.RevitProject.Common.Document.ToOrchidType()  # unwired: document
function_apply = ApplyFunction(func=toOrchidType, arg1=ʳʰʸᵗʰᵐ_applications)
all = Orchid.RevitProject.Views.ViewTemplate.All(document=function_apply)
name = Element.Name(element=all)
code_block_10 = CodeBlock()
# ---------- code_block_10.designscript (8 lines) ----------
//heigth
440;
//elemCount
true;
//sort

//id
false;
# ----------------------------------------
listview_data = Custom[Listview Data](Keys=name, Values=all, Height_optionnal=code_block_10.out0, ShowElementCount_optionnal=code_block_10.out1, ShowId_optionnal=code_block_10.out2)  # package Data-Shapes; Create data for ListView input in UI.MultiInputForm ++ . Check out www.data-shapes.net for more infos.
code_block_11 = CodeBlock { null; }
replaceEmptyLists = Custom[List.ReplaceEmptyLists](seq=code_block_6, Replacement=code_block_11)  # package Clockwork for Dynamo 2.x; Replaces all empty lists within a given list with a substitute
code_block_12 = CodeBlock(x=replaceEmptyLists)
# ---------- code_block_12.designscript (13 lines) ----------
x;

[Imperative]
{
	if(x == null)
	{
		return = false;
	}
	else
	{
		return = true;
	}
};
# ----------------------------------------
multipleinputform_2 = Custom[MultipleInputForm ++](Description_optional=code_block_8, ButtonText_optional=code_block_9.out0, Inputs=listview_data, Toggle=code_block_12.out1, CancelButtonText_optional=code_block_9.out1, Width_optional=code_block_9.out2, LabelWidth_optional=code_block_9.out3)
code_block_13 = CodeBlock(y=multipleinputform_2.User_Inputs, x=multipleinputform_2.Was_Run)
# ---------- code_block_13.designscript (14 lines) ----------
y;
x;

[Imperative]
{
	if(x == false || y == null)
	{
		return = [[],[]];
	}
	else
	{
		return = y;
	}
};
# ----------------------------------------
code_block_14 = CodeBlock(x=code_block_13.out2) { x[0]; }
function_apply_2 = ApplyFunction(func=ʳʰʸᵗʰᵐ_documents, arg1=code_block_14)
code_block_15 = CodeBlock(x=function_apply_2)
# ---------- code_block_15.designscript (12 lines) ----------
x;
[Imperative]
{
	if(x == null)
	{
		return = [];
	}
	else
	{
		return = x;
	}
};
# ----------------------------------------
await_ = Orchid.Common.DataStream.Await(pass=code_block_7, waitFor=code_block_15.out1)
code_block_16 = CodeBlock { false; }
ʳʰʸᵗʰᵐ_applications_2 = Rhythm.Revit.Application.Applications.CloseDocument(document=await_, save=code_block_16)
