# Dynamo graph script.dyn (Dynamo 2.3.2.15696)
# packages: Rhythm 2020.7.25, Orchid 200.4.0.7938, Data-Shapes 2021.2.94, Clockwork for Dynamo 2.x 2.4.0

ʳʰʸᵗʰᵐ_elements_setpinnedstatus = Rhythm.Revit.Elements.Elements.SetPinnedStatus()  # unwired: element, status
code_block = CodeBlock { "Bloquear/Desbloquear Elementos"; }
code_block_2 = CodeBlock()
# ---------- code_block_2.designscript (13 lines) ----------
//buttonText
"INICIAR";

//cancelButton
"CANCELAR";

//maxHeight
860;

//width
430;

//labelWidth
# ----------------------------------------
name = Material.Name()  # unwired: material
code_block_3 = CodeBlock { "Bloquear/Desbloquear Elementos"; }
code_block_4 = CodeBlock()
# ---------- code_block_4.designscript (14 lines) ----------
//buttonText
"SELECCIONAR";

//cancelButton
"CANCELAR";

//maxHeight
860;

//width
430;

//labelWidth
150;
# ----------------------------------------
code_block_5 = CodeBlock()
# ---------- code_block_5.designscript (10 lines) ----------
"Seleccionar Categoria";
[
"Structural Columns",
"Structural Framing",
"Floors",
"Walls",
"Structural Foundations"
];

0;
# ----------------------------------------
radiobuttons_data = Custom[RadioButtons Data](InputName=code_block_5.out0, Keys=code_block_5.out1, Values=code_block_5.out1, DefaultValueIndex=code_block_5.out2)  # package Data-Shapes; Create radio buttons input for UI.MultipleInputForm ++ .
boolean = BoolSelector(true)
multipleinputform = Custom[MultipleInputForm ++](Description_optional=code_block_3, ButtonText_optional=code_block_4.out0, Inputs=radiobuttons_data, Toggle=boolean, CancelButtonText_optional=code_block_4.out1, MaxHeight_optional=code_block_4.out2, Width_optional=code_block_4.out3, LabelWidth_optional=code_block_4.out4)  # package Data-Shapes; Create a form with multiple inputs. see www.data-shapes.net for tutorials and infos!
code_block_6 = CodeBlock(x=multipleinputform.User_Inputs)
# ---------- code_block_6.designscript (12 lines) ----------
x;
[Imperative]
{
	if(x == null)
	{
		return = [];
	}
	else
	{
		return = x[0];
	}
};
# ----------------------------------------
byName = Category.ByName(name=code_block_6.out1)
all_elements_of_category = ElementsOfCategory(Category=byName)
getMaterials = Element.GetMaterials(element=all_elements_of_category)
function_apply = ApplyFunction(func=name, arg1=getMaterials)
flatten = List.Flatten(list=function_apply)
uniqueItems = List.UniqueItems(list=flatten)
code_block_7 = CodeBlock(lst=uniqueItems) { "Material"; lst; 0; false; }
listview_data = Custom[Listview Data](InputName=code_block_7.out0, Keys=code_block_7.lst, Values=code_block_7.lst, SortItems_optionnal=code_block_7.out3)  # package Data-Shapes; Create data for ListView input in UI.MultiInputForm ++ . Check out www.data-shapes.net for more infos.
code_block_8 = CodeBlock { "Opciones"; ["BLOQUEAR","DESBLOQUEAR"]; [true,false]; 0; }
radiobuttons_data_2 = Custom[RadioButtons Data](InputName=code_block_8.out0, Keys=code_block_8.out1, Values=code_block_8.out2, DefaultValueIndex=code_block_8.out3)
list_create = List.Create(item0=listview_data, item1=radiobuttons_data_2)
multipleinputform_2 = Custom[MultipleInputForm ++](Description_optional=code_block, ButtonText_optional=code_block_2.out0, Inputs=list_create, Toggle=code_block_6.out1, CancelButtonText_optional=code_block_2.out1, MaxHeight_optional=code_block_2.out2, Width_optional=code_block_2.out3)
code_block_9 = CodeBlock { null; }
replaceEmptyLists = Custom[List.ReplaceEmptyLists](seq=multipleinputform_2.User_Inputs, Replacement=code_block_9)  # package Clockwork for Dynamo 2.x; Replaces all empty lists within a given list with a substitute
code_block_10 = CodeBlock(x=replaceEmptyLists)
# ---------- code_block_10.designscript (12 lines) ----------
x;
[Imperative]
{
	if(x == null)
	{
		return = [[],[]];
	}
	else
	{
		return = x;
	}
};
# ----------------------------------------
code_block_11 = CodeBlock(x=code_block_10.out1) { x[1]; }
code_block_12 = CodeBlock(x=code_block_6.out1) { x; }
byName_2 = Category.ByName(name=code_block_12)
all_elements_of_category_2 = ElementsOfCategory(Category=byName_2)
code_block_13 = CodeBlock(x=code_block_10.out1) { x[0]; }
name_2 = Material.Name()  # unwired: material
getMaterials_2 = Element.GetMaterials(element=all_elements_of_category_2)
function_apply_2 = ApplyFunction(func=name_2, arg1=getMaterials_2)
firstItem = List.FirstItem()  # unwired: list
map = List.Map(list=function_apply_2, f_x=firstItem)
eq = code_block_13 == map@L1
anyTrue = Orchid.Common.List.AnyTrue(list=eq)
filterByBoolMask = List.FilterByBoolMask(list=all_elements_of_category_2, mask=anyTrue)
isPinned = Orchid.RevitProject.Elements.Element.IsPinned(element=filterByBoolMask.in)
filterByBoolMask_2 = List.FilterByBoolMask(list=filterByBoolMask.in, mask=isPinned)
code_block_14 = CodeBlock(x=code_block_11, lstPinned=filterByBoolMask_2.in, lstUnpinned=filterByBoolMask_2.out)
# ---------- code_block_14.designscript (14 lines) ----------
x;
lstPinned;
lstUnpinned;
[Imperative]
{
	if(x == false)
	{
		return = lstPinned;
	}
	else
	{
		return = lstUnpinned;
	}
};
# ----------------------------------------
function_apply_3 = ApplyFunction(func=ʳʰʸᵗʰᵐ_elements_setpinnedstatus, arg1=code_block_14.out3, arg2=code_block_14.out0)
