# Dynamo graph PlantasTrabajo_script.dyn (Dynamo 2.3.2.15696)
# packages: Data-Shapes 2022.2.96, Orchid 200.4.0.7938, Genius Loci 2020.8.3, WombatDynamo 2.3.4, Clockwork for Dynamo 2.x 2.4.0, archi-lab.net 2022.210.2419, Crumple 2022.2.13, Genius Loci 2021.11.10

code_block = CodeBlock { "Building Section"; }
byName = Orchid.RevitProject.Views.ViewType.ByName(name=code_block)
code_block_2 = CodeBlock { "Plantas de Trabajo"; }
code_block_3 = CodeBlock { "INICIAR"; "CANCELAR"; 95; 430; }
code_block_4 = CodeBlock { "Niveles"; }
code_block_5 = CodeBlock { "Levels"; }
byName_2 = Category.ByName(name=code_block_5)
all_elements_of_category = ElementsOfCategory(Category=byName_2)
elevation = Level.Elevation(level=all_elements_of_category)
sortByKey = List.SortByKey(list=all_elements_of_category, keys=elevation)
code_block_6 = CodeBlock { "Building Story"; }
getParameterValueByName = Element.GetParameterValueByName(element=sortByKey.sorted_list, parameterName=code_block_6)
code_block_7 = CodeBlock { 1; }
eq = getParameterValueByName == code_block_7
filterByBoolMask = List.FilterByBoolMask(list=sortByKey.sorted_list, mask=eq)
name = Element.Name(element=filterByBoolMask.in)
code_block_8 = CodeBlock { 400; false; }
code_block_9 = CodeBlock(l=name) { count = DSCore.List.Count(l) - 1; 0..count..1; }
listview_data = Custom[Listview Data](InputName=code_block_4, Keys=name, Values=filterByBoolMask.in, Height_optionnal=code_block_8.out0, DefaultValueIndices_optionnal=code_block_9.out1, SortItems_optionnal=code_block_8.out1, ShowId_optionnal=code_block_8.out1)  # package Data-Shapes; Create data for ListView input in UI.MultiInputForm ++ . Check out www.data-shapes.net for more infos.
code_block_10 = CodeBlock { "Escala"; }
code_block_11 = CodeBlock()
# ---------- code_block_11.designscript (6 lines) ----------
[
"1:50",
"1:75",
"1:100"
];
":";
# ----------------------------------------
split = String.Split(str=code_block_11.out0, separator0=code_block_11.out1)
code_block_12 = CodeBlock { 1; }
getItemAtIndex = List.GetItemAtIndex(list=split@L2, index=code_block_12)
toNumber = String.ToNumber(str=getItemAtIndex)
code_block_13 = CodeBlock { 0; false; }
dropdown_data = Custom[DropDown Data](InputName=code_block_10, Keys=code_block_11.out0, Values=toNumber, DefaultValueIndex=code_block_13.out0, Sorted_optional=code_block_13.out1)  # package Data-Shapes; Create data for DropDown input in UI.MultiInputForm ++ . Check out www.data-shapes.net for more infos.
code_block_14 = CodeBlock()
# ---------- code_block_14.designscript (5 lines) ----------
"Selecciona\nUsuario";

["JNN","PCC","ACC","ASA","CSR","SJM","RPC","COC","MFS","DSP","HCP","LBM","MFS","RAV","XXX"];
["Jose Nuñez","Patricia Caroca","Alejandro Cifuentes","Anibal Sanchez","Cristian Salinas","Sergio Jimenez","Ruben Perez","Cristian Orrego","Macarena Fuentes","Danny Salazar","Hector Carrasco","Leandro Barrios","Macarena Fuentes","Reinaldo Aguila","Usuario"];
-1;
# ----------------------------------------
code_block_15 = CodeBlock { false; }
dropdown_data_2 = Custom[DropDown Data](InputName=code_block_14.out0, Keys=code_block_14.out2, Values=code_block_14.out1, DefaultValueIndex=code_block_14.out3, Sorted_optional=code_block_15)
list_create = List.Create(item0=listview_data, item1=dropdown_data, item2=dropdown_data_2)
boolean = BoolSelector(true)
multipleinputform = Custom[MultipleInputForm ++](Description_optional=code_block_2, ButtonText_optional=code_block_3.out0, Inputs=list_create, Toggle=boolean, CancelButtonText_optional=code_block_3.out1, Width_optional=code_block_3.out3, LabelWidth_optional=code_block_3.out2)  # package Data-Shapes; Create a form with multiple inputs. see www.data-shapes.net for tutorials and infos!
code_block_16 = CodeBlock(l=multipleinputform.User_Inputs)
# ---------- code_block_16.designscript (12 lines) ----------
l;
[Imperative]
{
	if (l == null)
		{
		return = [[],[],[]];
		}
	else
		{
		return = l;
		}
};
# ----------------------------------------
code_block_17 = CodeBlock(l=code_block_16.out1) { DSCore.List.Flatten(([l[0]]),1); }
nullToEmptyList = WombatDynamo.List.NullToEmptyList(data=code_block_17)
byLevel = StructuralPlanView.ByLevel(level=nullToEmptyList)
code_block_18 = CodeBlock { "Zona"; "(ALL)"; }
setParameterByName = Element.SetParameterByName(element=byLevel, parameterName=code_block_18.out0, value=code_block_18.out1)
code_block_19 = CodeBlock { "Structural Plan (Cielo)"; "Type"; }
byName_3 = Orchid.RevitProject.Views.ViewType.ByName(name=code_block_19.out0)
setParameterByName_2 = Element.SetParameterByName(element=setParameterByName, parameterName=code_block_19.out1, value=byName_3)
code_block_20 = CodeBlock(l=code_block_16.out1) { DSCore.List.Flatten(([l[1]]),1); }
nullToEmptyList_2 = WombatDynamo.List.NullToEmptyList(data=code_block_20)
setScale = View.SetScale(view=setParameterByName_2, scale=nullToEmptyList_2, lacing=Longest)
code_block_21 = CodeBlock { null; }
replaceEmptyLists = Custom[List.ReplaceEmptyLists](seq=setScale, Replacement=code_block_21)  # package Clockwork for Dynamo 2.x; Replaces all empty lists within a given list with a substitute
all = Orchid.RevitProject.Views.ViewTemplate.All()
name_2 = Element.Name(element=all)
code_block_22 = CodeBlock { "Architectural Reflected Ceiling Plan"; }
eq_2 = name_2 == code_block_22
filterByBoolMask_2 = List.FilterByBoolMask(list=all, mask=eq_2)
code_block_23 = CodeBlock(x=replaceEmptyLists, y=filterByBoolMask_2.in)
# ---------- code_block_23.designscript (14 lines) ----------
x;
y;

[Imperative]
{
	if (x == null)
		{
		return = [];
		}
	else
		{
		return = y;
		}
};
# ----------------------------------------
code_block_24 = CodeBlock(l=code_block_16.out1) { DSCore.List.Flatten(([l[2]]),1); }
nullToEmptyList_3 = WombatDynamo.List.NullToEmptyList(data=code_block_24)
code_block_25 = CodeBlock(user=nullToEmptyList_3) { x = user; "02_TRABAJO_"+user+"_STRUCTURAL PLAN (CIELO)"; }
duplicate = Orchid.RevitProject.Views.ViewTemplate.Duplicate(viewTemplate=code_block_23.out2, name=code_block_25.out1)
code_block_26 = CodeBlock()
# ---------- code_block_26.designscript (4 lines) ----------
[
"Clasificacion",
"Subclasificacion"
];
# ----------------------------------------
code_block_27 = CodeBlock { null; }
replaceEmptyLists_2 = Custom[List.ReplaceEmptyLists](seq=code_block_25.x, Replacement=code_block_27)
code_block_28 = CodeBlock(x=replaceEmptyLists_2)
# ---------- code_block_28.designscript (13 lines) ----------
x;

[Imperative]
{
	if (x == null)
		{
		return = [[]];
		}
	else
		{
		return = x;
		}
};
# ----------------------------------------
code_block_29 = CodeBlock(user=code_block_28.out1) { "02_TRABAJO"; user[0]; }
list_create_2 = List.Create(item0=code_block_29.out0, item1=code_block_29.out1)
setParameterByName_3 = Element.SetParameterByName(element=duplicate, parameterName=code_block_26, value=list_create_2, lacing=Longest)
uniqueItems = List.UniqueItems(list=setParameterByName_3)
code_block_30 = CodeBlock { null; }
replaceEmptyLists_3 = Custom[List.ReplaceEmptyLists](seq=uniqueItems, Replacement=code_block_30)
code_block_31 = CodeBlock { "Subclasificacion"; }
getParameterValueByName_2 = Element.GetParameterValueByName(element=uniqueItems, parameterName=code_block_31)
code_block_32 = CodeBlock(x=replaceEmptyLists_3, y=getParameterValueByName_2)  # same code as code_block_23
code_block_33 = CodeBlock { "Subclasificacion"; "NotEquals"; }
create = Orchid.RevitProject.Filters.FilterRule.Create(parameter=code_block_33.out0, ruleType=code_block_33.out1, value=getParameterValueByName_2)
code_block_34 = CodeBlock { "Sections"; }
byName_4 = Category.ByName(name=code_block_34)
byRule = Orchid.RevitProject.Filters.ParameterFilter.ByRule(name=code_block_32.out2, filterRule=create, category=byName_4)
code_block_35 = CodeBlock { false; }
addFilter = Orchid.RevitProject.Views.View.AddFilter(view=uniqueItems, parameterFilter=byRule, visibility=code_block_35, lacing=Longest)
set = Orchid.RevitProject.Views.ViewTemplate.Set(view=setScale, viewTemplate=addFilter, lacing=Longest)
code_block_36 = CodeBlock { "View Name"; }
code_block_37 = CodeBlock { "_"; }
identity = Object.Identity(obj=set)
code_block_38 = CodeBlock()
# ---------- code_block_38.designscript (4 lines) ----------
[
"Type",
"Subclasificacion"
];
# ----------------------------------------
getParameterValueByName_3 = Element.GetParameterValueByName(element=identity@L1, parameterName=code_block_38@L2, lacing=Longest)
code_block_39 = CodeBlock { null; }
replaceEmptyLists_4 = Custom[List.ReplaceEmptyLists](seq=getParameterValueByName_3, Replacement=code_block_39)
code_block_40 = CodeBlock(x=replaceEmptyLists_4, y=getParameterValueByName_3)
# ---------- code_block_40.designscript (14 lines) ----------
x;
y;

[Imperative]
{
	if (x == null)
		{
		return = [null,null];
		}
	else
		{
		return = y;
		}
};
# ----------------------------------------
code_block_41 = CodeBlock { 1; }
getItemAtIndex_2 = List.GetItemAtIndex(list=code_block_40.out2@L2, index=code_block_41)
code_block_42 = CodeBlock { 0; }
getItemAtIndex_3 = List.GetItemAtIndex(list=code_block_40.out2@L2, index=code_block_42)
nullToEmptyList_4 = WombatDynamo.List.NullToEmptyList(data=getItemAtIndex_3)
name_3 = Element.Name(element=nullToEmptyList_4)
code_block_43 = CodeBlock { 0; 17; }
remove = String.Remove(str=name_3, startIndex=code_block_43.out0, count=code_block_43.out1)
code_block_44 = CodeBlock { ")"; ""; }
replace = String.Replace(str=remove, searchFor=code_block_44.out0, replaceWith=code_block_44.out1)
toUpper = String.ToUpper(str=replace)
name_4 = Element.Name(element=identity)
list_create_3 = List.Create(item0=getItemAtIndex_2, item1=toUpper, item2=name_4)
transpose = List.Transpose(lists=list_create_3)
join = String.Join(separator=code_block_37, string0=transpose@L2)
setParameterByName_4 = Element.SetParameterByName(element=set, parameterName=code_block_36, value=join)
element_level = Custom[Element Level](element=setParameterByName_4)  # package Genius Loci; Gets an element's level. Based on a Clockwork's node
levelAbove = Custom[Level.LevelAbove](level=element_level)  # package archi-lab.net; This node takes an input of level and returns level above it.
empty = List.Empty()
replacenulls = Custom[© ReplaceNulls](lst=levelAbove, replace=empty)  # package Crumple; Replaces all nulls with a given substitute.
code_block_45 = CodeBlock { 1000; 300; }
set_viewrange = Custom[Set ViewRange](view=setParameterByName_4, TopLevel=replacenulls, Top=code_block_45.out1, CutLevel=element_level, CutPlane=code_block_45.out0, BottomLevel=element_level, Bottom=code_block_45.out0, DepthLevel=replacenulls, ViewDepth=code_block_45.out1, lacing=Longest)  # package Genius Loci; Set the view range of the given plan view.
list_clean = Custom[List Clean](list=set_viewrange)  # package Genius Loci; Removes all Null, Empty and Blank from a list or nested list of lists.
viewlevel = Custom[© ViewLevel](views=list_clean)  # package Crumple; Returns the associated level of a view (if it has one), as well as a boolean mask to remove views without levels after.
byLevel_2 = StructuralPlanView.ByLevel(level=viewlevel.lvls)
code_block_46 = CodeBlock { "Structural Plan (Piso)"; "Type"; }
byName_5 = Orchid.RevitProject.Views.ViewType.ByName(name=code_block_46.out0)
setParameterByName_5 = Element.SetParameterByName(element=byLevel_2, parameterName=code_block_46.out1, value=byName_5)
code_block_47 = CodeBlock { "Zona"; "(ALL)"; }
setParameterByName_6 = Element.SetParameterByName(element=setParameterByName_5, parameterName=code_block_47.out0, value=code_block_47.out1)
scale = Custom[View.Scale](view=list_clean)  # package Clockwork for Dynamo 2.x; Returns the scale of a given view
code_block_48 = CodeBlock(l=scale)
# ---------- code_block_48.designscript (13 lines) ----------
l;

[Imperative]
{
	if (l == [])
		{
		return = [[]];
		}
	else
		{
		return = l[0];
		}
};
# ----------------------------------------
setScale_2 = View.SetScale(view=setParameterByName_6, scale=code_block_48.out1)
code_block_49 = CodeBlock { "Subclasificacion"; }
code_block_50 = CodeBlock(x=list_clean) { DSCore.List.UniqueItems(x.GetParameterValueByName("Subclasificacion")); }
setParameterByName_7 = Element.SetParameterByName(element=setScale_2, parameterName=code_block_49, value=code_block_50, lacing=Longest)
code_block_51 = CodeBlock { null; }
replaceEmptyLists_5 = Custom[List.ReplaceEmptyLists](seq=setParameterByName_7, Replacement=code_block_51)
all_2 = Orchid.RevitProject.Views.ViewTemplate.All()
name_5 = Element.Name(element=all_2)
code_block_52 = CodeBlock { "Structural Foundation Plan"; }
eq_3 = name_5 == code_block_52
filterByBoolMask_3 = List.FilterByBoolMask(list=all_2, mask=eq_3)
code_block_53 = CodeBlock(x=replaceEmptyLists_5, y=filterByBoolMask_3.in)  # same code as code_block_23
code_block_54 = CodeBlock(x=setParameterByName_7)
# ---------- code_block_54.designscript (2 lines) ----------
user = DSCore.List.UniqueItems(x.GetParameterValueByName("Subclasificacion"));
"02_TRABAJO_"+user+"_STRUCTURAL PLAN (PISO)";
# ----------------------------------------
duplicate_2 = Orchid.RevitProject.Views.ViewTemplate.Duplicate(viewTemplate=code_block_53.out2, name=code_block_54.out1)
code_block_55 = CodeBlock()  # same code as code_block_26
code_block_56 = CodeBlock { null; }
replaceEmptyLists_6 = Custom[List.ReplaceEmptyLists](seq=code_block_54.user, Replacement=code_block_56)
code_block_57 = CodeBlock(x=replaceEmptyLists_6)  # same code as code_block_28
code_block_58 = CodeBlock(user=code_block_57.out1) { "02_TRABAJO"; user[0]; }
list_create_4 = List.Create(item0=code_block_58.out0, item1=code_block_58.out1)
setParameterByName_8 = Element.SetParameterByName(element=duplicate_2, parameterName=code_block_55, value=list_create_4, lacing=Longest)
uniqueItems_2 = List.UniqueItems(list=setParameterByName_8)
code_block_59 = CodeBlock(x=setParameterByName_7) { y = DSCore.List.UniqueItems(x.GetParameterValueByName("Subclasificacion")); pf = ParameterFilter.ByName(y); }
code_block_60 = CodeBlock { false; }
addFilter_2 = Orchid.RevitProject.Views.View.AddFilter(view=uniqueItems_2, parameterFilter=code_block_59.pf, visibility=code_block_60)
set_2 = Orchid.RevitProject.Views.ViewTemplate.Set(view=setParameterByName_7, viewTemplate=addFilter_2, lacing=Longest)
code_block_61 = CodeBlock { "View Name"; }
code_block_62 = CodeBlock { "_"; }
identity_2 = Object.Identity(obj=set_2)
code_block_63 = CodeBlock()  # same code as code_block_38
getParameterValueByName_4 = Element.GetParameterValueByName(element=identity_2@L1, parameterName=code_block_63@L2, lacing=Longest)
code_block_64 = CodeBlock { null; }
replaceEmptyLists_7 = Custom[List.ReplaceEmptyLists](seq=getParameterValueByName_4, Replacement=code_block_64)
code_block_65 = CodeBlock(x=replaceEmptyLists_7, y=getParameterValueByName_4)  # same code as code_block_40
code_block_66 = CodeBlock { 1; }
getItemAtIndex_4 = List.GetItemAtIndex(list=code_block_65.out2@L2, index=code_block_66)
code_block_67 = CodeBlock { 0; }
getItemAtIndex_5 = List.GetItemAtIndex(list=code_block_65.out2@L2, index=code_block_67)
nullToEmptyList_5 = WombatDynamo.List.NullToEmptyList(data=getItemAtIndex_5)
name_6 = Element.Name(element=nullToEmptyList_5)
code_block_68 = CodeBlock { 0; 17; }
remove_2 = String.Remove(str=name_6, startIndex=code_block_68.out0, count=code_block_68.out1)
code_block_69 = CodeBlock { ")"; ""; }
replace_2 = String.Replace(str=remove_2, searchFor=code_block_69.out0, replaceWith=code_block_69.out1)
toUpper_2 = String.ToUpper(str=replace_2)
name_7 = Element.Name(element=identity_2)
list_create_5 = List.Create(item0=getItemAtIndex_4, item1=toUpper_2, item2=name_7)
transpose_2 = List.Transpose(lists=list_create_5)
join_2 = String.Join(separator=code_block_62, string0=transpose_2@L2)
setParameterByName_9 = Element.SetParameterByName(element=set_2, parameterName=code_block_61, value=join_2)
element_level_2 = Custom[Element Level](element=setParameterByName_9)
code_block_70 = CodeBlock { 750; -1000; }
set_viewrange_2 = Custom[Set ViewRange](view=setParameterByName_9, TopLevel=element_level_2, Top=code_block_70.out0, CutLevel=element_level_2, CutPlane=code_block_70.out0, BottomLevel=element_level_2, Bottom=code_block_70.out1, DepthLevel=element_level_2, ViewDepth=code_block_70.out1, lacing=Longest)
code_block_71 = CodeBlock(x=set_viewrange_2) { user = DSCore.List.UniqueItems(x.GetParameterValueByName("Subclasificacion")); "02_TRABAJO_"+user+"_BUILDING SECTION"; }
code_block_72 = CodeBlock { null; }
replaceEmptyLists_8 = Custom[List.ReplaceEmptyLists](seq=code_block_71.user, Replacement=code_block_72)
all_3 = Orchid.RevitProject.Views.ViewTemplate.All()
name_8 = Element.Name(element=all_3)
code_block_73 = CodeBlock { "Architectural Section"; }
eq_4 = name_8 == code_block_73
filterByBoolMask_4 = List.FilterByBoolMask(list=all_3, mask=eq_4)
code_block_74 = CodeBlock(x=replaceEmptyLists_8, y=filterByBoolMask_4.in)  # same code as code_block_23
duplicate_3 = Orchid.RevitProject.Views.ViewTemplate.Duplicate(viewTemplate=code_block_74.out2, name=code_block_71.out1)
code_block_75 = CodeBlock(x=replaceEmptyLists_8)
# ---------- code_block_75.designscript (13 lines) ----------
x;

[Imperative]
{
	if (x == null)
		{
		return = [];
		}
	else
		{
		return = x[0];
		}
};
# ----------------------------------------
code_block_76 = CodeBlock(tip=code_block_75.out1)
# ---------- code_block_76.designscript (13 lines) ----------
[
"Clasificacion",
"Subclasificacion",
"Zona",
"Discipline"
];

[
"02_TRABAJO",
tip,
"(ALL)",
2
];
# ----------------------------------------
setParameterByName_10 = Element.SetParameterByName(element=duplicate_3, parameterName=code_block_76.out0, value=code_block_76.out1, lacing=Longest)
code_block_77 = CodeBlock(x=setParameterByName_10) { DSCore.List.UniqueItems(x.GetParameterValueByName("Subclasificacion")); }
uniqueItems_3 = List.UniqueItems(list=setParameterByName_10)
await_ = Orchid.Common.DataStream.Await(pass=code_block_77, waitFor=uniqueItems_3)
code_block_78 = CodeBlock(user=await_) { user; "Building Section ("+user+")"; }
duplicate_4 = archilab.Revit.Elements.ElementTypes.Duplicate(element=byName, name=code_block_78.out1)
code_block_79 = CodeBlock { "View Template applied to new views"; }
byName_6 = Orchid.RevitProject.Filters.ParameterFilter.ByName(name=await_)
code_block_80 = CodeBlock { false; }
addFilter_3 = Orchid.RevitProject.Views.View.AddFilter(view=uniqueItems_3, parameterFilter=byName_6, visibility=code_block_80, lacing=Longest)
end = Revit.Transaction.Transaction.End(input=addFilter_3)
setParameterByName_11 = Element.SetParameterByName(element=duplicate_4, parameterName=code_block_79, value=end)
isEmpty = List.IsEmpty(list=setParameterByName_11)
empty_2 = List.Empty()
code_block_81 = CodeBlock { "Reference Planes"; }
byName_7 = Category.ByName(name=code_block_81)
scopeIf = Custom[ScopeIf+](test=isEmpty, True=empty_2, False=byName_7)  # package Clockwork for Dynamo 2.x; A (hopefully) more robust implementation of ScopeIf. Tests a single boolean and returns a value accordingly.
create_2 = Orchid.RevitProject.Elements.SubCategory.Create(category=scopeIf, name=code_block_78.user)
linepatterns = Custom[© LinePatterns]()  # package Crumple; Returns all line patterns in a document.
code_block_82 = CodeBlock { "Hidden"; }
eq_5 = linepatterns.names == code_block_82
filterByBoolMask_5 = List.FilterByBoolMask(list=linepatterns.elements, mask=eq_5)
code_block_83 = CodeBlock { 1; }
color_palette = ColorPalette({R: 255, G: 0, B: 255, A: 255})
set_subcategory_properties = Custom[Set SubCategory Properties](subCategory=create_2, LinePattern=filterByBoolMask_5.in, ProjectionLineWeight=code_block_83, color=color_palette)  # package Genius Loci; Assigns Line Weight, Line Pattern and Line Color to the given subcategory.
await_2 = Orchid.Common.DataStream.Await(waitFor=set_subcategory_properties)  # unwired: pass
all_4 = Orchid.RevitProject.Views.ViewTemplate.All(condense=await_2)
string_from_object = FromObject(obj=create_2)
code_block_84 = CodeBlock { " - "; }
split_2 = String.Split(str=string_from_object, separator0=code_block_84)
code_block_85 = CodeBlock { null; }
replaceEmptyLists_9 = Custom[List.ReplaceEmptyLists](seq=split_2, Replacement=code_block_85)
code_block_86 = CodeBlock(x=replaceEmptyLists_9)
# ---------- code_block_86.designscript (13 lines) ----------
x;

[Imperative]
{
	if (x == null)
		{
		return = [null,null];
		}
	else
		{
		return = x;
		}
};
# ----------------------------------------
code_block_87 = CodeBlock { 1; }
getItemAtIndex_6 = List.GetItemAtIndex(list=code_block_86.out1@L2, index=code_block_87)
code_block_88 = CodeBlock(l=getItemAtIndex_6) { l[0]; }
code_block_89 = CodeBlock(x=code_block_88)  # same code as code_block_28
code_block_90 = CodeBlock(vt=all_4, user=code_block_89.out1)
# ---------- code_block_90.designscript (3 lines) ----------
vt;
mask = DSCore.String.Contains(vt.GetParameterValueByName("Subclasificacion"),user[0],false);
DSCore.List.FilterByBoolMask(vt,mask)["in"];
# ----------------------------------------
code_block_91 = CodeBlock { "Reference Planes"; }
byName_8 = Category.ByName(name=code_block_91)
byProperties = Revit.Filter.OverrideGraphicSettings.ByProperties()
setCategoryOverrides = View.SetCategoryOverrides(view=code_block_90.out2, category=byName_8, overrides=byProperties, lacing=Longest)
code_block_92 = CodeBlock { "Reference Planes"; }
code_block_93 = CodeBlock { null; }
replaceEmptyLists_10 = Custom[List.ReplaceEmptyLists](seq=setCategoryOverrides, Replacement=code_block_93)
code_block_94 = CodeBlock(x=replaceEmptyLists_10)  # same code as code_block_28
code_block_95 = CodeBlock(l=code_block_94.out1) { x = l[0]; x.GetParameterValueByName("Subclasificacion"); }
await_3 = Orchid.Common.DataStream.Await(pass=code_block_92, waitFor=code_block_95.x)
byName_9 = Category.ByName(name=await_3)
byCategory = Orchid.RevitProject.Elements.SubCategory.ByCategory(category=byName_9)
string_from_object_2 = FromObject(obj=byCategory)
code_block_96 = CodeBlock(x=string_from_object_2, cat=code_block_95.out1) { subC = x; mask = DSCore.String.Contains(subC,cat,false); DSCore.List.FilterByBoolMask(x,mask)["out"]; }
await_4 = Orchid.Common.DataStream.Await(pass=setCategoryOverrides, waitFor=code_block_96.out2)
byProperties_2 = Revit.Filter.OverrideGraphicSettings.ByProperties()
code_block_97 = CodeBlock { true; }
setCategoryOverrides_2 = View.SetCategoryOverrides(view=await_4, category=code_block_96.out2, overrides=byProperties_2, hide=code_block_97, lacing=Longest)
