# Dynamo graph acotadoEspesorMuro_script.dyn (Dynamo 2.12.1.8246)
# packages: Orchid 200.4.0.7938, Clockwork for Dynamo 2.x 2.4.0, Genius Loci 2021.11.10

activeView = Orchid.RevitProject.Common.Document.ActiveView()
code_block = CodeBlock(x=activeView) { x; }
byBestFitThroughPoints = Line.ByBestFitThroughPoints()  # unwired: bestFitPoints
code_block_2 = CodeBlock { "Walls"; }
byName = Category.ByName(name=code_block_2)
code_block_3 = CodeBlock(x=activeView) { x; }
all_elements_of_category_in_view = ElementsOfCategoryInView(Category=byName, View=code_block_3)
name = Element.Name(element=all_elements_of_category_in_view)
code_block_4 = CodeBlock { "M.H.A."; }
contains = String.Contains(string=name, searchFor=code_block_4)
filterByBoolMask = List.FilterByBoolMask(list=all_elements_of_category_in_view, mask=contains)
name_2 = Level.Name()  # unwired: level
level = Custom[Element.Level](element=filterByBoolMask.in)  # package Clockwork for Dynamo 2.x; Gets an element's level
function_apply = ApplyFunction(func=name_2, arg1=level)
name_3 = Level.Name()  # unwired: level
code_block_5 = CodeBlock(x=activeView) { x; }
level_2 = Custom[Element.Level](element=code_block_5)
function_apply_2 = ApplyFunction(func=name_3, arg1=level_2)
eq = function_apply == function_apply_2
filterByBoolMask_2 = List.FilterByBoolMask(list=filterByBoolMask.in, mask=eq)
element_surfaces_references = Custom[Element Surfaces References](element=filterByBoolMask_2.in)  # package Genius Loci; Retrieve the top, bottom, side surfaces and their associated references of the system family. This doesn't work with cylindrical system families (pipe...)
code_block_6 = CodeBlock { null; }
replaceEmptyLists = Custom[List.ReplaceEmptyLists](seq=element_surfaces_references.Vertical_Surface, Replacement=code_block_6)  # package Clockwork for Dynamo 2.x; Replaces all empty lists within a given list with a substitute
code_block_7 = CodeBlock(x=replaceEmptyLists)
# ---------- code_block_7.designscript (12 lines) ----------
x;
[Imperative]
{
	if(x == null)
	{
		return = [null,null];
	}
	else
	{
		return = x;
	}
};
# ----------------------------------------
code_block_8 = CodeBlock { [0,1]; }
getItemAtIndex = List.GetItemAtIndex(list=code_block_7.out1@L2, index=code_block_8)
list_clean = Custom[List Clean](list=getItemAtIndex)  # package Genius Loci; Removes all Null, Empty and Blank from a list or nested list of lists.
code_block_9 = CodeBlock { 0.5; }
pointAtParameter = Surface.PointAtParameter(surface=list_clean, u=code_block_9, v=code_block_9)
function_apply_3 = ApplyFunction(func=byBestFitThroughPoints, arg1=pointAtParameter)
code_block_10 = CodeBlock { null; }
replaceEmptyLists_2 = Custom[List.ReplaceEmptyLists](seq=element_surfaces_references.Vertical_Reference, Replacement=code_block_10)
code_block_11 = CodeBlock(x=replaceEmptyLists_2)  # same code as code_block_7
code_block_12 = CodeBlock { [0,1]; }
getItemAtIndex_2 = List.GetItemAtIndex(list=code_block_11.out1@L2, index=code_block_12)
list_clean_2 = Custom[List Clean](list=getItemAtIndex_2)
dimension_byreferences = Custom[Dimension ByReferences](view=code_block@L1, line=function_apply_3@L1, references=list_clean_2@L2, lacing=Longest)  # package Genius Loci; Creates a new linear dimension from at least two geometric references of an object.
