# Dynamo graph plantaEstructuraMetalica_script.dyn (Dynamo 2.3.1.11775)
# packages: Orchid 200.4.0.7938, Crumple 2022.2.13, Genius Loci 2020.8.3, Clockwork for Dynamo 2.x 2.4.0, Data-Shapes 2021.2.94

activeView = Orchid.RevitProject.Common.Document.ActiveView()
code_block = CodeBlock(x=activeView) { x; }

# group: Etiqueta Viga IN
activeView_2 = Orchid.RevitProject.Common.Document.ActiveView()
code_block_2 = CodeBlock { "Structural Framing"; }
byName = Category.ByName(name=code_block_2)
code_block_3 = CodeBlock(x=code_block) { x; }
all_elements_of_category_in_view = ElementsOfCategoryInView(Category=byName, View=code_block_3)
familyName = Orchid.RevitProject.Elements.Element.FamilyName(element=all_elements_of_category_in_view)
code_block_4 = CodeBlock { "EST_M_STRUCTURAL FRAMING_VIGA SOLDADA_IE"; }
code_block_5 = CodeBlock { null; }
code_block_6 = CodeBlock { 0; }
code_block_7 = CodeBlock { "Concrete, Cast-in-Place gray"; }
byName_2 = Material.ByName(name=code_block_7)
code_block_8 = CodeBlock { "Steel"; }
code_block_9 = CodeBlock { "EST_A_STRUCTURAL FRAMING TAG_PLANTA"; }
byName_3 = Orchid.RevitProject.Elements.Family.ByName(name=code_block_9)
code_block_10 = CodeBlock { "Tag Viga"; }
byFamilyAndName = FamilyType.ByFamilyAndName(family=byName_3, name=code_block_10)
activeView_3 = Orchid.RevitProject.Common.Document.ActiveView()
plane = Custom[View.Plane](view=activeView_3)  # package Clockwork for Dynamo 2.x; Retrieves the plane of a given view
normal = Plane.Normal(plane=plane)
code_block_11 = CodeBlock { 2; }
code_block_12 = CodeBlock { 0; }
code_block_13 = CodeBlock { 2; }
code_block_14 = CodeBlock { 0; }
code_block_15 = CodeBlock { 2; }
code_block_16 = CodeBlock { -1; }
code_block_17 = CodeBlock { null; }
ZAxis = Vector.ZAxis()
code_block_18 = CodeBlock { 90; }

ne = familyName != code_block_4

# group (continued): Etiqueta Viga IN
filterByBoolMask = List.FilterByBoolMask(list=all_elements_of_category_in_view, mask=ne)
getMaterials = Element.GetMaterials(element=filterByBoolMask.in)
replaceEmptyLists = Custom[List.ReplaceEmptyLists](seq=getMaterials, Replacement=code_block_5)  # package Clockwork for Dynamo 2.x; Replaces all empty lists within a given list with a substitute
getItemAtIndex = List.GetItemAtIndex(list=replaceEmptyLists@L2, index=code_block_6)
code_block_19 = CodeBlock(x=getItemAtIndex, y=byName_2)
# ---------- code_block_19.designscript (14 lines) ----------
x;
y;

[Imperative]
{
	if(x[0] == null)
	{
		return = y;
	}
	else
	{
		return = x;
	}
};
# ----------------------------------------
name = Material.Name(material=code_block_19.out2)
eq = name == code_block_8
filterByBoolMask_2 = List.FilterByBoolMask(list=filterByBoolMask.in, mask=eq)
element_taggedstatus = Custom[Element TaggedStatus](element=filterByBoolMask_2.in)  # package Genius Loci; Identify the tagged and untagged elements. Please note : This doesn't work with areas and spaces.
elementcentroid = Custom[© ElementCentroid](element=element_taggedstatus.NotTagged)  # package Crumple; Returns the centroid of the element's axis-aligned bounding box.
byOriginNormal = Plane.ByOriginNormal(origin=elementcentroid, normal=normal)
normal_2 = Plane.Normal(plane=byOriginNormal)
location = Custom[Element.Location+](element=element_taggedstatus.NotTagged)  # package Clockwork for Dynamo 2.x; Returns the location of an element as point, curve or curve loop, along with some booleans to help filtering the results. Unlike the OOTB Element.GetLocation node, it also retunrs sketch lines of sketch-based elements like floor slabs as well as the element's rotation property.
code_block_20 = CodeBlock(x=location.curves)
# ---------- code_block_20.designscript (13 lines) ----------
x;

[Imperative]
{
	if(x == null)
	{
		return = [];
	}
	else
	{
		return = x;
	}
};
# ----------------------------------------
direction = Line.Direction(line=code_block_20.out1)
normalized = Vector.Normalized(vector=direction)
code_block_21 = CodeBlock(p=normalized) { p.X; }
round = Math.Round(number=code_block_21, digits=code_block_11)
le = round <= code_block_12
reverse = Vector.Reverse(vector=normalized)
scopeIf = Custom[ScopeIf+](test=le, True=reverse, False=normalized, lacing=Shortest)  # package Clockwork for Dynamo 2.x; A (hopefully) more robust implementation of ScopeIf. Tests a single boolean and returns a value accordingly.
code_block_22 = CodeBlock(p=scopeIf) { p.X; }
round_2 = Math.Round(number=code_block_22, digits=code_block_13)
eq_2 = round_2 == code_block_14
code_block_23 = CodeBlock(p=scopeIf) { p.Y; }
round_3 = Math.Round(number=code_block_23, digits=code_block_15)
eq_3 = round_3 == code_block_16
and_ = eq_2 && eq_3
reverse_2 = Vector.Reverse(vector=scopeIf)
scopeIf_2 = Custom[ScopeIf+](test=and_, True=scopeIf, False=reverse_2, lacing=Shortest)
replaceEmptyLists_2 = Custom[List.ReplaceEmptyLists](seq=scopeIf_2, Replacement=code_block_17)
code_block_24 = CodeBlock(x=replaceEmptyLists_2, y=ZAxis)
# ---------- code_block_24.designscript (14 lines) ----------
x;
y;

[Imperative]
{
	if(x == null)
	{
		return = y;
	}
	else
	{
		return = x;
	}
};
# ----------------------------------------
rotate = Vector.Rotate(vector=normal_2, axis=code_block_24.out2, degrees=code_block_18)
code_block_25 = CodeBlock(x=element_taggedstatus.NotTagged) { Revit.Elements.Element.GetParameterValueByName(Revit.Elements.Element.GetParameterValueByName(x,"Type"),"Width")/2; }
translate = Geometry.Translate(geometry=elementcentroid, direction=rotate, distance=code_block_25)
byElementAndLocation = Orchid.RevitProject.Annotations.Tag.ByElementAndLocation(view=activeView_2, element=element_taggedstatus.NotTagged, tagType=byFamilyAndName, location=translate)

# group: Etiqueta Viga IE
activeView_4 = Orchid.RevitProject.Common.Document.ActiveView()
code_block_26 = CodeBlock { "Structural Framing"; }
byName_4 = Category.ByName(name=code_block_26)
code_block_27 = CodeBlock(x=code_block) { x; }
all_elements_of_category_in_view_2 = ElementsOfCategoryInView(Category=byName_4, View=code_block_27)
familyName_2 = Orchid.RevitProject.Elements.Element.FamilyName(element=all_elements_of_category_in_view_2)
code_block_28 = CodeBlock { "EST_M_STRUCTURAL FRAMING_VIGA SOLDADA_IE"; }
eq_4 = familyName_2 == code_block_28
filterByBoolMask_3 = List.FilterByBoolMask(list=all_elements_of_category_in_view_2, mask=eq_4)
getMaterials_2 = Element.GetMaterials(element=filterByBoolMask_3.in)
code_block_29 = CodeBlock { null; }
replaceEmptyLists_3 = Custom[List.ReplaceEmptyLists](seq=getMaterials_2, Replacement=code_block_29)
code_block_30 = CodeBlock { 0; }
getItemAtIndex_2 = List.GetItemAtIndex(list=replaceEmptyLists_3@L2, index=code_block_30)
code_block_31 = CodeBlock { "Concrete, Cast-in-Place gray"; }
byName_5 = Material.ByName(name=code_block_31)
code_block_32 = CodeBlock(x=getItemAtIndex_2, y=byName_5)  # same code as code_block_19
name_2 = Material.Name(material=code_block_32.out2)
code_block_33 = CodeBlock { "Steel"; }
eq_5 = name_2 == code_block_33
filterByBoolMask_4 = List.FilterByBoolMask(list=filterByBoolMask_3.in, mask=eq_5)
element_taggedstatus_2 = Custom[Element TaggedStatus](element=filterByBoolMask_4.in)
code_block_34 = CodeBlock { "EST_A_STRUCTURAL FRAMING TAG_PLANTA"; }
byName_6 = Orchid.RevitProject.Elements.Family.ByName(name=code_block_34)
code_block_35 = CodeBlock { "Tag Viga"; }
byFamilyAndName_2 = FamilyType.ByFamilyAndName(family=byName_6, name=code_block_35)
elementcentroid_2 = Custom[© ElementCentroid](element=element_taggedstatus_2.NotTagged)
activeView_5 = Orchid.RevitProject.Common.Document.ActiveView()
plane_2 = Custom[View.Plane](view=activeView_5)
normal_3 = Plane.Normal(plane=plane_2)
byOriginNormal_2 = Plane.ByOriginNormal(origin=elementcentroid_2, normal=normal_3)
normal_4 = Plane.Normal(plane=byOriginNormal_2)
location_2 = Custom[Element.Location+](element=element_taggedstatus_2.NotTagged)
code_block_36 = CodeBlock(x=location_2.curves)  # same code as code_block_20
direction_2 = Line.Direction(line=code_block_36.out1)
normalized_2 = Vector.Normalized(vector=direction_2)
code_block_37 = CodeBlock(p=normalized_2) { p.X; }
code_block_38 = CodeBlock { 2; }
round_4 = Math.Round(number=code_block_37, digits=code_block_38)
code_block_39 = CodeBlock { 0; }
le_2 = round_4 <= code_block_39
reverse_3 = Vector.Reverse(vector=normalized_2)
scopeIf_3 = Custom[ScopeIf+](test=le_2, True=reverse_3, False=normalized_2, lacing=Shortest)
code_block_40 = CodeBlock(p=scopeIf_3) { p.X; }
code_block_41 = CodeBlock { 2; }
round_5 = Math.Round(number=code_block_40, digits=code_block_41)
code_block_42 = CodeBlock { 0; }
eq_6 = round_5 == code_block_42
code_block_43 = CodeBlock(p=scopeIf_3) { p.Y; }
code_block_44 = CodeBlock { 2; }
round_6 = Math.Round(number=code_block_43, digits=code_block_44)
code_block_45 = CodeBlock { -1; }
eq_7 = round_6 == code_block_45
and_2 = eq_6 && eq_7
reverse_4 = Vector.Reverse(vector=scopeIf_3)
scopeIf_4 = Custom[ScopeIf+](test=and_2, True=scopeIf_3, False=reverse_4, lacing=Shortest)
code_block_46 = CodeBlock { null; }
replaceEmptyLists_4 = Custom[List.ReplaceEmptyLists](seq=scopeIf_4, Replacement=code_block_46)
ZAxis_2 = Vector.ZAxis()
code_block_47 = CodeBlock(x=replaceEmptyLists_4, y=ZAxis_2)  # same code as code_block_24
code_block_48 = CodeBlock { 90; }
rotate_2 = Vector.Rotate(vector=normal_4, axis=code_block_47.out2, degrees=code_block_48)
code_block_49 = CodeBlock(x=element_taggedstatus_2.NotTagged) { Revit.Elements.Element.GetParameterValueByName(Revit.Elements.Element.GetParameterValueByName(x,"Type"),"Bottom Flange Width")/2; }
translate_2 = Geometry.Translate(geometry=elementcentroid_2, direction=rotate_2, distance=code_block_49)
byElementAndLocation_2 = Orchid.RevitProject.Annotations.Tag.ByElementAndLocation(view=activeView_4, element=element_taggedstatus_2.NotTagged, tagType=byFamilyAndName_2, location=translate_2)

# group: Etiqueta Columna Metalica
activeView_6 = Orchid.RevitProject.Common.Document.ActiveView()
code_block_50 = CodeBlock { "Structural Columns"; }
byName_7 = Category.ByName(name=code_block_50)
code_block_51 = CodeBlock(x=code_block) { x; }
all_elements_of_category_in_view_3 = ElementsOfCategoryInView(Category=byName_7, View=code_block_51)
viewLevel = Custom[ViewLevel](View=code_block_51)  # package Data-Shapes; gets the level that a view is associated to
id = Element.Id(element=viewLevel)
level = Custom[Element.Level](element=all_elements_of_category_in_view_3)  # package Clockwork for Dynamo 2.x; Gets an element's level
id_2 = Element.Id(element=level)
eq_8 = id == id_2  # lacing=Longest
filterByBoolMask_5 = List.FilterByBoolMask(list=all_elements_of_category_in_view_3, mask=eq_8)
getMaterials_3 = Element.GetMaterials(element=filterByBoolMask_5.in)
code_block_52 = CodeBlock { null; }
replaceEmptyLists_5 = Custom[List.ReplaceEmptyLists](seq=getMaterials_3, Replacement=code_block_52)
code_block_53 = CodeBlock { 0; }
getItemAtIndex_3 = List.GetItemAtIndex(list=replaceEmptyLists_5@L2, index=code_block_53)
code_block_54 = CodeBlock { "Concrete, Cast-in-Place gray"; }
byName_8 = Material.ByName(name=code_block_54)
code_block_55 = CodeBlock(x=getItemAtIndex_3, y=byName_8)  # same code as code_block_19
name_3 = Material.Name(material=code_block_55.out2)
code_block_56 = CodeBlock { "Steel"; }
eq_9 = name_3 == code_block_56
filterByBoolMask_6 = List.FilterByBoolMask(list=filterByBoolMask_5.in, mask=eq_9)
element_taggedstatus_3 = Custom[Element TaggedStatus](element=filterByBoolMask_6.in)
code_block_57 = CodeBlock { "EST_A_STRUCTURAL COLUMN TAG_PLANTA"; }
byName_9 = Orchid.RevitProject.Elements.Family.ByName(name=code_block_57)
code_block_58 = CodeBlock { "Pilar Metalico Numerado"; }
byFamilyAndName_3 = FamilyType.ByFamilyAndName(family=byName_9, name=code_block_58)
geometry = Element.Geometry(element=element_taggedstatus_3.NotTagged)
flatten = List.Flatten(list=geometry)
elementcentroid_3 = Custom[© ElementCentroid](element=element_taggedstatus_3.NotTagged)
activeView_7 = Orchid.RevitProject.Common.Document.ActiveView()
plane_3 = Custom[View.Plane](view=activeView_7)
normal_5 = Plane.Normal(plane=plane_3)
byOriginNormal_3 = Plane.ByOriginNormal(origin=elementcentroid_3, normal=normal_5)
intersect = Geometry.Intersect(geometry=flatten, other=byOriginNormal_3)
flatten_2 = List.Flatten(list=intersect)
code_block_59 = CodeBlock { 1; }
pointAtParameter = Surface.PointAtParameter(surface=flatten_2, u=code_block_59)
byElementAndLocation_3 = Orchid.RevitProject.Annotations.Tag.ByElementAndLocation(view=activeView_6, element=element_taggedstatus_3.NotTagged, tagType=byFamilyAndName_3, location=pointAtParameter)
