# Dynamo graph plantaFundacion_script.dyn (Dynamo 2.12.1.8246)
# packages: Crumple 2022.2.13, Orchid 200.4.0.7938, Genius Loci 2020.8.3, Clockwork for Dynamo 2.x 2.4.0, WombatDynamo 2.3.4

activeView = Orchid.RevitProject.Common.Document.ActiveView()
code_block = CodeBlock(activeView=activeView)
# ---------- code_block.designscript (28 lines) ----------
activeView;
v = Revit.Elements.Element.GetParameterValueByName(Revit.Elements.Element.GetParameterValueByName(activeView,"Type"),"View Direction");

r = [Imperative]
{
	if (v != 0)
	{
		return = null;
	}
	else
	{
		return = activeView;
	}
};

r;

[Imperative]
{
	if (r == null)
	{
		return = "La vista proporcionada no es del tipo adecuado.";
	}
	else
	{
		return = [];
	}
};
# ----------------------------------------
code_block_2 = CodeBlock(x=code_block.out2)
# ---------- code_block_2.designscript (13 lines) ----------
x;

[Imperative]
{
	if (x == null)
	{
		return = [];
	}
	else
	{
		return = x;
	}
};
# ----------------------------------------
code_block_3 = CodeBlock(x=code_block_2.out1) { x; }

# group: Etiqueta Viga de Fundación
activeView_2 = Orchid.RevitProject.Common.Document.ActiveView()
code_block_4 = CodeBlock { "Structural Framing"; }
byName = Category.ByName(name=code_block_4)
code_block_5 = CodeBlock(x=code_block_3) { x; }
all_elements_of_category_in_view = ElementsOfCategoryInView(Category=byName, View=code_block_5)
familyName = Orchid.RevitProject.Elements.Element.FamilyName(element=all_elements_of_category_in_view)
code_block_6 = CodeBlock { "EST_M_STRUCTURAL FRAMING_VIGA FUNDACION"; }
eq = familyName == code_block_6
filterByBoolMask = List.FilterByBoolMask(list=all_elements_of_category_in_view, mask=eq)
getMaterials = Element.GetMaterials(element=filterByBoolMask.in)
code_block_7 = CodeBlock { null; }
replaceEmptyLists = Custom[List.ReplaceEmptyLists](seq=getMaterials, Replacement=code_block_7)  # package Clockwork for Dynamo 2.x; Replaces all empty lists within a given list with a substitute
code_block_8 = CodeBlock { 0; }
getItemAtIndex = List.GetItemAtIndex(list=replaceEmptyLists@L2, index=code_block_8)
code_block_9 = CodeBlock { "Steel"; }
byName_2 = Material.ByName(name=code_block_9)
code_block_10 = CodeBlock(x=getItemAtIndex, y=byName_2)
# ---------- code_block_10.designscript (14 lines) ----------
x;
y;

[Imperative]
{
	if(x[0] == null)
	{
		return = y;
	}
	else
	{
		return = x;
	}
};
# ----------------------------------------
name = Material.Name(material=code_block_10.out2)
code_block_11 = CodeBlock { "Concrete, Cast-in-Place gray"; }
eq_2 = name == code_block_11
filterByBoolMask_2 = List.FilterByBoolMask(list=filterByBoolMask.in, mask=eq_2)
element_taggedstatus = Custom[Element TaggedStatus](element=filterByBoolMask_2.in)  # package Genius Loci; Identify the tagged and untagged elements. Please note : This doesn't work with areas and spaces.
code_block_12 = CodeBlock { "EST_A_STRUCTURAL FRAMING TAG_PLANTA"; }
byName_3 = Orchid.RevitProject.Elements.Family.ByName(name=code_block_12)
code_block_13 = CodeBlock { "Tag Viga"; }
byFamilyAndName = FamilyType.ByFamilyAndName(family=byName_3, name=code_block_13)
elementcentroid = Custom[© ElementCentroid](element=element_taggedstatus.NotTagged)  # package Crumple; Returns the centroid of the element's axis-aligned bounding box.
activeView_3 = Orchid.RevitProject.Common.Document.ActiveView()
plane = Custom[View.Plane](view=activeView_3)  # package Clockwork for Dynamo 2.x; Retrieves the plane of a given view
normal = Plane.Normal(plane=plane)
byOriginNormal = Plane.ByOriginNormal(origin=elementcentroid, normal=normal)
normal_2 = Plane.Normal(plane=byOriginNormal)
location = Custom[Element.Location+](element=element_taggedstatus.NotTagged)  # package Clockwork for Dynamo 2.x; Returns the location of an element as point, curve or curve loop, along with some booleans to help filtering the results. Unlike the OOTB Element.GetLocation node, it also retunrs sketch lines of sketch-based elements like floor slabs as well as the element's rotation property.
code_block_14 = CodeBlock(x=location.curves)
# ---------- code_block_14.designscript (13 lines) ----------
x;

[Imperative]
{
	if(x == null)
	{
		return = [];
	}
	else
	{
		return = x;
	}
};
# ----------------------------------------
direction = Line.Direction(line=code_block_14.out1)
normalized = Vector.Normalized(vector=direction)
code_block_15 = CodeBlock(p=normalized) { p.X; }
code_block_16 = CodeBlock { 2; }
round = Math.Round(number=code_block_15, digits=code_block_16)
code_block_17 = CodeBlock { 0; }
le = round <= code_block_17
reverse = Vector.Reverse(vector=normalized)
scopeIf = Custom[ScopeIf+](test=le, True=reverse, False=normalized, lacing=Shortest)  # package Clockwork for Dynamo 2.x; A (hopefully) more robust implementation of ScopeIf. Tests a single boolean and returns a value accordingly.
code_block_18 = CodeBlock(p=scopeIf) { p.X; }
code_block_19 = CodeBlock { 2; }
round_2 = Math.Round(number=code_block_18, digits=code_block_19)
code_block_20 = CodeBlock { 0; }
eq_3 = round_2 == code_block_20
code_block_21 = CodeBlock(p=scopeIf) { p.Y; }
code_block_22 = CodeBlock { 2; }
round_3 = Math.Round(number=code_block_21, digits=code_block_22)
code_block_23 = CodeBlock { -1; }
eq_4 = round_3 == code_block_23
and_ = eq_3 && eq_4
reverse_2 = Vector.Reverse(vector=scopeIf)
scopeIf_2 = Custom[ScopeIf+](test=and_, True=scopeIf, False=reverse_2, lacing=Shortest)
code_block_24 = CodeBlock { null; }
replaceEmptyLists_2 = Custom[List.ReplaceEmptyLists](seq=scopeIf_2, Replacement=code_block_24)
ZAxis = Vector.ZAxis()
code_block_25 = CodeBlock(x=replaceEmptyLists_2, y=ZAxis)
# ---------- code_block_25.designscript (14 lines) ----------
x;
y;

[Imperative]
{
	if(x == null)
	{
		return = y;
	}
	else
	{
		return = x;
	}
};
# ----------------------------------------
code_block_26 = CodeBlock { 90; }
rotate = Vector.Rotate(vector=normal_2, axis=code_block_25.out2, degrees=code_block_26)
code_block_27 = CodeBlock(x=element_taggedstatus.NotTagged) { Revit.Elements.Element.GetParameterValueByName(Revit.Elements.Element.GetParameterValueByName(x,"Type"),"Width")/2; }
translate = Geometry.Translate(geometry=elementcentroid, direction=rotate, distance=code_block_27)
byElementAndLocation = Orchid.RevitProject.Annotations.Tag.ByElementAndLocation(view=activeView_2, element=element_taggedstatus.NotTagged, tagType=byFamilyAndName, location=translate)

# group: Etiqueta Radier
activeView_4 = Orchid.RevitProject.Common.Document.ActiveView()
code_block_28 = CodeBlock { "Floors"; }
byName_4 = Category.ByName(name=code_block_28)
code_block_29 = CodeBlock(x=code_block_3) { x; }
all_elements_of_category_in_view_2 = ElementsOfCategoryInView(Category=byName_4, View=code_block_29)
familyName_2 = Orchid.RevitProject.Elements.Element.FamilyName(element=all_elements_of_category_in_view_2)
code_block_30 = CodeBlock { "Floor"; }
eq_5 = familyName_2 == code_block_30
filterByBoolMask_3 = List.FilterByBoolMask(list=all_elements_of_category_in_view_2, mask=eq_5)
name_2 = Element.Name(element=filterByBoolMask_3.in)
code_block_31 = CodeBlock { "RADIER"; }
contains = String.Contains(string=name_2, searchFor=code_block_31)
filterByBoolMask_4 = List.FilterByBoolMask(list=filterByBoolMask_3.in, mask=contains)
getMaterials_2 = Element.GetMaterials(element=filterByBoolMask_4.in)
code_block_32 = CodeBlock { null; }
replaceEmptyLists_3 = Custom[List.ReplaceEmptyLists](seq=getMaterials_2, Replacement=code_block_32)
code_block_33 = CodeBlock { 0; }
getItemAtIndex_2 = List.GetItemAtIndex(list=replaceEmptyLists_3@L2, index=code_block_33)
code_block_34 = CodeBlock { "Steel"; }
byName_5 = Material.ByName(name=code_block_34)
code_block_35 = CodeBlock(x=getItemAtIndex_2, y=byName_5)  # same code as code_block_10
name_3 = Material.Name(material=code_block_35.out2)
code_block_36 = CodeBlock { "Concrete, Cast-in-Place gray"; }
eq_6 = name_3 == code_block_36
filterByBoolMask_5 = List.FilterByBoolMask(list=filterByBoolMask_4.in, mask=eq_6)
element_taggedstatus_2 = Custom[Element TaggedStatus](element=filterByBoolMask_5.in)
code_block_37 = CodeBlock { "EST_A_FLOOR TAG_PLANTA_RADIER"; }
byName_6 = Orchid.RevitProject.Elements.Family.ByName(name=code_block_37)
code_block_38 = CodeBlock { "Tope Radier y Nivel"; }
byFamilyAndName_2 = FamilyType.ByFamilyAndName(family=byName_6, name=code_block_38)
elementcentroid_2 = Custom[© ElementCentroid](element=element_taggedstatus_2.NotTagged)
byElementAndLocation_2 = Orchid.RevitProject.Annotations.Tag.ByElementAndLocation(view=activeView_4, element=element_taggedstatus_2.NotTagged, tagType=byFamilyAndName_2, location=elementcentroid_2)

# group: Etiqueta Sello y Numeracion Fundacion
activeView_5 = Orchid.RevitProject.Common.Document.ActiveView()
code_block_39 = CodeBlock { "Structural Foundations"; }
byName_7 = Category.ByName(name=code_block_39)
code_block_40 = CodeBlock(x=code_block_3) { x; }
all_elements_of_category_in_view_3 = ElementsOfCategoryInView(Category=byName_7, View=code_block_40)
familyName_3 = Orchid.RevitProject.Elements.Element.FamilyName(element=all_elements_of_category_in_view_3)
code_block_41 = CodeBlock { "EST_M_STRUCTURAL FOUNDATION_FUNDACION AISLADA"; }
eq_7 = familyName_3 == code_block_41
filterByBoolMask_6 = List.FilterByBoolMask(list=all_elements_of_category_in_view_3, mask=eq_7)
element_taggedstatus_3 = Custom[Element TaggedStatus](element=filterByBoolMask_6.in)
code_block_42 = CodeBlock(x=element_taggedstatus_3.NotTagged) { x; }
geometry = Element.Geometry(element=code_block_42)
flatten = List.Flatten(list=geometry)
explode = Geometry.Explode(geometry=flatten)
code_block_43 = CodeBlock { null; }
replaceEmptyLists_4 = Custom[List.ReplaceEmptyLists](seq=explode, Replacement=code_block_43)
code_block_44 = CodeBlock(x=replaceEmptyLists_4)
# ---------- code_block_44.designscript (13 lines) ----------
x;

[Imperative]
{
	if(x == null)
	{
		return = [null,null];
	}
	else
	{
		return = x;
	}
};
# ----------------------------------------
code_block_45 = CodeBlock { 1; }
getItemAtIndex_3 = List.GetItemAtIndex(list=code_block_44.out1@L2, index=code_block_45)
nullToEmptyList = WombatDynamo.List.NullToEmptyList(data=getItemAtIndex_3)
code_block_46 = CodeBlock { [0,1]; [0,0]; }
pointAtParameter = Surface.PointAtParameter(surface=nullToEmptyList@L1, u=code_block_46.out1@L2, v=code_block_46.out0@L2, lacing=Longest)
byElementAndLocation_3 = Tag.ByElementAndLocation(view=activeView_5, element=code_block_42, location=pointAtParameter, lacing=Longest)
transpose = List.Transpose(lists=byElementAndLocation_3)
code_block_47 = CodeBlock { null; }
replaceEmptyLists_5 = Custom[List.ReplaceEmptyLists](seq=transpose, Replacement=code_block_47)
code_block_48 = CodeBlock(x=replaceEmptyLists_5)
# ---------- code_block_48.designscript (13 lines) ----------
x;

[Imperative]
{
	if(x == null)
	{
		return = [];
	}
	else
	{
		return = x[0];
	}
};
# ----------------------------------------
code_block_49 = CodeBlock { "Type"; }
code_block_50 = CodeBlock { "EST_A_STRUCTURAL FOUNDATION TAG_PLANTA_SELLO FUNDACION"; }
byName_8 = Orchid.RevitProject.Elements.Family.ByName(name=code_block_50)
code_block_51 = CodeBlock { "Sello Fundacion"; }
byFamilyAndName_3 = FamilyType.ByFamilyAndName(family=byName_8, name=code_block_51)
setParameterByName = Element.SetParameterByName(element=code_block_48.out1, parameterName=code_block_49, value=byFamilyAndName_3)
code_block_52 = CodeBlock { null; }
replaceEmptyLists_6 = Custom[List.ReplaceEmptyLists](seq=transpose, Replacement=code_block_52)
code_block_53 = CodeBlock(x=replaceEmptyLists_6)
# ---------- code_block_53.designscript (13 lines) ----------
x;

[Imperative]
{
	if(x == null)
	{
		return = [];
	}
	else
	{
		return = x[1];
	}
};
# ----------------------------------------
code_block_54 = CodeBlock { "Type"; }
code_block_55 = CodeBlock { "EST_A_STRUCTURAL FOUNDATION TAG_PLANTA_TIPO FUNDACION"; }
byName_9 = Orchid.RevitProject.Elements.Family.ByName(name=code_block_55)
code_block_56 = CodeBlock { "Tipo Fundacion"; }
byFamilyAndName_4 = FamilyType.ByFamilyAndName(family=byName_9, name=code_block_56)
setParameterByName_2 = Element.SetParameterByName(element=code_block_53.out1, parameterName=code_block_54, value=byFamilyAndName_4)

# group: Etiqueta Sello Fundacion Corrida
activeView_6 = Orchid.RevitProject.Common.Document.ActiveView()
code_block_57 = CodeBlock { "Structural Foundations"; }
byName_10 = Category.ByName(name=code_block_57)
code_block_58 = CodeBlock(x=code_block_3) { x; }
all_elements_of_category_in_view_4 = ElementsOfCategoryInView(Category=byName_10, View=code_block_58)
kind = Custom[StructuralFoundation.Kind](structuralFoundation=all_elements_of_category_in_view_4)  # package Clockwork for Dynamo 2.x; Retrieves the kind of a given structural foundation (isolated, wall, slab).
code_block_59 = CodeBlock { "Wall Footing"; }
eq_8 = kind == code_block_59
filterByBoolMask_7 = List.FilterByBoolMask(list=all_elements_of_category_in_view_4, mask=eq_8)
element_taggedstatus_4 = Custom[Element TaggedStatus](element=filterByBoolMask_7.in)
code_block_60 = CodeBlock(x=element_taggedstatus_4.NotTagged) { x; }
code_block_61 = CodeBlock { "EST_A_STRUCTURAL FOUNDATION TAG_PLANTA_SELLO FUNDACION"; }
byName_11 = Orchid.RevitProject.Elements.Family.ByName(name=code_block_61)
code_block_62 = CodeBlock { "Sello Fundacion"; }
byFamilyAndName_5 = FamilyType.ByFamilyAndName(family=byName_11, name=code_block_62)
elementcentroid_3 = Custom[© ElementCentroid](element=code_block_60)
activeView_7 = Orchid.RevitProject.Common.Document.ActiveView()
plane_2 = Custom[View.Plane](view=activeView_7)
normal_3 = Plane.Normal(plane=plane_2)
byOriginNormal_2 = Plane.ByOriginNormal(origin=elementcentroid_3, normal=normal_3)
normal_4 = Plane.Normal(plane=byOriginNormal_2)
host = Custom[Element.Host+](element=code_block_60)  # package Clockwork for Dynamo 2.x; Gets an element's host. Unlike the OOTB node FamilyInstance.GetHost it not only works for family instances but also for elements like wall sweeps, foundations, railings, builing pads and topo subregions.
location_2 = Custom[Element.Location+](element=host)
code_block_63 = CodeBlock(x=location_2.curves)  # same code as code_block_14
direction_2 = Line.Direction(line=code_block_63.out1)
normalized_2 = Vector.Normalized(vector=direction_2)
code_block_64 = CodeBlock(p=normalized_2) { p.Y; }
code_block_65 = CodeBlock { 2; }
round_4 = Math.Round(number=code_block_64, digits=code_block_65)
code_block_66 = CodeBlock { 0; }
lt = round_4 < code_block_66
reverse_3 = Vector.Reverse(vector=normalized_2)
scopeIf_3 = Custom[ScopeIf+](test=lt, True=reverse_3, False=normalized_2, lacing=Shortest)
code_block_67 = CodeBlock(p=scopeIf_3) { p.X; }
code_block_68 = CodeBlock { 2; }
round_5 = Math.Round(number=code_block_67, digits=code_block_68)
code_block_69 = CodeBlock { 0; }
lt_2 = round_5 < code_block_69
reverse_4 = Vector.Reverse(vector=scopeIf_3)
scopeIf_4 = Custom[ScopeIf+](test=lt_2, True=reverse_4, False=scopeIf_3, lacing=Shortest)
code_block_70 = CodeBlock { null; }
replaceEmptyLists_7 = Custom[List.ReplaceEmptyLists](seq=scopeIf_4, Replacement=code_block_70)
ZAxis_2 = Vector.ZAxis()
code_block_71 = CodeBlock(x=replaceEmptyLists_7, y=ZAxis_2)  # same code as code_block_25
code_block_72 = CodeBlock { 90; }
rotate_2 = Vector.Rotate(vector=normal_4, axis=code_block_71.out2, degrees=code_block_72)
code_block_73 = CodeBlock(x=code_block_60) { Revit.Elements.Element.GetParameterValueByName(Revit.Elements.Element.GetParameterValueByName(x,"Type"),"Width")/2; }
translate_2 = Geometry.Translate(geometry=elementcentroid_3, direction=rotate_2, distance=code_block_73)
code_block_74 = CodeBlock(p=code_block_71.out2) { p.Y; }
code_block_75 = CodeBlock { 2; }
round_6 = Math.Round(number=code_block_74, digits=code_block_75)
python_script = Python(IN[0]=round_6)  # IronPython2
# ---------- python_script.python (11 lines) ----------
lst = IN[0]

boolList = []

for l in lst:
	if l != 1:
		resultado = True		
	else:
		resultado = False
	boolList.append(resultado)
OUT = boolList
# ----------------------------------------
byElementAndLocation_4 = Orchid.RevitProject.Annotations.Tag.ByElementAndLocation(view=activeView_6, element=code_block_60, tagType=byFamilyAndName_5, location=translate_2, horizontal=python_script)

code_block_76 = CodeBlock { "Error"; }
uimessenger = Custom[© UIMessenger](title=code_block_76, body=code_block.out4)  # package Crumple; Displays a message box with a title/body and OK/cancel button. If OK is selected, the third input's data will be passed through.
