# Dynamo graph elevacionEje_script.dyn (Dynamo 2.12.1.8246)
# packages: Data-Shapes 2021.2.94, Clockwork for Dynamo 2.x 2.4.0, Orchid 200.4.0.7938, Genius Loci 2021.11.10

code_block = CodeBlock { "Elevación por Eje"; }
file_path = Filename("..\..\..\..\..\..\..\..\..\..\..\Arainco\Arainco.png")
code_block_2 = CodeBlock()
# ---------- code_block_2.designscript (9 lines) ----------
//buttonText
"INICIAR";
//buttonCancel
"CANCELAR";
//maxHeight
850;
//width
440;
//label
# ----------------------------------------
code_block_3 = CodeBlock { "(Categoria MA)"; }
code_block_4 = CodeBlock { "Escala:"; }
code_block_5 = CodeBlock()
# ---------- code_block_5.designscript (6 lines) ----------
[
"1:50",
"1:75",
"1:100",
"1:125"
];
# ----------------------------------------
code_block_6 = CodeBlock { ":"; }
split = String.Split(string=code_block_5, separator0=code_block_6)
code_block_7 = CodeBlock { 1; }
getItemAtIndex = List.GetItemAtIndex(list=split@L2, index=code_block_7)
toNumber = String.ToNumber(string=getItemAtIndex)
code_block_8 = CodeBlock { 0; false; }
dropdown_data = Custom[DropDown Data](InputName=code_block_4, Keys=code_block_5, Values=toNumber, DefaultValueIndex=code_block_8.out0, Sorted_optional=code_block_8.out1)  # package Data-Shapes; Create data for DropDown input in UI.MultiInputForm ++ . Check out www.data-shapes.net for more infos.
code_block_9 = CodeBlock { "Grids"; }
byName = Category.ByName(name=code_block_9)
all_elements_of_category = ElementsOfCategory(Category=byName)
code_block_10 = CodeBlock(g=all_elements_of_category) { "ELEVACIÓN EJE "+Revit.Elements.Element.Name(g); }
python_script = Python()  # IronPython2; unwired: IN[0]
# ---------- python_script.python (27 lines) ----------
#### IMPORTAR LIBRERIAS ####
import clr

clr.AddReference("RevitAPI")
from Autodesk.Revit.DB import *

clr.AddReference("RevitNodes")
import Revit
clr.ImportExtensions(Revit.GeometryConversion)

clr.AddReference("RevitServices")
import RevitServices
from RevitServices.Persistence import DocumentManager
from RevitServices.Transactions import TransactionManager

#### ACCESO AL DOCUMENTO ####
doc = DocumentManager.Instance.CurrentDBDocument

#### ASIGNAR INPUTS A VARIABLES ####
name = IN[0]

#### TRANSACCIONES ####

views = FilteredElementCollector(doc).OfClass(ViewSection).ToElements()

#### RESULTADOS ####
OUT = views
# ----------------------------------------
code_block_11 = CodeBlock { "Subclasificacion"; }
getParameterValueByName = Element.GetParameterValueByName(element=python_script, parameterName=code_block_11)
code_block_12 = CodeBlock { "02_MA"; }
eq = getParameterValueByName == code_block_12
filterByBoolMask = List.FilterByBoolMask(list=python_script, mask=eq)
code_block_13 = CodeBlock { "Title on Sheet"; }
getParameterValueByName_2 = Element.GetParameterValueByName(element=filterByBoolMask.in, parameterName=code_block_13)
code_block_14 = CodeBlock { null; }
replaceEmptyLists = Custom[List.ReplaceEmptyLists](seq=getParameterValueByName_2, Replacement=code_block_14)  # package Clockwork for Dynamo 2.x; Replaces all empty lists within a given list with a substitute
eq_2 = code_block_10@L1 == replaceEmptyLists@L2  # lacing=Longest
anyTrue = Orchid.Common.List.AnyTrue(list=eq_2)
filterByBoolMask_2 = List.FilterByBoolMask(list=all_elements_of_category, mask=anyTrue)
code_block_15 = CodeBlock { "Name"; }
getParameterValueByName_3 = Element.GetParameterValueByName(element=filterByBoolMask_2.out, parameterName=code_block_15)
toNumber_2 = Custom[Character.ToNumber](str=getParameterValueByName_3)  # package Clockwork for Dynamo 2.x; Converts an Excel-style character to a number (e.g. A = 1, AA = 27 etc.).
code_block_16 = CodeBlock { 0; }
eq_3 = toNumber_2 == code_block_16
toNumber_3 = String.ToNumber()  # unwired: string
function_apply = ApplyFunction(function=toNumber_3, argument0=getParameterValueByName_3)
scopeIf = Custom[ScopeIf+](test=eq_3, True=function_apply, False=getParameterValueByName_3, lacing=Shortest)  # package Clockwork for Dynamo 2.x; A (hopefully) more robust implementation of ScopeIf. Tests a single boolean and returns a value accordingly.
sortByKey = List.SortByKey(list=filterByBoolMask_2.out, keys=scopeIf)
code_block_17 = CodeBlock(g=sortByKey.sortedList) { "ELEVACIÓN EJE "+Revit.Elements.Element.Name(g); }
radiobuttons_data = Custom[RadioButtons Data](Keys=code_block_17, Values=sortByKey.sortedList)  # package Data-Shapes; Create radio buttons input for UI.MultipleInputForm ++ .
list_create = List.Create(item0=dropdown_data, item1=radiobuttons_data)
inputgroup_data = Custom[InputGroup Data](GroupTitle=code_block_3, Inputs=list_create)  # package Data-Shapes; Creates a group of inputs for UI.MultipleInputForm ++ . Check out www.data-shapes.net for more infos !
boolean = BoolSelector(true)
multipleinputform = Custom[MultipleInputForm ++](Description_optional=code_block, Logo_optional=file_path, ButtonText_optional=code_block_2.out0, Inputs=inputgroup_data, Toggle=boolean, CancelButtonText_optional=code_block_2.out1, MaxHeight_optional=code_block_2.out2, Width_optional=code_block_2.out3)  # package Data-Shapes; Create a form with multiple inputs. see www.data-shapes.net for tutorials and infos!
code_block_18 = CodeBlock(x=multipleinputform.User_Inputs)
# ---------- code_block_18.designscript (13 lines) ----------
x;

[Imperative]
{
	if(x == null)
	{
		return = [[],[]];
	}
	else
	{
		return = x;
	}
};
# ----------------------------------------
code_block_19 = CodeBlock(l=code_block_18.out1) { l[1]; }
curve = Grid.Curve(grid=code_block_19)
direction = Line.Direction(line=curve)
normalized = Vector.Normalized(vector=direction)
code_block_20 = CodeBlock(p=normalized) { p.X; }
code_block_21 = CodeBlock { 2; }
round = Math.Round(number=code_block_20, digits=code_block_21)
code_block_22 = CodeBlock { 0; }
le = round <= code_block_22
reverse = Curve.Reverse(curve=curve)
scopeIf_2 = Custom[ScopeIf+](test=le, True=reverse, False=curve, lacing=Shortest)
code_block_23 = CodeBlock(x=scopeIf_2) { x; }
direction_2 = Line.Direction(line=code_block_23)
code_block_24 = CodeBlock(x=direction_2) { x.X; }
code_block_25 = CodeBlock { 0; }
ge = code_block_24 >= code_block_25
reverse_2 = Curve.Reverse(curve=code_block_23)
scopeIf_3 = Custom[ScopeIf+](test=ge, True=reverse_2, False=code_block_23, lacing=Shortest)
direction_3 = Line.Direction(line=scopeIf_3)
normalized_2 = Vector.Normalized(vector=direction_3)
code_block_26 = CodeBlock(x=normalized_2) { x.X; }
code_block_27 = CodeBlock { 0; }
eq_4 = code_block_26 == code_block_27
code_block_28 = CodeBlock(x=normalized_2) { x.Y; }
code_block_29 = CodeBlock { 0; }
gt = code_block_28 > code_block_29
and_ = eq_4 && gt
reverse_3 = Curve.Reverse(curve=scopeIf_3)
scopeIf_4 = Custom[ScopeIf+](test=and_, True=reverse_3, False=scopeIf_3, lacing=Shortest)
code_block_30 = CodeBlock { "Levels"; }
byName_2 = Category.ByName(name=code_block_30)
all_elements_of_category_2 = ElementsOfCategory(Category=byName_2)
elevation = Level.Elevation(level=all_elements_of_category_2)
minimumItem = List.MinimumItem(list=elevation)
eq_5 = elevation == minimumItem
filterByBoolMask_3 = List.FilterByBoolMask(list=all_elements_of_category_2, mask=eq_5)
plane = Custom[Level.Plane](level=filterByBoolMask_3.in)  # package Clockwork for Dynamo 2.x; Retrieves the plane of a given level
pullOntoPlane = Curve.PullOntoPlane(curve=scopeIf_4, plane=plane, lacing=Longest)
ZAxis = Vector.ZAxis()
code_block_31 = CodeBlock { -3000; }
translate = Geometry.Translate(geometry=pullOntoPlane, direction=ZAxis, distance=code_block_31, lacing=Longest)
python_script_2 = Python()  # IronPython2; unwired: IN[0]
# ---------- python_script_2.python (27 lines) ----------
#### IMPORTAR LIBRERIAS ####
import clr

clr.AddReference("RevitAPI")
from Autodesk.Revit.DB import *

clr.AddReference("RevitNodes")
import Revit
clr.ImportExtensions(Revit.GeometryConversion)

clr.AddReference("RevitServices")
import RevitServices
from RevitServices.Persistence import DocumentManager
from RevitServices.Transactions import TransactionManager

#### ACCESO AL DOCUMENTO ####
doc = DocumentManager.Instance.CurrentDBDocument

#### ASIGNAR INPUTS A VARIABLES ####
name = IN[0]

#### TRANSACCIONES ####

views = FilteredElementCollector(doc).OfClass(ViewFamilyType).ToElements()

#### RESULTADOS ####
OUT = views
# ----------------------------------------
name = Element.Name(element=python_script_2)
code_block_32 = CodeBlock { "Building Section (02_MA)"; }
eq_6 = name == code_block_32
filterByBoolMask_4 = List.FilterByBoolMask(list=python_script_2, mask=eq_6)
code_block_33 = CodeBlock(X=filterByBoolMask_4.in) { X[0]; }
code_block_34 = CodeBlock { 0.5; }
pointAtParameter = Curve.PointAtParameter(curve=translate, param=code_block_34)
code_block_35 = CodeBlock { "Levels"; }
byName_3 = Category.ByName(name=code_block_35)
all_elements_of_category_3 = ElementsOfCategory(Category=byName_3)
elevation_2 = Level.Elevation(level=all_elements_of_category_3)
maximumItem = List.MaximumItem(list=elevation_2)
eq_7 = elevation_2 == maximumItem
filterByBoolMask_5 = List.FilterByBoolMask(list=all_elements_of_category_3, mask=eq_7)
plane_2 = Custom[Level.Plane](level=filterByBoolMask_5.in)
pullOntoPlane_2 = Curve.PullOntoPlane(curve=scopeIf_4, plane=plane_2, lacing=Longest)
ZAxis_2 = Vector.ZAxis()
code_block_36 = CodeBlock { 3000; }
translate_2 = Geometry.Translate(geometry=pullOntoPlane_2, direction=ZAxis_2, distance=code_block_36, lacing=Longest)
code_block_37 = CodeBlock { 0.5; }
pointAtParameter_2 = Curve.PointAtParameter(curve=translate_2, param=code_block_37)
distanceTo = Geometry.DistanceTo(geometry=pointAtParameter, other=pointAtParameter_2)
code_block_38 = CodeBlock { null; }
replaceEmptyLists_2 = Custom[List.ReplaceEmptyLists](seq=distanceTo, Replacement=code_block_38)
code_block_39 = CodeBlock(x=replaceEmptyLists_2)
# ---------- code_block_39.designscript (12 lines) ----------
x;
[Imperative]
{
	if(x == null)
	{
		return = [[]];
	}
	else
	{
		return = x;
	}
};
# ----------------------------------------
code_block_40 = CodeBlock(h=code_block_39.out1)
# ---------- code_block_40.designscript (6 lines) ----------
//height
h[0];
//offset
300;
//depth
300;
# ----------------------------------------
byLine = Custom[ViewSection.ByLine](Curves=translate, input=code_block_33, ViewSectionHeight=code_block_40.out0, OffsetFromLine=code_block_40.out1, Depth=code_block_40.out2)  # package Data-Shapes; Create ViewSections in current document from DS Lines.
code_block_41 = CodeBlock(g=code_block_19) { "View Name"; "MA_ELEVACION EJE "+Revit.Elements.Element.Name(g); }
setParameterByName = Element.SetParameterByName(element=byLine, parameterName=code_block_41.out0, value=code_block_41.out1, lacing=Longest)
code_block_42 = CodeBlock(g=code_block_19) { "Title on Sheet"; "ELEVACIÓN EJE "+Revit.Elements.Element.Name(g); }
setParameterByName_2 = Element.SetParameterByName(element=setParameterByName, parameterName=code_block_42.out0, value=code_block_42.out1, lacing=Longest)
code_block_43 = CodeBlock(l=code_block_18.out1) { l[0]; }
setScale = View.SetScale(view=setParameterByName_2, scale=code_block_43, lacing=Longest)
code_block_44 = CodeBlock()
# ---------- code_block_44.designscript (5 lines) ----------
[
"Crop View",
"Crop Region Visible"
];
[1,0];
# ----------------------------------------
setParameterByName_3 = Element.SetParameterByName(element=setScale@L1, parameterName=code_block_44.out0@L2, value=code_block_44.out1@L2, lacing=Longest)
flatten = List.Flatten(list=setParameterByName_3)
uniqueItems = List.UniqueItems(list=flatten)
end = Revit.Transaction.Transaction.End(input=uniqueItems)
start = Revit.Transaction.Transaction.Start(input=end)
code_block_45 = CodeBlock { null; }
replaceEmptyLists_3 = Custom[List.ReplaceEmptyLists](seq=start, Replacement=code_block_45)
code_block_46 = CodeBlock(x=replaceEmptyLists_3)
# ---------- code_block_46.designscript (12 lines) ----------
x;
[Imperative]
{
	if(x == null)
	{
		return = [];
	}
	else
	{
		return = x[0];
	}
};
# ----------------------------------------
code_block_47 = CodeBlock(x=code_block_46.out1) { x; }
byLoft = Surface.ByLoft()  # unwired: crossSections
getCropBox = Orchid.RevitProject.Views.View.GetCropBox(view=code_block_46.out1)
code_block_48 = CodeBlock { null; }
replaceEmptyLists_4 = Custom[List.ReplaceEmptyLists](seq=getCropBox.Curve, Replacement=code_block_48)
code_block_49 = CodeBlock(x=replaceEmptyLists_4)
# ---------- code_block_49.designscript (12 lines) ----------
x;
[Imperative]
{
	if(x == null)
	{
		return = [];
	}
	else
	{
		return = x[1];
	}
};
# ----------------------------------------
code_block_50 = CodeBlock()
# ---------- code_block_50.designscript (6 lines) ----------
[
"Structural Columns",
"Structural Framing",
"Floors",
"Walls"
];
# ----------------------------------------
byName_4 = Category.ByName(name=code_block_50)
all_elements_of_category_in_view = ElementsOfCategoryInView(Category=byName_4, View=code_block_46.out1)
flatten_2 = List.Flatten(list=all_elements_of_category_in_view)
element_level = Custom[Element Level](element=flatten_2)  # package Genius Loci; Gets an element's level. Based on a Clockwork's node
uniqueItems_2 = List.UniqueItems(list=element_level)
elevation_3 = Level.Elevation(level=uniqueItems_2)
maximumItem_2 = List.MaximumItem(list=elevation_3)
eq_8 = elevation_3 == maximumItem_2
filterByBoolMask_6 = List.FilterByBoolMask(list=uniqueItems_2, mask=eq_8)
plane_bylevel = Custom[Plane ByLevel](level=filterByBoolMask_6.in)  # package Genius Loci; Constructs a Plane from a level.
pullOntoPlane_3 = Curve.PullOntoPlane(curve=code_block_49.out1, plane=plane_bylevel)
ZAxis_3 = Vector.ZAxis()
code_block_51 = CodeBlock { 1500; }
translate_3 = Geometry.Translate(geometry=pullOntoPlane_3, direction=ZAxis_3, distance=code_block_51)
code_block_52 = CodeBlock(x=replaceEmptyLists_4)
# ---------- code_block_52.designscript (12 lines) ----------
x;
[Imperative]
{
	if(x == null)
	{
		return = [];
	}
	else
	{
		return = x[3];
	}
};
# ----------------------------------------
list_create_2 = List.Create(item0=translate_3, item1=code_block_52.out1)
flatten_3 = List.Flatten(list=list_create_2)
function_apply_2 = ApplyFunction(func=byLoft, arg1=flatten_3)
code_block_53 = CodeBlock(x=function_apply_2)
# ---------- code_block_53.designscript (12 lines) ----------
x;
[Imperative]
{
	if(x == null)
	{
		return = [];
	}
	else
	{
		return = x;
	}
};
# ----------------------------------------
perimeterCurves = Surface.PerimeterCurves(surface=code_block_53.out1)
setCropBox = Orchid.RevitProject.Views.View.SetCropBox(view=code_block_47, curve=perimeterCurves)
openView = Orchid.RevitProject.Common.Document.OpenView(view=setCropBox)
