# Dynamo graph script.dyn "cotasElevacion_script" (Dynamo 2.3.2.15696)
# packages: Clockwork for Dynamo 2.x 2.4.0, Data-Shapes 2021.2.94, Orchid 200.4.0.7938, Rhythm 2020.7.25

activeView = Orchid.RevitProject.Common.Document.ActiveView()
code_block = CodeBlock { "Niveles en Elevacion"; }
code_block_2 = CodeBlock { "INICIAR"; "CANCELAR"; 430; 150; }
code_block_3 = CodeBlock { "Selecciona una\ncota de Elevacion"; }
code_block_4 = CodeBlock { "SELECCIONAR"; }
code_block_5 = CodeBlock { "Dimensions"; }
byName = Category.ByName(name=code_block_5)
code_block_6 = CodeBlock { true; }
selectmodelelements_data = Custom[SelectModelElements Data](InputName=code_block_3, ButtonText=code_block_4, CategoryFilter=byName, SelectSingleElement=code_block_6)  # package Data-Shapes; Creates a Revit element selection input for UI.MultipleInputForm++ . Check out www.data-shapes.net for more infos!
boolean = BoolSelector(true)
multipleinputform = Custom[MultipleInputForm ++](Description_optional=code_block, ButtonText_optional=code_block_2.out0, Inputs=selectmodelelements_data, Toggle=boolean, CancelButtonText_optional=code_block_2.out1, Width_optional=code_block_2.out2, LabelWidth_optional=code_block_2.out3)  # package Data-Shapes; Create a form with multiple inputs. see www.data-shapes.net for tutorials and infos!
code_block_7 = CodeBlock { null; }
replaceEmptyLists = Custom[List.ReplaceEmptyLists](seq=multipleinputform.User_Inputs, Replacement=code_block_7)  # package Clockwork for Dynamo 2.x; Replaces all empty lists within a given list with a substitute
code_block_8 = CodeBlock(x=replaceEmptyLists)
# ---------- code_block_8.designscript (12 lines) ----------
x;
[Imperative]
{
	if(x == null)
	{
		return = [];
	}
	else
	{
		return = x[0];
	}
};
# ----------------------------------------
ʳʰʸᵗʰᵐ_dimensions = Rhythm.Revit.Elements.Dimensions.GetReferenceElements(dimension=code_block_8.out1)
getCategory = Element.GetCategory(element=ʳʰʸᵗʰᵐ_dimensions)
string_from_object = FromObject(obj=getCategory)
code_block_9 = CodeBlock()
# ---------- code_block_9.designscript (4 lines) ----------
[
"Structural Framing",
"Walls"
];
# ----------------------------------------
eq = string_from_object == code_block_9  # lacing=CrossProduct
anyTrue = Orchid.Common.List.AnyTrue(list=eq)
filterByBoolMask = List.FilterByBoolMask(list=ʳʰʸᵗʰᵐ_dimensions, mask=anyTrue)
ʳʰʸᵗʰᵐ_dimensions_getcurve = Rhythm.Revit.Elements.Dimensions.GetCurve(dimension=code_block_8.out1)
code_block_10 = CodeBlock(line1=ʳʰʸᵗʰᵐ_dimensions_getcurve)
# ---------- code_block_10.designscript (4 lines) ----------
point1 = Autodesk.Curve.StartPoint(line1);
point2 = Autodesk.Curve.EndPoint(line1);
t1 = [point1, point2];
t2 = DSCore.List.Flatten(t1, 1);
# ----------------------------------------
pruneDuplicates = Point.PruneDuplicates(points=code_block_10.t2)
filterByBoolMask_2 = List.FilterByBoolMask(list=pruneDuplicates, mask=anyTrue)
byElementAndLocation = Tag.ByElementAndLocation(view=activeView, element=filterByBoolMask.out, location=filterByBoolMask_2.out)
code_block_11 = CodeBlock { "Type"; }
getCategory_2 = Element.GetCategory(element=filterByBoolMask.out)
string_from_object_2 = FromObject(obj=getCategory_2)
code_block_12 = CodeBlock { "Structural Foundations"; }
eq_2 = string_from_object_2 == code_block_12  # lacing=Longest
tag_sello_fundacion = CodeBlock()
# ---------- tag_sello_fundacion.designscript (2 lines) ----------
family1 = Revit.Family.ByName("EST_A_FOUNDATION TAG_ELEVACION");
familytype1 = Revit.FamilyType.ByFamilyAndName(family1, "Orientación Izquierda");
# ----------------------------------------
tag_tope_losa = CodeBlock()
# ---------- tag_tope_losa.designscript (2 lines) ----------
family1 = Revit.Family.ByName("EST_A_FLOOR TAG_ELEVACION_TOPE LOSA");
familytype1 = Revit.FamilyType.ByFamilyAndName(family1, "Orientación Izquierda");
# ----------------------------------------
scopeIf = Custom[ScopeIf+](test=eq_2, True=tag_sello_fundacion.familytype1, False=tag_tope_losa.familytype1)  # package Clockwork for Dynamo 2.x; A (hopefully) more robust implementation of ScopeIf. Tests a single boolean and returns a value accordingly.
setParameterByName = Element.SetParameterByName(element=byElementAndLocation, parameterName=code_block_11, value=scopeIf, lacing=Longest)
code_block_13 = CodeBlock { "Type"; }
taggedElement = Tag.TaggedElement(tag=setParameterByName)
name = Element.Name(element=taggedElement)
code_block_14 = CodeBlock { "RADIER e="; }
contains = String.Contains(str=name, searchFor=code_block_14)
tag_tope_radier = CodeBlock()
# ---------- tag_tope_radier.designscript (2 lines) ----------
family1 = Revit.Family.ByName("EST_A_FLOOR TAG_ELEVACION_TOPE RADIER");
familytype1 = Revit.FamilyType.ByFamilyAndName(family1, "Orientación Izquierda");
# ----------------------------------------
code_block_15 = CodeBlock { []; }
scopeIf_2 = Custom[ScopeIf+](test=contains, True=tag_tope_radier.familytype1, False=code_block_15, lacing=Shortest)
setParameterByName_2 = Element.SetParameterByName(element=setParameterByName, parameterName=code_block_13, value=scopeIf_2)
