# Dynamo graph contorno_script.dyn (Dynamo 2.12.1.8246)
# packages: archi-lab.net 2022.210.2419, Clockwork for Dynamo 2.x 2.4.0, Orchid 200.4.0.7938

activeView = Orchid.RevitProject.Common.Document.ActiveView()

# group: Redibujar Contorno
code_block = CodeBlock(x=activeView) { x; }
plane = Custom[View.Plane](view=code_block)  # package Clockwork for Dynamo 2.x; Retrieves the plane of a given view
normal = Plane.Normal(plane=plane)
code_block_2 = CodeBlock(t2=code_block) { t1 = Revit.Elements.Element.GetParameterValueByName(t2, "Far Clip Offset"); t3 = t1 / 2; t4 = t3 * -1; }
translate = Geometry.Translate(geometry=plane, direction=normal, distance=code_block_2.t4)
byUnion = Solid.ByUnion()  # unwired: solids
code_block_3 = CodeBlock()
# ---------- code_block_3.designscript (6 lines) ----------
["Floors",
"Structural Framing",
"Walls",
"Structural Foundations",
"Structural Columns"
];
# ----------------------------------------
byName = Category.ByName(name=code_block_3)
all_elements_of_category_in_view = ElementsOfCategoryInView(Category=byName, View=code_block)
flatten = List.Flatten(list=all_elements_of_category_in_view)
solids = Element.Solids(element=flatten)
flatten_2 = List.Flatten(list=solids)
function_apply = ApplyFunction(func=byUnion, arg1=flatten_2)
intersect = Geometry.Intersect(geometry=translate, other=function_apply)
perimeterCurves = Surface.PerimeterCurves(surface=intersect)
flatten_3 = List.Flatten(list=perimeterCurves)
byCurve = Custom[DetailCurve.ByCurve+](curve=flatten_3, view=code_block)  # package Clockwork for Dynamo 2.x; Creates a detail line based on a given curve. Unlike the OOTB node it can also draw circles.
code_block_4 = CodeBlock { "Line Style"; }
code_block_5 = CodeBlock { "<Wide Lines>"; }
get_line_style_by_name = Custom[Get Line Style by Name](name=code_block_5)  # package archi-lab.net; This node will return a line style object by its name. Line styles can be either Drafting or Model Line Property.
setParameterByName = Element.SetParameterByName(element=byCurve, parameterName=code_block_4, value=get_line_style_by_name, lacing=Longest)
