# Dynamo graph elevacionVigaNum_script.dyn (Dynamo 2.12.1.8246)
# packages: Clockwork for Dynamo 2.x 2.4.0, Data-Shapes 2021.2.94, Orchid 200.4.0.7938, archi-lab.net 2022.210.2419, Crumple 2022.2.13, Genius Loci 2021.11.10

code_block = CodeBlock { "Info."; }
code_block_2 = CodeBlock { "Elevación Viga Numerada"; }
file_path = Filename("..\..\..\..\..\..\..\..\..\..\..\Arainco\Arainco.png")
code_block_3 = CodeBlock()
# ---------- code_block_3.designscript (10 lines) ----------
//buttonText
"INICIAR";
//buttonCancel
"CANCELAR";
//maxHeight

//width
440;
//label
180;
# ----------------------------------------
code_block_4 = CodeBlock { "Seleccionar Vigas:"; }
code_block_5 = CodeBlock { "SELECCIONAR"; }
code_block_6 = CodeBlock { "Structural Framing"; }
byName = Category.ByName(name=code_block_6)
selectmodelelements_data = Custom[SelectModelElements Data](InputName=code_block_4, ButtonText=code_block_5, CategoryFilter=byName)  # package Data-Shapes; Creates a Revit element selection input for UI.MultipleInputForm++ . Check out www.data-shapes.net for more infos!
code_block_7 = CodeBlock { "Escala:"; }
code_block_8 = CodeBlock()
# ---------- code_block_8.designscript (6 lines) ----------
[
"1:50",
"1:75",
"1:100",
"1:125"
];
# ----------------------------------------
code_block_9 = CodeBlock { ":"; }
split = String.Split(string=code_block_8, separator0=code_block_9)
code_block_10 = CodeBlock { 1; }
getItemAtIndex = List.GetItemAtIndex(list=split@L2, index=code_block_10)
toNumber = String.ToNumber(string=getItemAtIndex)
code_block_11 = CodeBlock { 0; false; }
dropdown_data = Custom[DropDown Data](InputName=code_block_7, Keys=code_block_8, Values=toNumber, DefaultValueIndex=code_block_11.out0, Sorted_optional=code_block_11.out1)  # package Data-Shapes; Create data for DropDown input in UI.MultiInputForm ++ . Check out www.data-shapes.net for more infos.
list_create = List.Create(item0=selectmodelelements_data, item1=dropdown_data)
inputgroup_data = Custom[InputGroup Data](Inputs=list_create)  # package Data-Shapes; Creates a group of inputs for UI.MultipleInputForm ++ . Check out www.data-shapes.net for more infos !
boolean = BoolSelector(true)
multipleinputform = Custom[MultipleInputForm ++](Description_optional=code_block_2, Logo_optional=file_path, ButtonText_optional=code_block_3.out0, Inputs=inputgroup_data, Toggle=boolean, CancelButtonText_optional=code_block_3.out1, Width_optional=code_block_3.out2, LabelWidth_optional=code_block_3.out3)  # package Data-Shapes; Create a form with multiple inputs. see www.data-shapes.net for tutorials and infos!
code_block_12 = CodeBlock(x=multipleinputform.User_Inputs)
# ---------- code_block_12.designscript (13 lines) ----------
x;

[Imperative]
{
	if(x == null)
	{
		return = [[],[]];
	}
	else
	{
		return = x;
	}
};
# ----------------------------------------
code_block_13 = CodeBlock(x=code_block_12.out1) { x[0]; }
code_block_14 = CodeBlock { "Numeracion Viga"; }
getParameterValueByName = Element.GetParameterValueByName(element=code_block_13, parameterName=code_block_14)
code_block_15 = CodeBlock { ""; }
eq = getParameterValueByName == code_block_15
anyTrue = Orchid.Common.List.AnyTrue(list=eq)
code_block_16 = CodeBlock(x=anyTrue, y=code_block_12.out1)
# ---------- code_block_16.designscript (14 lines) ----------
x;
y;

[Imperative]
{
	if(x == true)
	{
		return = null;
	}
	else
	{
		return = y;
	}
};
# ----------------------------------------
code_block_17 = CodeBlock(x=code_block_16.out2)
# ---------- code_block_17.designscript (12 lines) ----------
x;
[Imperative]
{
	if (x == null)
	{
		return = "Algunas de las vigas seleccionadas no tienen Numeracion.\nTodas las vigas deben tener su numeración correspondiente antes de ser elevadas.";
	}
	else
	{
		return = [];
	}
};
# ----------------------------------------
uimessenger = Custom[© UIMessenger](title=code_block, body=code_block_17.out1)  # package Crumple; Displays a message box with a title/body and OK/cancel button. If OK is selected, the third input's data will be passed through.
byBestFitThroughPoints = Line.ByBestFitThroughPoints()  # unwired: bestFitPoints
code_block_18 = CodeBlock(x=code_block_16.out2)  # same code as code_block_12
code_block_19 = CodeBlock(x=code_block_18.out1) { x[0]; }
location = Custom[Element.Location+](element=code_block_19)  # package Clockwork for Dynamo 2.x; Returns the location of an element as point, curve or curve loop, along with some booleans to help filtering the results. Unlike the OOTB Element.GetLocation node, it also retunrs sketch lines of sketch-based elements like floor slabs as well as the element's rotation property.
code_block_20 = CodeBlock(x=location.curveEndpoints)  # same code as code_block_12
flatten = List.Flatten(list=code_block_20.out1)
function_apply = ApplyFunction(func=byBestFitThroughPoints, arg1=flatten)
code_block_21 = CodeBlock(x=function_apply)
# ---------- code_block_21.designscript (13 lines) ----------
x;

[Imperative]
{
	if(x == null)
	{
		return = [];
	}
	else
	{
		return = x;
	}
};
# ----------------------------------------
direction = Line.Direction(line=code_block_21.out1)
code_block_22 = CodeBlock(x=direction) { x.X; }
code_block_23 = CodeBlock { 0; }
ge = code_block_22 >= code_block_23
reverse = Curve.Reverse(curve=code_block_21.out1)
scopeIf = Custom[ScopeIf+](test=ge, True=reverse, False=code_block_21.out1, lacing=Shortest)  # package Clockwork for Dynamo 2.x; A (hopefully) more robust implementation of ScopeIf. Tests a single boolean and returns a value accordingly.
direction_2 = Line.Direction(line=scopeIf)
normalized = Vector.Normalized(vector=direction_2)
code_block_24 = CodeBlock(x=normalized) { x.X; }
code_block_25 = CodeBlock { 0; }
eq_2 = code_block_24 == code_block_25
code_block_26 = CodeBlock(x=normalized) { x.Y; }
code_block_27 = CodeBlock { 0; }
gt = code_block_26 > code_block_27
and_ = eq_2 && gt
reverse_2 = Curve.Reverse(curve=scopeIf)
scopeIf_2 = Custom[ScopeIf+](test=and_, True=reverse_2, False=scopeIf, lacing=Shortest)
python_script = Python()  # IronPython2; unwired: IN[0]
# ---------- python_script.python (27 lines) ----------
#### IMPORTAR LIBRERIAS ####
import clr

clr.AddReference("RevitAPI")
from Autodesk.Revit.DB import *

clr.AddReference("RevitNodes")
import Revit
clr.ImportExtensions(Revit.GeometryConversion)

clr.AddReference("RevitServices")
import RevitServices
from RevitServices.Persistence import DocumentManager
from RevitServices.Transactions import TransactionManager

#### ACCESO AL DOCUMENTO ####
doc = DocumentManager.Instance.CurrentDBDocument

#### ASIGNAR INPUTS A VARIABLES ####
name = IN[0]

#### TRANSACCIONES ####

views = FilteredElementCollector(doc).OfClass(ViewFamilyType).ToElements()

#### RESULTADOS ####
OUT = views
# ----------------------------------------
name = Element.Name(element=python_script)
code_block_28 = CodeBlock { "Building Section (03_VH)"; }
eq_3 = name == code_block_28
filterByBoolMask = List.FilterByBoolMask(list=python_script, mask=eq_3)
code_block_29 = CodeBlock(X=filterByBoolMask.in) { X[0]; }
code_block_30 = CodeBlock()
# ---------- code_block_30.designscript (6 lines) ----------
//height
500;
//offset
300;
//depth
300;
# ----------------------------------------
byLine = Custom[ViewSection.ByLine](Curves=scopeIf_2, input=code_block_29, ViewSectionHeight=code_block_30.out0, OffsetFromLine=code_block_30.out1, Depth=code_block_30.out2)  # package Data-Shapes; Create ViewSections in current document from DS Lines.
byJoinedCurves = PolyCurve.ByJoinedCurves()  # unwired: curves
byLoft = Surface.ByLoft()  # unwired: crossSections
ZAxis = Vector.ZAxis()
code_block_31 = CodeBlock { [500,-500]; }
translate = Geometry.Translate(geometry=scopeIf_2, direction=ZAxis, distance=code_block_31)
function_apply_2 = ApplyFunction(func=byLoft, arg1=translate)
code_block_32 = CodeBlock(x=function_apply_2)  # same code as code_block_21
perimeterCurves = Surface.PerimeterCurves(surface=code_block_32.out1)
function_apply_3 = ApplyFunction(func=byJoinedCurves, arg1=perimeterCurves)
code_block_33 = CodeBlock(x=function_apply_3)  # same code as code_block_21
code_block_34 = CodeBlock { 1000; false; }
offset = PolyCurve.Offset(polyCurve=code_block_33.out1, signedDistance=code_block_34.out0, extendCircular=code_block_34.out1)
explode = Geometry.Explode(geometry=offset)
setCropBox = Orchid.RevitProject.Views.View.SetCropBox(view=byLine, curve=explode)
code_block_35 = CodeBlock(x=code_block_18.out1) { x[1]; }
setScale = View.SetScale(view=setCropBox, scale=code_block_35)
code_block_36 = CodeBlock { ["View Name","Title on Sheet"]; }
name_2 = Level.Name()  # unwired: level
activeView = Orchid.RevitProject.Common.Document.ActiveView()
viewlevel = Custom[© ViewLevel](views=activeView)  # package Crumple; Returns the associated level of a view (if it has one), as well as a boolean mask to remove views without levels after.
function_apply_4 = ApplyFunction(func=name_2, arg1=viewlevel.lvls)
code_block_37 = CodeBlock(x=code_block_18.out1) { x[0]; }
code_block_38 = CodeBlock { "Numeracion Viga"; }
getParameterValueByName_2 = Element.GetParameterValueByName(element=code_block_37, parameterName=code_block_38)
uniqueItems = List.UniqueItems(list=getParameterValueByName_2)
code_block_39 = CodeBlock(lvl=function_apply_4, num=uniqueItems)
# ---------- code_block_39.designscript (2 lines) ----------
["VH_CIELO "+lvl+"_EJE "+num,
"ELEV. VIGA CIELO "+lvl+",NUM. "+num];
# ----------------------------------------
setParameterByName = Element.SetParameterByName(element=setScale, parameterName=code_block_36, value=code_block_39, lacing=Longest)
flatten_2 = List.Flatten(list=setParameterByName)
uniqueItems_2 = List.UniqueItems(list=flatten_2)
all_elements_in_view_s = Custom[All Elements In View(s)](Views=uniqueItems_2)  # package Data-Shapes; Retrieves all visible element in a view or a set of views
code_block_40 = CodeBlock { "View Name"; }
exists = Orchid.RevitProject.Parameters.Parameter.Exists(parameterName=code_block_40, element=all_elements_in_view_s)
filterByBoolMask_2 = List.FilterByBoolMask(list=all_elements_in_view_s, mask=exists)
code_block_41 = CodeBlock { "Type"; }
getParameterValueByName_3 = Element.GetParameterValueByName(element=filterByBoolMask_2.in, parameterName=code_block_41)
name_3 = Orchid.RevitProject.Elements.ElementType.Name(elementType=getParameterValueByName_3)
code_block_42 = CodeBlock { "Building Section (03_VH)"; }
eq_4 = name_3 == code_block_42
filterByBoolMask_3 = List.FilterByBoolMask(list=filterByBoolMask_2.in, mask=eq_4)
hideElements = archilab.Revit.Views.Views.HideElements(view=uniqueItems_2, elements=filterByBoolMask_3.in)
code_block_43 = CodeBlock { null; }
replaceEmptyLists = Custom[List.ReplaceEmptyLists](seq=hideElements, Replacement=code_block_43)  # package Clockwork for Dynamo 2.x; Replaces all empty lists within a given list with a substitute
end = Revit.Transaction.Transaction.End(input=replaceEmptyLists)
code_block_44 = CodeBlock(x=end)
# ---------- code_block_44.designscript (13 lines) ----------
x;

[Imperative]
{
	if(x == null)
	{
		return = [];
	}
	else
	{
		return = "Section";
	}
};
# ----------------------------------------
getByType = archilab.Revit.Views.Views.GetByType(viewType=code_block_44.out1)
all_elements_in_view_s_2 = Custom[All Elements In View(s)](Views=getByType)
code_block_45 = CodeBlock { "View Name"; }
exists_2 = Orchid.RevitProject.Parameters.Parameter.Exists(parameterName=code_block_45, element=all_elements_in_view_s_2)
filterByBoolMask_4 = List.FilterByBoolMask(list=all_elements_in_view_s_2, mask=exists_2)
hideElements_2 = archilab.Revit.Views.Views.HideElements(view=getByType, elements=filterByBoolMask_4.in)
end_2 = Revit.Transaction.Transaction.End(input=setParameterByName)
flatten_3 = List.Flatten(list=end_2)
uniqueItems_3 = List.UniqueItems(list=flatten_3)
openView = Orchid.RevitProject.Common.Document.OpenView(view=uniqueItems_3)
all = Orchid.RevitProject.Views.View.All()
code_block_46 = CodeBlock { "Subclasificacion"; }
getParameterValueByName_4 = Element.GetParameterValueByName(element=all, parameterName=code_block_46)
code_block_47 = CodeBlock { "03_VH"; }
eq_5 = getParameterValueByName_4 == code_block_47
filterByBoolMask_5 = List.FilterByBoolMask(list=all, mask=eq_5)
viewType = archilab.Revit.Views.Views.ViewType(view=filterByBoolMask_5.in)
code_block_48 = CodeBlock { "CeilingPlan"; }
eq_6 = viewType == code_block_48
filterByBoolMask_6 = List.FilterByBoolMask(list=filterByBoolMask_5.in, mask=eq_6)
code_block_49 = CodeBlock { "Structural Framing"; }
byName_2 = Category.ByName(name=code_block_49)
all_elements_of_category = ElementsOfCategory(Category=byName_2)
code_block_50 = CodeBlock { "Numeracion Viga"; }
exists_3 = Orchid.RevitProject.Parameters.Parameter.Exists(parameterName=code_block_50, element=all_elements_of_category)
filterByBoolMask_7 = List.FilterByBoolMask(list=all_elements_of_category, mask=exists_3)
code_block_51 = CodeBlock { "Numeracion Viga"; }
getParameterValueByName_5 = Element.GetParameterValueByName(element=filterByBoolMask_7.in, parameterName=code_block_51)
code_block_52 = CodeBlock(x=code_block_18.out1) { x[0]; }
code_block_53 = CodeBlock { "Numeracion Viga"; }
getParameterValueByName_6 = Element.GetParameterValueByName(element=code_block_52, parameterName=code_block_53)
code_block_54 = CodeBlock { null; }
replaceEmptyLists_2 = Custom[List.ReplaceEmptyLists](seq=getParameterValueByName_6, Replacement=code_block_54)
eq_7 = getParameterValueByName_5@L1 == replaceEmptyLists_2@L2  # lacing=Longest
anyTrue_2 = Orchid.Common.List.AnyTrue(list=eq_7@L2)
filterByBoolMask_8 = List.FilterByBoolMask(list=filterByBoolMask_7.in, mask=anyTrue_2)
code_block_55 = CodeBlock { null; }
replaceEmptyLists_3 = Custom[List.ReplaceEmptyLists](seq=filterByBoolMask_8.in, Replacement=code_block_55)
fillpatterns = Custom[© FillPatterns]()  # package Crumple; Returns all fill patterns in a document.
code_block_56 = CodeBlock { "<Solid fill>"; }
eq_8 = fillpatterns.names == code_block_56
filterByBoolMask_9 = List.FilterByBoolMask(list=fillpatterns.elements, mask=eq_8)
firstItem = List.FirstItem(list=filterByBoolMask_9.in)
color_palette = ColorPalette({R: 255, G: 215, B: 0, A: 255})
create_overridegraphicsettings = Custom[Create OverrideGraphicSettings](SurfaceForegroundPattern=firstItem, SurfaceForegroundPatternColor=color_palette, SurfaceBackgroundPattern=firstItem, SurfaceBackgroundColor=color_palette, CutForegroundPattern=firstItem, CutForegroundPatternColor=color_palette, CutBackgroundPattern=firstItem, CutBackgroundPatternColor=color_palette)  # package Genius Loci; Create a OverrideGraphicSettings (All graphic inputs are optional). Unlike the OOTB OverrideGraphicSettings.ByProperties node, the Foreground and background patterns are available. Note : Prior to Revit 2019, the materials have only one surface pattern and one cut pattern.
view_setelementoverrides = Custom[View SetElementOverrides](view=filterByBoolMask_6.in@L1, elements=replaceEmptyLists_3@L2, overrides=create_overridegraphicsettings@L1, lacing=Longest)  # package Genius Loci; Overrides element graphics settings in the given view. For use with the Create OverrideGraphicSettings node. Can also be used to hide or unhide elements.
