# Dynamo graph elevacionVigaEje_script.dyn (Dynamo 2.12.1.8246)
# packages: Clockwork for Dynamo 2.x 2.4.0, Data-Shapes 2021.2.94, Orchid 200.4.0.7938, Crumple 2022.2.13, archi-lab.net 2022.210.2419, Data-Shapes 2022.2.103

code_block = CodeBlock { "Elevación Viga en Eje"; }
file_path = Filename("..\..\..\..\..\..\..\..\..\..\..\Arainco\Arainco.png")
code_block_2 = CodeBlock()
# ---------- code_block_2.designscript (10 lines) ----------
//buttonText
"INICIAR";
//buttonCancel
"CANCELAR";
//maxHeight

//width
440;
//label
180;
# ----------------------------------------
code_block_3 = CodeBlock { "Seleccionar Vigas:"; }
code_block_4 = CodeBlock { "SELECCIONAR"; }
code_block_5 = CodeBlock { "Structural Framing"; }
byName = Category.ByName(name=code_block_5)
selectmodelelements_data = Custom[SelectModelElements Data](InputName=code_block_3, ButtonText=code_block_4, CategoryFilter=byName)  # package Data-Shapes; Creates a Revit element selection input for UI.MultipleInputForm++ . Check out www.data-shapes.net for more infos!
code_block_6 = CodeBlock { "Seleccionar Eje:"; }
code_block_7 = CodeBlock { "SELECCIONAR"; }
code_block_8 = CodeBlock { "Grids"; }
byName_2 = Category.ByName(name=code_block_8)
code_block_9 = CodeBlock { true; }
selectmodelelements_data_2 = Custom[SelectModelElements Data](InputName=code_block_6, ButtonText=code_block_7, CategoryFilter=byName_2, SelectSingleElement=code_block_9)
code_block_10 = CodeBlock { "Escala:"; }
code_block_11 = CodeBlock()
# ---------- code_block_11.designscript (4 lines) ----------
[
"1:50",
"1:75"
];
# ----------------------------------------
code_block_12 = CodeBlock { ":"; }
split = String.Split(string=code_block_11, separator0=code_block_12)
code_block_13 = CodeBlock { 1; }
getItemAtIndex = List.GetItemAtIndex(list=split@L2, index=code_block_13)
toNumber = String.ToNumber(string=getItemAtIndex)
code_block_14 = CodeBlock { 0; false; }
dropdown_data = Custom[DropDown Data](InputName=code_block_10, Keys=code_block_11, Values=toNumber, DefaultValueIndex=code_block_14.out0, Sorted_optional=code_block_14.out1)  # package Data-Shapes; Create data for DropDown input in UI.MultiInputForm ++ . Check out www.data-shapes.net for more infos.
list_create = List.Create(item0=selectmodelelements_data, item1=selectmodelelements_data_2, item2=dropdown_data)
inputgroup_data = Custom[InputGroup Data](Inputs=list_create)  # package Data-Shapes; Creates a group of inputs for UI.MultipleInputForm ++ . Check out www.data-shapes.net for more infos !
boolean = BoolSelector(true)
multipleinputform = Custom[MultipleInputForm ++](Description_optional=code_block, Logo_optional=file_path, ButtonText_optional=code_block_2.out0, Inputs=inputgroup_data, Toggle=boolean, CancelButtonText_optional=code_block_2.out1, Width_optional=code_block_2.out2, LabelWidth_optional=code_block_2.out3)  # package Data-Shapes; Create a form with multiple inputs. see www.data-shapes.net for tutorials and infos!
code_block_15 = CodeBlock(x=multipleinputform.User_Inputs)
# ---------- code_block_15.designscript (13 lines) ----------
x;

[Imperative]
{
	if(x == null)
	{
		return = [[],[],[]];
	}
	else
	{
		return = x;
	}
};
# ----------------------------------------
code_block_16 = CodeBlock(x=code_block_15.out1) { x[0]; }
color_palette = ColorPalette({R: 0, G: 128, B: 0, A: 255})
overrideColorInView = Element.OverrideColorInView(element=code_block_16, color=color_palette)
byBestFitThroughPoints = Line.ByBestFitThroughPoints()  # unwired: bestFitPoints
code_block_17 = CodeBlock(x=code_block_15.out1) { x[0]; }
location = Custom[Element.Location+](element=code_block_17)  # package Clockwork for Dynamo 2.x; Returns the location of an element as point, curve or curve loop, along with some booleans to help filtering the results. Unlike the OOTB Element.GetLocation node, it also retunrs sketch lines of sketch-based elements like floor slabs as well as the element's rotation property.
code_block_18 = CodeBlock(x=location.curveEndpoints)
# ---------- code_block_18.designscript (13 lines) ----------
x;

[Imperative]
{
	if(x == null)
	{
		return = [[],[]];
	}
	else
	{
		return = x;
	}
};
# ----------------------------------------
flatten = List.Flatten(list=code_block_18.out1)
function_apply = ApplyFunction(func=byBestFitThroughPoints, arg1=flatten)
code_block_19 = CodeBlock(x=function_apply)
# ---------- code_block_19.designscript (13 lines) ----------
x;

[Imperative]
{
	if(x == null)
	{
		return = [];
	}
	else
	{
		return = x;
	}
};
# ----------------------------------------
direction = Line.Direction(line=code_block_19.out1)
code_block_20 = CodeBlock(x=direction) { x.X; }
code_block_21 = CodeBlock { 0; }
ge = code_block_20 >= code_block_21
reverse = Curve.Reverse(curve=code_block_19.out1)
scopeIf = Custom[ScopeIf+](test=ge, True=reverse, False=code_block_19.out1, lacing=Shortest)  # package Clockwork for Dynamo 2.x; A (hopefully) more robust implementation of ScopeIf. Tests a single boolean and returns a value accordingly.
direction_2 = Line.Direction(line=scopeIf)
normalized = Vector.Normalized(vector=direction_2)
code_block_22 = CodeBlock(x=normalized) { x.X; }
code_block_23 = CodeBlock { 0; }
eq = code_block_22 == code_block_23
code_block_24 = CodeBlock(x=normalized) { x.Y; }
code_block_25 = CodeBlock { 0; }
gt = code_block_24 > code_block_25
and_ = eq && gt
reverse_2 = Curve.Reverse(curve=scopeIf)
scopeIf_2 = Custom[ScopeIf+](test=and_, True=reverse_2, False=scopeIf, lacing=Shortest)
python_script = Python()  # IronPython2; unwired: IN[0]
# ---------- python_script.python (27 lines) ----------
#### IMPORTAR LIBRERIAS ####
import clr

clr.AddReference("RevitAPI")
from Autodesk.Revit.DB import *

clr.AddReference("RevitNodes")
import Revit
clr.ImportExtensions(Revit.GeometryConversion)

clr.AddReference("RevitServices")
import RevitServices
from RevitServices.Persistence import DocumentManager
from RevitServices.Transactions import TransactionManager

#### ACCESO AL DOCUMENTO ####
doc = DocumentManager.Instance.CurrentDBDocument

#### ASIGNAR INPUTS A VARIABLES ####
name = IN[0]

#### TRANSACCIONES ####

views = FilteredElementCollector(doc).OfClass(ViewFamilyType).ToElements()

#### RESULTADOS ####
OUT = views
# ----------------------------------------
name = Element.Name(element=python_script)
code_block_26 = CodeBlock { "Building Section (03_VH)"; }
eq_2 = name == code_block_26
filterByBoolMask = List.FilterByBoolMask(list=python_script, mask=eq_2)
code_block_27 = CodeBlock(X=filterByBoolMask.in) { X[0]; }
code_block_28 = CodeBlock()
# ---------- code_block_28.designscript (6 lines) ----------
//height
500;
//offset
300;
//depth
300;
# ----------------------------------------
byLine = Custom[ViewSection.ByLine](Curves=scopeIf_2, input=code_block_27, ViewSectionHeight=code_block_28.out0, OffsetFromLine=code_block_28.out1, Depth=code_block_28.out2)  # package Data-Shapes; Create ViewSections in current document from DS Lines.
byJoinedCurves = PolyCurve.ByJoinedCurves()  # unwired: curves
byLoft = Surface.ByLoft()  # unwired: crossSections
ZAxis = Vector.ZAxis()
code_block_29 = CodeBlock { [500,-500]; }
translate = Geometry.Translate(geometry=scopeIf_2, direction=ZAxis, distance=code_block_29)
function_apply_2 = ApplyFunction(func=byLoft, arg1=translate)
code_block_30 = CodeBlock(x=function_apply_2)  # same code as code_block_19
perimeterCurves = Surface.PerimeterCurves(surface=code_block_30.out1)
function_apply_3 = ApplyFunction(func=byJoinedCurves, arg1=perimeterCurves)
code_block_31 = CodeBlock(x=function_apply_3)  # same code as code_block_19
code_block_32 = CodeBlock { 1000; false; }
offset = PolyCurve.Offset(polyCurve=code_block_31.out1, signedDistance=code_block_32.out0, extendCircular=code_block_32.out1)
explode = Geometry.Explode(geometry=offset)
setCropBox = Orchid.RevitProject.Views.View.SetCropBox(view=byLine, curve=explode)
code_block_33 = CodeBlock(x=code_block_15.out1) { x[2]; }
setScale = View.SetScale(view=setCropBox, scale=code_block_33)
code_block_34 = CodeBlock { ["View Name","Title on Sheet"]; }
name_2 = Level.Name()  # unwired: level
activeView = Orchid.RevitProject.Common.Document.ActiveView()
viewlevel = Custom[© ViewLevel](views=activeView)  # package Crumple; Returns the associated level of a view (if it has one), as well as a boolean mask to remove views without levels after.
function_apply_4 = ApplyFunction(func=name_2, arg1=viewlevel.lvls)
code_block_35 = CodeBlock(x=code_block_15.out1) { x[1]; }
name_3 = Element.Name(element=code_block_35)
code_block_36 = CodeBlock(lvl=function_apply_4, gr=name_3)
# ---------- code_block_36.designscript (2 lines) ----------
["VH_CIELO "+lvl+"_EJE "+gr,
"ELEV. VIGA CIELO "+lvl+",EJE "+gr];
# ----------------------------------------
setParameterByName = Element.SetParameterByName(element=setScale, parameterName=code_block_34, value=code_block_36, lacing=Longest)
flatten_2 = List.Flatten(list=setParameterByName)
uniqueItems = List.UniqueItems(list=flatten_2)
all_elements_in_view_s = Custom[All Elements In View(s)](Views=uniqueItems)  # package Data-Shapes; Retrieves all visible element in a view or a set of views
code_block_37 = CodeBlock { "View Name"; }
exists = Orchid.RevitProject.Parameters.Parameter.Exists(parameterName=code_block_37, element=all_elements_in_view_s)
filterByBoolMask_2 = List.FilterByBoolMask(list=all_elements_in_view_s, mask=exists)
code_block_38 = CodeBlock { "Type"; }
getParameterValueByName = Element.GetParameterValueByName(element=filterByBoolMask_2.in, parameterName=code_block_38)
name_4 = Orchid.RevitProject.Elements.ElementType.Name(elementType=getParameterValueByName)
code_block_39 = CodeBlock { "Building Section (03_VH)"; }
eq_3 = name_4 == code_block_39
filterByBoolMask_3 = List.FilterByBoolMask(list=filterByBoolMask_2.in, mask=eq_3)
hideElements = archilab.Revit.Views.Views.HideElements(view=uniqueItems, elements=filterByBoolMask_3.in)
code_block_40 = CodeBlock { null; }
replaceEmptyLists = Custom[List.ReplaceEmptyLists](seq=hideElements, Replacement=code_block_40)  # package Clockwork for Dynamo 2.x; Replaces all empty lists within a given list with a substitute
end = Revit.Transaction.Transaction.End(input=replaceEmptyLists)
code_block_41 = CodeBlock(x=end)
# ---------- code_block_41.designscript (13 lines) ----------
x;

[Imperative]
{
	if(x == null)
	{
		return = [];
	}
	else
	{
		return = "Section";
	}
};
# ----------------------------------------
getByType = archilab.Revit.Views.Views.GetByType(viewType=code_block_41.out1)
all_elements_in_view_s_2 = Custom[All Elements In View(s)](Views=getByType)
code_block_42 = CodeBlock { "View Name"; }
exists_2 = Orchid.RevitProject.Parameters.Parameter.Exists(parameterName=code_block_42, element=all_elements_in_view_s_2)
filterByBoolMask_4 = List.FilterByBoolMask(list=all_elements_in_view_s_2, mask=exists_2)
hideElements_2 = archilab.Revit.Views.Views.HideElements(view=getByType, elements=filterByBoolMask_4.in)
end_2 = Revit.Transaction.Transaction.End(input=setParameterByName)
flatten_3 = List.Flatten(list=end_2)
uniqueItems_2 = List.UniqueItems(list=flatten_3)
openView = Orchid.RevitProject.Common.Document.OpenView(view=uniqueItems_2)
