# Dynamo graph elevacionColumNum_script.dyn (Dynamo 2.12.1.8246)
# packages: Clockwork for Dynamo 2.x 2.4.0, Orchid 200.4.0.7938, Data-Shapes 2021.2.94, Crumple 2022.2.13, BIM4Struc.Productivity 2.2.2, Genius Loci 2020.8.3, archi-lab.net 2022.210.2419, Genius Loci 2021.11.10, Data-Shapes 2022.2.103

code_block = CodeBlock { "Elevación Columna Numerada"; }
file_path = Filename("..\..\..\..\..\..\..\..\..\..\..\Arainco\Arainco.png")
code_block_2 = CodeBlock()
# ---------- code_block_2.designscript (10 lines) ----------
//buttonText
"INICIAR";
//buttonCancel
"CANCELAR";
//maxHeight

//width
440;
//label
180;
# ----------------------------------------
code_block_3 = CodeBlock { "Seleccionar una Columna Numerada:"; }
code_block_4 = CodeBlock { "SELECCIONAR"; }
code_block_5 = CodeBlock { "Structural Columns"; }
byName = Category.ByName(name=code_block_5)
code_block_6 = CodeBlock { true; }
selectmodelelements_data = Custom[SelectModelElements Data](InputName=code_block_3, ButtonText=code_block_4, CategoryFilter=byName, SelectSingleElement=code_block_6)  # package Data-Shapes; Creates a Revit element selection input for UI.MultipleInputForm++ . Check out www.data-shapes.net for more infos!
code_block_7 = CodeBlock { "Orientación Seccion:"; }
code_block_8 = CodeBlock { ["Horizontal","Vertical"]; [0,1]; }
code_block_9 = CodeBlock { 0; }
radiobuttons_data = Custom[RadioButtons Data](InputName=code_block_7, Keys=code_block_8.out0, Values=code_block_8.out1, DefaultValueIndex=code_block_9)  # package Data-Shapes; Create radio buttons input for UI.MultipleInputForm ++ .
code_block_10 = CodeBlock { "Escala:"; }
code_block_11 = CodeBlock()
# ---------- code_block_11.designscript (6 lines) ----------
[
"1:50",
"1:75",
"1:100",
"1:125"
];
# ----------------------------------------
code_block_12 = CodeBlock { ":"; }
split = String.Split(string=code_block_11, separator0=code_block_12)
code_block_13 = CodeBlock { 1; }
getItemAtIndex = List.GetItemAtIndex(list=split@L2, index=code_block_13)
toNumber = String.ToNumber(string=getItemAtIndex)
code_block_14 = CodeBlock { 0; false; }
dropdown_data = Custom[DropDown Data](InputName=code_block_10, Keys=code_block_11, Values=toNumber, DefaultValueIndex=code_block_14.out0, Sorted_optional=code_block_14.out1)  # package Data-Shapes; Create data for DropDown input in UI.MultiInputForm ++ . Check out www.data-shapes.net for more infos.
list_create = List.Create(item0=selectmodelelements_data, item1=radiobuttons_data, item2=dropdown_data)
inputgroup_data = Custom[InputGroup Data](Inputs=list_create)  # package Data-Shapes; Creates a group of inputs for UI.MultipleInputForm ++ . Check out www.data-shapes.net for more infos !
boolean = BoolSelector(true)
multipleinputform = Custom[MultipleInputForm ++](Description_optional=code_block, Logo_optional=file_path, ButtonText_optional=code_block_2.out0, Inputs=inputgroup_data, Toggle=boolean, CancelButtonText_optional=code_block_2.out1, Width_optional=code_block_2.out2, LabelWidth_optional=code_block_2.out3)  # package Data-Shapes; Create a form with multiple inputs. see www.data-shapes.net for tutorials and infos!
code_block_15 = CodeBlock(x=multipleinputform.User_Inputs)
# ---------- code_block_15.designscript (13 lines) ----------
x;

[Imperative]
{
	if(x == null)
	{
		return = [[],[],[]];
	}
	else
	{
		return = x;
	}
};
# ----------------------------------------
code_block_16 = CodeBlock(x=code_block_15.out1) { x[0]; }
code_block_17 = CodeBlock { "Numeracion Columna"; }
getParameterValueByName = Element.GetParameterValueByName(element=code_block_16, parameterName=code_block_17)
code_block_18 = CodeBlock { ""; }
eq = getParameterValueByName == code_block_18
anyTrue = Orchid.Common.List.AnyTrue(list=eq)
code_block_19 = CodeBlock(x=anyTrue, y=code_block_15.out1)
# ---------- code_block_19.designscript (14 lines) ----------
x;
y;

[Imperative]
{
	if(x == true)
	{
		return = null;
	}
	else
	{
		return = y;
	}
};
# ----------------------------------------
code_block_20 = CodeBlock(x=code_block_19.out2)  # same code as code_block_15
code_block_21 = CodeBlock(x=code_block_20.out1) { x[0]; }
code_block_22 = CodeBlock { "Column Style"; 1; }
setParameterByName = Element.SetParameterByName(element=code_block_21, parameterName=code_block_22.out0, value=code_block_22.out1)
geometry = Element.Geometry(element=setParameterByName)
flatten = List.Flatten(list=geometry)
location = Custom[Element.Location+](element=setParameterByName)  # package Clockwork for Dynamo 2.x; Returns the location of an element as point, curve or curve loop, along with some booleans to help filtering the results. Unlike the OOTB Element.GetLocation node, it also retunrs sketch lines of sketch-based elements like floor slabs as well as the element's rotation property.
code_block_23 = CodeBlock(x=location.curves)
# ---------- code_block_23.designscript (12 lines) ----------
x;
[Imperative]
{
	if(x == null)
	{
		return = [];
	}
	else
	{
		return = x;
	}
};
# ----------------------------------------
code_block_24 = CodeBlock { 0.5; }
pointAtParameter = Curve.PointAtParameter(curve=code_block_23.out1, param=code_block_24)
activeView = Orchid.RevitProject.Common.Document.ActiveView()
plane = Custom[View.Plane](view=activeView)  # package Clockwork for Dynamo 2.x; Retrieves the plane of a given view
normal = Plane.Normal(plane=plane)
byOriginNormal = Plane.ByOriginNormal(origin=pointAtParameter, normal=normal)
intersect = Geometry.Intersect(geometry=flatten, other=byOriginNormal)
await_ = Orchid.Common.DataStream.Await(pass=setParameterByName, waitFor=intersect)
code_block_25 = CodeBlock { "Column Style"; 0; }
setParameterByName_2 = Element.SetParameterByName(element=await_, parameterName=code_block_25.out0, value=code_block_25.out1)
code_block_26 = CodeBlock { "Error."; }
code_block_27 = CodeBlock(x=code_block_19.out2)
# ---------- code_block_27.designscript (12 lines) ----------
x;
[Imperative]
{
	if (x == null)
	{
		return = "La Columna seleccionada no tienen Numeración.\nLa Columna seleccionada debe haber sido numerada antes de ser elevada.";
	}
	else
	{
		return = [];
	}
};
# ----------------------------------------
uimessenger = Custom[© UIMessenger](title=code_block_26, body=code_block_27.out1)  # package Crumple; Displays a message box with a title/body and OK/cancel button. If OK is selected, the third input's data will be passed through.
all = Orchid.RevitProject.Views.View.All()
code_block_28 = CodeBlock { "Subclasificacion"; }
getParameterValueByName_2 = Element.GetParameterValueByName(element=all, parameterName=code_block_28)
code_block_29 = CodeBlock { "04_CH"; }
eq_2 = getParameterValueByName_2 == code_block_29
filterByBoolMask = List.FilterByBoolMask(list=all, mask=eq_2)
viewType = archilab.Revit.Views.Views.ViewType(view=filterByBoolMask.in)
code_block_30 = CodeBlock { "CeilingPlan"; }
eq_3 = viewType == code_block_30
filterByBoolMask_2 = List.FilterByBoolMask(list=filterByBoolMask.in, mask=eq_3)
code_block_31 = CodeBlock { "Structural Columns"; }
byName_2 = Category.ByName(name=code_block_31)
all_elements_of_category = ElementsOfCategory(Category=byName_2)
code_block_32 = CodeBlock { "Numeracion Columna"; }
exists = Orchid.RevitProject.Parameters.Parameter.Exists(parameterName=code_block_32, element=all_elements_of_category)
filterByBoolMask_3 = List.FilterByBoolMask(list=all_elements_of_category, mask=exists)
code_block_33 = CodeBlock { "Numeracion Columna"; }
getParameterValueByName_3 = Element.GetParameterValueByName(element=filterByBoolMask_3.in, parameterName=code_block_33)
code_block_34 = CodeBlock(x=code_block_20.out1) { x[0]; }
code_block_35 = CodeBlock { "Numeracion Columna"; }
getParameterValueByName_4 = Element.GetParameterValueByName(element=code_block_34, parameterName=code_block_35)
code_block_36 = CodeBlock { null; }
replaceEmptyLists = Custom[List.ReplaceEmptyLists](seq=getParameterValueByName_4, Replacement=code_block_36)  # package Clockwork for Dynamo 2.x; Replaces all empty lists within a given list with a substitute
eq_4 = getParameterValueByName_3@L1 == replaceEmptyLists@L2  # lacing=Longest
anyTrue_2 = Orchid.Common.List.AnyTrue(list=eq_4@L2)
filterByBoolMask_4 = List.FilterByBoolMask(list=filterByBoolMask_3.in, mask=anyTrue_2)
code_block_37 = CodeBlock { null; }
replaceEmptyLists_2 = Custom[List.ReplaceEmptyLists](seq=filterByBoolMask_4.in, Replacement=code_block_37)
fillpatterns = Custom[© FillPatterns]()  # package Crumple; Returns all fill patterns in a document.
code_block_38 = CodeBlock { "<Solid fill>"; }
eq_5 = fillpatterns.names == code_block_38
filterByBoolMask_5 = List.FilterByBoolMask(list=fillpatterns.elements, mask=eq_5)
firstItem = List.FirstItem(list=filterByBoolMask_5.in)
color_palette = ColorPalette({R: 46, G: 139, B: 87, A: 255})
create_overridegraphicsettings = Custom[Create OverrideGraphicSettings](SurfaceForegroundPattern=firstItem, SurfaceForegroundPatternColor=color_palette, SurfaceBackgroundPattern=firstItem, SurfaceBackgroundColor=color_palette, CutForegroundPattern=firstItem, CutForegroundPatternColor=color_palette, CutBackgroundPattern=firstItem, CutBackgroundPatternColor=color_palette)  # package Genius Loci; Create a OverrideGraphicSettings (All graphic inputs are optional). Unlike the OOTB OverrideGraphicSettings.ByProperties node, the Foreground and background patterns are available. Note : Prior to Revit 2019, the materials have only one surface pattern and one cut pattern.
view_setelementoverrides = Custom[View SetElementOverrides](view=filterByBoolMask_2.in@L1, elements=replaceEmptyLists_2@L2, overrides=create_overridegraphicsettings@L1, lacing=Longest)  # package Genius Loci; Overrides element graphics settings in the given view. For use with the Create OverrideGraphicSettings node. Can also be used to hide or unhide elements.
code_block_39 = CodeBlock { 0; }
code_block_40 = CodeBlock(x=code_block_20.out1) { x[1]; }
eq_6 = code_block_39 == code_block_40
byBestFitThroughPoints = Line.ByBestFitThroughPoints()  # unwired: bestFitPoints
byJoinedCurves = PolyCurve.ByJoinedCurves()  # unwired: curves
flatten_2 = List.Flatten(list=intersect)
perimeterCurves = Surface.PerimeterCurves(surface=flatten_2)
flatten_3 = List.Flatten(list=perimeterCurves)
function_apply = ApplyFunction(func=byJoinedCurves, arg1=flatten_3)
code_block_41 = CodeBlock(x=function_apply)  # same code as code_block_23
code_block_42 = CodeBlock { 1750; false; }
offset = PolyCurve.Offset(polyCurve=code_block_41.out1, signedDistance=code_block_42.out0, extendCircular=code_block_42.out1)
byPatch = Surface.ByPatch(closedCurve=offset)
code_block_43 = CodeBlock { [0,1]; [0.5,0.5]; }
pointAtParameter_2 = Surface.PointAtParameter(surface=byPatch, u=code_block_43.out0, v=code_block_43.out1, lacing=Longest)
flatten_4 = List.Flatten(list=pointAtParameter_2)
function_apply_2 = ApplyFunction(func=byBestFitThroughPoints, arg1=flatten_4)
byBestFitThroughPoints_2 = Line.ByBestFitThroughPoints()  # unwired: bestFitPoints
code_block_44 = CodeBlock { [0.5,0.5]; [0,1]; }
pointAtParameter_3 = Surface.PointAtParameter(surface=byPatch, u=code_block_44.out0, v=code_block_44.out1, lacing=Longest)
flatten_5 = List.Flatten(list=pointAtParameter_3)
function_apply_3 = ApplyFunction(func=byBestFitThroughPoints_2, arg1=flatten_5)
scopeIf = Custom[ScopeIf+](test=eq_6, True=function_apply_2, False=function_apply_3)  # package Clockwork for Dynamo 2.x; A (hopefully) more robust implementation of ScopeIf. Tests a single boolean and returns a value accordingly.
code_block_45 = CodeBlock(x=byOriginNormal) { x; }
rotationAngle = Custom[Element.RotationAngle](element=code_block_21)  # package BIM4Struc.Productivity; Get the rotation element of a Revit element. The rotation angle is based on the Location.Rotation property in the RevitAPI. If Location is not equal to a LocationPoint (ie. in case of slanted columns) then the Angle will be set to null.
flatten_6 = List.Flatten(list=rotationAngle)
rotate = Geometry.Rotate(geometry=scopeIf, basePlane=code_block_45, degrees=flatten_6)
code_block_46 = CodeBlock(x=rotate) { x; }
direction = Line.Direction(line=code_block_46)
code_block_47 = CodeBlock(x=direction) { x.X; }
code_block_48 = CodeBlock { 0; }
ge = code_block_47 >= code_block_48
reverse = Curve.Reverse(curve=code_block_46)
scopeIf_2 = Custom[ScopeIf+](test=ge, True=reverse, False=code_block_46, lacing=Shortest)
direction_2 = Line.Direction(line=scopeIf_2)
normalized = Vector.Normalized(vector=direction_2)
code_block_49 = CodeBlock(x=normalized) { x.X; }
code_block_50 = CodeBlock { 0; }
eq_7 = code_block_49 == code_block_50
code_block_51 = CodeBlock(x=normalized) { x.Y; }
code_block_52 = CodeBlock { 0; }
gt = code_block_51 > code_block_52
and_ = eq_7 && gt
reverse_2 = Curve.Reverse(curve=scopeIf_2)
scopeIf_3 = Custom[ScopeIf+](test=and_, True=reverse_2, False=scopeIf_2, lacing=Shortest)
code_block_53 = CodeBlock { "Levels"; }
byName_3 = Category.ByName(name=code_block_53)
all_elements_of_category_2 = ElementsOfCategory(Category=byName_3)
elevation = Level.Elevation(level=all_elements_of_category_2)
minimumItem = List.MinimumItem(list=elevation)
eq_8 = elevation == minimumItem
filterByBoolMask_6 = List.FilterByBoolMask(list=all_elements_of_category_2, mask=eq_8)
plane_2 = Custom[Level.Plane](level=filterByBoolMask_6.in)  # package Clockwork for Dynamo 2.x; Retrieves the plane of a given level
pullOntoPlane = Curve.PullOntoPlane(curve=scopeIf_3, plane=plane_2)
ZAxis = Vector.ZAxis()
code_block_54 = CodeBlock { -3000; }
translate = Geometry.Translate(geometry=pullOntoPlane, direction=ZAxis, distance=code_block_54, lacing=Longest)
python_script = Python()  # IronPython2; unwired: IN[0]
# ---------- python_script.python (27 lines) ----------
#### IMPORTAR LIBRERIAS ####
import clr

clr.AddReference("RevitAPI")
from Autodesk.Revit.DB import *

clr.AddReference("RevitNodes")
import Revit
clr.ImportExtensions(Revit.GeometryConversion)

clr.AddReference("RevitServices")
import RevitServices
from RevitServices.Persistence import DocumentManager
from RevitServices.Transactions import TransactionManager

#### ACCESO AL DOCUMENTO ####
doc = DocumentManager.Instance.CurrentDBDocument

#### ASIGNAR INPUTS A VARIABLES ####
name = IN[0]

#### TRANSACCIONES ####

views = FilteredElementCollector(doc).OfClass(ViewFamilyType).ToElements()

#### RESULTADOS ####
OUT = views
# ----------------------------------------
name = Element.Name(element=python_script)
code_block_55 = CodeBlock { "Building Section (04_CH)"; }
eq_9 = name == code_block_55
filterByBoolMask_7 = List.FilterByBoolMask(list=python_script, mask=eq_9)
code_block_56 = CodeBlock(X=filterByBoolMask_7.in) { X[0]; }
code_block_57 = CodeBlock { 0.5; }
pointAtParameter_4 = Curve.PointAtParameter(curve=translate, param=code_block_57)
code_block_58 = CodeBlock { "Levels"; }
byName_4 = Category.ByName(name=code_block_58)
all_elements_of_category_3 = ElementsOfCategory(Category=byName_4)
elevation_2 = Level.Elevation(level=all_elements_of_category_3)
maximumItem = List.MaximumItem(list=elevation_2)
eq_10 = elevation_2 == maximumItem
filterByBoolMask_8 = List.FilterByBoolMask(list=all_elements_of_category_3, mask=eq_10)
plane_3 = Custom[Level.Plane](level=filterByBoolMask_8.in)
pullOntoPlane_2 = Curve.PullOntoPlane(curve=scopeIf_3, plane=plane_3)
ZAxis_2 = Vector.ZAxis()
code_block_59 = CodeBlock { 3000; }
translate_2 = Geometry.Translate(geometry=pullOntoPlane_2, direction=ZAxis_2, distance=code_block_59, lacing=Longest)
code_block_60 = CodeBlock { 0.5; }
pointAtParameter_5 = Curve.PointAtParameter(curve=translate_2, param=code_block_60)
distanceTo = Geometry.DistanceTo(geometry=pointAtParameter_4, other=pointAtParameter_5)
code_block_61 = CodeBlock { null; }
replaceEmptyLists_3 = Custom[List.ReplaceEmptyLists](seq=distanceTo, Replacement=code_block_61)
code_block_62 = CodeBlock(x=replaceEmptyLists_3)
# ---------- code_block_62.designscript (12 lines) ----------
x;
[Imperative]
{
	if(x == null)
	{
		return = [[]];
	}
	else
	{
		return = x;
	}
};
# ----------------------------------------
code_block_63 = CodeBlock(h=code_block_62.out1)
# ---------- code_block_63.designscript (6 lines) ----------
//height
h[0];
//offset
300;
//depth
300;
# ----------------------------------------
byLine = Custom[ViewSection.ByLine](Curves=translate, input=code_block_56, ViewSectionHeight=code_block_63.out0, OffsetFromLine=code_block_63.out1, Depth=code_block_63.out2)  # package Data-Shapes; Create ViewSections in current document from DS Lines.
code_block_64 = CodeBlock(x=code_block_20.out1) { x[2]; }
setScale = View.SetScale(view=byLine, scale=code_block_64)
code_block_65 = CodeBlock()
# ---------- code_block_65.designscript (4 lines) ----------
[
"View Name",
"Title on Sheet"
];
# ----------------------------------------
code_block_66 = CodeBlock(x=code_block_20.out1) { x[0]; }
code_block_67 = CodeBlock { "Numeracion Columna"; }
getParameterValueByName_5 = Element.GetParameterValueByName(element=code_block_66, parameterName=code_block_67)
code_block_68 = CodeBlock(num=getParameterValueByName_5) { DSCore.List.Flatten(["CH_COLUMNA P"+num,"ELEV. PILAR P"+num],1); }
setParameterByName_3 = Element.SetParameterByName(element=setScale@L1, parameterName=code_block_65@L2, value=code_block_68@L2, lacing=Longest)
flatten_7 = List.Flatten(list=setParameterByName_3)
uniqueItems = List.UniqueItems(list=flatten_7)
all_elements_in_view_s = Custom[All Elements In View(s)](Views=uniqueItems)  # package Data-Shapes; Retrieves all visible element in a view or a set of views
code_block_69 = CodeBlock { "View Name"; }
exists_2 = Orchid.RevitProject.Parameters.Parameter.Exists(parameterName=code_block_69, element=all_elements_in_view_s)
filterByBoolMask_9 = List.FilterByBoolMask(list=all_elements_in_view_s, mask=exists_2)
code_block_70 = CodeBlock { "Type"; }
getParameterValueByName_6 = Element.GetParameterValueByName(element=filterByBoolMask_9.in, parameterName=code_block_70)
name_2 = Orchid.RevitProject.Elements.ElementType.Name(elementType=getParameterValueByName_6)
code_block_71 = CodeBlock { "Building Section (04_CH)"; }
eq_11 = name_2 == code_block_71
filterByBoolMask_10 = List.FilterByBoolMask(list=filterByBoolMask_9.in, mask=eq_11)
hideElements = archilab.Revit.Views.Views.HideElements(view=uniqueItems, elements=filterByBoolMask_10.in)
code_block_72 = CodeBlock { null; }
replaceEmptyLists_4 = Custom[List.ReplaceEmptyLists](seq=hideElements, Replacement=code_block_72)
end = Revit.Transaction.Transaction.End(input=replaceEmptyLists_4)
code_block_73 = CodeBlock(x=end)
# ---------- code_block_73.designscript (13 lines) ----------
x;

[Imperative]
{
	if(x == null)
	{
		return = [];
	}
	else
	{
		return = "Section";
	}
};
# ----------------------------------------
getByType = archilab.Revit.Views.Views.GetByType(viewType=code_block_73.out1)
all_elements_in_view_s_2 = Custom[All Elements In View(s)](Views=getByType)
code_block_74 = CodeBlock { "View Name"; }
exists_3 = Orchid.RevitProject.Parameters.Parameter.Exists(parameterName=code_block_74, element=all_elements_in_view_s_2)
filterByBoolMask_11 = List.FilterByBoolMask(list=all_elements_in_view_s_2, mask=exists_3)
hideElements_2 = archilab.Revit.Views.Views.HideElements(view=getByType, elements=filterByBoolMask_11.in)
end_2 = Revit.Transaction.Transaction.End(input=uniqueItems)
start = Revit.Transaction.Transaction.Start(input=end_2)
code_block_75 = CodeBlock { null; }
replaceEmptyLists_5 = Custom[List.ReplaceEmptyLists](seq=start, Replacement=code_block_75)
code_block_76 = CodeBlock(x=replaceEmptyLists_5)
# ---------- code_block_76.designscript (12 lines) ----------
x;
[Imperative]
{
	if(x == null)
	{
		return = [];
	}
	else
	{
		return = x[0];
	}
};
# ----------------------------------------
code_block_77 = CodeBlock(x=code_block_76.out1) { x; }
byLoft = Surface.ByLoft()  # unwired: crossSections
getCropBox = Orchid.RevitProject.Views.View.GetCropBox(view=code_block_76.out1)
code_block_78 = CodeBlock { null; }
replaceEmptyLists_6 = Custom[List.ReplaceEmptyLists](seq=getCropBox.Curve, Replacement=code_block_78)
code_block_79 = CodeBlock(x=replaceEmptyLists_6)
# ---------- code_block_79.designscript (12 lines) ----------
x;
[Imperative]
{
	if(x == null)
	{
		return = [];
	}
	else
	{
		return = x[1];
	}
};
# ----------------------------------------
code_block_80 = CodeBlock()
# ---------- code_block_80.designscript (6 lines) ----------
[
"Structural Columns",
"Structural Framing",
"Floors",
"Walls"
];
# ----------------------------------------
byName_5 = Category.ByName(name=code_block_80)
all_elements_of_category_in_view = ElementsOfCategoryInView(Category=byName_5, View=code_block_76.out1)
flatten_8 = List.Flatten(list=all_elements_of_category_in_view)
element_level = Custom[Element Level](element=flatten_8)  # package Genius Loci; Gets an element's level. Based on a Clockwork's node
uniqueItems_2 = List.UniqueItems(list=element_level)
elevation_3 = Level.Elevation(level=uniqueItems_2)
maximumItem_2 = List.MaximumItem(list=elevation_3)
eq_12 = elevation_3 == maximumItem_2
filterByBoolMask_12 = List.FilterByBoolMask(list=uniqueItems_2, mask=eq_12)
plane_bylevel = Custom[Plane ByLevel](level=filterByBoolMask_12.in)  # package Genius Loci; Constructs a Plane from a level.
pullOntoPlane_3 = Curve.PullOntoPlane(curve=code_block_79.out1, plane=plane_bylevel)
ZAxis_3 = Vector.ZAxis()
code_block_81 = CodeBlock { 1500; }
translate_3 = Geometry.Translate(geometry=pullOntoPlane_3, direction=ZAxis_3, distance=code_block_81)
code_block_82 = CodeBlock(x=replaceEmptyLists_6)
# ---------- code_block_82.designscript (12 lines) ----------
x;
[Imperative]
{
	if(x == null)
	{
		return = [];
	}
	else
	{
		return = x[3];
	}
};
# ----------------------------------------
list_create_2 = List.Create(item0=translate_3, item1=code_block_82.out1)
flatten_9 = List.Flatten(list=list_create_2)
function_apply_4 = ApplyFunction(func=byLoft, arg1=flatten_9)
code_block_83 = CodeBlock(x=function_apply_4)  # same code as code_block_23
perimeterCurves_2 = Surface.PerimeterCurves(surface=code_block_83.out1)
setCropBox = Orchid.RevitProject.Views.View.SetCropBox(view=code_block_77, curve=perimeterCurves_2)
openView = Orchid.RevitProject.Common.Document.OpenView(view=setCropBox)
