# Dynamo graph contornoBreak_script.dyn (Dynamo 2.12.1.8246)
# packages: archi-lab.net 2022.210.2419, Clockwork for Dynamo 2.x 2.4.0, Orchid 200.4.0.7938

activeView = Orchid.RevitProject.Common.Document.ActiveView()
code_block = CodeBlock(x=activeView) { x; }

# group: Redibujar Contorno
code_block_2 = CodeBlock(x=code_block) { x; }
plane = Custom[View.Plane](view=code_block_2)  # package Clockwork for Dynamo 2.x; Retrieves the plane of a given view
normal = Plane.Normal(plane=plane)
code_block_3 = CodeBlock(t2=code_block_2) { t1 = Revit.Elements.Element.GetParameterValueByName(t2, "Far Clip Offset"); t3 = t1 / 2; t4 = t3 * -1; }
translate = Geometry.Translate(geometry=plane, direction=normal, distance=code_block_3.t4)
byUnion = Solid.ByUnion()  # unwired: solids
code_block_4 = CodeBlock()
# ---------- code_block_4.designscript (6 lines) ----------
["Floors",
"Structural Framing",
"Walls",
"Structural Foundations",
"Structural Columns"
];
# ----------------------------------------
byName = Category.ByName(name=code_block_4)
all_elements_of_category_in_view = ElementsOfCategoryInView(Category=byName, View=code_block_2)
flatten = List.Flatten(list=all_elements_of_category_in_view)
solids = Element.Solids(element=flatten)
flatten_2 = List.Flatten(list=solids)
function_apply = ApplyFunction(func=byUnion, arg1=flatten_2)
intersect = Geometry.Intersect(geometry=translate, other=function_apply)
perimeterCurves = Surface.PerimeterCurves(surface=intersect)
flatten_3 = List.Flatten(list=perimeterCurves)
byCurve = Custom[DetailCurve.ByCurve+](curve=flatten_3, view=code_block_2)  # package Clockwork for Dynamo 2.x; Creates a detail line based on a given curve. Unlike the OOTB node it can also draw circles.
code_block_5 = CodeBlock { "Line Style"; }
code_block_6 = CodeBlock { "<Wide Lines>"; }
get_line_style_by_name = Custom[Get Line Style by Name](name=code_block_6)  # package archi-lab.net; This node will return a line style object by its name. Line styles can be either Drafting or Model Line Property.
setParameterByName = Element.SetParameterByName(element=byCurve, parameterName=code_block_5, value=get_line_style_by_name, lacing=Longest)

await_ = Orchid.Common.DataStream.Await(pass=code_block, waitFor=setParameterByName)

# group: Breaklines
byLoft = Surface.ByLoft()  # unwired: crossSections
translate_2 = Geometry.Translate(lacing=Longest)  # unwired: geometry, direction, distance
byJoinedCurves = PolyCurve.ByJoinedCurves()  # unwired: curves
code_block_7 = CodeBlock(x=await_) { x; }
code_block_8 = CodeBlock(x=code_block_7) { x; }
getCropBox = Orchid.RevitProject.Views.View.GetCropBox(view=code_block_8)
function_apply_2 = ApplyFunction(func=byJoinedCurves, arg1=getCropBox.Curve)
code_block_9 = CodeBlock(x=function_apply_2)
# ---------- code_block_9.designscript (13 lines) ----------
x;

[Imperative]
{
	if(x == null)
	{
		return = [];
	}
	else
	{
		return = x;
	}
};
# ----------------------------------------
code_block_10 = CodeBlock { -290; false; }
offset = PolyCurve.Offset(polyCurve=code_block_9.out1, signedDistance=code_block_10.out0, extendCircular=code_block_10.out1)
plane_2 = Custom[View.Plane](view=code_block_8)
normal_2 = Plane.Normal(plane=plane_2)
reverse = Vector.Reverse(vector=normal_2)
list_create = List.Create(item0=normal_2, item1=reverse)
code_block_11 = CodeBlock { 1000; }
function_apply_3 = ApplyFunction(func=translate_2, arg1=offset, arg2=list_create, arg3=code_block_11)
function_apply_4 = ApplyFunction(func=byLoft, arg1=function_apply_3)
byUnion_2 = Solid.ByUnion()  # unwired: solids
code_block_12 = CodeBlock()
# ---------- code_block_12.designscript (6 lines) ----------
[
"Walls",
"Structural Columns",
"Structural Framing",
"Floors"
];
# ----------------------------------------
byName_2 = Category.ByName(name=code_block_12)
all_elements_of_category_in_view_2 = ElementsOfCategoryInView(Category=byName_2, View=code_block_8)
geometry = Element.Geometry(element=all_elements_of_category_in_view_2)
flatten_4 = List.Flatten(list=geometry)
function_apply_5 = ApplyFunction(func=byUnion_2, arg1=flatten_4)
code_block_13 = CodeBlock(x=function_apply_5)  # same code as code_block_9
intersect_2 = Geometry.Intersect(geometry=function_apply_4, other=code_block_13.out1)
code_block_14 = CodeBlock { [0.5,0.5]; [0,1]; }
pointAtParameter = Surface.PointAtParameter(surface=intersect_2@L1, u=code_block_14.out1@L2, v=code_block_14.out0@L2, lacing=Longest)
transpose = List.Transpose(lists=pointAtParameter)
code_block_15 = CodeBlock { null; }
replaceEmptyLists = Custom[List.ReplaceEmptyLists](seq=transpose, Replacement=code_block_15)  # package Clockwork for Dynamo 2.x; Replaces all empty lists within a given list with a substitute
code_block_16 = CodeBlock(x=replaceEmptyLists)
# ---------- code_block_16.designscript (13 lines) ----------
x;

[Imperative]
{
	if(x == null)
	{
		return = [[],[]];
	}
	else
	{
		return = x;
	}
};
# ----------------------------------------
code_block_17 = CodeBlock(x=code_block_16.out1) { x[0]; x[1]; }
byStartPointEndPoint = Line.ByStartPointEndPoint(startPoint=code_block_17.out0, endPoint=code_block_17.out1)
reverse_2 = Curve.Reverse(curve=byStartPointEndPoint)
code_block_18 = CodeBlock(x=code_block_7) { x; }
plane_3 = Custom[View.Plane](view=code_block_18)
pullOntoPlane = Curve.PullOntoPlane(curve=reverse_2, plane=plane_3)
code_block_19 = CodeBlock { "EST_D_BREAKLINE"; }
byName_3 = FamilyType.ByName(name=code_block_19)
byCurve_2 = Custom[DetailComponent.ByCurve](curve=pullOntoPlane, familyType=byName_3, view=code_block_18, lacing=Longest)  # package Clockwork for Dynamo 2.x; Places a line-based detail component in a given view
code_block_20 = CodeBlock { "Length of masking region"; 900; }
setParameterByName_2 = Element.SetParameterByName(element=byCurve_2, parameterName=code_block_20.out0, value=code_block_20.out1)
code_block_21 = CodeBlock(x=code_block_7) { x; }
plane_4 = Custom[View.Plane](view=code_block_21)
normal_3 = Plane.Normal(plane=plane_4)
X = Vector.X(vector=normal_3)
byPatch = Surface.ByPatch(closedCurve=offset)
code_block_22 = CodeBlock { 0.5; }
normalAtParameter = Surface.NormalAtParameter(surface=byPatch, u=code_block_22, v=code_block_22)
X_2 = Vector.X(vector=normalAtParameter)
eq = X == X_2
