# Dynamo graph hideRevisionCloudsMultiple_script.dyn (Dynamo 2.3.2.15696)
# packages: Data-Shapes 2021.2.94, archi-lab.net 2022.210.2419

code_block = CodeBlock { "Ocultar Nubes"; }
code_block_2 = CodeBlock { "INICIAR"; "CANCELAR"; 100; 500; 900; }
code_block_3 = CodeBlock { "Niveles"; }
code_block_4 = CodeBlock { "-"; }
code_block_5 = CodeBlock { "Sheets"; }
byName = Category.ByName(name=code_block_5)
all_elements_of_category = ElementsOfCategory(Category=byName)
name = Element.Name(element=all_elements_of_category)
code_block_6 = CodeBlock { "SPLASH SCREEN"; }
eq = name == code_block_6
filterByBoolMask = List.FilterByBoolMask(list=all_elements_of_category, mask=eq)
sheetNumber = Sheet.SheetNumber(sheet=filterByBoolMask.out)
sortByKey = List.SortByKey(list=filterByBoolMask.out, keys=sheetNumber)
sheetNumber_2 = Sheet.SheetNumber(sheet=sortByKey.sorted_list)
sheetName = Sheet.SheetName(sheet=sortByKey.sorted_list)
list_create = List.Create(item0=sheetNumber_2, item1=sheetName)
transpose = List.Transpose(lists=list_create)
join = String.Join(separator=code_block_4, string0=transpose, lacing=Longest)
code_block_7 = CodeBlock { 580; false; true; }
listview_data = Custom[Listview Data](InputName=code_block_3, Keys=join, Values=sortByKey.sorted_list, Height_optionnal=code_block_7.out0, ShowElementCount_optionnal=code_block_7.out2, SortItems_optionnal=code_block_7.out1, ShowId_optionnal=code_block_7.out1)  # package Data-Shapes; Create data for ListView input in UI.MultiInputForm ++ . Check out www.data-shapes.net for more infos.
boolean = BoolSelector(true)
multipleinputform = Custom[MultipleInputForm ++](Description_optional=code_block, ButtonText_optional=code_block_2.out0, Inputs=listview_data, Toggle=boolean, CancelButtonText_optional=code_block_2.out1, MaxHeight_optional=code_block_2.out4, Width_optional=code_block_2.out3, LabelWidth_optional=code_block_2.out2)  # package Data-Shapes; Create a form with multiple inputs. see www.data-shapes.net for tutorials and infos!
code_block_8 = CodeBlock(x=multipleinputform.User_Inputs)
# ---------- code_block_8.designscript (12 lines) ----------
x;
[Imperative]
{
	if(x == null)
	{
		return = [];
	}
	else
	{
		return = x;
	}
};
# ----------------------------------------
code_block_9 = CodeBlock { "Revision Clouds"; }
byName_2 = Category.ByName(name=code_block_9)
all_elements_of_category_in_view = ElementsOfCategoryInView(Category=byName_2, View=code_block_8.out1)
hideElements = archilab.Revit.Views.Views.HideElements(view=code_block_8.out1@L1, elements=all_elements_of_category_in_view@L2, lacing=Longest)
