# Dynamo graph script.dyn (Dynamo 2.3.2.15696)
# packages: Orchid 200.4.0.7938

code_block = CodeBlock { "Structural Framing"; }
byName = Category.ByName(name=code_block)
activeView = Orchid.RevitProject.Common.Document.ActiveView()
all_elements_of_category_in_view = ElementsOfCategoryInView(Category=byName, View=activeView)
code_block_2 = CodeBlock(x=all_elements_of_category_in_view) { x; }
code_block_3 = CodeBlock { "End Join Cutback"; }
exists = Orchid.RevitProject.Parameters.Parameter.Exists(parameterName=code_block_3, element=code_block_2)
filterByBoolMask = List.FilterByBoolMask(list=code_block_2, mask=exists)
code_block_4 = CodeBlock { 0; }
setParameterByName = Element.SetParameterByName(element=filterByBoolMask.in, parameterName=code_block_3, value=code_block_4)
code_block_5 = CodeBlock(x=all_elements_of_category_in_view) { x; }
code_block_6 = CodeBlock { "Start Join Cutback"; }
exists_2 = Orchid.RevitProject.Parameters.Parameter.Exists(parameterName=code_block_6, element=code_block_5)
filterByBoolMask_2 = List.FilterByBoolMask(list=code_block_5, mask=exists_2)
code_block_7 = CodeBlock { 0; }
setParameterByName_2 = Element.SetParameterByName(element=filterByBoolMask_2.in, parameterName=code_block_6, value=code_block_7)
