# Dynamo graph ejes2D_script.dyn "niveles2D_script" (Dynamo 2.3.1.11775)
# packages: Genius Loci 2021.11.10, Orchid 200.4.0.7938

code_block = CodeBlock { "Grids"; }
byName = Category.ByName(name=code_block)
activeView = Orchid.RevitProject.Common.Document.ActiveView()
all_elements_of_category_in_view = ElementsOfCategoryInView(Category=byName, View=activeView)
activeView_2 = Orchid.RevitProject.Common.Document.ActiveView()
enumerate_datum_extent_type = Custom[Enumerate Datum Extent Type]()  # package Genius Loci; Enumerate Datum Extent Type : Model (3D extent) or ViewSpecific (2D extent). For use with "Switch between 2D or 3D extent" node.
switch_between_2d_or_3d_extent = Custom[Switch between 2D or 3D extent](element=all_elements_of_category_in_view@L2, view=activeView_2, DatumExtentType=enumerate_datum_extent_type.2D_extent)  # package Genius Loci; Switch the extents of grid and level from 2d to 3d or vice versa. For use with "Enumerate Datum Extent Type" node.
