# Dynamo graph asdf.dyn (Dynamo 2.3.1.11775)
# packages: Crumple 2022.2.13, Clockwork for Dynamo 2.x 2.4.0

currentselection = Custom[© CurrentSelection]()  # package Crumple; Returns all elements currently selected by the user in the active document when this node ran.
location = Custom[Element.Location+](element=currentselection)  # package Clockwork for Dynamo 2.x; Returns the location of an element as point, curve or curve loop, along with some booleans to help filtering the results. Unlike the OOTB Element.GetLocation node, it also retunrs sketch lines of sketch-based elements like floor slabs as well as the element's rotation property.
watch = Watch(location.curveEndpoints)
flatten = List.Flatten(list=watch)
byBestFitThroughPoints = Line.ByBestFitThroughPoints(bestFitPoints=flatten)
boolean = BoolSelector(true)
currentselection_2 = Custom[© CurrentSelection](refresh=boolean)
location_2 = Custom[Element.Location+](element=currentselection_2)
watch_2 = Watch(location_2.curveEndpoints)
flatten_2 = List.Flatten(list=watch_2)
byBestFitThroughPoints_2 = Line.ByBestFitThroughPoints(bestFitPoints=flatten_2)
boolean_2 = BoolSelector(true)
currentselection_3 = Custom[© CurrentSelection](refresh=boolean_2)
location_3 = Custom[Element.Location+](element=currentselection_3)
flatten_3 = List.Flatten(list=location_3.curveEndpoints)
byBestFitThroughPoints_3 = Line.ByBestFitThroughPoints(bestFitPoints=flatten_3)
