# Dynamo graph elevacionEje_script.dyn (Dynamo 2.3.1.11775)
# packages: Clockwork for Dynamo 2.x 2.4.0, Orchid 200.4.0.7938, Data-Shapes 2021.2.94, Crumple 2022.2.13

byBestFitThroughPoints = Line.ByBestFitThroughPoints()  # unwired: bestFitPoints
code_block = CodeBlock { "Elevación Viga en Eje"; }
code_block_2 = CodeBlock()
# ---------- code_block_2.designscript (10 lines) ----------
//buttonText
"INICIAR";
//buttonCancel
"CANCELAR";
//maxHeight

//width
440;
//label
180;
# ----------------------------------------
code_block_3 = CodeBlock { "Seleccionar Vigas:"; }
code_block_4 = CodeBlock { "SELECCIONAR"; }
code_block_5 = CodeBlock { "Structural Framing"; }
byName = Category.ByName(name=code_block_5)
selectmodelelements_data_ordered = Custom[SelectModelElements Data (ordered)](InputName=code_block_3, ButtonText=code_block_4, CategoryFilter=byName)  # package Data-Shapes; Creates a Revit element selection input for UI.MultipleInputForm++ . Check out www.data-shapes.net for more infos!
code_block_6 = CodeBlock { "Seleccionar Eje:"; }
code_block_7 = CodeBlock { "SELECCIONAR"; }
code_block_8 = CodeBlock { "Grids"; }
byName_2 = Category.ByName(name=code_block_8)
code_block_9 = CodeBlock { true; }
selectmodelelements_data = Custom[SelectModelElements Data](InputName=code_block_6, ButtonText=code_block_7, CategoryFilter=byName_2, SelectSingleElement=code_block_9)  # package Data-Shapes; Creates a Revit element selection input for UI.MultipleInputForm++ . Check out www.data-shapes.net for more infos!
code_block_10 = CodeBlock { "Escala:"; }
code_block_11 = CodeBlock()
# ---------- code_block_11.designscript (6 lines) ----------
[
"1:50",
"1:75",
"1:100",
"1:125"
];
# ----------------------------------------
code_block_12 = CodeBlock { ":"; }
split = String.Split(str=code_block_11, separator0=code_block_12)
code_block_13 = CodeBlock { 1; }
getItemAtIndex = List.GetItemAtIndex(list=split@L2, index=code_block_13)
toNumber = String.ToNumber(str=getItemAtIndex)
code_block_14 = CodeBlock { 0; false; }
dropdown_data = Custom[DropDown Data](InputName=code_block_10, Keys=code_block_11, Values=toNumber, DefaultValueIndex=code_block_14.out0, Sorted_optional=code_block_14.out1)  # package Data-Shapes; Create data for DropDown input in UI.MultiInputForm ++ . Check out www.data-shapes.net for more infos.
list_create = List.Create(item0=selectmodelelements_data_ordered, item1=selectmodelelements_data, item2=dropdown_data)
inputgroup_data = Custom[InputGroup Data](Inputs=list_create)  # package Data-Shapes; Creates a group of inputs for UI.MultipleInputForm ++ . Check out www.data-shapes.net for more infos !
boolean = BoolSelector(true)
multipleinputform = Custom[MultipleInputForm ++](Description_optional=code_block, ButtonText_optional=code_block_2.out0, Inputs=inputgroup_data, Toggle=boolean, CancelButtonText_optional=code_block_2.out1, Width_optional=code_block_2.out2, LabelWidth_optional=code_block_2.out3)  # package Data-Shapes; Create a form with multiple inputs. see www.data-shapes.net for tutorials and infos!
code_block_15 = CodeBlock(x=multipleinputform.User_Inputs)
# ---------- code_block_15.designscript (13 lines) ----------
x;

[Imperative]
{
	if(x == null)
	{
		return = [[],[],[]];
	}
	else
	{
		return = x;
	}
};
# ----------------------------------------
code_block_16 = CodeBlock(x=code_block_15.out1) { x[0]; }
location = Custom[Element.Location+](element=code_block_16)  # package Clockwork for Dynamo 2.x; Returns the location of an element as point, curve or curve loop, along with some booleans to help filtering the results. Unlike the OOTB Element.GetLocation node, it also retunrs sketch lines of sketch-based elements like floor slabs as well as the element's rotation property.
code_block_17 = CodeBlock(x=location.curveEndpoints)
# ---------- code_block_17.designscript (13 lines) ----------
x;

[Imperative]
{
	if(x == null)
	{
		return = [[],[]];
	}
	else
	{
		return = x;
	}
};
# ----------------------------------------
flatten = List.Flatten(list=code_block_17.out1)
function_apply = ApplyFunction(func=byBestFitThroughPoints, arg1=flatten)
code_block_18 = CodeBlock(x=function_apply)
# ---------- code_block_18.designscript (13 lines) ----------
x;

[Imperative]
{
	if(x == null)
	{
		return = [];
	}
	else
	{
		return = x;
	}
};
# ----------------------------------------
direction = Line.Direction(line=code_block_18.out1)
normalized = Vector.Normalized(vector=direction)
code_block_19 = CodeBlock(p=normalized) { p.X; }
code_block_20 = CodeBlock { 2; }
round = Math.Round(number=code_block_19, digits=code_block_20)
code_block_21 = CodeBlock { 0; }
eq = round == code_block_21
code_block_22 = CodeBlock(p=normalized) { p.Y; }
code_block_23 = CodeBlock { 2; }
round_2 = Math.Round(number=code_block_22, digits=code_block_23)
code_block_24 = CodeBlock { -1; }
eq_2 = round_2 == code_block_24
and_ = eq && eq_2
reverse = Curve.Reverse(curve=code_block_18.out1)
scopeIf = Custom[ScopeIf+](test=and_, True=code_block_18.out1, False=reverse, lacing=Shortest)  # package Clockwork for Dynamo 2.x; A (hopefully) more robust implementation of ScopeIf. Tests a single boolean and returns a value accordingly.
code_block_25 = CodeBlock { "Building Section (03_VH)"; }
byName_3 = Orchid.RevitProject.Views.ViewType.ByName(name=code_block_25)
code_block_26 = CodeBlock()
# ---------- code_block_26.designscript (6 lines) ----------
//height
500;
//offset
300;
//depth
300;
# ----------------------------------------
byLine = Custom[ViewSection.ByLine](Curves=scopeIf, ViewFamilyType=byName_3, ViewSectionHeight=code_block_26.out0, OffsetFromLine=code_block_26.out1, Depth=code_block_26.out2)  # package Data-Shapes; Create ViewSections in current document from DS Lines.
byJoinedCurves = PolyCurve.ByJoinedCurves()  # unwired: curves
byLoft = Surface.ByLoft()  # unwired: crossSections
ZAxis = Vector.ZAxis()
code_block_27 = CodeBlock { [500,-500]; }
translate = Geometry.Translate(geometry=scopeIf, direction=ZAxis, distance=code_block_27)
function_apply_2 = ApplyFunction(func=byLoft, arg1=translate)
code_block_28 = CodeBlock(x=function_apply_2)  # same code as code_block_18
perimeterCurves = Surface.PerimeterCurves(surface=code_block_28.out1)
function_apply_3 = ApplyFunction(func=byJoinedCurves, arg1=perimeterCurves)
code_block_29 = CodeBlock(x=function_apply_3)  # same code as code_block_18
code_block_30 = CodeBlock { 1000; false; }
offset = PolyCurve.Offset(polyCurve=code_block_29.out1, signedDistance=code_block_30.out0, extendCircular=code_block_30.out1)
explode = Geometry.Explode(geometry=offset)
setCropBox = Orchid.RevitProject.Views.View.SetCropBox(view=byLine, curve=explode)
code_block_31 = CodeBlock(x=code_block_15.out1) { x[2]; }
setScale = View.SetScale(view=setCropBox, scale=code_block_31)
code_block_32 = CodeBlock { ["View Name","Title on Sheet"]; }
activeView = Orchid.RevitProject.Common.Document.ActiveView()
viewlevel = Custom[© ViewLevel](views=activeView)  # package Crumple; Returns the associated level of a view (if it has one), as well as a boolean mask to remove views without levels after.
name = Level.Name(level=viewlevel.lvls)
code_block_33 = CodeBlock(x=code_block_15.out1) { x[1]; }
name_2 = Element.Name(element=code_block_33)
code_block_34 = CodeBlock(lvl=name, gr=name_2)
# ---------- code_block_34.designscript (2 lines) ----------
["VH_CIELO "+lvl+"_EJE "+gr,
"ELEV. VIGA CIELO "+lvl+",EJE "+gr];
# ----------------------------------------
setParameterByName = Element.SetParameterByName(element=setScale, parameterName=code_block_32, value=code_block_34, lacing=Longest)
code_block_35 = CodeBlock(x=code_block_15.out1) { x[0]; }
color_palette = ColorPalette({R: 0, G: 128, B: 0, A: 255})
overrideColorInView = Element.OverrideColorInView(element=code_block_35, color=color_palette)
