# Dynamo graph elevacionVigaEje_script.dyn (Dynamo 2.3.2.15696)
# packages: Clockwork for Dynamo 2.x 2.4.0, Orchid 200.4.0.7938, Data-Shapes 2021.2.94, Crumple 2022.2.13, archi-lab.net 2022.210.2419, Genius Loci 2020.8.3, Genius Loci 2021.11.10

code_block = CodeBlock { "Elevación Viga en Eje"; }
code_block_2 = CodeBlock()
# ---------- code_block_2.designscript (10 lines) ----------
//buttonText
"INICIAR";
//buttonCancel
"CANCELAR";
//maxHeight

//width
440;
//label
180;
# ----------------------------------------
code_block_3 = CodeBlock { "Seleccionar Vigas:"; }
code_block_4 = CodeBlock { "SELECCIONAR"; }
code_block_5 = CodeBlock { "Structural Framing"; }
byName = Category.ByName(name=code_block_5)
selectmodelelements_data_ordered = Custom[SelectModelElements Data (ordered)](InputName=code_block_3, ButtonText=code_block_4, CategoryFilter=byName)  # package Data-Shapes; Creates a Revit element selection input for UI.MultipleInputForm++ . Check out www.data-shapes.net for more infos!
code_block_6 = CodeBlock { "Seleccionar Eje:"; }
code_block_7 = CodeBlock { "SELECCIONAR"; }
code_block_8 = CodeBlock { "Grids"; }
byName_2 = Category.ByName(name=code_block_8)
code_block_9 = CodeBlock { true; }
selectmodelelements_data = Custom[SelectModelElements Data](InputName=code_block_6, ButtonText=code_block_7, CategoryFilter=byName_2, SelectSingleElement=code_block_9)  # package Data-Shapes; Creates a Revit element selection input for UI.MultipleInputForm++ . Check out www.data-shapes.net for more infos!
code_block_10 = CodeBlock { "Escala:"; }
code_block_11 = CodeBlock()
# ---------- code_block_11.designscript (4 lines) ----------
[
"1:50",
"1:75"
];
# ----------------------------------------
code_block_12 = CodeBlock { ":"; }
split = String.Split(str=code_block_11, separator0=code_block_12)
code_block_13 = CodeBlock { 1; }
getItemAtIndex = List.GetItemAtIndex(list=split@L2, index=code_block_13)
toNumber = String.ToNumber(str=getItemAtIndex)
code_block_14 = CodeBlock { 0; false; }
dropdown_data = Custom[DropDown Data](InputName=code_block_10, Keys=code_block_11, Values=toNumber, DefaultValueIndex=code_block_14.out0, Sorted_optional=code_block_14.out1)  # package Data-Shapes; Create data for DropDown input in UI.MultiInputForm ++ . Check out www.data-shapes.net for more infos.
list_create = List.Create(item0=selectmodelelements_data_ordered, item1=selectmodelelements_data, item2=dropdown_data)
inputgroup_data = Custom[InputGroup Data](Inputs=list_create)  # package Data-Shapes; Creates a group of inputs for UI.MultipleInputForm ++ . Check out www.data-shapes.net for more infos !
boolean = BoolSelector(true)
multipleinputform = Custom[MultipleInputForm ++](Description_optional=code_block, ButtonText_optional=code_block_2.out0, Inputs=inputgroup_data, Toggle=boolean, CancelButtonText_optional=code_block_2.out1, Width_optional=code_block_2.out2, LabelWidth_optional=code_block_2.out3)  # package Data-Shapes; Create a form with multiple inputs. see www.data-shapes.net for tutorials and infos!
code_block_15 = CodeBlock(x=multipleinputform.User_Inputs)
# ---------- code_block_15.designscript (13 lines) ----------
x;

[Imperative]
{
	if(x == null)
	{
		return = [[],[],[]];
	}
	else
	{
		return = x;
	}
};
# ----------------------------------------
code_block_16 = CodeBlock(x=code_block_15.out1) { x[0]; }
color_palette = ColorPalette({R: 0, G: 128, B: 0, A: 255})
overrideColorInView = Element.OverrideColorInView(element=code_block_16, color=color_palette)
byBestFitThroughPoints = Line.ByBestFitThroughPoints()  # unwired: bestFitPoints
code_block_17 = CodeBlock(x=code_block_15.out1) { x[0]; }
location = Custom[Element.Location+](element=code_block_17)  # package Clockwork for Dynamo 2.x; Returns the location of an element as point, curve or curve loop, along with some booleans to help filtering the results. Unlike the OOTB Element.GetLocation node, it also retunrs sketch lines of sketch-based elements like floor slabs as well as the element's rotation property.
code_block_18 = CodeBlock(x=location.curveEndpoints)
# ---------- code_block_18.designscript (13 lines) ----------
x;

[Imperative]
{
	if(x == null)
	{
		return = [[],[]];
	}
	else
	{
		return = x;
	}
};
# ----------------------------------------
flatten = List.Flatten(list=code_block_18.out1)
function_apply = ApplyFunction(func=byBestFitThroughPoints, arg1=flatten)
code_block_19 = CodeBlock(x=function_apply)
# ---------- code_block_19.designscript (13 lines) ----------
x;

[Imperative]
{
	if(x == null)
	{
		return = [];
	}
	else
	{
		return = x;
	}
};
# ----------------------------------------
direction = Line.Direction(line=code_block_19.out1)
code_block_20 = CodeBlock(x=direction) { x.X; }
code_block_21 = CodeBlock { 0; }
ge = code_block_20 >= code_block_21
reverse = Curve.Reverse(curve=code_block_19.out1)
scopeIf = Custom[ScopeIf+](test=ge, True=reverse, False=code_block_19.out1, lacing=Shortest)  # package Clockwork for Dynamo 2.x; A (hopefully) more robust implementation of ScopeIf. Tests a single boolean and returns a value accordingly.
direction_2 = Line.Direction(line=scopeIf)
normalized = Vector.Normalized(vector=direction_2)
code_block_22 = CodeBlock(x=normalized) { x.X; }
code_block_23 = CodeBlock { 0; }
eq = code_block_22 == code_block_23
code_block_24 = CodeBlock(x=normalized) { x.Y; }
code_block_25 = CodeBlock { 0; }
gt = code_block_24 > code_block_25
and_ = eq && gt
reverse_2 = Curve.Reverse(curve=scopeIf)
scopeIf_2 = Custom[ScopeIf+](test=and_, True=reverse_2, False=scopeIf, lacing=Shortest)
code_block_26 = CodeBlock { "Building Section (03_VH)"; }
byName_3 = Orchid.RevitProject.Views.ViewType.ByName(name=code_block_26)
code_block_27 = CodeBlock()
# ---------- code_block_27.designscript (6 lines) ----------
//height
500;
//offset
300;
//depth
300;
# ----------------------------------------
byLine = Custom[ViewSection.ByLine](Curves=scopeIf_2, ViewFamilyType=byName_3, ViewSectionHeight=code_block_27.out0, OffsetFromLine=code_block_27.out1, Depth=code_block_27.out2)  # package Data-Shapes; Create ViewSections in current document from DS Lines.
byJoinedCurves = PolyCurve.ByJoinedCurves()  # unwired: curves
byLoft = Surface.ByLoft()  # unwired: crossSections
ZAxis = Vector.ZAxis()
code_block_28 = CodeBlock { [500,-500]; }
translate = Geometry.Translate(geometry=scopeIf_2, direction=ZAxis, distance=code_block_28)
function_apply_2 = ApplyFunction(func=byLoft, arg1=translate)
code_block_29 = CodeBlock(x=function_apply_2)  # same code as code_block_19
perimeterCurves = Surface.PerimeterCurves(surface=code_block_29.out1)
function_apply_3 = ApplyFunction(func=byJoinedCurves, arg1=perimeterCurves)
code_block_30 = CodeBlock(x=function_apply_3)  # same code as code_block_19
code_block_31 = CodeBlock { 1000; false; }
offset = PolyCurve.Offset(polyCurve=code_block_30.out1, signedDistance=code_block_31.out0, extendCircular=code_block_31.out1)
explode = Geometry.Explode(geometry=offset)
setCropBox = Orchid.RevitProject.Views.View.SetCropBox(view=byLine, curve=explode)
code_block_32 = CodeBlock(x=code_block_15.out1) { x[2]; }
setScale = View.SetScale(view=setCropBox, scale=code_block_32)
code_block_33 = CodeBlock { ["View Name","Title on Sheet"]; }
name = Level.Name()  # unwired: level
activeView = Orchid.RevitProject.Common.Document.ActiveView()
viewlevel = Custom[© ViewLevel](views=activeView)  # package Crumple; Returns the associated level of a view (if it has one), as well as a boolean mask to remove views without levels after.
function_apply_4 = ApplyFunction(func=name, arg1=viewlevel.lvls)
code_block_34 = CodeBlock(x=code_block_15.out1) { x[1]; }
name_2 = Element.Name(element=code_block_34)
code_block_35 = CodeBlock(lvl=function_apply_4, gr=name_2)
# ---------- code_block_35.designscript (2 lines) ----------
["VH_CIELO "+lvl+"_EJE "+gr,
"ELEV. VIGA CIELO "+lvl+",EJE "+gr];
# ----------------------------------------
setParameterByName = Element.SetParameterByName(element=setScale, parameterName=code_block_33, value=code_block_35, lacing=Longest)
end = Revit.Transaction.Transaction.End(input=setParameterByName)
flatten_2 = List.Flatten(list=end)
uniqueItems = List.UniqueItems(list=flatten_2)
openView = Orchid.RevitProject.Common.Document.OpenView(view=uniqueItems)
code_block_36 = CodeBlock(x=openView) { x; }

# group: Etiqueta Vigas Hormigon
activeView_2 = Orchid.RevitProject.Common.Document.ActiveView()
code_block_37 = CodeBlock(x=code_block_36) { x; }
code_block_38 = CodeBlock { null; }
replaceEmptyLists = Custom[List.ReplaceEmptyLists](seq=code_block_37, Replacement=code_block_38)  # package Clockwork for Dynamo 2.x; Replaces all empty lists within a given list with a substitute
code_block_39 = CodeBlock(x=replaceEmptyLists)  # same code as code_block_18
code_block_40 = CodeBlock(x=code_block_39.out1) { x[0]; }
code_block_41 = CodeBlock { "Structural Framing"; }
byName_4 = Category.ByName(name=code_block_41)
all_elements_of_category_in_view = ElementsOfCategoryInView(Category=byName_4, View=code_block_40)
familyName = Orchid.RevitProject.Elements.Element.FamilyName(element=all_elements_of_category_in_view)
code_block_42 = CodeBlock()
# ---------- code_block_42.designscript (6 lines) ----------
[
"EST_M_STRUCTURAL FRAMING_VIGA INVERTIDA",
"EST_M_STRUCTURAL FRAMING_VIGA SEMI INVERTIDA",
"EST_M_STRUCTURAL FRAMING_VIGA TRADICIONAL",
"EST_M_STRUCTURAL FRAMING_VIGA FUNDACION"
];
# ----------------------------------------
eq_2 = familyName@L1 == code_block_42
anyTrue = Orchid.Common.List.AnyTrue(list=eq_2)
filterByBoolMask = List.FilterByBoolMask(list=all_elements_of_category_in_view, mask=anyTrue)
location_2 = Custom[Element.Location+](element=filterByBoolMask.in)
code_block_43 = CodeBlock(x=location_2.curves)
# ---------- code_block_43.designscript (12 lines) ----------
x;
[Imperative]
{
	if(x == null)
	{
		return = [];
	}
	else
	{
		return = x;
	}
};
# ----------------------------------------
direction_3 = Line.Direction(line=code_block_43.out1)
code_block_44 = CodeBlock(x=code_block_39.out1) { x[0]; }
plane = Custom[View.Plane](view=code_block_44)  # package Clockwork for Dynamo 2.x; Retrieves the plane of a given view
isParallelToPlane = Custom[Vector.IsParallelToPlane](vector=direction_3, plane=plane)  # package Clockwork for Dynamo 2.x; Checks if a given vector is parallel to a given plane
filterByBoolMask_2 = List.FilterByBoolMask(list=filterByBoolMask.in, mask=isParallelToPlane)
element_taggedstatus = Custom[Element TaggedStatus](element=filterByBoolMask_2.in)  # package Genius Loci; Identify the tagged and untagged elements. Please note : This doesn't work with areas and spaces.
elementcentroid = Custom[© ElementCentroid](element=element_taggedstatus.NotTagged)  # package Crumple; Returns the centroid of the element's axis-aligned bounding box.
location_3 = Custom[Element.Location+](element=element_taggedstatus.NotTagged)
code_block_45 = CodeBlock(x=location_3.curves)  # same code as code_block_43
code_block_46 = CodeBlock { 0.5; }
planeAtParameter = Curve.PlaneAtParameter(curve=code_block_45.out1, param=code_block_46)
code_block_47 = CodeBlock { 0.5; }
pointAtParameter = Curve.PointAtParameter(curve=code_block_45.out1, param=code_block_47)
plane_2 = Custom[View.Plane](view=code_block_44)
normal = Plane.Normal(plane=plane_2)
code_block_48 = CodeBlock { 90; }
rotate = Geometry.Rotate(geometry=planeAtParameter, origin=pointAtParameter, axis=normal, degrees=code_block_48)
normal_2 = Plane.Normal(plane=rotate)
code_block_49 = CodeBlock(z=normal_2) { z.Z; }
code_block_50 = CodeBlock { 0; }
gt_2 = code_block_49 > code_block_50
code_block_51 = CodeBlock { -1; }
ne = code_block_49 != code_block_51
and_2 = gt_2 && ne
reverse_3 = Vector.Reverse(vector=normal_2)
scopeIf_3 = Custom[ScopeIf+](test=and_2, True=normal_2, False=reverse_3, lacing=Shortest)
code_block_52 = CodeBlock(x=element_taggedstatus.NotTagged) { Revit.Elements.Element.GetParameterValueByName(Revit.Elements.Element.GetParameterValueByName(x,"Type"),"Height")/2; }
translate_2 = Geometry.Translate(geometry=elementcentroid, direction=scopeIf_3, distance=code_block_52)
list_create_2 = List.Create(item0=elementcentroid, item1=translate_2)
transpose = List.Transpose(lists=list_create_2)
byElementAndLocation = Tag.ByElementAndLocation(view=code_block_40@L1, element=element_taggedstatus.NotTagged@L1, location=transpose@L2, lacing=Longest)
transpose_2 = List.Transpose(lists=byElementAndLocation)
code_block_53 = CodeBlock { null; }
replaceEmptyLists_2 = Custom[List.ReplaceEmptyLists](seq=transpose_2, Replacement=code_block_53)
code_block_54 = CodeBlock(x=replaceEmptyLists_2)
# ---------- code_block_54.designscript (12 lines) ----------
x;
[Imperative]
{
	if(x == null)
	{
		return = [[],[]];
	}
	else
	{
		return = x;
	}
};
# ----------------------------------------
code_block_55 = CodeBlock(x=code_block_54.out1) { x[1]; }
code_block_56 = CodeBlock { "Type"; }
code_block_57 = CodeBlock { "EST_A_STRUCTURAL FRAMING TAG_ELEVACION"; }
byName_5 = Orchid.RevitProject.Elements.Family.ByName(name=code_block_57)
code_block_58 = CodeBlock { "Tag Viga"; }
byFamilyAndName = FamilyType.ByFamilyAndName(family=byName_5, name=code_block_58)
setParameterByName_2 = Element.SetParameterByName(element=code_block_55, parameterName=code_block_56, value=byFamilyAndName)
code_block_59 = CodeBlock(x=code_block_54.out1) { x[0]; }
code_block_60 = CodeBlock { "Type"; }
code_block_61 = CodeBlock { "EST_A_STRUCTURAL FRAMING TAG_ELEVACION_ESTRIBO Y LATERAL"; }
byName_6 = Orchid.RevitProject.Elements.Family.ByName(name=code_block_61)
code_block_62 = CodeBlock { "Estribo Simple y Laterales"; }
byFamilyAndName_2 = FamilyType.ByFamilyAndName(family=byName_6, name=code_block_62)
setParameterByName_3 = Element.SetParameterByName(element=code_block_59, parameterName=code_block_60, value=byFamilyAndName_2)

flatten_3 = List.Flatten(list=setParameterByName)
uniqueItems_2 = List.UniqueItems(list=flatten_3)
all_elements_in_view_s = Custom[All Elements In View(s)](Views=uniqueItems_2)  # package Data-Shapes; Retrieves all visible element in a view or a set of views
code_block_63 = CodeBlock { "View Name"; }
exists = Orchid.RevitProject.Parameters.Parameter.Exists(parameterName=code_block_63, element=all_elements_in_view_s)
filterByBoolMask_3 = List.FilterByBoolMask(list=all_elements_in_view_s, mask=exists)
code_block_64 = CodeBlock { "Type"; }
getParameterValueByName = Element.GetParameterValueByName(element=filterByBoolMask_3.in, parameterName=code_block_64)
name_3 = Orchid.RevitProject.Elements.ElementType.Name(elementType=getParameterValueByName)
code_block_65 = CodeBlock { "Building Section (03_VH)"; }
eq_3 = name_3 == code_block_65
filterByBoolMask_4 = List.FilterByBoolMask(list=filterByBoolMask_3.in, mask=eq_3)
hideElements = archilab.Revit.Views.Views.HideElements(view=uniqueItems_2, elements=filterByBoolMask_4.in)
code_block_66 = CodeBlock { null; }
replaceEmptyLists_3 = Custom[List.ReplaceEmptyLists](seq=hideElements, Replacement=code_block_66)
end_2 = Revit.Transaction.Transaction.End(input=replaceEmptyLists_3)
code_block_67 = CodeBlock(x=end_2)
# ---------- code_block_67.designscript (13 lines) ----------
x;

[Imperative]
{
	if(x == null)
	{
		return = [];
	}
	else
	{
		return = "Section";
	}
};
# ----------------------------------------
getByType = archilab.Revit.Views.Views.GetByType(viewType=code_block_67.out1)
all_elements_in_view_s_2 = Custom[All Elements In View(s)](Views=getByType)
code_block_68 = CodeBlock { "View Name"; }
exists_2 = Orchid.RevitProject.Parameters.Parameter.Exists(parameterName=code_block_68, element=all_elements_in_view_s_2)
filterByBoolMask_5 = List.FilterByBoolMask(list=all_elements_in_view_s_2, mask=exists_2)
hideElements_2 = archilab.Revit.Views.Views.HideElements(view=getByType, elements=filterByBoolMask_5.in)

# group: Cota Parcial entre EJes
code_block_69 = CodeBlock { null; }
replaceEmptyLists_4 = Custom[List.ReplaceEmptyLists](seq=code_block_36, Replacement=code_block_69)
code_block_70 = CodeBlock(x=replaceEmptyLists_4)  # same code as code_block_18
code_block_71 = CodeBlock(x=code_block_70.out1) { x[0]; }
code_block_72 = CodeBlock { "Grids"; }
byName_7 = Category.ByName(name=code_block_72)
code_block_73 = CodeBlock(x=code_block_70.out1) { x[0]; }
all_elements_of_category_in_view_2 = ElementsOfCategoryInView(Category=byName_7, View=code_block_73)
getCropBox = Orchid.RevitProject.Views.View.GetCropBox(view=code_block_73)
code_block_74 = CodeBlock { null; }
replaceEmptyLists_5 = Custom[List.ReplaceEmptyLists](seq=getCropBox.Curve, Replacement=code_block_74)
code_block_75 = CodeBlock(x=replaceEmptyLists_5)
# ---------- code_block_75.designscript (13 lines) ----------
x;

[Imperative]
{
	if(x == null)
	{
		return = [[],[],[],[]];
	}
	else
	{
		return = x;
	}
};
# ----------------------------------------
code_block_76 = CodeBlock(x=code_block_75.out1) { x[3]; }
ZAxis_2 = Vector.ZAxis()
code_block_77 = CodeBlock { ["50","75"]; [700,1050]; }
byKeysValues = DesignScript.Builtin.Dictionary.ByKeysValues(keys=code_block_77.out0, values=code_block_77.out1)
code_block_78 = CodeBlock(x=code_block_70.out1) { x[0]; }
scale = Custom[View.Scale](view=code_block_78)  # package Clockwork for Dynamo 2.x; Returns the scale of a given view
string_from_object = FromObject(obj=scale)
valueAtKey = DesignScript.Builtin.Dictionary.ValueAtKey(dictionary=byKeysValues, key=string_from_object)
translate_3 = Geometry.Translate(geometry=code_block_76, direction=ZAxis_2, distance=valueAtKey)
byElements = Dimension.ByElements(view=code_block_71, referenceElements=all_elements_of_category_in_view_2, line=translate_3)

# group: Breaklines
byLoft_2 = Surface.ByLoft()  # unwired: crossSections
translate_4 = Geometry.Translate(lacing=Longest)  # unwired: geometry, direction, distance
byJoinedCurves_2 = PolyCurve.ByJoinedCurves()  # unwired: curves
code_block_79 = CodeBlock { null; }
replaceEmptyLists_6 = Custom[List.ReplaceEmptyLists](seq=code_block_36, Replacement=code_block_79)
code_block_80 = CodeBlock(x=replaceEmptyLists_6)  # same code as code_block_18
code_block_81 = CodeBlock(x=code_block_80.out1) { x[0]; }
getCropBox_2 = Orchid.RevitProject.Views.View.GetCropBox(view=code_block_81)
function_apply_5 = ApplyFunction(func=byJoinedCurves_2, arg1=getCropBox_2.Curve)
code_block_82 = CodeBlock(x=function_apply_5)  # same code as code_block_19
code_block_83 = CodeBlock { -290; false; }
offset_2 = PolyCurve.Offset(polyCurve=code_block_82.out1, signedDistance=code_block_83.out0, extendCircular=code_block_83.out1)
plane_3 = Custom[View.Plane](view=code_block_81)
normal_3 = Plane.Normal(plane=plane_3)
reverse_4 = Vector.Reverse(vector=normal_3)
list_create_3 = List.Create(item0=normal_3, item1=reverse_4)
code_block_84 = CodeBlock { 1000; }
function_apply_6 = ApplyFunction(func=translate_4, arg1=offset_2, arg2=list_create_3, arg3=code_block_84)
function_apply_7 = ApplyFunction(func=byLoft_2, arg1=function_apply_6)
byUnion = Solid.ByUnion()  # unwired: solids
code_block_85 = CodeBlock()
# ---------- code_block_85.designscript (6 lines) ----------
[
"Walls",
"Structural Columns",
"Structural Framing",
"Floors"
];
# ----------------------------------------
byName_8 = Category.ByName(name=code_block_85)
all_elements_of_category_in_view_3 = ElementsOfCategoryInView(Category=byName_8, View=code_block_81)
geometry = Element.Geometry(element=all_elements_of_category_in_view_3)
flatten_4 = List.Flatten(list=geometry)
function_apply_8 = ApplyFunction(func=byUnion, arg1=flatten_4)
code_block_86 = CodeBlock(x=function_apply_8)  # same code as code_block_19
intersect = Geometry.Intersect(geometry=function_apply_7, other=code_block_86.out1)
code_block_87 = CodeBlock { [0.5,0.5]; [0,1]; }
pointAtParameter_2 = Surface.PointAtParameter(surface=intersect@L1, u=code_block_87.out1@L2, v=code_block_87.out0@L2, lacing=Longest)
transpose_3 = List.Transpose(lists=pointAtParameter_2)
code_block_88 = CodeBlock { null; }
replaceEmptyLists_7 = Custom[List.ReplaceEmptyLists](seq=transpose_3, Replacement=code_block_88)
code_block_89 = CodeBlock(x=replaceEmptyLists_7)  # same code as code_block_18
code_block_90 = CodeBlock(x=code_block_89.out1) { x[0]; x[1]; }
byStartPointEndPoint = Line.ByStartPointEndPoint(startPoint=code_block_90.out0, endPoint=code_block_90.out1)
code_block_91 = CodeBlock(x=code_block_80.out1) { x[0]; }
plane_4 = Custom[View.Plane](view=code_block_91)
pullOntoPlane = Curve.PullOntoPlane(curve=byStartPointEndPoint, plane=plane_4)
code_block_92 = CodeBlock { "EST_D_BREAKLINE"; }
byName_9 = FamilyType.ByName(name=code_block_92)
byCurve = Custom[DetailComponent.ByCurve](curve=pullOntoPlane, familyType=byName_9, view=code_block_91, lacing=Longest)  # package Clockwork for Dynamo 2.x; Places a line-based detail component in a given view
code_block_93 = CodeBlock { "Length of masking region"; 900; }
setParameterByName_4 = Element.SetParameterByName(element=byCurve, parameterName=code_block_93.out0, value=code_block_93.out1)
code_block_94 = CodeBlock(x=code_block_80.out1) { x[0]; }
plane_5 = Custom[View.Plane](view=code_block_94)
normal_4 = Plane.Normal(plane=plane_5)
X = Vector.X(vector=normal_4)
byPatch = Surface.ByPatch(closedCurve=offset_2)
code_block_95 = CodeBlock { 0.5; }
normalAtParameter = Surface.NormalAtParameter(surface=byPatch, u=code_block_95, v=code_block_95)
X_2 = Vector.X(vector=normalAtParameter)
eq_4 = X == X_2
reverse_5 = Curve.Reverse(curve=byStartPointEndPoint)
scopeIf_4 = Custom[ScopeIf+](test=eq_4, True=byStartPointEndPoint, False=reverse_5)

# group: Overrides Vigas Hormigon en Corte
code_block_96 = CodeBlock { null; }
replaceEmptyLists_8 = Custom[List.ReplaceEmptyLists](seq=openView, Replacement=code_block_96)
code_block_97 = CodeBlock(x=replaceEmptyLists_8)
# ---------- code_block_97.designscript (13 lines) ----------
x;

[Imperative]
{
	if(x == null)
	{
		return = [];
	}
	else
	{
		return = x[0];
	}
};
# ----------------------------------------
code_block_98 = CodeBlock(x=code_block_97.out1) { x; }
code_block_99 = CodeBlock { "Structural Framing"; }
byName_10 = Category.ByName(name=code_block_99)
all_elements_of_category_in_view_4 = ElementsOfCategoryInView(Category=byName_10, View=code_block_98)
familyName_2 = Orchid.RevitProject.Elements.Element.FamilyName(element=all_elements_of_category_in_view_4)
code_block_100 = CodeBlock()  # same code as code_block_42
eq_5 = familyName_2@L1 == code_block_100
anyTrue_2 = Orchid.Common.List.AnyTrue(list=eq_5)
filterByBoolMask_6 = List.FilterByBoolMask(list=all_elements_of_category_in_view_4, mask=anyTrue_2)
code_block_101 = CodeBlock(x=code_block_97.out1) { x; }
code_block_102 = CodeBlock { null; }
replaceEmptyLists_9 = Custom[List.ReplaceEmptyLists](seq=code_block_101, Replacement=code_block_102)
code_block_103 = CodeBlock(x=replaceEmptyLists_9)
# ---------- code_block_103.designscript (12 lines) ----------
x;
[Imperative]
{
	if(x == null)
	{
		return = [];
	}
	else
	{
		return = "Hidden";
	}
};
# ----------------------------------------
getByName = LinePatternElement.GetByName(name=code_block_103.out1)
color_palette_2 = ColorPalette({R: 0, G: 0, B: 0, A: 255})
code_block_104 = CodeBlock { 1; }
create_overridegraphicsettings = Custom[Create OverrideGraphicSettings](ProjectionLinePattern=getByName, ProjectionLineColor=color_palette_2, ProjectionLineWeight=code_block_104, CutLinePattern=getByName, CutLineColor=color_palette_2, CutLineWeight=code_block_104)  # package Genius Loci; Create a OverrideGraphicSettings (All graphic inputs are optional). Unlike the OOTB OverrideGraphicSettings.ByProperties node, the Foreground and background patterns are available. Note : Prior to Revit 2019, the materials have only one surface pattern and one cut pattern.
view_setelementoverrides = Custom[View SetElementOverrides](view=code_block_98, elements=filterByBoolMask_6.in, overrides=create_overridegraphicsettings)  # package Genius Loci; Overrides element graphics settings in the given view. For use with the Create OverrideGraphicSettings node. Can also be used to hide or unhide elements.

# group: Sobrescribir Columnas de Hormigon
code_block_105 = CodeBlock { null; }
replaceEmptyLists_10 = Custom[List.ReplaceEmptyLists](seq=openView, Replacement=code_block_105)
code_block_106 = CodeBlock(x=replaceEmptyLists_10)  # same code as code_block_97
code_block_107 = CodeBlock { "Structural Columns"; }
byName_11 = Category.ByName(name=code_block_107)
all_elements_of_category_in_view_5 = ElementsOfCategoryInView(Category=byName_11, View=code_block_106.out1)
familyName_3 = Orchid.RevitProject.Elements.Element.FamilyName(element=all_elements_of_category_in_view_5)
code_block_108 = CodeBlock { "EST_M_STRUCTURAL COLUMN_RECTANGULAR"; }
eq_6 = familyName_3 == code_block_108
filterByBoolMask_7 = List.FilterByBoolMask(list=all_elements_of_category_in_view_5, mask=eq_6)
code_block_109 = CodeBlock { "Hidden"; }
getByName_2 = LinePatternElement.GetByName(name=code_block_109)
code_block_110 = CodeBlock { 1; }
create_overridegraphicsettings_2 = Custom[Create OverrideGraphicSettings](ProjectionLinePattern=getByName_2, ProjectionLineWeight=code_block_110, CutLinePattern=getByName_2, CutLineWeight=code_block_110)
code_block_111 = CodeBlock { false; }
view_setelementoverrides_2 = Custom[View SetElementOverrides](view=code_block_106.out1, elements=filterByBoolMask_7.in, overrides=create_overridegraphicsettings_2, hide=code_block_111)

# group: Redibujar Contorno
code_block_112 = CodeBlock { null; }
replaceEmptyLists_11 = Custom[List.ReplaceEmptyLists](seq=openView, Replacement=code_block_112)
code_block_113 = CodeBlock(x=replaceEmptyLists_11)  # same code as code_block_97
plane_6 = Custom[View.Plane](view=code_block_113.out1)
normal_5 = Plane.Normal(plane=plane_6)
code_block_114 = CodeBlock(t2=code_block_113.out1) { t1 = Revit.Elements.Element.GetParameterValueByName(t2, "Far Clip Offset"); t3 = t1 / 2; t4 = t3 * -1; }
translate_5 = Geometry.Translate(geometry=plane_6, direction=normal_5, distance=code_block_114.t4)
byUnion_2 = Solid.ByUnion()  # unwired: solids
code_block_115 = CodeBlock()
# ---------- code_block_115.designscript (6 lines) ----------
["Floors",
"Structural Framing",
"Walls",
"Structural Foundations",
"Structural Columns"
];
# ----------------------------------------
byName_12 = Category.ByName(name=code_block_115)
all_elements_of_category_in_view_6 = ElementsOfCategoryInView(Category=byName_12, View=code_block_113.out1)
flatten_5 = List.Flatten(list=all_elements_of_category_in_view_6)
solids = Element.Solids(element=flatten_5)
flatten_6 = List.Flatten(list=solids)
function_apply_9 = ApplyFunction(func=byUnion_2, arg1=flatten_6)
intersect_2 = Geometry.Intersect(geometry=translate_5, other=function_apply_9)
perimeterCurves_2 = Surface.PerimeterCurves(surface=intersect_2)
flatten_7 = List.Flatten(list=perimeterCurves_2)
byCurve_2 = Custom[DetailCurve.ByCurve+](curve=flatten_7, view=code_block_113.out1)  # package Clockwork for Dynamo 2.x; Creates a detail line based on a given curve. Unlike the OOTB node it can also draw circles.
code_block_116 = CodeBlock { "Line Style"; }
code_block_117 = CodeBlock { "Wide Lines"; }
get_line_style_by_name = Custom[Get Line Style by Name](name=code_block_117)  # package archi-lab.net; This node will return a line style object by its name. Line styles can be either Drafting or Model Line Property.
setParameterByName_5 = Element.SetParameterByName(element=byCurve_2, parameterName=code_block_116, value=get_line_style_by_name, lacing=Longest)
