# Dynamo graph elevacionEjeEM_script.dyn (Dynamo 2.3.1.11775)
# packages: Data-Shapes 2021.2.94, Orchid 200.4.0.7938, Clockwork for Dynamo 2.x 2.4.0, archi-lab.net 2022.210.2419

hideElements = archilab.Revit.Views.Views.HideElements()  # unwired: view, elements
code_block = CodeBlock { "Elevación por Eje"; }
code_block_2 = CodeBlock()
# ---------- code_block_2.designscript (9 lines) ----------
//buttonText
"INICIAR";
//buttonCancel
"CANCELAR";
//maxHeight

//width
440;
//label
# ----------------------------------------
code_block_3 = CodeBlock { "(Categoria EM)"; }
code_block_4 = CodeBlock { "Grids"; }
byName = Category.ByName(name=code_block_4)
all_elements_of_category = ElementsOfCategory(Category=byName)
code_block_5 = CodeBlock(g=all_elements_of_category) { "ELEVACIÓN EJE "+Revit.Elements.Element.Name(g)+"_EE.MM."; }
code_block_6 = CodeBlock { "Building Section (05_EM)"; }
byName_2 = Orchid.RevitProject.Views.ViewType.ByName(name=code_block_6)
byType = Orchid.RevitProject.Views.View.ByType(viewType=byName_2)
code_block_7 = CodeBlock { "Subclasificacion"; }
getParameterValueByName = Element.GetParameterValueByName(element=byType, parameterName=code_block_7)
code_block_8 = CodeBlock { "05_EM"; }
eq = getParameterValueByName == code_block_8
filterByBoolMask = List.FilterByBoolMask(list=byType, mask=eq)
code_block_9 = CodeBlock { "Title on Sheet"; }
getParameterValueByName_2 = Element.GetParameterValueByName(element=filterByBoolMask.in, parameterName=code_block_9)
code_block_10 = CodeBlock { "_EE.MM."; }
add = getParameterValueByName_2 + code_block_10
code_block_11 = CodeBlock { null; }
replaceEmptyLists = Custom[List.ReplaceEmptyLists](seq=add, Replacement=code_block_11)  # package Clockwork for Dynamo 2.x; Replaces all empty lists within a given list with a substitute
eq_2 = code_block_5@L1 == replaceEmptyLists@L2  # lacing=Longest
anyTrue = Orchid.Common.List.AnyTrue(list=eq_2)
filterByBoolMask_2 = List.FilterByBoolMask(list=all_elements_of_category, mask=anyTrue)
code_block_12 = CodeBlock(g=filterByBoolMask_2.out) { "ELEVACIÓN EJE "+Revit.Elements.Element.Name(g); }
code_block_13 = CodeBlock()
# ---------- code_block_13.designscript (8 lines) ----------
//heigth
440;
//elemCount
true;
//sort

//id
false;
# ----------------------------------------
listview_data = Custom[Listview Data](Keys=code_block_12, Values=filterByBoolMask_2.out, Height_optionnal=code_block_13.out0, ShowElementCount_optionnal=code_block_13.out1, ShowId_optionnal=code_block_13.out2)  # package Data-Shapes; Create data for ListView input in UI.MultiInputForm ++ . Check out www.data-shapes.net for more infos.
code_block_14 = CodeBlock { "Escala:"; }
code_block_15 = CodeBlock()
# ---------- code_block_15.designscript (6 lines) ----------
[
"1:50",
"1:75",
"1:100",
"1:125"
];
# ----------------------------------------
code_block_16 = CodeBlock { ":"; }
split = String.Split(str=code_block_15, separator0=code_block_16)
code_block_17 = CodeBlock { 1; }
getItemAtIndex = List.GetItemAtIndex(list=split@L2, index=code_block_17)
toNumber = String.ToNumber(str=getItemAtIndex)
code_block_18 = CodeBlock { 0; false; }
dropdown_data = Custom[DropDown Data](InputName=code_block_14, Keys=code_block_15, Values=toNumber, DefaultValueIndex=code_block_18.out0, Sorted_optional=code_block_18.out1)  # package Data-Shapes; Create data for DropDown input in UI.MultiInputForm ++ . Check out www.data-shapes.net for more infos.
list_create = List.Create(item0=listview_data, item1=dropdown_data)
inputgroup_data = Custom[InputGroup Data](GroupTitle=code_block_3, Inputs=list_create)  # package Data-Shapes; Creates a group of inputs for UI.MultipleInputForm ++ . Check out www.data-shapes.net for more infos !
boolean = BoolSelector(true)
multipleinputform = Custom[MultipleInputForm ++](Description_optional=code_block, ButtonText_optional=code_block_2.out0, Inputs=inputgroup_data, Toggle=boolean, CancelButtonText_optional=code_block_2.out1, Width_optional=code_block_2.out2)  # package Data-Shapes; Create a form with multiple inputs. see www.data-shapes.net for tutorials and infos!
code_block_19 = CodeBlock(x=multipleinputform.User_Inputs)
# ---------- code_block_19.designscript (13 lines) ----------
x;

[Imperative]
{
	if(x == null)
	{
		return = [[],[]];
	}
	else
	{
		return = x;
	}
};
# ----------------------------------------
code_block_20 = CodeBlock(l=code_block_19.out1) { l[0]; }
curve = Grid.Curve(grid=code_block_20)
direction = Line.Direction(line=curve)
normalized = Vector.Normalized(vector=direction)
code_block_21 = CodeBlock(p=normalized) { p.X; }
code_block_22 = CodeBlock { 2; }
round = Math.Round(number=code_block_21, digits=code_block_22)
code_block_23 = CodeBlock { 0; }
le = round <= code_block_23
reverse = Curve.Reverse(curve=curve)
scopeIf = Custom[ScopeIf+](test=le, True=reverse, False=curve, lacing=Shortest)  # package Clockwork for Dynamo 2.x; A (hopefully) more robust implementation of ScopeIf. Tests a single boolean and returns a value accordingly.
code_block_24 = CodeBlock(x=scopeIf) { x; }
direction_2 = Line.Direction(line=code_block_24)
code_block_25 = CodeBlock(x=direction_2) { x.X; }
code_block_26 = CodeBlock { 0; }
ge = code_block_25 >= code_block_26
reverse_2 = Curve.Reverse(curve=code_block_24)
scopeIf_2 = Custom[ScopeIf+](test=ge, True=reverse_2, False=code_block_24, lacing=Shortest)
direction_3 = Line.Direction(line=scopeIf_2)
normalized_2 = Vector.Normalized(vector=direction_3)
code_block_27 = CodeBlock(x=normalized_2) { x.X; }
code_block_28 = CodeBlock { 0; }
eq_3 = code_block_27 == code_block_28
code_block_29 = CodeBlock(x=normalized_2) { x.Y; }
code_block_30 = CodeBlock { 0; }
gt = code_block_29 > code_block_30
and_ = eq_3 && gt
reverse_3 = Curve.Reverse(curve=scopeIf_2)
scopeIf_3 = Custom[ScopeIf+](test=and_, True=reverse_3, False=scopeIf_2, lacing=Shortest)
code_block_31 = CodeBlock { "Levels"; }
byName_3 = Category.ByName(name=code_block_31)
all_elements_of_category_2 = ElementsOfCategory(Category=byName_3)
elevation = Level.Elevation(level=all_elements_of_category_2)
minimumItem = List.MinimumItem(list=elevation)
eq_4 = elevation == minimumItem
filterByBoolMask_3 = List.FilterByBoolMask(list=all_elements_of_category_2, mask=eq_4)
plane = Custom[Level.Plane](level=filterByBoolMask_3.in)  # package Clockwork for Dynamo 2.x; Retrieves the plane of a given level
pullOntoPlane = Curve.PullOntoPlane(curve=scopeIf_3, plane=plane, lacing=Longest)
ZAxis = Vector.ZAxis()
code_block_32 = CodeBlock { -3000; }
translate = Geometry.Translate(geometry=pullOntoPlane, direction=ZAxis, distance=code_block_32, lacing=Longest)
code_block_33 = CodeBlock { "Building Section (05_EM)"; }
byName_4 = Orchid.RevitProject.Views.ViewType.ByName(name=code_block_33)
code_block_34 = CodeBlock { 0.5; }
pointAtParameter = Curve.PointAtParameter(curve=translate, param=code_block_34)
code_block_35 = CodeBlock { "Levels"; }
byName_5 = Category.ByName(name=code_block_35)
all_elements_of_category_3 = ElementsOfCategory(Category=byName_5)
elevation_2 = Level.Elevation(level=all_elements_of_category_3)
maximumItem = List.MaximumItem(list=elevation_2)
eq_5 = elevation_2 == maximumItem
filterByBoolMask_4 = List.FilterByBoolMask(list=all_elements_of_category_3, mask=eq_5)
plane_2 = Custom[Level.Plane](level=filterByBoolMask_4.in)
pullOntoPlane_2 = Curve.PullOntoPlane(curve=scopeIf_3, plane=plane_2, lacing=Longest)
ZAxis_2 = Vector.ZAxis()
code_block_36 = CodeBlock { 3000; }
translate_2 = Geometry.Translate(geometry=pullOntoPlane_2, direction=ZAxis_2, distance=code_block_36, lacing=Longest)
code_block_37 = CodeBlock { 0.5; }
pointAtParameter_2 = Curve.PointAtParameter(curve=translate_2, param=code_block_37)
distanceTo = Geometry.DistanceTo(geometry=pointAtParameter, other=pointAtParameter_2)
code_block_38 = CodeBlock { null; }
replaceEmptyLists_2 = Custom[List.ReplaceEmptyLists](seq=distanceTo, Replacement=code_block_38)
code_block_39 = CodeBlock(x=replaceEmptyLists_2)
# ---------- code_block_39.designscript (12 lines) ----------
x;
[Imperative]
{
	if(x == null)
	{
		return = [[]];
	}
	else
	{
		return = x;
	}
};
# ----------------------------------------
code_block_40 = CodeBlock(h=code_block_39.out1)
# ---------- code_block_40.designscript (6 lines) ----------
//height
h[0];
//offset
300;
//depth
300;
# ----------------------------------------
byLine = Custom[ViewSection.ByLine](Curves=translate, ViewFamilyType=byName_4, ViewSectionHeight=code_block_40.out0, OffsetFromLine=code_block_40.out1, Depth=code_block_40.out2)  # package Data-Shapes; Create ViewSections in current document from DS Lines.
code_block_41 = CodeBlock(g=code_block_20) { "View Name"; "EM_ELEVACION EJE "+Revit.Elements.Element.Name(g); }
setParameterByName = Element.SetParameterByName(element=byLine, parameterName=code_block_41.out0, value=code_block_41.out1, lacing=Longest)
code_block_42 = CodeBlock(g=code_block_20) { "Title on Sheet"; "ELEVACIÓN EJE "+Revit.Elements.Element.Name(g); }
setParameterByName_2 = Element.SetParameterByName(element=setParameterByName, parameterName=code_block_42.out0, value=code_block_42.out1, lacing=Longest)
code_block_43 = CodeBlock(l=code_block_19.out1) { l[1]; }
setScale = View.SetScale(view=setParameterByName_2, scale=code_block_43, lacing=Longest)
code_block_44 = CodeBlock()
# ---------- code_block_44.designscript (5 lines) ----------
[
"Crop View",
"Crop Region Visible"
];
[0,0];
# ----------------------------------------
setParameterByName_3 = Element.SetParameterByName(element=setScale@L1, parameterName=code_block_44.out0@L2, value=code_block_44.out1@L2, lacing=Longest)
flatten = List.Flatten(list=setParameterByName_3)
uniqueItems = List.UniqueItems(list=flatten)
all_elements_in_view_s = Custom[All Elements In View(s)](Views=uniqueItems)  # package Data-Shapes; Retrieves all visible element in a view or a set of views
code_block_45 = CodeBlock { "View Name"; }
exists = Orchid.RevitProject.Parameters.Parameter.Exists(parameterName=code_block_45, element=all_elements_in_view_s)
filterByBoolMask_5 = List.FilterByBoolMask(list=all_elements_in_view_s, mask=exists)
code_block_46 = CodeBlock { "Type"; }
getParameterValueByName_3 = Element.GetParameterValueByName(element=filterByBoolMask_5.in, parameterName=code_block_46)
name = Orchid.RevitProject.Elements.ElementType.Name(elementType=getParameterValueByName_3)
code_block_47 = CodeBlock { "Building Section (05_EM)"; }
eq_6 = name == code_block_47
filterByBoolMask_6 = List.FilterByBoolMask(list=filterByBoolMask_5.in, mask=eq_6)
function_apply = ApplyFunction(func=hideElements, arg1=uniqueItems, arg2=filterByBoolMask_6.in)
code_block_48 = CodeBlock { null; }
replaceEmptyLists_3 = Custom[List.ReplaceEmptyLists](seq=function_apply, Replacement=code_block_48)
end = Revit.Transaction.Transaction.End(input=replaceEmptyLists_3)
code_block_49 = CodeBlock(x=end)
# ---------- code_block_49.designscript (13 lines) ----------
x;

[Imperative]
{
	if(x == null)
	{
		return = [];
	}
	else
	{
		return = "Building Section (05_EM)";
	}
};
# ----------------------------------------
byName_6 = Orchid.RevitProject.Views.ViewType.ByName(name=code_block_49.out1)
byType_2 = Orchid.RevitProject.Views.View.ByType(viewType=byName_6)
all_elements_in_view_s_2 = Custom[All Elements In View(s)](Views=byType_2)
code_block_50 = CodeBlock { "View Name"; }
exists_2 = Orchid.RevitProject.Parameters.Parameter.Exists(parameterName=code_block_50, element=all_elements_in_view_s_2)
filterByBoolMask_7 = List.FilterByBoolMask(list=all_elements_in_view_s_2, mask=exists_2)
code_block_51 = CodeBlock { "Type"; }
getParameterValueByName_4 = Element.GetParameterValueByName(element=filterByBoolMask_7.in, parameterName=code_block_51)
name_2 = Orchid.RevitProject.Elements.ElementType.Name(elementType=getParameterValueByName_4)
code_block_52 = CodeBlock { "Building Section (05_EM)"; }
eq_7 = name_2 == code_block_52
filterByBoolMask_8 = List.FilterByBoolMask(list=filterByBoolMask_7.in, mask=eq_7)
hideElements_2 = archilab.Revit.Views.Views.HideElements(view=byType_2, elements=filterByBoolMask_8.in)
