# Dynamo graph PlantasEM_script.dyn (Dynamo 2.3.2.15696)
# packages: Data-Shapes 2022.2.96, WombatDynamo 2.3.4, Orchid 200.4.0.7938, Clockwork for Dynamo 2.x 2.4.0, Data-Shapes 2021.2.94, Genius Loci 2020.8.3, archi-lab.net 2022.210.2419, Crumple 2022.2.13

code_block = CodeBlock { "Building Section"; }
byName = Orchid.RevitProject.Views.ViewType.ByName(name=code_block)
code_block_2 = CodeBlock { "Plantas Montacarga - MC"; }
code_block_3 = CodeBlock()
# ---------- code_block_3.designscript (6 lines) ----------
"INICIAR";
"CANCELAR";
//Label
120;
//Width
450;
# ----------------------------------------
code_block_4 = CodeBlock { "Niveles:"; }
code_block_5 = CodeBlock { "Levels"; }
byName_2 = Category.ByName(name=code_block_5)
all_elements_of_category = ElementsOfCategory(Category=byName_2)
elevation = Level.Elevation(level=all_elements_of_category)
sortByKey = List.SortByKey(list=all_elements_of_category, keys=elevation)
code_block_6 = CodeBlock { "Building Story"; }
getParameterValueByName = Element.GetParameterValueByName(element=sortByKey.sorted_list, parameterName=code_block_6)
code_block_7 = CodeBlock { 1; }
eq = getParameterValueByName == code_block_7
filterByBoolMask = List.FilterByBoolMask(list=sortByKey.sorted_list, mask=eq)
name = Element.Name(element=filterByBoolMask.in)
code_block_8 = CodeBlock()
# ---------- code_block_8.designscript (8 lines) ----------
//Height
360;
//elemCount
true;
//sort
false;
//id
false;
# ----------------------------------------
code_block_9 = CodeBlock(l=name) { count = DSCore.List.Count(l) - 1; 0..count..1; }
listview_data = Custom[Listview Data](InputName=code_block_4, Keys=name, Values=filterByBoolMask.in, Height_optionnal=code_block_8.out0, ShowElementCount_optionnal=code_block_8.out1, DefaultValueIndices_optionnal=code_block_9.out1, SortItems_optionnal=code_block_8.out2, ShowId_optionnal=code_block_8.out3)  # package Data-Shapes; Create data for ListView input in UI.MultiInputForm ++ . Check out www.data-shapes.net for more infos.
code_block_10 = CodeBlock { "Escala:"; }
code_block_11 = CodeBlock()
# ---------- code_block_11.designscript (10 lines) ----------
[
"1:50",
"1:75",
"1:100",
"1:125",
"1:150",
"1:175",
"1:200"
];
":";
# ----------------------------------------
split = String.Split(str=code_block_11.out0, separator0=code_block_11.out1)
code_block_12 = CodeBlock { 1; }
getItemAtIndex = List.GetItemAtIndex(list=split@L2, index=code_block_12)
toNumber = String.ToNumber(str=getItemAtIndex)
code_block_13 = CodeBlock { 0; false; }
dropdown_data = Custom[DropDown Data](InputName=code_block_10, Keys=code_block_11.out0, Values=toNumber, DefaultValueIndex=code_block_13.out0, Sorted_optional=code_block_13.out1)  # package Data-Shapes; Create data for DropDown input in UI.MultiInputForm ++ . Check out www.data-shapes.net for more infos.
code_block_14 = CodeBlock { "Nombre Estanque:"; "Ejemplo, MCA-01"; }
textbox_data = Custom[TextBox Data](InputName=code_block_14.out0, DefaultText=code_block_14.out1)  # package Data-Shapes; Create Data for TextBox input in UI.MultipleInputForm ++ . Check out www.data-shapes.net for more informations
code_block_15 = CodeBlock()
# ---------- code_block_15.designscript (2 lines) ----------
"Importante:";
"El nombre de la Estructura debe ser único. Si ya existe, por ejemplo, la Estructura Cubierta, usar un nombre diferente.";
# ----------------------------------------
textnote_data = Custom[TextNote Data](Title=code_block_15.out0, TextNote=code_block_15.out1)  # package Data-Shapes; Create Data for TextNote input in UI.MultipleInputForm ++ . Check out www.data-shapes.net for more informations
list_create = List.Create(item0=textbox_data, item1=textnote_data)
inputgroup_data = Custom[InputGroup Data](Inputs=list_create)  # package Data-Shapes; Creates a group of inputs for UI.MultipleInputForm ++ . Check out www.data-shapes.net for more infos !
list_create_2 = List.Create(item0=listview_data, item1=dropdown_data, item2=inputgroup_data)
boolean = BoolSelector(true)
multipleinputform = Custom[MultipleInputForm ++](Description_optional=code_block_2, ButtonText_optional=code_block_3.out0, Inputs=list_create_2, Toggle=boolean, CancelButtonText_optional=code_block_3.out1, Width_optional=code_block_3.out3, LabelWidth_optional=code_block_3.out2)  # package Data-Shapes; Create a form with multiple inputs. see www.data-shapes.net for tutorials and infos!
code_block_16 = CodeBlock(l=multipleinputform.User_Inputs)
# ---------- code_block_16.designscript (12 lines) ----------
l;
[Imperative]
{
	if (l == null)
		{
		return = [[],[],[]];
		}
	else
		{
		return = l;
		}
};
# ----------------------------------------
code_block_17 = CodeBlock(l=code_block_16.out1) { DSCore.List.Flatten(([l[0]]),1); }
nullToEmptyList = WombatDynamo.List.NullToEmptyList(data=code_block_17)
byLevel = StructuralPlanView.ByLevel(level=nullToEmptyList)
code_block_18 = CodeBlock { "Zona"; }
code_block_19 = CodeBlock(l=code_block_16.out1) { DSCore.String.ToUpper(DSCore.List.Flatten(([l[2]]),1)); }
setParameterByName = Element.SetParameterByName(element=byLevel, parameterName=code_block_18, value=code_block_19, lacing=Longest)
code_block_20 = CodeBlock { "Structural Plan (Piso)"; "Type"; }
byName_3 = Orchid.RevitProject.Views.ViewType.ByName(name=code_block_20.out0)
setParameterByName_2 = Element.SetParameterByName(element=setParameterByName, parameterName=code_block_20.out1, value=byName_3)
code_block_21 = CodeBlock(l=code_block_16.out1) { DSCore.List.Flatten(([l[1]]),1); }
nullToEmptyList_2 = WombatDynamo.List.NullToEmptyList(data=code_block_21)
setScale = View.SetScale(view=setParameterByName_2, scale=nullToEmptyList_2, lacing=Longest)
code_block_22 = CodeBlock { null; }
replaceEmptyLists = Custom[List.ReplaceEmptyLists](seq=setScale, Replacement=code_block_22)  # package Clockwork for Dynamo 2.x; Replaces all empty lists within a given list with a substitute
all = Orchid.RevitProject.Views.ViewTemplate.All()
name_2 = Element.Name(element=all)
code_block_23 = CodeBlock { "Structural Foundation Plan"; }
eq_2 = name_2 == code_block_23
filterByBoolMask_2 = List.FilterByBoolMask(list=all, mask=eq_2)
code_block_24 = CodeBlock(x=replaceEmptyLists, y=filterByBoolMask_2.in)
# ---------- code_block_24.designscript (14 lines) ----------
x;
y;

[Imperative]
{
	if (x == null)
		{
		return = [];
		}
	else
		{
		return = y;
		}
};
# ----------------------------------------
code_block_25 = CodeBlock(x=setScale) { esc = DSCore.List.UniqueItems(x.GetParameterValueByName("Zona")); "01_ENTREGABLE_05_EM_STRUCTURAL PLAN (PISO)_"+esc; }
duplicate = Orchid.RevitProject.Views.ViewTemplate.Duplicate(viewTemplate=code_block_24.out2, name=code_block_25.out1)
code_block_26 = CodeBlock(esc=code_block_25.esc)
# ---------- code_block_26.designscript (13 lines) ----------
DSCore.List.Flatten(
[
"Clasificacion",
"Subclasificacion",
"Zona"
]);

DSCore.List.Flatten(
[
"01_ENTREGABLE",
"05_EM",
esc
]);
# ----------------------------------------
setParameterByName_3 = Element.SetParameterByName(element=duplicate, parameterName=code_block_26.out0, value=code_block_26.out1, lacing=Longest)
uniqueItems = List.UniqueItems(list=setParameterByName_3)
code_block_27 = CodeBlock { null; }
replaceEmptyLists_2 = Custom[List.ReplaceEmptyLists](seq=uniqueItems, Replacement=code_block_27)
code_block_28 = CodeBlock { null; }
replaceEmptyLists_3 = Custom[List.ReplaceEmptyLists](seq=setParameterByName_3, Replacement=code_block_28)
code_block_29 = CodeBlock(x=replaceEmptyLists_3)
# ---------- code_block_29.designscript (13 lines) ----------
x;

[Imperative]
{
	if (x == null)
		{
		return = [[]];
		}
	else
		{
		return = x;
		}
};
# ----------------------------------------
code_block_30 = CodeBlock(a=code_block_29.out1)
# ---------- code_block_30.designscript (6 lines) ----------
esc = DSCore.List.UniqueItems(a.GetParameterValueByName("Zona"))[0];

["Zona","Subclasificacion"];
["NotEquals","NotEquals"];
[esc,"05_EM"];
"05_EM_"+esc;
# ----------------------------------------
code_block_31 = CodeBlock(x=replaceEmptyLists_2, y=code_block_30.out4)  # same code as code_block_24
create = Orchid.RevitProject.Filters.FilterRule.Create(parameter=code_block_30.out1, ruleType=code_block_30.out2, value=code_block_30.out3)
code_block_32 = CodeBlock { "Sections"; }
byName_4 = Category.ByName(name=code_block_32)
byRule = Orchid.RevitProject.Filters.ParameterFilter.ByRule(name=code_block_31.out2@L1, filterRule=create@L2, category=byName_4@L1, lacing=Longest)
code_block_33 = CodeBlock { false; }
addFilter = Orchid.RevitProject.Views.View.AddFilter(view=uniqueItems, parameterFilter=byRule, visibility=code_block_33, lacing=Longest)
set = Orchid.RevitProject.Views.ViewTemplate.Set(view=setScale, viewTemplate=addFilter, lacing=Longest)
code_block_34 = CodeBlock { "View Name"; }
identity = Object.Identity(obj=set)
code_block_35 = CodeBlock()
# ---------- code_block_35.designscript (4 lines) ----------
[
"Type",
"Subclasificacion"
];
# ----------------------------------------
getParameterValueByName_2 = Element.GetParameterValueByName(element=identity@L1, parameterName=code_block_35@L2, lacing=Longest)
code_block_36 = CodeBlock { null; }
replaceEmptyLists_4 = Custom[List.ReplaceEmptyLists](seq=getParameterValueByName_2, Replacement=code_block_36)
code_block_37 = CodeBlock(x=replaceEmptyLists_4, y=getParameterValueByName_2)
# ---------- code_block_37.designscript (14 lines) ----------
x;
y;

[Imperative]
{
	if (x == null)
		{
		return = [null,null];
		}
	else
		{
		return = y;
		}
};
# ----------------------------------------
code_block_38 = CodeBlock { 1; }
getItemAtIndex_2 = List.GetItemAtIndex(list=code_block_37.out2@L2, index=code_block_38)
code_block_39 = CodeBlock { "_"; }
code_block_40 = CodeBlock { 0; }
getItemAtIndex_3 = List.GetItemAtIndex(list=code_block_37.out2@L2, index=code_block_40)
nullToEmptyList_3 = WombatDynamo.List.NullToEmptyList(data=getItemAtIndex_3)
name_3 = Element.Name(element=nullToEmptyList_3)
code_block_41 = CodeBlock { 0; 17; }
remove = String.Remove(str=name_3, startIndex=code_block_41.out0, count=code_block_41.out1)
code_block_42 = CodeBlock { ")"; ""; }
replace = String.Replace(str=remove, searchFor=code_block_42.out0, replaceWith=code_block_42.out1)
toUpper = String.ToUpper(str=replace)
name_4 = Element.Name(element=identity)
code_block_43 = CodeBlock { "Zona"; }
getParameterValueByName_3 = Element.GetParameterValueByName(element=identity, parameterName=code_block_43)
list_create_3 = List.Create(item0=getItemAtIndex_2, item1=toUpper, item2=name_4, item3=getParameterValueByName_3)
transpose = List.Transpose(lists=list_create_3)
join = String.Join(separator=code_block_39, string0=transpose@L2)
code_block_44 = CodeBlock(x=getItemAtIndex_2, y=join)
# ---------- code_block_44.designscript (14 lines) ----------
x;
y;

[Imperative]
{
	if (x[0] == null)
		{
		return = [];
		}
	else
		{
		return = y;
		}
};
# ----------------------------------------
code_block_45 = CodeBlock { 0; 3; }
remove_2 = String.Remove(str=code_block_44.out2, startIndex=code_block_45.out0, count=code_block_45.out1)
setParameterByName_4 = Element.SetParameterByName(element=set, parameterName=code_block_34, value=remove_2)
element_level = Custom[Element Level](element=setParameterByName_4)  # package Genius Loci; Gets an element's level. Based on a Clockwork's node
code_block_46 = CodeBlock { 750; -1500; }
set_viewrange = Custom[Set ViewRange](view=setParameterByName_4, TopLevel=element_level, Top=code_block_46.out0, CutLevel=element_level, CutPlane=code_block_46.out0, BottomLevel=element_level, Bottom=code_block_46.out1, DepthLevel=element_level, ViewDepth=code_block_46.out1, lacing=Longest)  # package Genius Loci; Set the view range of the given plan view.
code_block_47 = CodeBlock { "Title on Sheet"; }
name_5 = Element.Name(element=set_viewrange)
code_block_48 = CodeBlock { "_"; }
split_2 = String.Split(str=name_5, separator0=code_block_48)
code_block_49 = CodeBlock { null; }
replaceEmptyLists_5 = Custom[List.ReplaceEmptyLists](seq=split_2, Replacement=code_block_49)
code_block_50 = CodeBlock(x=replaceEmptyLists_5, y=split_2)
# ---------- code_block_50.designscript (14 lines) ----------
x;
y;

[Imperative]
{
	if (x == null)
		{
		return = [null,null,null,null];
		}
	else
		{
		return = y;
		}
};
# ----------------------------------------
code_block_51 = CodeBlock { 2; }
getItemAtIndex_4 = List.GetItemAtIndex(list=code_block_50.out2@L2, index=code_block_51)
code_block_52 = CodeBlock(nivel=getItemAtIndex_4) { title = "PLANTA PLACAS BASE "+nivel; }
setParameterByName_5 = Element.SetParameterByName(element=set_viewrange, parameterName=code_block_47, value=code_block_52)
viewlevel = Custom[© ViewLevel](views=setParameterByName_5)  # package Crumple; Returns the associated level of a view (if it has one), as well as a boolean mask to remove views without levels after.
byLevel_2 = StructuralPlanView.ByLevel(level=viewlevel.lvls)
code_block_53 = CodeBlock { "Zona"; }
code_block_54 = CodeBlock { null; }
replaceEmptyLists_6 = Custom[List.ReplaceEmptyLists](seq=setParameterByName_5, Replacement=code_block_54)
code_block_55 = CodeBlock(x=replaceEmptyLists_6)  # same code as code_block_29
code_block_56 = CodeBlock(x=code_block_55.out1) { DSCore.List.UniqueItems(x.GetParameterValueByName("Zona"))[0]; }
setParameterByName_6 = Element.SetParameterByName(element=byLevel_2, parameterName=code_block_53, value=code_block_56, lacing=Longest)
code_block_57 = CodeBlock { "Structural Plan (Cielo)"; "Type"; }
byName_5 = Orchid.RevitProject.Views.ViewType.ByName(name=code_block_57.out0)
setParameterByName_7 = Element.SetParameterByName(element=setParameterByName_6, parameterName=code_block_57.out1, value=byName_5, lacing=Longest)
scale = Custom[View.Scale](view=setParameterByName_5)  # package Clockwork for Dynamo 2.x; Returns the scale of a given view
code_block_58 = CodeBlock(l=scale)
# ---------- code_block_58.designscript (13 lines) ----------
l;

[Imperative]
{
	if (l == [])
		{
		return = [[]];
		}
	else
		{
		return = l[0];
		}
};
# ----------------------------------------
setScale_2 = View.SetScale(view=setParameterByName_7, scale=code_block_58.out1)
code_block_59 = CodeBlock { null; }
replaceEmptyLists_7 = Custom[List.ReplaceEmptyLists](seq=setParameterByName_7, Replacement=code_block_59)
all_2 = Orchid.RevitProject.Views.ViewTemplate.All()
name_6 = Element.Name(element=all_2)
code_block_60 = CodeBlock { "Architectural Reflected Ceiling Plan"; }
eq_3 = name_6 == code_block_60
filterByBoolMask_3 = List.FilterByBoolMask(list=all_2, mask=eq_3)
code_block_61 = CodeBlock(x=replaceEmptyLists_7, y=filterByBoolMask_3.in)  # same code as code_block_24
code_block_62 = CodeBlock(x=replaceEmptyLists_7)  # same code as code_block_29
code_block_63 = CodeBlock(x=code_block_62.out1) { "05_EM_"+DSCore.List.UniqueItems(x.GetParameterValueByName("Zona"))[0]; }
code_block_64 = CodeBlock(esc=code_block_63) { "01_ENTREGABLE_05_EM_STRUCTURAL PLAN (CIELO)_"+esc; }
duplicate_2 = Orchid.RevitProject.Views.ViewTemplate.Duplicate(viewTemplate=code_block_61.out2, name=code_block_64)
code_block_65 = CodeBlock(esc=code_block_63)  # same code as code_block_26
setParameterByName_8 = Element.SetParameterByName(element=duplicate_2, parameterName=code_block_65.out0, value=code_block_65.out1, lacing=Longest)
uniqueItems_2 = List.UniqueItems(list=setParameterByName_8)
await_ = Orchid.Common.DataStream.Await(pass=code_block_63, waitFor=setScale_2)
byName_6 = Orchid.RevitProject.Filters.ParameterFilter.ByName(name=await_)
code_block_66 = CodeBlock { false; }
addFilter_2 = Orchid.RevitProject.Views.View.AddFilter(view=uniqueItems_2, parameterFilter=byName_6, visibility=code_block_66, lacing=Longest)
set_2 = Orchid.RevitProject.Views.ViewTemplate.Set(view=setScale_2, viewTemplate=addFilter_2, lacing=Longest)
element_level_2 = Custom[Element Level](element=set_2)
levelAbove = Custom[Level.LevelAbove](level=element_level_2)  # package archi-lab.net; This node takes an input of level and returns level above it.
empty = List.Empty()
replacenulls = Custom[© ReplaceNulls](lst=levelAbove, replace=empty)  # package Crumple; Replaces all nulls with a given substitute.
code_block_67 = CodeBlock { 1000; 300; }
set_viewrange_2 = Custom[Set ViewRange](view=set_2, TopLevel=replacenulls, Top=code_block_67.out1, CutLevel=element_level_2, CutPlane=code_block_67.out0, BottomLevel=element_level_2, Bottom=code_block_67.out0, DepthLevel=replacenulls, ViewDepth=code_block_67.out1, lacing=Longest)
code_block_68 = CodeBlock { "View Name"; }
identity_2 = Object.Identity(obj=set_viewrange_2)
code_block_69 = CodeBlock()  # same code as code_block_35
getParameterValueByName_4 = Element.GetParameterValueByName(element=identity_2@L1, parameterName=code_block_69@L2, lacing=Longest)
code_block_70 = CodeBlock { null; }
replaceEmptyLists_8 = Custom[List.ReplaceEmptyLists](seq=getParameterValueByName_4, Replacement=code_block_70)
code_block_71 = CodeBlock(x=replaceEmptyLists_8, y=getParameterValueByName_4)  # same code as code_block_37
code_block_72 = CodeBlock { 1; }
getItemAtIndex_5 = List.GetItemAtIndex(list=code_block_71.out2@L2, index=code_block_72)
code_block_73 = CodeBlock { "_"; }
code_block_74 = CodeBlock { 0; }
getItemAtIndex_6 = List.GetItemAtIndex(list=code_block_71.out2@L2, index=code_block_74)
nullToEmptyList_4 = WombatDynamo.List.NullToEmptyList(data=getItemAtIndex_6)
name_7 = Element.Name(element=nullToEmptyList_4)
code_block_75 = CodeBlock { 0; 17; }
remove_3 = String.Remove(str=name_7, startIndex=code_block_75.out0, count=code_block_75.out1)
code_block_76 = CodeBlock { ")"; ""; }
replace_2 = String.Replace(str=remove_3, searchFor=code_block_76.out0, replaceWith=code_block_76.out1)
toUpper_2 = String.ToUpper(str=replace_2)
name_8 = Element.Name(element=identity_2)
code_block_77 = CodeBlock { "Zona"; }
getParameterValueByName_5 = Element.GetParameterValueByName(element=identity_2, parameterName=code_block_77)
list_create_4 = List.Create(item0=getItemAtIndex_5, item1=toUpper_2, item2=name_8, item3=getParameterValueByName_5)
transpose_2 = List.Transpose(lists=list_create_4)
join_2 = String.Join(separator=code_block_73, string0=transpose_2@L2)
code_block_78 = CodeBlock(x=getItemAtIndex_5, y=join_2)  # same code as code_block_44
code_block_79 = CodeBlock { 0; 3; }
remove_4 = String.Remove(str=code_block_78.out2, startIndex=code_block_79.out0, count=code_block_79.out1)
code_block_80 = CodeBlock { null; }
replaceEmptyLists_9 = Custom[List.ReplaceEmptyLists](seq=remove_4, Replacement=code_block_80)
code_block_81 = CodeBlock(l=replaceEmptyLists_9)
# ---------- code_block_81.designscript (13 lines) ----------
l;

[Imperative]
{
	if (l == null)
		{
		return = null;
		}
	else
		{
		return = l;
		}
};
# ----------------------------------------
setParameterByName_9 = Element.SetParameterByName(element=set_viewrange_2, parameterName=code_block_68, value=code_block_81.out1, lacing=Longest)
code_block_82 = CodeBlock()
# ---------- code_block_82.designscript (4 lines) ----------
[
"Subclasificacion",
"Zona"
];
# ----------------------------------------
getParameterValueByName_6 = Element.GetParameterValueByName(element=setParameterByName_9, parameterName=code_block_82)
uniqueItems_3 = List.UniqueItems(list=getParameterValueByName_6)
code_block_83 = CodeBlock { null; }
replaceEmptyLists_10 = Custom[List.ReplaceEmptyLists](seq=uniqueItems_3, Replacement=code_block_83)
code_block_84 = CodeBlock(x=replaceEmptyLists_10)
# ---------- code_block_84.designscript (13 lines) ----------
x;

[Imperative]
{
	if (x == null)
		{
		return = [[],[]];
		}
	else
		{
		return = x;
		}
};
# ----------------------------------------
all_3 = Orchid.RevitProject.Views.ViewTemplate.All()
name_9 = Element.Name(element=all_3)
code_block_85 = CodeBlock { "Architectural Section"; }
eq_4 = name_9 == code_block_85
filterByBoolMask_4 = List.FilterByBoolMask(list=all_3, mask=eq_4)
code_block_86 = CodeBlock(x=code_block_84.out1, y=filterByBoolMask_4.in)
# ---------- code_block_86.designscript (15 lines) ----------
x[0];
x[1];
y;

[Imperative]
{
	if (x == null)
		{
		return = [];
		}
	else
		{
		return = y;
		}
};
# ----------------------------------------
code_block_87 = CodeBlock(esc=code_block_86.out1) { "01_ENTREGABLE_05_EM_BUILDING SECTION_"+esc; }
duplicate_3 = Orchid.RevitProject.Views.ViewTemplate.Duplicate(viewTemplate=code_block_86.out3, name=code_block_87)
code_block_88 = CodeBlock(x=code_block_84.out1)
# ---------- code_block_88.designscript (13 lines) ----------
x;

[Imperative]
{
	if (x == null)
		{
		return = [];
		}
	else
		{
		return = x;
		}
};
# ----------------------------------------
code_block_89 = CodeBlock(lst=code_block_88.out1)
# ---------- code_block_89.designscript (15 lines) ----------
lst;

[
"Clasificacion",
"Subclasificacion",
"Zona",
"Discipline"
];

[
"01_ENTREGABLE",
lst[0],
lst[1],
2
];
# ----------------------------------------
setParameterByName_10 = Element.SetParameterByName(element=duplicate_3, parameterName=code_block_89.out1, value=code_block_89.out2, lacing=Longest)
uniqueItems_4 = List.UniqueItems(list=setParameterByName_10)
code_block_90 = CodeBlock(esc=code_block_86.out1) { "05_EM_"+esc; }
await_2 = Orchid.Common.DataStream.Await(pass=code_block_90, waitFor=uniqueItems_4)
byName_7 = Orchid.RevitProject.Filters.ParameterFilter.ByName(name=await_2)
code_block_91 = CodeBlock { false; }
addFilter_3 = Orchid.RevitProject.Views.View.AddFilter(view=uniqueItems_4, parameterFilter=byName_7, visibility=code_block_91, lacing=Longest)
end = Revit.Transaction.Transaction.End(input=addFilter_3)
await_3 = Orchid.Common.DataStream.Await(pass=code_block_86.out1, waitFor=end)
code_block_92 = CodeBlock(esc=await_3) { "Building Section (05_EM_"+esc+")"; }
duplicate_4 = archilab.Revit.Elements.ElementTypes.Duplicate(element=byName, name=code_block_92)
code_block_93 = CodeBlock { "View Template applied to new views"; }
setParameterByName_11 = Element.SetParameterByName(element=duplicate_4, parameterName=code_block_93, value=end)
code_block_94 = CodeBlock { "Detail"; }
byName_8 = Orchid.RevitProject.Views.ViewType.ByName(name=code_block_94)
all_4 = Orchid.RevitProject.Views.ViewTemplate.All()
name_10 = Element.Name(element=all_4)
code_block_95 = CodeBlock { "Architectural Section"; }
eq_5 = name_10 == code_block_95
filterByBoolMask_5 = List.FilterByBoolMask(list=all_4, mask=eq_5)
code_block_96 = CodeBlock(x=code_block_84.out1, y=filterByBoolMask_5.in)  # same code as code_block_86
code_block_97 = CodeBlock(esc=code_block_96.out1) { "01_ENTREGABLE_05_EM_DETAIL_"+esc; }
duplicate_5 = Orchid.RevitProject.Views.ViewTemplate.Duplicate(viewTemplate=code_block_96.out3, name=code_block_97)
code_block_98 = CodeBlock(x=code_block_84.out1)  # same code as code_block_88
code_block_99 = CodeBlock(lst=code_block_98.out1)  # same code as code_block_89
setParameterByName_12 = Element.SetParameterByName(element=duplicate_5, parameterName=code_block_99.out1, value=code_block_99.out2, lacing=Longest)
uniqueItems_5 = List.UniqueItems(list=setParameterByName_12)
code_block_100 = CodeBlock(esc=code_block_96.out1) { "05_EM_"+esc; }
await_4 = Orchid.Common.DataStream.Await(pass=code_block_100, waitFor=uniqueItems_5)
byName_9 = Orchid.RevitProject.Filters.ParameterFilter.ByName(name=await_4)
code_block_101 = CodeBlock { false; }
addFilter_4 = Orchid.RevitProject.Views.View.AddFilter(view=uniqueItems_5, parameterFilter=byName_9, visibility=code_block_101, lacing=Longest)
end_2 = Revit.Transaction.Transaction.End(input=addFilter_4)
await_5 = Orchid.Common.DataStream.Await(pass=code_block_96.out1, waitFor=end_2)
code_block_102 = CodeBlock(esc=await_5) { "Detail (05_EM_"+esc+")"; }
duplicate_6 = archilab.Revit.Elements.ElementTypes.Duplicate(element=byName_8, name=code_block_102)
code_block_103 = CodeBlock { "View Template applied to new views"; }
setParameterByName_13 = Element.SetParameterByName(element=duplicate_6, parameterName=code_block_103, value=end_2)
