# Dynamo graph PlantasMA_script.dyn (Dynamo 2.3.1.11775)
# packages: Data-Shapes 2022.2.96, WombatDynamo 2.3.4, Genius Loci 2020.8.3, Crumple 2022.2.13, archi-lab.net 2022.210.2419, Orchid 200.4.0.7938, Data-Shapes 2021.2.94, Clockwork for Dynamo 2.x 2.4.0

boolean = BoolSelector(false)
code_block = CodeBlock { "Detail"; }
byName = Orchid.RevitProject.Views.ViewType.ByName(name=code_block)
code_block_2 = CodeBlock { "Detail (02_MA)"; }
duplicate = archilab.Revit.Elements.ElementTypes.Duplicate(element=byName, name=code_block_2)
code_block_3 = CodeBlock { "View Template applied to new views"; }
code_block_4 = CodeBlock { "Planta Ubicacion Elev. por Eje - MA"; }
code_block_5 = CodeBlock { "INICIAR"; "CANCELAR"; 95; 450; }
code_block_6 = CodeBlock { "Niveles"; }
code_block_7 = CodeBlock { "Levels"; }
byName_2 = Category.ByName(name=code_block_7)
all_elements_of_category = ElementsOfCategory(Category=byName_2)
elevation = Level.Elevation(level=all_elements_of_category)
sortByKey = List.SortByKey(list=all_elements_of_category, keys=elevation)
code_block_8 = CodeBlock { "Building Story"; }
getParameterValueByName = Element.GetParameterValueByName(element=sortByKey.sorted_list, parameterName=code_block_8)
code_block_9 = CodeBlock { 1; }
eq = getParameterValueByName == code_block_9
filterByBoolMask = List.FilterByBoolMask(list=sortByKey.sorted_list, mask=eq)
name = Element.Name(element=filterByBoolMask.in)
code_block_10 = CodeBlock { 430; false; true; }
code_block_11 = CodeBlock(l=name) { count = DSCore.List.Count(l) - 1; 0..count..1; }
listview_data = Custom[Listview Data](InputName=code_block_6, Keys=name, Values=filterByBoolMask.in, Height_optionnal=code_block_10.out0, ShowElementCount_optionnal=code_block_10.out2, DefaultValueIndices_optionnal=code_block_11.out1, SortItems_optionnal=code_block_10.out1, ShowId_optionnal=code_block_10.out1)  # package Data-Shapes; Create data for ListView input in UI.MultiInputForm ++ . Check out www.data-shapes.net for more infos.
code_block_12 = CodeBlock { "Escala"; }
code_block_13 = CodeBlock()
# ---------- code_block_13.designscript (10 lines) ----------
[
"1:50",
"1:75",
"1:100",
"1:125",
"1:150",
"1:175",
"1:200"
];
":";
# ----------------------------------------
split = String.Split(str=code_block_13.out0, separator0=code_block_13.out1)
code_block_14 = CodeBlock { 1; }
getItemAtIndex = List.GetItemAtIndex(list=split@L2, index=code_block_14)
toNumber = String.ToNumber(str=getItemAtIndex)
code_block_15 = CodeBlock { 0; false; }
dropdown_data = Custom[DropDown Data](InputName=code_block_12, Keys=code_block_13.out0, Values=toNumber, DefaultValueIndex=code_block_15.out0, Sorted_optional=code_block_15.out1)  # package Data-Shapes; Create data for DropDown input in UI.MultiInputForm ++ . Check out www.data-shapes.net for more infos.
list_create = List.Create(item0=listview_data, item1=dropdown_data)
all = Orchid.RevitProject.Views.View.All()
code_block_16 = CodeBlock { "Subclasificacion"; }
getParameterValueByName_2 = Element.GetParameterValueByName(element=all, parameterName=code_block_16)
code_block_17 = CodeBlock { "02_MA"; }
eq_2 = getParameterValueByName_2 == code_block_17
filterByBoolMask_2 = List.FilterByBoolMask(list=all, mask=eq_2)
isEmpty = List.IsEmpty(list=filterByBoolMask_2.in)
multipleinputform = Custom[MultipleInputForm ++](Description_optional=code_block_4, ButtonText_optional=code_block_5.out0, Inputs=list_create, Toggle=isEmpty, CancelButtonText_optional=code_block_5.out1, Width_optional=code_block_5.out3, LabelWidth_optional=code_block_5.out2)  # package Data-Shapes; Create a form with multiple inputs. see www.data-shapes.net for tutorials and infos!
code_block_18 = CodeBlock(l=multipleinputform.User_Inputs)
# ---------- code_block_18.designscript (16 lines) ----------
l;
[Imperative]
{
	if (l == null)
		{
		return = [[],[]];
		}
	elseif (l[0] == "Set toggle to true!")
		{
		return = [[],[]];
		}
	else
		{
		return = l;
		}
};
# ----------------------------------------
code_block_19 = CodeBlock(l=code_block_18.out1) { DSCore.List.Flatten(([l[0]]),1); }
nullToEmptyList = WombatDynamo.List.NullToEmptyList(data=code_block_19)
byLevel = StructuralPlanView.ByLevel(level=nullToEmptyList)
code_block_20 = CodeBlock { "Zona"; "GGENERAL"; }
setParameterByName = Element.SetParameterByName(element=byLevel, parameterName=code_block_20.out0, value=code_block_20.out1)
code_block_21 = CodeBlock { "Structural Plan (Cielo)"; "Type"; }
byName_3 = Orchid.RevitProject.Views.ViewType.ByName(name=code_block_21.out0)
setParameterByName_2 = Element.SetParameterByName(element=setParameterByName, parameterName=code_block_21.out1, value=byName_3)
code_block_22 = CodeBlock(l=code_block_18.out1) { DSCore.List.Flatten(([l[1]]),1); }
nullToEmptyList_2 = WombatDynamo.List.NullToEmptyList(data=code_block_22)
setScale = View.SetScale(view=setParameterByName_2, scale=nullToEmptyList_2, lacing=Longest)
code_block_23 = CodeBlock { null; }
replaceEmptyLists = Custom[List.ReplaceEmptyLists](seq=setScale, Replacement=code_block_23)  # package Clockwork for Dynamo 2.x; Replaces all empty lists within a given list with a substitute
all_2 = Orchid.RevitProject.Views.ViewTemplate.All()
name_2 = Element.Name(element=all_2)
code_block_24 = CodeBlock { "Architectural Reflected Ceiling Plan"; }
eq_3 = name_2 == code_block_24
filterByBoolMask_3 = List.FilterByBoolMask(list=all_2, mask=eq_3)
code_block_25 = CodeBlock(x=replaceEmptyLists, y=filterByBoolMask_3.in)
# ---------- code_block_25.designscript (14 lines) ----------
x;
y;

[Imperative]
{
	if (x == null)
		{
		return = [];
		}
	else
		{
		return = y;
		}
};
# ----------------------------------------
code_block_26 = CodeBlock { "01_ENTREGABLE_02_MA_STRUCTURAL PLAN (CIELO)"; }
duplicate_2 = Orchid.RevitProject.Views.ViewTemplate.Duplicate(viewTemplate=code_block_25.out2, name=code_block_26)
code_block_27 = CodeBlock()
# ---------- code_block_27.designscript (4 lines) ----------
[
"Clasificacion",
"Subclasificacion"
];
# ----------------------------------------
code_block_28 = CodeBlock { "01_ENTREGABLE"; "02_MA"; }
list_create_2 = List.Create(item0=code_block_28.out0, item1=code_block_28.out1)
setParameterByName_3 = Element.SetParameterByName(element=duplicate_2, parameterName=code_block_27, value=list_create_2, lacing=Longest)
uniqueItems = List.UniqueItems(list=setParameterByName_3)
code_block_29 = CodeBlock { null; }
replaceEmptyLists_2 = Custom[List.ReplaceEmptyLists](seq=uniqueItems, Replacement=code_block_29)
code_block_30 = CodeBlock { "Subclasificacion"; "NotEquals"; "02_MA"; }
code_block_31 = CodeBlock(x=replaceEmptyLists_2, y=code_block_30.out2)  # same code as code_block_25
create = Orchid.RevitProject.Filters.FilterRule.Create(parameter=code_block_30.out0, ruleType=code_block_30.out1, value=code_block_30.out2)
code_block_32 = CodeBlock { "Sections"; }
byName_4 = Category.ByName(name=code_block_32)
byRule = Orchid.RevitProject.Filters.ParameterFilter.ByRule(name=code_block_31.out2, filterRule=create, category=byName_4)
code_block_33 = CodeBlock { false; }
addFilter = Orchid.RevitProject.Views.View.AddFilter(view=uniqueItems, parameterFilter=byRule, visibility=code_block_33, lacing=Longest)
set = Orchid.RevitProject.Views.ViewTemplate.Set(view=setScale, viewTemplate=addFilter, lacing=Longest)
code_block_34 = CodeBlock { "View Name"; }
identity = Object.Identity(obj=set)
code_block_35 = CodeBlock()
# ---------- code_block_35.designscript (4 lines) ----------
[
"Type",
"Subclasificacion"
];
# ----------------------------------------
getParameterValueByName_3 = Element.GetParameterValueByName(element=identity@L1, parameterName=code_block_35@L2, lacing=Longest)
code_block_36 = CodeBlock { null; }
replaceEmptyLists_3 = Custom[List.ReplaceEmptyLists](seq=getParameterValueByName_3, Replacement=code_block_36)
code_block_37 = CodeBlock(x=replaceEmptyLists_3, y=getParameterValueByName_3)
# ---------- code_block_37.designscript (14 lines) ----------
x;
y;

[Imperative]
{
	if (x == null)
		{
		return = [null,null];
		}
	else
		{
		return = y;
		}
};
# ----------------------------------------
code_block_38 = CodeBlock { 1; }
getItemAtIndex_2 = List.GetItemAtIndex(list=code_block_37.out2@L2, index=code_block_38)
code_block_39 = CodeBlock { "_"; }
code_block_40 = CodeBlock { 0; }
getItemAtIndex_3 = List.GetItemAtIndex(list=code_block_37.out2@L2, index=code_block_40)
nullToEmptyList_3 = WombatDynamo.List.NullToEmptyList(data=getItemAtIndex_3)
name_3 = Element.Name(element=nullToEmptyList_3)
code_block_41 = CodeBlock { 0; 17; }
remove = String.Remove(str=name_3, startIndex=code_block_41.out0, count=code_block_41.out1)
code_block_42 = CodeBlock { ")"; ""; }
replace = String.Replace(str=remove, searchFor=code_block_42.out0, replaceWith=code_block_42.out1)
toUpper = String.ToUpper(str=replace)
name_4 = Element.Name(element=identity)
list_create_3 = List.Create(item0=getItemAtIndex_2, item1=toUpper, item2=name_4)
transpose = List.Transpose(lists=list_create_3)
join = String.Join(separator=code_block_39, string0=transpose@L2)
code_block_43 = CodeBlock(x=getItemAtIndex_2, y=join)
# ---------- code_block_43.designscript (14 lines) ----------
x;
y;

[Imperative]
{
	if (x[0] == null)
		{
		return = [];
		}
	else
		{
		return = y;
		}
};
# ----------------------------------------
code_block_44 = CodeBlock { 0; 3; }
remove_2 = String.Remove(str=code_block_43.out2, startIndex=code_block_44.out0, count=code_block_44.out1)
setParameterByName_4 = Element.SetParameterByName(element=set, parameterName=code_block_34, value=remove_2)
element_level = Custom[Element Level](element=setParameterByName_4)  # package Genius Loci; Gets an element's level. Based on a Clockwork's node
levelAbove = Custom[Level.LevelAbove](level=element_level)  # package archi-lab.net; This node takes an input of level and returns level above it.
empty = List.Empty()
replacenulls = Custom[© ReplaceNulls](lst=levelAbove, replace=empty)  # package Crumple; Replaces all nulls with a given substitute.
code_block_45 = CodeBlock { 1000; 300; }
set_viewrange = Custom[Set ViewRange](view=setParameterByName_4, TopLevel=replacenulls, Top=code_block_45.out1, CutLevel=element_level, CutPlane=code_block_45.out0, BottomLevel=element_level, Bottom=code_block_45.out0, DepthLevel=replacenulls, ViewDepth=code_block_45.out1, lacing=Longest)  # package Genius Loci; Set the view range of the given plan view.
code_block_46 = CodeBlock { "Title on Sheet"; }
name_5 = Element.Name(element=set_viewrange)
code_block_47 = CodeBlock { "_"; }
split_2 = String.Split(str=name_5, separator0=code_block_47)
code_block_48 = CodeBlock { null; }
replaceEmptyLists_4 = Custom[List.ReplaceEmptyLists](seq=split_2, Replacement=code_block_48)
code_block_49 = CodeBlock(x=replaceEmptyLists_4, y=split_2)
# ---------- code_block_49.designscript (14 lines) ----------
x;
y;

[Imperative]
{
	if (x == null)
		{
		return = [null,null,null,null];
		}
	else
		{
		return = y;
		}
};
# ----------------------------------------
code_block_50 = CodeBlock { 2; }
getItemAtIndex_4 = List.GetItemAtIndex(list=code_block_49.out2@L2, index=code_block_50)
code_block_51 = CodeBlock { 3; }
getItemAtIndex_5 = List.GetItemAtIndex(list=code_block_49.out2@L2, index=code_block_51)
code_block_52 = CodeBlock(nivel=getItemAtIndex_4, num=getItemAtIndex_5) { "PLANTA LOSA CIELO "+nivel+" "+num; }
setParameterByName_5 = Element.SetParameterByName(element=set_viewrange, parameterName=code_block_46, value=code_block_52)
flatten = List.Flatten(list=setParameterByName_5)
uniqueItems_2 = List.UniqueItems(list=flatten)
code_block_53 = CodeBlock { "Subclasificacion"; }
getParameterValueByName_4 = Element.GetParameterValueByName(element=uniqueItems_2, parameterName=code_block_53)
uniqueItems_3 = List.UniqueItems(list=getParameterValueByName_4)
code_block_54 = CodeBlock { null; }
replaceEmptyLists_5 = Custom[List.ReplaceEmptyLists](seq=uniqueItems_3, Replacement=code_block_54)
all_3 = Orchid.RevitProject.Views.ViewTemplate.All()
name_6 = Element.Name(element=all_3)
code_block_55 = CodeBlock { "Architectural Section"; }
eq_4 = name_6 == code_block_55
filterByBoolMask_4 = List.FilterByBoolMask(list=all_3, mask=eq_4)
code_block_56 = CodeBlock(x=replaceEmptyLists_5, y=filterByBoolMask_4.in)  # same code as code_block_25
code_block_57 = CodeBlock { "01_ENTREGABLE_02_MA_DETAIL"; }
duplicate_3 = Orchid.RevitProject.Views.ViewTemplate.Duplicate(viewTemplate=code_block_56.out2, name=code_block_57)
code_block_58 = CodeBlock(x=replaceEmptyLists_5)
# ---------- code_block_58.designscript (13 lines) ----------
x;

[Imperative]
{
	if (x == null)
		{
		return = [];
		}
	else
		{
		return = x[0];
		}
};
# ----------------------------------------
code_block_59 = CodeBlock(tip=code_block_58.out1)
# ---------- code_block_59.designscript (13 lines) ----------
[
"Clasificacion",
"Subclasificacion",
"Zona",
"Discipline"
];

[
"01_ENTREGABLE",
tip,
"GENERAL",
2
];
# ----------------------------------------
setParameterByName_6 = Element.SetParameterByName(element=duplicate_3, parameterName=code_block_59.out0, value=code_block_59.out1, lacing=Longest)
uniqueItems_4 = List.UniqueItems(list=setParameterByName_6)
code_block_60 = CodeBlock { "02_MA"; }
await_ = Orchid.Common.DataStream.Await(pass=code_block_60, waitFor=uniqueItems_4)
byName_5 = Orchid.RevitProject.Filters.ParameterFilter.ByName(name=await_)
code_block_61 = CodeBlock { false; }
addFilter_2 = Orchid.RevitProject.Views.View.AddFilter(view=uniqueItems_4, parameterFilter=byName_5, visibility=code_block_61, lacing=Longest)
end = Revit.Transaction.Transaction.End(input=addFilter_2)
setParameterByName_7 = Element.SetParameterByName(element=duplicate, parameterName=code_block_3, value=end)
code_block_62 = CodeBlock { "Planta Ubicacion Elev. por Eje - MA"; }
code_block_63 = CodeBlock { "OK"; 450; }
code_block_64 = CodeBlock { "Error"; }
code_block_65 = CodeBlock { "Las vistas de esta categoria ya fueron generadas. Para vistas adicionales, duplicar de las ya existentes."; }
textnote_data = Custom[TextNote Data](Title=code_block_64, TextNote=code_block_65)  # package Data-Shapes; Create Data for TextNote input in UI.MultipleInputForm ++ . Check out www.data-shapes.net for more informations
code_block_66 = CodeBlock { false; }
eq_5 = multipleinputform.Was_Run == code_block_66
code_block_67 = CodeBlock { true; false; }
scopeIf = Custom[ScopeIf+](test=eq_5, True=code_block_67.out0, False=code_block_67.out1)  # package Clockwork for Dynamo 2.x; A (hopefully) more robust implementation of ScopeIf. Tests a single boolean and returns a value accordingly.
multipleinputform_2 = Custom[MultipleInputForm ++](Description_optional=code_block_62, ButtonText_optional=code_block_63.out0, Inputs=textnote_data, Toggle=scopeIf, Width_optional=code_block_63.out1)
code_block_68 = CodeBlock { "Building Section"; }
byName_6 = Orchid.RevitProject.Views.ViewType.ByName(name=code_block_68)
code_block_69 = CodeBlock { "Building Section (02_MA)"; }
duplicate_4 = archilab.Revit.Elements.ElementTypes.Duplicate(element=byName_6, name=code_block_69)
code_block_70 = CodeBlock { "View Template applied to new views"; }
code_block_71 = CodeBlock { null; }
replaceEmptyLists_6 = Custom[List.ReplaceEmptyLists](seq=uniqueItems_3, Replacement=code_block_71)
all_4 = Orchid.RevitProject.Views.ViewTemplate.All()
name_7 = Element.Name(element=all_4)
code_block_72 = CodeBlock { "Architectural Section"; }
eq_6 = name_7 == code_block_72
filterByBoolMask_5 = List.FilterByBoolMask(list=all_4, mask=eq_6)
code_block_73 = CodeBlock(x=replaceEmptyLists_6, y=filterByBoolMask_5.in)  # same code as code_block_25
code_block_74 = CodeBlock { "01_ENTREGABLE_02_MA_BUILDING SECTION"; }
duplicate_5 = Orchid.RevitProject.Views.ViewTemplate.Duplicate(viewTemplate=code_block_73.out2, name=code_block_74)
code_block_75 = CodeBlock(x=replaceEmptyLists_6)  # same code as code_block_58
code_block_76 = CodeBlock(tip=code_block_75.out1)  # same code as code_block_59
setParameterByName_8 = Element.SetParameterByName(element=duplicate_5, parameterName=code_block_76.out0, value=code_block_76.out1, lacing=Longest)
uniqueItems_5 = List.UniqueItems(list=setParameterByName_8)
code_block_77 = CodeBlock { "02_MA"; }
await_2 = Orchid.Common.DataStream.Await(pass=code_block_77, waitFor=uniqueItems_5)
byName_7 = Orchid.RevitProject.Filters.ParameterFilter.ByName(name=await_2)
code_block_78 = CodeBlock { false; }
addFilter_3 = Orchid.RevitProject.Views.View.AddFilter(view=uniqueItems_5, parameterFilter=byName_7, visibility=code_block_78, lacing=Longest)
end_2 = Revit.Transaction.Transaction.End(input=addFilter_3)
setParameterByName_9 = Element.SetParameterByName(element=duplicate_4, parameterName=code_block_70, value=end_2)
