# Dynamo graph acotadoAnchoFundacion_script.dyn "acotadoEspesorFundacion_script" (Dynamo 2.3.2.15696)
# packages: Orchid 200.4.0.7938, Clockwork for Dynamo 2.x 2.4.0, Genius Loci 2021.11.10

activeView = Orchid.RevitProject.Common.Document.ActiveView()
code_block = CodeBlock { "Structural Foundations"; }
byName = Category.ByName(name=code_block)
activeView_2 = Orchid.RevitProject.Common.Document.ActiveView()
all_elements_of_category_in_view = ElementsOfCategoryInView(Category=byName, View=activeView_2)
kind = Custom[StructuralFoundation.Kind](structuralFoundation=all_elements_of_category_in_view)  # package Clockwork for Dynamo 2.x; Retrieves the kind of a given structural foundation (isolated, wall, slab).
code_block_2 = CodeBlock(x=kind) { x == "Wall Footing"; }
filterByBoolMask = List.FilterByBoolMask(list=all_elements_of_category_in_view, mask=code_block_2)
element_surfaces_references = Custom[Element Surfaces References](element=filterByBoolMask.in)  # package Genius Loci; Retrieve the top, bottom, side surfaces and their associated references of the system family. This doesn't work with cylindrical system families (pipe...)
code_block_3 = CodeBlock { [0,1]; }
getItemAtIndex = List.GetItemAtIndex(list=element_surfaces_references.Vertical_Surface@L2, index=code_block_3)
code_block_4 = CodeBlock { 0.3; 0.5; }
pointAtParameter = Surface.PointAtParameter(surface=getItemAtIndex, u=code_block_4.out1, v=code_block_4.out0)
byBestFitThroughPoints = Line.ByBestFitThroughPoints(bestFitPoints=pointAtParameter)
code_block_5 = CodeBlock { [0,1]; }
getItemAtIndex_2 = List.GetItemAtIndex(list=element_surfaces_references.Vertical_Reference@L2, index=code_block_5)
dimension_byreferences = Custom[Dimension ByReferences](view=activeView, line=byBestFitThroughPoints, references=getItemAtIndex_2@L2, lacing=Longest)  # package Genius Loci; Creates a new linear dimension from at least two geometric references of an object.
