# Dynamo graph parcialEntreEjesPlanta_script.dyn "parcialEntreEjesPlanta" (Dynamo 2.3.2.15696)
# packages: Orchid 200.4.0.7938, Clockwork for Dynamo 2.x 2.4.0, Genius Loci 2021.11.10

activeView = Orchid.RevitProject.Common.Document.ActiveView()
code_block = CodeBlock(x=activeView) { x; }
code_block_2 = CodeBlock(x=activeView) { x; }
getCropBox = Orchid.RevitProject.Views.View.GetCropBox(view=code_block_2)
plane = Custom[View.Plane](view=code_block_2)  # package Clockwork for Dynamo 2.x; Retrieves the plane of a given view
pullOntoPlane = Curve.PullOntoPlane(curve=getCropBox.Curve, plane=plane)
code_block_3 = CodeBlock(x=pullOntoPlane) { x; }
code_block_4 = CodeBlock { "Grids"; }
byName = Category.ByName(name=code_block_4)
code_block_5 = CodeBlock(x=activeView) { x; }
all_elements_of_category_in_view = ElementsOfCategoryInView(Category=byName, View=code_block_5)
code_block_6 = CodeBlock(x=all_elements_of_category_in_view) { x; }
code_block_7 = CodeBlock(x=pullOntoPlane) { x[0]; }
curve = Grid.Curve(grid=all_elements_of_category_in_view)
plane_2 = Custom[View.Plane](view=code_block_5)
pullOntoPlane_2 = Curve.PullOntoPlane(curve=curve, plane=plane_2)
doesIntersect = Geometry.DoesIntersect(geometry=code_block_7, other=pullOntoPlane_2)
filterByBoolMask = List.FilterByBoolMask(list=code_block_6, mask=doesIntersect)
code_block_8 = CodeBlock(x=pullOntoPlane) { x[1]; }
doesIntersect_2 = Geometry.DoesIntersect(geometry=code_block_8, other=pullOntoPlane_2)
filterByBoolMask_2 = List.FilterByBoolMask(list=code_block_6, mask=doesIntersect_2)
code_block_9 = CodeBlock(x=pullOntoPlane) { x[2]; }
doesIntersect_3 = Geometry.DoesIntersect(geometry=code_block_9, other=pullOntoPlane_2)
filterByBoolMask_3 = List.FilterByBoolMask(list=code_block_6, mask=doesIntersect_3)
code_block_10 = CodeBlock(x=pullOntoPlane) { x[3]; }
doesIntersect_4 = Geometry.DoesIntersect(geometry=code_block_10, other=pullOntoPlane_2)
filterByBoolMask_4 = List.FilterByBoolMask(list=code_block_6, mask=doesIntersect_4)
list_create = List.Create(item0=filterByBoolMask.in, item1=filterByBoolMask_2.in, item2=filterByBoolMask_3.in, item3=filterByBoolMask_4.in)
element_reference = Custom[Element Reference](element=list_create@L2)  # package Genius Loci; Gets the reference of a geometric object or a dimension or a reference plane.
dimension_byreferences = Custom[Dimension ByReferences](view=code_block@L1, line=code_block_3@L1, references=element_reference@L2, lacing=Longest)  # package Genius Loci; Creates a new linear dimension from at least two geometric references of an object.
