# Dynamo graph Duplica Vistas_script.dyn (Dynamo 2.3.1.11775)
# packages: archi-lab.net 2022.210.2419, Data-Shapes 2021.2.94, Clockwork for Dynamo 2.x 2.4.0

boolean = BoolSelector(true)
code_block = CodeBlock { "Duplica Plantas por Categoria y Zona"; }
code_block_2 = CodeBlock()
# ---------- code_block_2.designscript (6 lines) ----------
//Width
450;

//Botones
"SELECCIONAR";
"CANCELAR";
# ----------------------------------------
code_block_3 = CodeBlock { "CeilingPlan"; }
getByType = archilab.Revit.Views.Views.GetByType(viewType=code_block_3)
code_block_4 = CodeBlock { "EngineeringPlan"; }
getByType_2 = archilab.Revit.Views.Views.GetByType(viewType=code_block_4)
code_block_5 = CodeBlock(l1=getByType, l2=getByType_2) { DSCore.List.Flatten([l1,l2],1); }
code_block_6 = CodeBlock { "Subclasificacion"; }
getParameterValueByName = Element.GetParameterValueByName(element=code_block_5, parameterName=code_block_6)
code_block_7 = CodeBlock { "Duplica Plantas por Categoria y Zona"; }
code_block_8 = CodeBlock()  # same code as code_block_2
code_block_9 = CodeBlock { "Categoria de\nlas Plantas"; }
code_block_10 = CodeBlock()
# ---------- code_block_10.designscript (11 lines) ----------
[
"Plantas Generales - PG",
"Plantas Losa - LO"
];

[
"00_PG",
"01_LO"
];

0;
# ----------------------------------------
radiobuttons_data = Custom[RadioButtons Data](InputName=code_block_9, Keys=code_block_10.out0, Values=code_block_10.out1, DefaultValueIndex=code_block_10.out2)  # package Data-Shapes; Create radio buttons input for UI.MultipleInputForm ++ .
boolean_2 = BoolSelector(true)
multipleinputform = Custom[MultipleInputForm ++](Description_optional=code_block_7, ButtonText_optional=code_block_8.out1, Inputs=radiobuttons_data, Toggle=boolean_2, CancelButtonText_optional=code_block_8.out2, Width_optional=code_block_8.out0)  # package Data-Shapes; Create a form with multiple inputs. see www.data-shapes.net for tutorials and infos!
code_block_11 = CodeBlock(l=multipleinputform.User_Inputs)
# ---------- code_block_11.designscript (13 lines) ----------
l;

[Imperative]
{
	if (l == null)
		{
		return = [[],false];
		}
	else
		{
		return = [l[0],true];
		}
};
# ----------------------------------------
code_block_12 = CodeBlock(l=code_block_11.out1) { l[0]; }
eq = getParameterValueByName == code_block_12  # lacing=Longest
filterByBoolMask = List.FilterByBoolMask(list=code_block_5, mask=eq)
code_block_13 = CodeBlock { "Subclasificacion"; }
getParameterValueByName_2 = Element.GetParameterValueByName(element=filterByBoolMask.in, parameterName=code_block_13)
uniqueItems = List.UniqueItems(list=getParameterValueByName_2)
name = Element.Name(element=filterByBoolMask.in)
code_block_14 = CodeBlock()
# ---------- code_block_14.designscript (8 lines) ----------
//ElemCount
true;

//SortItem
false;

//Id
false;
# ----------------------------------------
listview_data = Custom[Listview Data](InputName=uniqueItems, Keys=name, Values=filterByBoolMask.in, ShowElementCount_optionnal=code_block_14.out0, SortItems_optionnal=code_block_14.out1, ShowId_optionnal=code_block_14.out2)  # package Data-Shapes; Create data for ListView input in UI.MultiInputForm ++ . Check out www.data-shapes.net for more infos.
code_block_15 = CodeBlock { "Zona"; }
code_block_16 = CodeBlock { "Escribe aqui el nombre de la Zona"; }
textbox_data = Custom[TextBox Data](InputName=code_block_15, DefaultText=code_block_16)  # package Data-Shapes; Create Data for TextBox input in UI.MultipleInputForm ++ . Check out www.data-shapes.net for more informations
code_block_17 = CodeBlock { "Escala"; }
code_block_18 = CodeBlock()
# ---------- code_block_18.designscript (10 lines) ----------
[
"1:50",
"1:75",
"1:100",
"1:125",
"1:150",
"1:175",
"1:200"
];
":";
# ----------------------------------------
split = String.Split(str=code_block_18.out0, separator0=code_block_18.out1)
code_block_19 = CodeBlock { 1; }
getItemAtIndex = List.GetItemAtIndex(list=split@L2, index=code_block_19)
toNumber = String.ToNumber(str=getItemAtIndex)
code_block_20 = CodeBlock { 0; false; }
dropdown_data = Custom[DropDown Data](InputName=code_block_17, Keys=code_block_18.out0, Values=toNumber, DefaultValueIndex=code_block_20.out0, Sorted_optional=code_block_20.out1)  # package Data-Shapes; Create data for DropDown input in UI.MultiInputForm ++ . Check out www.data-shapes.net for more infos.
list_create = List.Create(item0=listview_data, item1=textbox_data, item2=dropdown_data)
flatten = List.Flatten(list=list_create)
inputgroup_data = Custom[InputGroup Data](Inputs=flatten)  # package Data-Shapes; Creates a group of inputs for UI.MultipleInputForm ++ . Check out www.data-shapes.net for more infos !
code_block_21 = CodeBlock(l=code_block_11.out1) { l[1]; }
multipleinputform_2 = Custom[MultipleInputForm ++](Description_optional=code_block, ButtonText_optional=code_block_2.out1, Inputs=inputgroup_data, Toggle=code_block_21, CancelButtonText_optional=code_block_2.out2, Width_optional=code_block_2.out0)
code_block_22 = CodeBlock(l=multipleinputform_2.User_Inputs)
# ---------- code_block_22.designscript (16 lines) ----------
l;
[Imperative]
{
	if (l == null)
		{
		return = [[],[],[]];
		}
	elseif (l[0] == "Set toggle to true!")
		{
		return = [[],[],[]];
		}
	else
		{
		return = l;
		}
};
# ----------------------------------------
code_block_23 = CodeBlock(l=code_block_22.out1) { l[0]; }
code_block_24 = CodeBlock(l=code_block_22.out1) { l[0].Name+"_"+DSCore.String.ToUpper(l[1]); }
duplicate = Custom[View.Duplicate](view=code_block_23, name=code_block_24)  # package Clockwork for Dynamo 2.x; Duplicates a given view
code_block_25 = CodeBlock { "Zona"; }
code_block_26 = CodeBlock(l=code_block_22.out1) { DSCore.String.ToUpper(l[1]); }
setParameterByName = Element.SetParameterByName(element=duplicate, parameterName=code_block_25, value=code_block_26)
code_block_27 = CodeBlock(l=code_block_22.out1) { l[2]; }
setScale = View.SetScale(view=setParameterByName, scale=code_block_27)
