# Dynamo graph cotasElevacion_script.dyn (Dynamo 2.3.2.15696)
# packages: Genius Loci 2021.11.10, Orchid 200.4.0.7938, Clockwork for Dynamo 2.x 2.4.0

activeView = Orchid.RevitProject.Common.Document.ActiveView()
code_block = CodeBlock(x=activeView) { x; }

# group: Cota Losas, Radier y Sello de Fundacion
code_block_2 = CodeBlock { null; }
replaceEmptyLists = Custom[List.ReplaceEmptyLists](seq=code_block, Replacement=code_block_2)  # package Clockwork for Dynamo 2.x; Replaces all empty lists within a given list with a substitute
code_block_3 = CodeBlock(x=replaceEmptyLists)
# ---------- code_block_3.designscript (12 lines) ----------
x;
[Imperative]
{
	if(x == null)
	{
		return = [];
	}
	else
	{
		return = x;
	}
};
# ----------------------------------------
code_block_4 = CodeBlock(x=code_block_3.out1) { x; }
code_block_5 = CodeBlock(x=code_block_3.out1) { x; }
getCropBox = Orchid.RevitProject.Views.View.GetCropBox(view=code_block_5)
code_block_6 = CodeBlock { null; }
replaceEmptyLists_2 = Custom[List.ReplaceEmptyLists](seq=getCropBox.Curve, Replacement=code_block_6)
code_block_7 = CodeBlock(x=replaceEmptyLists_2)
# ---------- code_block_7.designscript (12 lines) ----------
x;
[Imperative]
{
	if(x == null)
	{
		return = [];
	}
	else
	{
		return = x[2];
	}
};
# ----------------------------------------
code_block_8 = CodeBlock(x=code_block_7.out1) { x; }
code_block_9 = CodeBlock { 0.5; }
planeAtParameter = Curve.PlaneAtParameter(curve=code_block_8, param=code_block_9)
pointAtParameter = Curve.PointAtParameter(curve=code_block_8, param=code_block_9)
plane = Custom[View.Plane](view=code_block_5)  # package Clockwork for Dynamo 2.x; Retrieves the plane of a given view
normal = Plane.Normal(plane=plane)
byOriginNormal = Plane.ByOriginNormal(origin=pointAtParameter, normal=normal)
normal_2 = Plane.Normal(plane=byOriginNormal)
code_block_10 = CodeBlock { 90; }
rotate = Geometry.Rotate(geometry=planeAtParameter, origin=pointAtParameter, axis=normal_2, degrees=code_block_10)
normal_3 = Plane.Normal(plane=rotate)
code_block_11 = CodeBlock { 350; }
translate = Geometry.Translate(geometry=code_block_7.out1, direction=normal_3, distance=code_block_11)
code_block_12 = CodeBlock { "Floors"; }
byName = Category.ByName(name=code_block_12)
all_elements_of_category_in_view = ElementsOfCategoryInView(Category=byName, View=code_block_5)
code_block_13 = CodeBlock { "Slope"; }
getParameterValueByName = Element.GetParameterValueByName(element=all_elements_of_category_in_view, parameterName=code_block_13)
code_block_14 = CodeBlock { ""; }
eq = getParameterValueByName == code_block_14
filterByBoolMask = List.FilterByBoolMask(list=all_elements_of_category_in_view, mask=eq)
level = Custom[Element.Level]()  # package Clockwork for Dynamo 2.x; Gets an element's level; unwired: element
groupByFunction = List.GroupByFunction(list=filterByBoolMask.in, func=level)
code_block_15 = CodeBlock { "Height Offset From Level"; }
getParameterValueByName_2 = Element.GetParameterValueByName(element=groupByFunction, parameterName=code_block_15)
minimumItem = List.MinimumItem(list=getParameterValueByName_2@L2)
code_block_16 = CodeBlock(x=minimumItem)
# ---------- code_block_16.designscript (12 lines) ----------
x;
[Imperative]
{
	if(x[0] == null)
	{
		return = [];
	}
	else
	{
		return = x;
	}
};
# ----------------------------------------
eq_2 = getParameterValueByName_2@L2 == code_block_16.out1@L1
filterByBoolMask_2 = List.FilterByBoolMask(list=groupByFunction, mask=eq_2)
code_block_17 = CodeBlock { "Structural Foundations"; }
byName_2 = Category.ByName(name=code_block_17)
all_elements_of_category_in_view_2 = ElementsOfCategoryInView(Category=byName_2, View=code_block_5)
familyName = Orchid.RevitProject.Elements.Element.FamilyName(element=all_elements_of_category_in_view_2)
code_block_18 = CodeBlock { "EST_M_STRUCTURAL FOUNDATION_FUNDACION AISLADA"; }
eq_3 = familyName == code_block_18
code_block_19 = CodeBlock { "Wall Foundation"; }
eq_4 = familyName == code_block_19
or_ = eq_3 || eq_4
filterByBoolMask_3 = List.FilterByBoolMask(list=all_elements_of_category_in_view_2, mask=or_)
code_block_20 = CodeBlock { null; }
replaceEmptyLists_3 = Custom[List.ReplaceEmptyLists](seq=filterByBoolMask_3.in, Replacement=code_block_20)
code_block_21 = CodeBlock(x=replaceEmptyLists_3)
# ---------- code_block_21.designscript (12 lines) ----------
x;
[Imperative]
{
	if(x == null)
	{
		return = [];
	}
	else
	{
		return = x[0];
	}
};
# ----------------------------------------
element_surfaces_references = Custom[Element Surfaces References](element=code_block_21.out1)  # package Genius Loci; Retrieve the top, bottom, side surfaces and their associated references of the system family. This doesn't work with cylindrical system families (pipe...)
code_block_22 = CodeBlock { null; }
replaceEmptyLists_4 = Custom[List.ReplaceEmptyLists](seq=element_surfaces_references.Bottom_Reference, Replacement=code_block_22)
code_block_23 = CodeBlock(x=replaceEmptyLists_4)  # same code as code_block_21
all = Orchid.RevitProject.Annotations.DimensionType.All()
name = Element.Name(element=all)
code_block_24 = CodeBlock { "Linear - 2.5mm Arial"; }
eq_5 = name == code_block_24
filterByBoolMask_4 = List.FilterByBoolMask(list=all, mask=eq_5)
code_block_25 = CodeBlock(x=filterByBoolMask_4.in) { x[0]; }

flatten = List.Flatten(list=filterByBoolMask_2.in)

# group (continued): Cota Losas, Radier y Sello de Fundacion
element_surfaces_references_2 = Custom[Element Surfaces References](element=flatten@L1)
code_block_26 = CodeBlock(x=element_surfaces_references_2.Top_Reference) { DSCore.List.Flatten(x,2); }
code_block_27 = CodeBlock(refLosas=code_block_26, refrFunAis=code_block_23.out1) { DSCore.List.Flatten(([refLosas,refrFunAis]),2); }
dimension_byreferences = Custom[Dimension ByReferences](view=code_block_4, line=translate, references=code_block_27, dimensionType=code_block_25)  # package Genius Loci; Creates a new linear dimension from at least two geometric references of an object.

# group: Cota Radier, Tope y Sello de Fundacion
code_block_28 = CodeBlock { null; }
replaceEmptyLists_5 = Custom[List.ReplaceEmptyLists](seq=code_block, Replacement=code_block_28)
code_block_29 = CodeBlock(x=replaceEmptyLists_5)  # same code as code_block_3
code_block_30 = CodeBlock(x=code_block_29.out1) { x; }
code_block_31 = CodeBlock(x=code_block_29.out1) { x; }
getCropBox_2 = Orchid.RevitProject.Views.View.GetCropBox(view=code_block_31)
code_block_32 = CodeBlock { null; }
replaceEmptyLists_6 = Custom[List.ReplaceEmptyLists](seq=getCropBox_2.Curve, Replacement=code_block_32)
code_block_33 = CodeBlock(x=replaceEmptyLists_6)  # same code as code_block_7
code_block_34 = CodeBlock { "Floors"; }
byName_3 = Category.ByName(name=code_block_34)
all_elements_of_category_in_view_3 = ElementsOfCategoryInView(Category=byName_3, View=code_block_31)
code_block_35 = CodeBlock { "Slope"; }
getParameterValueByName_3 = Element.GetParameterValueByName(element=all_elements_of_category_in_view_3, parameterName=code_block_35)
code_block_36 = CodeBlock { ""; }
eq_6 = getParameterValueByName_3 == code_block_36
filterByBoolMask_5 = List.FilterByBoolMask(list=all_elements_of_category_in_view_3, mask=eq_6)
element_level = Custom[Element Level](element=filterByBoolMask_5.in)  # package Genius Loci; Gets an element's level. Based on a Clockwork's node
elevation = Level.Elevation(level=element_level)
minimumItem_2 = List.MinimumItem(list=elevation)
eq_7 = elevation == minimumItem_2
filterByBoolMask_6 = List.FilterByBoolMask(list=filterByBoolMask_5.in, mask=eq_7)
element_surfaces_references_3 = Custom[Element Surfaces References](element=filterByBoolMask_6.in)
code_block_37 = CodeBlock(x=element_surfaces_references_3.Top_Reference) { DSCore.List.Flatten(x,2); }
code_block_38 = CodeBlock { "Structural Foundations"; }
byName_4 = Category.ByName(name=code_block_38)
all_elements_of_category_in_view_4 = ElementsOfCategoryInView(Category=byName_4, View=code_block_31)
familyName_2 = Orchid.RevitProject.Elements.Element.FamilyName(element=all_elements_of_category_in_view_4)
code_block_39 = CodeBlock { "EST_M_STRUCTURAL FOUNDATION_FUNDACION AISLADA"; }
eq_8 = familyName_2 == code_block_39
code_block_40 = CodeBlock { "Wall Foundation"; }
eq_9 = familyName_2 == code_block_40
or_2 = eq_8 || eq_9
filterByBoolMask_7 = List.FilterByBoolMask(list=all_elements_of_category_in_view_4, mask=or_2)
code_block_41 = CodeBlock { null; }
replaceEmptyLists_7 = Custom[List.ReplaceEmptyLists](seq=filterByBoolMask_7.in, Replacement=code_block_41)
code_block_42 = CodeBlock(x=replaceEmptyLists_7)  # same code as code_block_21
element_surfaces_references_4 = Custom[Element Surfaces References](element=code_block_42.out1)
list_create = List.Create(item0=element_surfaces_references_4.Top_Reference, item1=element_surfaces_references_4.Bottom_Reference)
flatten_2 = List.Flatten(list=list_create)
code_block_43 = CodeBlock { null; }
replaceEmptyLists_8 = Custom[List.ReplaceEmptyLists](seq=flatten_2, Replacement=code_block_43)
code_block_44 = CodeBlock(x=replaceEmptyLists_8)  # same code as code_block_3
code_block_45 = CodeBlock(refLosas=code_block_37, refrFunAis=code_block_44.out1) { DSCore.List.Flatten(([refLosas,refrFunAis]),2); }
all_2 = Orchid.RevitProject.Annotations.DimensionType.All()
name_2 = Element.Name(element=all_2)
code_block_46 = CodeBlock { "Linear - 2.5mm Arial"; }
eq_10 = name_2 == code_block_46
filterByBoolMask_8 = List.FilterByBoolMask(list=all_2, mask=eq_10)
code_block_47 = CodeBlock(x=filterByBoolMask_8.in) { x[0]; }
dimension_byreferences_2 = Custom[Dimension ByReferences](view=code_block_30, line=code_block_33.out1, references=code_block_45, dimensionType=code_block_47)
