# Dynamo graph cotasElevacion_script.dyn (Dynamo 2.3.2.15696)
# packages: Genius Loci 2021.11.10, Clockwork for Dynamo 2.x 2.4.0, Rhythm 2020.7.25, Orchid 200.4.0.7938

activeView = Orchid.RevitProject.Common.Document.ActiveView()
code_block = CodeBlock(x=activeView) { x; }

# group: Cota Radier, Tope y Sello de Fundacion
code_block_2 = CodeBlock { null; }
replaceEmptyLists = Custom[List.ReplaceEmptyLists](seq=code_block, Replacement=code_block_2)  # package Clockwork for Dynamo 2.x; Replaces all empty lists within a given list with a substitute
code_block_3 = CodeBlock(x=replaceEmptyLists)
# ---------- code_block_3.designscript (12 lines) ----------
x;
[Imperative]
{
	if(x == null)
	{
		return = [];
	}
	else
	{
		return = x;
	}
};
# ----------------------------------------
code_block_4 = CodeBlock(x=code_block_3.out1) { x; }
code_block_5 = CodeBlock(x=code_block_3.out1) { x; }
getCropBox = Orchid.RevitProject.Views.View.GetCropBox(view=code_block_5)
code_block_6 = CodeBlock { null; }
replaceEmptyLists_2 = Custom[List.ReplaceEmptyLists](seq=getCropBox.Curve, Replacement=code_block_6)
code_block_7 = CodeBlock(x=replaceEmptyLists_2)
# ---------- code_block_7.designscript (12 lines) ----------
x;
[Imperative]
{
	if(x == null)
	{
		return = [];
	}
	else
	{
		return = x[2];
	}
};
# ----------------------------------------
code_block_8 = CodeBlock { "Floors"; }
byName = Category.ByName(name=code_block_8)
all_elements_of_category_in_view = ElementsOfCategoryInView(Category=byName, View=code_block_5)
code_block_9 = CodeBlock { "Slope"; }
getParameterValueByName = Element.GetParameterValueByName(element=all_elements_of_category_in_view, parameterName=code_block_9)
code_block_10 = CodeBlock { ""; }
eq = getParameterValueByName == code_block_10
filterByBoolMask = List.FilterByBoolMask(list=all_elements_of_category_in_view, mask=eq)
element_level = Custom[Element Level](element=filterByBoolMask.in)  # package Genius Loci; Gets an element's level. Based on a Clockwork's node
elevation = Level.Elevation(level=element_level)
minimumItem = List.MinimumItem(list=elevation)
eq_2 = elevation == minimumItem
filterByBoolMask_2 = List.FilterByBoolMask(list=filterByBoolMask.in, mask=eq_2)
element_surfaces_references = Custom[Element Surfaces References](element=filterByBoolMask_2.in)  # package Genius Loci; Retrieve the top, bottom, side surfaces and their associated references of the system family. This doesn't work with cylindrical system families (pipe...)
code_block_11 = CodeBlock(x=element_surfaces_references.Top_Reference) { DSCore.List.Flatten(x,2); }
code_block_12 = CodeBlock { "Structural Foundations"; }
byName_2 = Category.ByName(name=code_block_12)
all_elements_of_category_in_view_2 = ElementsOfCategoryInView(Category=byName_2, View=code_block_5)
familyName = Orchid.RevitProject.Elements.Element.FamilyName(element=all_elements_of_category_in_view_2)
code_block_13 = CodeBlock { "EST_M_STRUCTURAL FOUNDATION_FUNDACION AISLADA"; }
eq_3 = familyName == code_block_13
code_block_14 = CodeBlock { "Wall Foundation"; }
eq_4 = familyName == code_block_14
or_ = eq_3 || eq_4
filterByBoolMask_3 = List.FilterByBoolMask(list=all_elements_of_category_in_view_2, mask=or_)
code_block_15 = CodeBlock { null; }
replaceEmptyLists_3 = Custom[List.ReplaceEmptyLists](seq=filterByBoolMask_3.in, Replacement=code_block_15)
code_block_16 = CodeBlock(x=replaceEmptyLists_3)
# ---------- code_block_16.designscript (12 lines) ----------
x;
[Imperative]
{
	if(x == null)
	{
		return = [];
	}
	else
	{
		return = x[0];
	}
};
# ----------------------------------------
element_surfaces_references_2 = Custom[Element Surfaces References](element=code_block_16.out1)
list_create = List.Create(item0=element_surfaces_references_2.Top_Reference, item1=element_surfaces_references_2.Bottom_Reference)
flatten = List.Flatten(list=list_create)
code_block_17 = CodeBlock { null; }
replaceEmptyLists_4 = Custom[List.ReplaceEmptyLists](seq=flatten, Replacement=code_block_17)
code_block_18 = CodeBlock(x=replaceEmptyLists_4)  # same code as code_block_3
code_block_19 = CodeBlock(refLosas=code_block_11, refrFunAis=code_block_18.out1) { DSCore.List.Flatten(([refLosas,refrFunAis]),2); }
all = Orchid.RevitProject.Annotations.DimensionType.All()
name = Element.Name(element=all)
code_block_20 = CodeBlock { "Linear - 2.5mm Arial"; }
eq_5 = name == code_block_20
filterByBoolMask_4 = List.FilterByBoolMask(list=all, mask=eq_5)
code_block_21 = CodeBlock(x=filterByBoolMask_4.in) { x[0]; }
dimension_byreferences = Custom[Dimension ByReferences](view=code_block_4, line=code_block_7.out1, references=code_block_19, dimensionType=code_block_21)  # package Genius Loci; Creates a new linear dimension from at least two geometric references of an object.

# group: Cota Losas, Radier y Sello de Fundacion
code_block_22 = CodeBlock { null; }
replaceEmptyLists_5 = Custom[List.ReplaceEmptyLists](seq=code_block, Replacement=code_block_22)
code_block_23 = CodeBlock(x=replaceEmptyLists_5)  # same code as code_block_3
code_block_24 = CodeBlock(x=code_block_23.out1) { x; }
code_block_25 = CodeBlock(x=code_block_23.out1) { x; }
getCropBox_2 = Orchid.RevitProject.Views.View.GetCropBox(view=code_block_25)
code_block_26 = CodeBlock { null; }
replaceEmptyLists_6 = Custom[List.ReplaceEmptyLists](seq=getCropBox_2.Curve, Replacement=code_block_26)
code_block_27 = CodeBlock(x=replaceEmptyLists_6)  # same code as code_block_7
code_block_28 = CodeBlock(x=code_block_27.out1) { x; }
code_block_29 = CodeBlock { 0.5; }
planeAtParameter = Curve.PlaneAtParameter(curve=code_block_28, param=code_block_29)
pointAtParameter = Curve.PointAtParameter(curve=code_block_28, param=code_block_29)
plane = Custom[View.Plane](view=code_block_25)  # package Clockwork for Dynamo 2.x; Retrieves the plane of a given view
normal = Plane.Normal(plane=plane)
byOriginNormal = Plane.ByOriginNormal(origin=pointAtParameter, normal=normal)
normal_2 = Plane.Normal(plane=byOriginNormal)
code_block_30 = CodeBlock { 90; }
rotate = Geometry.Rotate(geometry=planeAtParameter, origin=pointAtParameter, axis=normal_2, degrees=code_block_30)
normal_3 = Plane.Normal(plane=rotate)
code_block_31 = CodeBlock { 350; }
translate = Geometry.Translate(geometry=code_block_27.out1, direction=normal_3, distance=code_block_31)
code_block_32 = CodeBlock { "Floors"; }
byName_3 = Category.ByName(name=code_block_32)
all_elements_of_category_in_view_3 = ElementsOfCategoryInView(Category=byName_3, View=code_block_25)
code_block_33 = CodeBlock { "Slope"; }
getParameterValueByName_2 = Element.GetParameterValueByName(element=all_elements_of_category_in_view_3, parameterName=code_block_33)
code_block_34 = CodeBlock { ""; }
eq_6 = getParameterValueByName_2 == code_block_34
filterByBoolMask_5 = List.FilterByBoolMask(list=all_elements_of_category_in_view_3, mask=eq_6)
level = Custom[Element.Level]()  # package Clockwork for Dynamo 2.x; Gets an element's level; unwired: element
groupByFunction = List.GroupByFunction(list=filterByBoolMask_5.in, func=level)
code_block_35 = CodeBlock { "Height Offset From Level"; }
getParameterValueByName_3 = Element.GetParameterValueByName(element=groupByFunction, parameterName=code_block_35)
minimumItem_2 = List.MinimumItem(list=getParameterValueByName_3@L2)
code_block_36 = CodeBlock(x=minimumItem_2)
# ---------- code_block_36.designscript (12 lines) ----------
x;
[Imperative]
{
	if(x[0] == null)
	{
		return = [];
	}
	else
	{
		return = x;
	}
};
# ----------------------------------------
eq_7 = getParameterValueByName_3@L2 == code_block_36.out1@L1
filterByBoolMask_6 = List.FilterByBoolMask(list=groupByFunction, mask=eq_7)
code_block_37 = CodeBlock { "Structural Foundations"; }
byName_4 = Category.ByName(name=code_block_37)
all_elements_of_category_in_view_4 = ElementsOfCategoryInView(Category=byName_4, View=code_block_25)
familyName_2 = Orchid.RevitProject.Elements.Element.FamilyName(element=all_elements_of_category_in_view_4)
code_block_38 = CodeBlock { "EST_M_STRUCTURAL FOUNDATION_FUNDACION AISLADA"; }
eq_8 = familyName_2 == code_block_38
code_block_39 = CodeBlock { "Wall Foundation"; }
eq_9 = familyName_2 == code_block_39
or_2 = eq_8 || eq_9
filterByBoolMask_7 = List.FilterByBoolMask(list=all_elements_of_category_in_view_4, mask=or_2)
code_block_40 = CodeBlock { null; }
replaceEmptyLists_7 = Custom[List.ReplaceEmptyLists](seq=filterByBoolMask_7.in, Replacement=code_block_40)
code_block_41 = CodeBlock(x=replaceEmptyLists_7)  # same code as code_block_16
element_surfaces_references_3 = Custom[Element Surfaces References](element=code_block_41.out1)
code_block_42 = CodeBlock { null; }
replaceEmptyLists_8 = Custom[List.ReplaceEmptyLists](seq=element_surfaces_references_3.Bottom_Reference, Replacement=code_block_42)
code_block_43 = CodeBlock(x=replaceEmptyLists_8)  # same code as code_block_16
all_2 = Orchid.RevitProject.Annotations.DimensionType.All()
name_2 = Element.Name(element=all_2)
code_block_44 = CodeBlock { "Linear - 2.5mm Arial"; }
eq_10 = name_2 == code_block_44
filterByBoolMask_8 = List.FilterByBoolMask(list=all_2, mask=eq_10)
code_block_45 = CodeBlock(x=filterByBoolMask_8.in) { x[0]; }

code_block_46 = CodeBlock(x=code_block_24) { x; }
flatten_2 = List.Flatten(list=filterByBoolMask_6.in)

# group (continued): Cota Losas, Radier y Sello de Fundacion
element_surfaces_references_4 = Custom[Element Surfaces References](element=flatten_2@L1)
code_block_47 = CodeBlock(x=element_surfaces_references_4.Top_Reference) { DSCore.List.Flatten(x,2); }
code_block_48 = CodeBlock(refLosas=code_block_47, refrFunAis=code_block_43.out1) { DSCore.List.Flatten(([refLosas,refrFunAis]),2); }
dimension_byreferences_2 = Custom[Dimension ByReferences](view=code_block_24, line=translate, references=code_block_48, dimensionType=code_block_45)

# group: Niveles en Elevacion
code_block_49 = CodeBlock { null; }
replaceEmptyLists_9 = Custom[List.ReplaceEmptyLists](seq=dimension_byreferences_2, Replacement=code_block_49)
code_block_50 = CodeBlock(x=replaceEmptyLists_9)  # same code as code_block_3
ʳʰʸᵗʰᵐ_dimensions = Rhythm.Revit.Elements.Dimensions.GetReferenceElements(dimension=code_block_50.out1)
ʳʰʸᵗʰᵐ_dimensions_getcurve = Rhythm.Revit.Elements.Dimensions.GetCurve(dimension=code_block_50.out1)
code_block_51 = CodeBlock(line1=ʳʰʸᵗʰᵐ_dimensions_getcurve)
# ---------- code_block_51.designscript (5 lines) ----------
point1 = Autodesk.Curve.StartPoint(line1);
point2 = Autodesk.Curve.EndPoint(line1);
t1 = [point1, point2];
t2 = DSCore.List.Flatten(t1, -1);
t3 = DSCore.List.UniqueItems(t2);
# ----------------------------------------
byElementAndLocation = Tag.ByElementAndLocation(view=code_block_46, element=ʳʰʸᵗʰᵐ_dimensions, location=code_block_51.t3)
code_block_52 = CodeBlock { "Type"; }
getCategory = Element.GetCategory(element=ʳʰʸᵗʰᵐ_dimensions)
string_from_object = FromObject(obj=getCategory)
code_block_53 = CodeBlock { "Structural Foundations"; }
eq_11 = string_from_object == code_block_53  # lacing=Longest
tag_sello_fundacion = CodeBlock()
# ---------- tag_sello_fundacion.designscript (2 lines) ----------
family1 = Revit.Family.ByName("EST_A_FOUNDATION TAG_ELEVACION");
familytype1 = Revit.FamilyType.ByFamilyAndName(family1, "Orientación Izquierda");
# ----------------------------------------
tag_tope_losa = CodeBlock()
# ---------- tag_tope_losa.designscript (2 lines) ----------
family1 = Revit.Family.ByName("EST_A_FLOOR TAG_ELEVACION_TOPE LOSA");
familytype1 = Revit.FamilyType.ByFamilyAndName(family1, "Orientación Izquierda");
# ----------------------------------------
scopeIf = Custom[ScopeIf+](test=eq_11, True=tag_sello_fundacion.familytype1, False=tag_tope_losa.familytype1)  # package Clockwork for Dynamo 2.x; A (hopefully) more robust implementation of ScopeIf. Tests a single boolean and returns a value accordingly.
setParameterByName = Element.SetParameterByName(element=byElementAndLocation, parameterName=code_block_52, value=scopeIf, lacing=Longest)
code_block_54 = CodeBlock { "Type"; }
taggedElement = Tag.TaggedElement(tag=setParameterByName)
name_3 = Element.Name(element=taggedElement)
code_block_55 = CodeBlock { "RADIER e="; }
contains = String.Contains(str=name_3, searchFor=code_block_55)
tag_tope_radier = CodeBlock()
# ---------- tag_tope_radier.designscript (2 lines) ----------
family1 = Revit.Family.ByName("EST_A_FLOOR TAG_ELEVACION_TOPE RADIER");
familytype1 = Revit.FamilyType.ByFamilyAndName(family1, "Orientación Izquierda");
# ----------------------------------------
code_block_56 = CodeBlock { []; }
scopeIf_2 = Custom[ScopeIf+](test=contains, True=tag_tope_radier.familytype1, False=code_block_56, lacing=Shortest)
setParameterByName_2 = Element.SetParameterByName(element=setParameterByName, parameterName=code_block_54, value=scopeIf_2)

# group: Cota Parcial entre Ejes
code_block_57 = CodeBlock { "Grids"; }
byName_5 = Category.ByName(name=code_block_57)
code_block_58 = CodeBlock { null; }
replaceEmptyLists_10 = Custom[List.ReplaceEmptyLists](seq=code_block, Replacement=code_block_58)
code_block_59 = CodeBlock(x=replaceEmptyLists_10)  # same code as code_block_3
code_block_60 = CodeBlock(x=code_block_59.out1) { x; }
all_elements_of_category_in_view_5 = ElementsOfCategoryInView(Category=byName_5, View=code_block_60)
element_reference = Custom[Element Reference](element=all_elements_of_category_in_view_5)  # package Genius Loci; Gets the reference of a geometric object or a dimension or a reference plane.
code_block_61 = CodeBlock { null; }
replaceEmptyLists_11 = Custom[List.ReplaceEmptyLists](seq=element_reference, Replacement=code_block_61)
code_block_62 = CodeBlock(x=code_block_59.out1) { x; }
code_block_63 = CodeBlock(x=replaceEmptyLists_11, y=code_block_62)
# ---------- code_block_63.designscript (13 lines) ----------
x;
y;
[Imperative]
{
	if(x == null)
	{
		return = [];
	}
	else
	{
		return = y;
	}
};
# ----------------------------------------
getCropBox_3 = Orchid.RevitProject.Views.View.GetCropBox(view=code_block_60)
code_block_64 = CodeBlock { null; }
replaceEmptyLists_12 = Custom[List.ReplaceEmptyLists](seq=getCropBox_3.Curve, Replacement=code_block_64)
code_block_65 = CodeBlock(x=replaceEmptyLists_12)
# ---------- code_block_65.designscript (12 lines) ----------
x;
[Imperative]
{
	if(x == null)
	{
		return = [];
	}
	else
	{
		return = x[3];
	}
};
# ----------------------------------------
all_3 = Orchid.RevitProject.Annotations.DimensionType.All()
name_4 = Element.Name(element=all_3)
code_block_66 = CodeBlock { "Linear - 2.5mm Arial"; }
eq_12 = name_4 == code_block_66
filterByBoolMask_9 = List.FilterByBoolMask(list=all_3, mask=eq_12)
code_block_67 = CodeBlock(x=filterByBoolMask_9.in) { x[0]; }
dimension_byreferences_3 = Custom[Dimension ByReferences](view=code_block_63.out2, line=code_block_65.out1, references=element_reference, dimensionType=code_block_67)
