# Dynamo graph cotasEjes_script.dyn (Dynamo 2.3.2.15696)
# packages: Orchid 200.4.0.7938, Genius Loci 2021.11.10, Clockwork for Dynamo 2.x 2.4.0

activeView = Orchid.RevitProject.Common.Document.ActiveView()
code_block = CodeBlock(x=activeView) { x; }

# group: Cota Parcial entre Ejes
code_block_2 = CodeBlock { null; }
replaceEmptyLists = Custom[List.ReplaceEmptyLists](seq=code_block, Replacement=code_block_2)  # package Clockwork for Dynamo 2.x; Replaces all empty lists within a given list with a substitute
code_block_3 = CodeBlock(x=replaceEmptyLists)
# ---------- code_block_3.designscript (12 lines) ----------
x;
[Imperative]
{
	if(x == null)
	{
		return = [];
	}
	else
	{
		return = x;
	}
};
# ----------------------------------------
code_block_4 = CodeBlock(x=code_block_3.out1) { x; }
code_block_5 = CodeBlock { "Grids"; }
byName = Category.ByName(name=code_block_5)
code_block_6 = CodeBlock(x=code_block_3.out1) { x; }
all_elements_of_category_in_view = ElementsOfCategoryInView(Category=byName, View=code_block_6)
element_reference = Custom[Element Reference](element=all_elements_of_category_in_view)  # package Genius Loci; Gets the reference of a geometric object or a dimension or a reference plane.
code_block_7 = CodeBlock { null; }
replaceEmptyLists_2 = Custom[List.ReplaceEmptyLists](seq=element_reference, Replacement=code_block_7)
code_block_8 = CodeBlock(x=replaceEmptyLists_2, y=code_block_4)
# ---------- code_block_8.designscript (13 lines) ----------
x;
y;
[Imperative]
{
	if(x == null)
	{
		return = [];
	}
	else
	{
		return = y;
	}
};
# ----------------------------------------
getCropBox = Orchid.RevitProject.Views.View.GetCropBox(view=code_block_6)
code_block_9 = CodeBlock { null; }
replaceEmptyLists_3 = Custom[List.ReplaceEmptyLists](seq=getCropBox.Curve, Replacement=code_block_9)
code_block_10 = CodeBlock(x=replaceEmptyLists_3)
# ---------- code_block_10.designscript (12 lines) ----------
x;
[Imperative]
{
	if(x == null)
	{
		return = [];
	}
	else
	{
		return = x[3];
	}
};
# ----------------------------------------
all = Orchid.RevitProject.Annotations.DimensionType.All()
name = Element.Name(element=all)
code_block_11 = CodeBlock { "Linear - 2.5mm Arial"; }
eq = name == code_block_11
filterByBoolMask = List.FilterByBoolMask(list=all, mask=eq)
code_block_12 = CodeBlock(x=filterByBoolMask.in) { x[0]; }
dimension_byreferences = Custom[Dimension ByReferences](view=code_block_8.out2, line=code_block_10.out1, references=element_reference, dimensionType=code_block_12)  # package Genius Loci; Creates a new linear dimension from at least two geometric references of an object.

flatten = List.Flatten(list=dimension_byreferences)
await_ = Orchid.Common.DataStream.Await(pass=code_block_4, waitFor=flatten)
openView = Orchid.RevitProject.Common.Document.OpenView(view=await_)
