# Dynamo graph cotasElevacion_script.dyn "Cotas Elevacion" (Dynamo 2.3.2.15696)
# packages: Genius Loci 2021.11.10, Clockwork for Dynamo 2.x 2.4.0, Orchid 200.4.0.7938, Rhythm 2020.7.25

activeView = Orchid.RevitProject.Common.Document.ActiveView()

# group: Cota Losas, Radier y Sello de Fundacion
code_block = CodeBlock(x=activeView) { x; }
code_block_2 = CodeBlock(x=code_block) { x; }
code_block_3 = CodeBlock(x=code_block) { x; }
getCropBox = Orchid.RevitProject.Views.View.GetCropBox(view=code_block_3)
code_block_4 = CodeBlock { null; }
replaceEmptyLists = Custom[List.ReplaceEmptyLists](seq=getCropBox.Curve, Replacement=code_block_4)  # package Clockwork for Dynamo 2.x; Replaces all empty lists within a given list with a substitute
code_block_5 = CodeBlock(x=replaceEmptyLists)
# ---------- code_block_5.designscript (12 lines) ----------
x;
[Imperative]
{
	if(x == null)
	{
		return = [];
	}
	else
	{
		return = x[0];
	}
};
# ----------------------------------------
code_block_6 = CodeBlock(x=code_block_5.out1) { x; }
code_block_7 = CodeBlock { 0.5; }
planeAtParameter = Curve.PlaneAtParameter(curve=code_block_6, param=code_block_7)
pointAtParameter = Curve.PointAtParameter(curve=code_block_6, param=code_block_7)
plane = Custom[View.Plane](view=code_block_3)  # package Clockwork for Dynamo 2.x; Retrieves the plane of a given view
normal = Plane.Normal(plane=plane)
byOriginNormal = Plane.ByOriginNormal(origin=pointAtParameter, normal=normal)
normal_2 = Plane.Normal(plane=byOriginNormal)
code_block_8 = CodeBlock { 90; }
rotate = Geometry.Rotate(geometry=planeAtParameter, origin=pointAtParameter, axis=normal_2, degrees=code_block_8)
normal_3 = Plane.Normal(plane=rotate)
code_block_9 = CodeBlock { 350; }
translate = Geometry.Translate(geometry=code_block_5.out1, direction=normal_3, distance=code_block_9)
code_block_10 = CodeBlock { "Floors"; }
byName = Category.ByName(name=code_block_10)
all_elements_of_category_in_view = ElementsOfCategoryInView(Category=byName, View=code_block_3)
code_block_11 = CodeBlock { "Slope"; }
getParameterValueByName = Element.GetParameterValueByName(element=all_elements_of_category_in_view, parameterName=code_block_11)
code_block_12 = CodeBlock { ""; }
eq = getParameterValueByName == code_block_12
filterByBoolMask = List.FilterByBoolMask(list=all_elements_of_category_in_view, mask=eq)
level = Custom[Element.Level]()  # package Clockwork for Dynamo 2.x; Gets an element's level; unwired: element
groupByFunction = List.GroupByFunction(list=filterByBoolMask.in, func=level)
code_block_13 = CodeBlock { "Height Offset From Level"; }
getParameterValueByName_2 = Element.GetParameterValueByName(element=groupByFunction, parameterName=code_block_13)
minimumItem = List.MinimumItem(list=getParameterValueByName_2@L2)
code_block_14 = CodeBlock(x=minimumItem)
# ---------- code_block_14.designscript (12 lines) ----------
x;
[Imperative]
{
	if(x[0] == null)
	{
		return = [];
	}
	else
	{
		return = x;
	}
};
# ----------------------------------------
eq_2 = getParameterValueByName_2@L2 == code_block_14.out1@L1
filterByBoolMask_2 = List.FilterByBoolMask(list=groupByFunction, mask=eq_2)
code_block_15 = CodeBlock { "Structural Foundations"; }
byName_2 = Category.ByName(name=code_block_15)
all_elements_of_category_in_view_2 = ElementsOfCategoryInView(Category=byName_2, View=code_block_3)
familyName = Orchid.RevitProject.Elements.Element.FamilyName(element=all_elements_of_category_in_view_2)
code_block_16 = CodeBlock { "EST_M_STRUCTURAL FOUNDATION_FUNDACION AISLADA"; }
eq_3 = familyName == code_block_16
code_block_17 = CodeBlock { "Wall Foundation"; }
eq_4 = familyName == code_block_17
or_ = eq_3 || eq_4
filterByBoolMask_3 = List.FilterByBoolMask(list=all_elements_of_category_in_view_2, mask=or_)
code_block_18 = CodeBlock { null; }
replaceEmptyLists_2 = Custom[List.ReplaceEmptyLists](seq=filterByBoolMask_3.in, Replacement=code_block_18)
code_block_19 = CodeBlock(x=replaceEmptyLists_2)  # same code as code_block_5
element_surfaces_references = Custom[Element Surfaces References](element=code_block_19.out1)  # package Genius Loci; Retrieve the top, bottom, side surfaces and their associated references of the system family. This doesn't work with cylindrical system families (pipe...)
code_block_20 = CodeBlock { null; }
replaceEmptyLists_3 = Custom[List.ReplaceEmptyLists](seq=element_surfaces_references.Bottom_Reference, Replacement=code_block_20)
code_block_21 = CodeBlock(x=replaceEmptyLists_3)  # same code as code_block_5
all = Orchid.RevitProject.Annotations.DimensionType.All()
name = Element.Name(element=all)
code_block_22 = CodeBlock { "Linear - 2.5mm Arial"; }
eq_5 = name == code_block_22
filterByBoolMask_4 = List.FilterByBoolMask(list=all, mask=eq_5)
code_block_23 = CodeBlock(x=filterByBoolMask_4.in) { x[0]; }

code_block_24 = CodeBlock(x=code_block_2) { x; }
flatten = List.Flatten(list=filterByBoolMask_2.in)

# group (continued): Cota Losas, Radier y Sello de Fundacion
element_surfaces_references_2 = Custom[Element Surfaces References](element=flatten@L1, lacing=Longest)
code_block_25 = CodeBlock(x=element_surfaces_references_2.Top_Reference) { DSCore.List.Flatten(x,2); }
code_block_26 = CodeBlock(refLosas=code_block_25, refrFunAis=code_block_21.out1) { DSCore.List.Flatten(([refLosas,refrFunAis]),2); }
dimension_byreferences = Custom[Dimension ByReferences](view=code_block_2, line=translate, references=code_block_26, dimensionType=code_block_23)  # package Genius Loci; Creates a new linear dimension from at least two geometric references of an object.

# group: Niveles en Elevacion
setParameterByName = Element.SetParameterByName()  # unwired: element, parameterName, value
code_block_27 = CodeBlock { null; }
replaceEmptyLists_4 = Custom[List.ReplaceEmptyLists](seq=dimension_byreferences, Replacement=code_block_27)
code_block_28 = CodeBlock(x=replaceEmptyLists_4)
# ---------- code_block_28.designscript (12 lines) ----------
x;
[Imperative]
{
	if(x == null)
	{
		return = [];
	}
	else
	{
		return = x;
	}
};
# ----------------------------------------
ʳʰʸᵗʰᵐ_dimensions = Rhythm.Revit.Elements.Dimensions.GetReferenceElements(dimension=code_block_28.out1)
ʳʰʸᵗʰᵐ_dimensions_getcurve = Rhythm.Revit.Elements.Dimensions.GetCurve(dimension=code_block_28.out1)
code_block_29 = CodeBlock(line1=ʳʰʸᵗʰᵐ_dimensions_getcurve)
# ---------- code_block_29.designscript (5 lines) ----------
point1 = Autodesk.Curve.StartPoint(line1);
point2 = Autodesk.Curve.EndPoint(line1);
t1 = [point1, point2];
t2 = DSCore.List.Flatten(t1, -1);
t3 = DSCore.List.UniqueItems(t2);
# ----------------------------------------
byElementAndLocation = Tag.ByElementAndLocation(view=code_block_24, element=ʳʰʸᵗʰᵐ_dimensions, location=code_block_29.t3)
code_block_30 = CodeBlock { "Type"; }
getCategory = Element.GetCategory(element=ʳʰʸᵗʰᵐ_dimensions)
string_from_object = FromObject(obj=getCategory)
code_block_31 = CodeBlock { "Structural Foundations"; }
eq_6 = string_from_object == code_block_31  # lacing=Longest
tag_sello_fundacion = CodeBlock()
# ---------- tag_sello_fundacion.designscript (2 lines) ----------
family1 = Revit.Family.ByName("EST_A_FOUNDATION TAG_ELEVACION");
familytype1 = Revit.FamilyType.ByFamilyAndName(family1, "Orientación Izquierda");
# ----------------------------------------
tag_tope_losa = CodeBlock()
# ---------- tag_tope_losa.designscript (2 lines) ----------
family1 = Revit.Family.ByName("EST_A_FLOOR TAG_ELEVACION_TOPE LOSA");
familytype1 = Revit.FamilyType.ByFamilyAndName(family1, "Orientación Izquierda");
# ----------------------------------------
scopeIf = Custom[ScopeIf+](test=eq_6, True=tag_sello_fundacion.familytype1, False=tag_tope_losa.familytype1)  # package Clockwork for Dynamo 2.x; A (hopefully) more robust implementation of ScopeIf. Tests a single boolean and returns a value accordingly.
setParameterByName_2 = Element.SetParameterByName(element=byElementAndLocation, parameterName=code_block_30, value=scopeIf, lacing=Longest)
code_block_32 = CodeBlock { "Type"; }
taggedElement = Tag.TaggedElement(tag=setParameterByName_2)
name_2 = Element.Name(element=taggedElement)
code_block_33 = CodeBlock { "RADIER e="; }
contains = String.Contains(str=name_2, searchFor=code_block_33)
tag_tope_radier = CodeBlock()
# ---------- tag_tope_radier.designscript (2 lines) ----------
family1 = Revit.Family.ByName("EST_A_FLOOR TAG_ELEVACION_TOPE RADIER");
familytype1 = Revit.FamilyType.ByFamilyAndName(family1, "Orientación Izquierda");
# ----------------------------------------
code_block_34 = CodeBlock { []; }
scopeIf_2 = Custom[ScopeIf+](test=contains, True=tag_tope_radier.familytype1, False=code_block_34)
function_apply = ApplyFunction(func=setParameterByName, arg1=setParameterByName_2, arg2=code_block_32, arg3=scopeIf_2)
