# Dynamo graph postproceso_script.dyn (Dynamo 2.3.2.15696)
# packages: Genius Loci 2021.11.10, archi-lab.net 2022.210.2419, Clockwork for Dynamo 2.x 2.4.0, Orchid 200.4.0.7938, Crumple 2022.2.13, Rhythm 2020.7.25

activeView = Orchid.RevitProject.Common.Document.ActiveView()
code_block = CodeBlock(x=activeView)
# ---------- code_block.designscript (12 lines) ----------
x;
[Imperative]
{
	if(x == null)
	{
		return = [];
	}
	else
	{
		return = x[0];
	}
};
# ----------------------------------------

# group: Overrides Vigas Hormigon en Corte
code_block_2 = CodeBlock { null; }
replaceEmptyLists = Custom[List.ReplaceEmptyLists](seq=code_block.out1, Replacement=code_block_2)  # package Clockwork for Dynamo 2.x; Replaces all empty lists within a given list with a substitute
code_block_3 = CodeBlock(x=replaceEmptyLists)
# ---------- code_block_3.designscript (13 lines) ----------
x;

[Imperative]
{
	if(x == null)
	{
		return = [];
	}
	else
	{
		return = x;
	}
};
# ----------------------------------------
code_block_4 = CodeBlock(x=code_block_3.out1) { x; }
code_block_5 = CodeBlock { "Structural Framing"; }
byName = Category.ByName(name=code_block_5)
all_elements_of_category_in_view = ElementsOfCategoryInView(Category=byName, View=code_block_4)
familyName = Orchid.RevitProject.Elements.Element.FamilyName(element=all_elements_of_category_in_view)
code_block_6 = CodeBlock()
# ---------- code_block_6.designscript (6 lines) ----------
[
"EST_M_STRUCTURAL FRAMING_VIGA INVERTIDA",
"EST_M_STRUCTURAL FRAMING_VIGA SEMI INVERTIDA",
"EST_M_STRUCTURAL FRAMING_VIGA TRADICIONAL",
"EST_M_STRUCTURAL FRAMING_VIGA FUNDACION"
];
# ----------------------------------------
eq = familyName@L1 == code_block_6
anyTrue = Orchid.Common.List.AnyTrue(list=eq)
filterByBoolMask = List.FilterByBoolMask(list=all_elements_of_category_in_view, mask=anyTrue)
code_block_7 = CodeBlock(x=code_block_3.out1) { x; }
code_block_8 = CodeBlock { null; }
replaceEmptyLists_2 = Custom[List.ReplaceEmptyLists](seq=code_block_7, Replacement=code_block_8)
code_block_9 = CodeBlock(x=replaceEmptyLists_2)
# ---------- code_block_9.designscript (12 lines) ----------
x;
[Imperative]
{
	if(x == null)
	{
		return = [];
	}
	else
	{
		return = "Hidden";
	}
};
# ----------------------------------------
getByName = LinePatternElement.GetByName(name=code_block_9.out1)
color_palette = ColorPalette({R: 0, G: 0, B: 0, A: 255})
code_block_10 = CodeBlock { 1; }
create_overridegraphicsettings = Custom[Create OverrideGraphicSettings](ProjectionLinePattern=getByName, ProjectionLineColor=color_palette, ProjectionLineWeight=code_block_10, CutLinePattern=getByName, CutLineColor=color_palette, CutLineWeight=code_block_10)  # package Genius Loci; Create a OverrideGraphicSettings (All graphic inputs are optional). Unlike the OOTB OverrideGraphicSettings.ByProperties node, the Foreground and background patterns are available. Note : Prior to Revit 2019, the materials have only one surface pattern and one cut pattern.
view_setelementoverrides = Custom[View SetElementOverrides](view=code_block_4, elements=filterByBoolMask.in, overrides=create_overridegraphicsettings)  # package Genius Loci; Overrides element graphics settings in the given view. For use with the Create OverrideGraphicSettings node. Can also be used to hide or unhide elements.

# group: Redibujar Contorno
code_block_11 = CodeBlock { null; }
replaceEmptyLists_3 = Custom[List.ReplaceEmptyLists](seq=code_block.out1, Replacement=code_block_11)
code_block_12 = CodeBlock(x=replaceEmptyLists_3)  # same code as code_block_3
plane = Custom[View.Plane](view=code_block_12.out1)  # package Clockwork for Dynamo 2.x; Retrieves the plane of a given view
normal = Plane.Normal(plane=plane)
code_block_13 = CodeBlock(t2=code_block_12.out1) { t1 = Revit.Elements.Element.GetParameterValueByName(t2, "Far Clip Offset"); t3 = t1 / 2; t4 = t3 * -1; }
translate = Geometry.Translate(geometry=plane, direction=normal, distance=code_block_13.t4)
byUnion = Solid.ByUnion()  # unwired: solids
code_block_14 = CodeBlock()
# ---------- code_block_14.designscript (6 lines) ----------
["Floors",
"Structural Framing",
"Walls",
"Structural Foundations",
"Structural Columns"
];
# ----------------------------------------
byName_2 = Category.ByName(name=code_block_14)
all_elements_of_category_in_view_2 = ElementsOfCategoryInView(Category=byName_2, View=code_block_12.out1)
flatten = List.Flatten(list=all_elements_of_category_in_view_2)
solids = Element.Solids(element=flatten)
flatten_2 = List.Flatten(list=solids)
function_apply = ApplyFunction(func=byUnion, arg1=flatten_2)
intersect = Geometry.Intersect(geometry=translate, other=function_apply)
perimeterCurves = Surface.PerimeterCurves(surface=intersect)
flatten_3 = List.Flatten(list=perimeterCurves)
byCurve = Custom[DetailCurve.ByCurve+](curve=flatten_3, view=code_block_12.out1)  # package Clockwork for Dynamo 2.x; Creates a detail line based on a given curve. Unlike the OOTB node it can also draw circles.
code_block_15 = CodeBlock { "Line Style"; }
code_block_16 = CodeBlock { "Wide Lines"; }
get_line_style_by_name = Custom[Get Line Style by Name](name=code_block_16)  # package archi-lab.net; This node will return a line style object by its name. Line styles can be either Drafting or Model Line Property.
setParameterByName = Element.SetParameterByName(element=byCurve, parameterName=code_block_15, value=get_line_style_by_name, lacing=Longest)

code_block_17 = CodeBlock(x=code_block.out1) { x; }

# group: Breaklines
byLoft = Surface.ByLoft()  # unwired: crossSections
translate_2 = Geometry.Translate(lacing=Longest)  # unwired: geometry, direction, distance
byJoinedCurves = PolyCurve.ByJoinedCurves()  # unwired: curves
code_block_18 = CodeBlock { null; }
replaceEmptyLists_4 = Custom[List.ReplaceEmptyLists](seq=code_block_17, Replacement=code_block_18)
code_block_19 = CodeBlock(x=replaceEmptyLists_4)
# ---------- code_block_19.designscript (13 lines) ----------
x;

[Imperative]
{
	if(x == null)
	{
		return = [[],[]];
	}
	else
	{
		return = x;
	}
};
# ----------------------------------------
code_block_20 = CodeBlock(x=code_block_19.out1) { x; }
getCropBox = Orchid.RevitProject.Views.View.GetCropBox(view=code_block_20)
function_apply_2 = ApplyFunction(func=byJoinedCurves, arg1=getCropBox.Curve)
code_block_21 = CodeBlock(x=function_apply_2)  # same code as code_block_3
code_block_22 = CodeBlock { -290; false; }
offset = PolyCurve.Offset(polyCurve=code_block_21.out1, signedDistance=code_block_22.out0, extendCircular=code_block_22.out1)
plane_2 = Custom[View.Plane](view=code_block_20)
normal_2 = Plane.Normal(plane=plane_2)
reverse = Vector.Reverse(vector=normal_2)
list_create = List.Create(item0=normal_2, item1=reverse)
code_block_23 = CodeBlock { 1000; }
function_apply_3 = ApplyFunction(func=translate_2, arg1=offset, arg2=list_create, arg3=code_block_23)
function_apply_4 = ApplyFunction(func=byLoft, arg1=function_apply_3)
byUnion_2 = Solid.ByUnion()  # unwired: solids
code_block_24 = CodeBlock()
# ---------- code_block_24.designscript (6 lines) ----------
[
"Walls",
"Structural Columns",
"Structural Framing",
"Floors"
];
# ----------------------------------------
byName_3 = Category.ByName(name=code_block_24)
all_elements_of_category_in_view_3 = ElementsOfCategoryInView(Category=byName_3, View=code_block_20)
geometry = Element.Geometry(element=all_elements_of_category_in_view_3)
flatten_4 = List.Flatten(list=geometry)
function_apply_5 = ApplyFunction(func=byUnion_2, arg1=flatten_4)
code_block_25 = CodeBlock(x=function_apply_5)  # same code as code_block_3
intersect_2 = Geometry.Intersect(geometry=function_apply_4, other=code_block_25.out1)
code_block_26 = CodeBlock { [0.5,0.5]; [0,1]; }
pointAtParameter = Surface.PointAtParameter(surface=intersect_2@L1, u=code_block_26.out1@L2, v=code_block_26.out0@L2, lacing=Longest)
transpose = List.Transpose(lists=pointAtParameter)
code_block_27 = CodeBlock { null; }
replaceEmptyLists_5 = Custom[List.ReplaceEmptyLists](seq=transpose, Replacement=code_block_27)
code_block_28 = CodeBlock(x=replaceEmptyLists_5)  # same code as code_block_19
code_block_29 = CodeBlock(x=code_block_28.out1) { x[0]; x[1]; }
byStartPointEndPoint = Line.ByStartPointEndPoint(startPoint=code_block_29.out0, endPoint=code_block_29.out1)
reverse_2 = Curve.Reverse(curve=byStartPointEndPoint)
code_block_30 = CodeBlock(x=code_block_19.out1) { x; }
plane_3 = Custom[View.Plane](view=code_block_30)
pullOntoPlane = Curve.PullOntoPlane(curve=reverse_2, plane=plane_3)
code_block_31 = CodeBlock { "EST_D_BREAKLINE"; }
byName_4 = FamilyType.ByName(name=code_block_31)
byCurve_2 = Custom[DetailComponent.ByCurve](curve=pullOntoPlane, familyType=byName_4, view=code_block_30, lacing=Longest)  # package Clockwork for Dynamo 2.x; Places a line-based detail component in a given view
code_block_32 = CodeBlock { "Length of masking region"; 900; }
setParameterByName_2 = Element.SetParameterByName(element=byCurve_2, parameterName=code_block_32.out0, value=code_block_32.out1)
code_block_33 = CodeBlock(x=code_block_19.out1) { x; }
plane_4 = Custom[View.Plane](view=code_block_33)
normal_3 = Plane.Normal(plane=plane_4)
X = Vector.X(vector=normal_3)
byPatch = Surface.ByPatch(closedCurve=offset)
code_block_34 = CodeBlock { 0.5; }
normalAtParameter = Surface.NormalAtParameter(surface=byPatch, u=code_block_34, v=code_block_34)
X_2 = Vector.X(vector=normalAtParameter)
eq_2 = X == X_2

# group: Sobrescribir Columnas de Hormigon
code_block_35 = CodeBlock { null; }
replaceEmptyLists_6 = Custom[List.ReplaceEmptyLists](seq=code_block.out1, Replacement=code_block_35)
code_block_36 = CodeBlock(x=replaceEmptyLists_6)  # same code as code_block_3
code_block_37 = CodeBlock { "Structural Columns"; }
byName_5 = Category.ByName(name=code_block_37)
all_elements_of_category_in_view_4 = ElementsOfCategoryInView(Category=byName_5, View=code_block_36.out1)
familyName_2 = Orchid.RevitProject.Elements.Element.FamilyName(element=all_elements_of_category_in_view_4)
code_block_38 = CodeBlock { "EST_M_STRUCTURAL COLUMN_RECTANGULAR"; }
eq_3 = familyName_2 == code_block_38
filterByBoolMask_2 = List.FilterByBoolMask(list=all_elements_of_category_in_view_4, mask=eq_3)
code_block_39 = CodeBlock { "Hidden"; }
getByName_2 = LinePatternElement.GetByName(name=code_block_39)
code_block_40 = CodeBlock { 1; }
create_overridegraphicsettings_2 = Custom[Create OverrideGraphicSettings](ProjectionLinePattern=getByName_2, ProjectionLineWeight=code_block_40, CutLinePattern=getByName_2, CutLineWeight=code_block_40)
code_block_41 = CodeBlock { false; }
view_setelementoverrides_2 = Custom[View SetElementOverrides](view=code_block_36.out1, elements=filterByBoolMask_2.in, overrides=create_overridegraphicsettings_2, hide=code_block_41)

# group: Etiqueta Vigas Hormigon
activeView_2 = Orchid.RevitProject.Common.Document.ActiveView()
code_block_42 = CodeBlock(x=code_block_17) { x; }
code_block_43 = CodeBlock { null; }
replaceEmptyLists_7 = Custom[List.ReplaceEmptyLists](seq=code_block_42, Replacement=code_block_43)
code_block_44 = CodeBlock(x=replaceEmptyLists_7)  # same code as code_block_19
code_block_45 = CodeBlock(x=code_block_44.out1) { x; }
code_block_46 = CodeBlock { "Structural Framing"; }
byName_6 = Category.ByName(name=code_block_46)
all_elements_of_category_in_view_5 = ElementsOfCategoryInView(Category=byName_6, View=code_block_45)
familyName_3 = Orchid.RevitProject.Elements.Element.FamilyName(element=all_elements_of_category_in_view_5)
code_block_47 = CodeBlock()  # same code as code_block_6
eq_4 = familyName_3@L1 == code_block_47
anyTrue_2 = Orchid.Common.List.AnyTrue(list=eq_4)
filterByBoolMask_3 = List.FilterByBoolMask(list=all_elements_of_category_in_view_5, mask=anyTrue_2)
location = Custom[Element.Location+](element=filterByBoolMask_3.in)  # package Clockwork for Dynamo 2.x; Returns the location of an element as point, curve or curve loop, along with some booleans to help filtering the results. Unlike the OOTB Element.GetLocation node, it also retunrs sketch lines of sketch-based elements like floor slabs as well as the element's rotation property.
code_block_48 = CodeBlock(x=location.curves)
# ---------- code_block_48.designscript (12 lines) ----------
x;
[Imperative]
{
	if(x == null)
	{
		return = [];
	}
	else
	{
		return = x;
	}
};
# ----------------------------------------
direction = Line.Direction(line=code_block_48.out1)
code_block_49 = CodeBlock(x=code_block_44.out1) { x; }
plane_5 = Custom[View.Plane](view=code_block_49)
isParallelToPlane = Custom[Vector.IsParallelToPlane](vector=direction, plane=plane_5)  # package Clockwork for Dynamo 2.x; Checks if a given vector is parallel to a given plane
filterByBoolMask_4 = List.FilterByBoolMask(list=filterByBoolMask_3.in, mask=isParallelToPlane)
element_taggedstatus = Custom[Element TaggedStatus](element=filterByBoolMask_4.in)  # package Genius Loci; Identify the tagged and untagged elements. Please note : This doesn't work with areas and spaces.
elementcentroid = Custom[© ElementCentroid](element=element_taggedstatus.NotTagged)  # package Crumple; Returns the centroid of the element's axis-aligned bounding box.
location_2 = Custom[Element.Location+](element=element_taggedstatus.NotTagged)
code_block_50 = CodeBlock(x=location_2.curves)  # same code as code_block_48
code_block_51 = CodeBlock { 0.5; }
planeAtParameter = Curve.PlaneAtParameter(curve=code_block_50.out1, param=code_block_51)
code_block_52 = CodeBlock { 0.5; }
pointAtParameter_2 = Curve.PointAtParameter(curve=code_block_50.out1, param=code_block_52)
plane_6 = Custom[View.Plane](view=code_block_49)
normal_4 = Plane.Normal(plane=plane_6)
code_block_53 = CodeBlock { 90; }
rotate = Geometry.Rotate(geometry=planeAtParameter, origin=pointAtParameter_2, axis=normal_4, degrees=code_block_53)
normal_5 = Plane.Normal(plane=rotate)
code_block_54 = CodeBlock(z=normal_5) { z.Z; }
code_block_55 = CodeBlock { 0; }
gt = code_block_54 > code_block_55
code_block_56 = CodeBlock { -1; }
ne = code_block_54 != code_block_56
and_ = gt && ne
reverse_3 = Vector.Reverse(vector=normal_5)
scopeIf = Custom[ScopeIf+](test=and_, True=normal_5, False=reverse_3, lacing=Shortest)  # package Clockwork for Dynamo 2.x; A (hopefully) more robust implementation of ScopeIf. Tests a single boolean and returns a value accordingly.
code_block_57 = CodeBlock(x=element_taggedstatus.NotTagged) { Revit.Elements.Element.GetParameterValueByName(Revit.Elements.Element.GetParameterValueByName(x,"Type"),"Height")/2; }
translate_3 = Geometry.Translate(geometry=elementcentroid, direction=scopeIf, distance=code_block_57)
list_create_2 = List.Create(item0=elementcentroid, item1=translate_3)
transpose_2 = List.Transpose(lists=list_create_2)
byElementAndLocation = Tag.ByElementAndLocation(view=code_block_45@L1, element=element_taggedstatus.NotTagged@L1, location=transpose_2@L2, lacing=Longest)
transpose_3 = List.Transpose(lists=byElementAndLocation)
code_block_58 = CodeBlock { null; }
replaceEmptyLists_8 = Custom[List.ReplaceEmptyLists](seq=transpose_3, Replacement=code_block_58)
code_block_59 = CodeBlock(x=replaceEmptyLists_8)
# ---------- code_block_59.designscript (12 lines) ----------
x;
[Imperative]
{
	if(x == null)
	{
		return = [[],[]];
	}
	else
	{
		return = x;
	}
};
# ----------------------------------------
code_block_60 = CodeBlock(x=code_block_59.out1) { x[1]; }
code_block_61 = CodeBlock { "Type"; }
code_block_62 = CodeBlock { "EST_A_STRUCTURAL FRAMING TAG_ELEVACION"; }
byName_7 = Orchid.RevitProject.Elements.Family.ByName(name=code_block_62)
code_block_63 = CodeBlock { "Tag Viga"; }
byFamilyAndName = FamilyType.ByFamilyAndName(family=byName_7, name=code_block_63)
setParameterByName_3 = Element.SetParameterByName(element=code_block_60, parameterName=code_block_61, value=byFamilyAndName)
code_block_64 = CodeBlock(x=code_block_59.out1) { x[0]; }
code_block_65 = CodeBlock { "Type"; }
code_block_66 = CodeBlock { "EST_A_STRUCTURAL FRAMING TAG_ELEVACION_ESTRIBO Y LATERAL"; }
byName_8 = Orchid.RevitProject.Elements.Family.ByName(name=code_block_66)
code_block_67 = CodeBlock { "Estribo Simple y Laterales"; }
byFamilyAndName_2 = FamilyType.ByFamilyAndName(family=byName_8, name=code_block_67)
setParameterByName_4 = Element.SetParameterByName(element=code_block_64, parameterName=code_block_65, value=byFamilyAndName_2)

code_block_68 = CodeBlock { null; }
replaceEmptyLists_9 = Custom[List.ReplaceEmptyLists](seq=code_block.out1, Replacement=code_block_68)
code_block_69 = CodeBlock(x=replaceEmptyLists_9)  # same code as code_block_3

# group: Etiqueta Muros
code_block_70 = CodeBlock(x=code_block_69.out1) { x; }
code_block_71 = CodeBlock(x=code_block_70) { x; }
code_block_72 = CodeBlock { "Walls"; }
byName_9 = Category.ByName(name=code_block_72)
all_elements_of_category_in_view_6 = ElementsOfCategoryInView(Category=byName_9, View=code_block_71)
wallType = archilab.Revit.Elements.Walls.WallType(wall=all_elements_of_category_in_view_6)
kind = Orchid.RevitProject.Elements.WallType.Kind(wallType=wallType)
code_block_73 = CodeBlock { "Basic"; }
eq_5 = kind == code_block_73
filterByBoolMask_5 = List.FilterByBoolMask(list=all_elements_of_category_in_view_6, mask=eq_5)
name = Material.Name()  # unwired: material
getMaterials = Element.GetMaterials(element=filterByBoolMask_5.in)
flatten_5 = List.Flatten(list=getMaterials)
function_apply_6 = ApplyFunction(func=name, arg1=flatten_5)
code_block_74 = CodeBlock { "Concrete, Cast-in-Place gray"; }
eq_6 = function_apply_6 == code_block_74
filterByBoolMask_6 = List.FilterByBoolMask(list=filterByBoolMask_5.in, mask=eq_6)
location_3 = Custom[Element.Location+](element=filterByBoolMask_6.in)
code_block_75 = CodeBlock(x=location_3.curves)  # same code as code_block_48
direction_2 = Line.Direction(line=code_block_75.out1)
code_block_76 = CodeBlock(x=code_block_70) { x; }
plane_7 = Custom[View.Plane](view=code_block_76)
isParallelToPlane_2 = Custom[Vector.IsParallelToPlane](vector=direction_2, plane=plane_7)
filterByBoolMask_7 = List.FilterByBoolMask(list=filterByBoolMask_6.in, mask=isParallelToPlane_2)
element_taggedstatus_2 = Custom[Element TaggedStatus](element=filterByBoolMask_7.in)
elementcentroid_2 = Custom[© ElementCentroid](element=element_taggedstatus_2.NotTagged)
byElementAndLocation_2 = Tag.ByElementAndLocation(view=code_block_71, element=element_taggedstatus_2.NotTagged, location=elementcentroid_2)
code_block_77 = CodeBlock { "Type"; }
code_block_78 = CodeBlock { "EST_A_WALL TAG_ELEVACION_MHA"; }
byName_10 = Orchid.RevitProject.Elements.Family.ByName(name=code_block_78)
code_block_79 = CodeBlock { "Doble Malla"; }
byFamilyAndName_3 = FamilyType.ByFamilyAndName(family=byName_10, name=code_block_79)
setParameterByName_5 = Element.SetParameterByName(element=byElementAndLocation_2, parameterName=code_block_77, value=byFamilyAndName_3)

# group: Columnas Metalicas Rectangulares
code_block_80 = CodeBlock(x=code_block_69.out1) { x; }
code_block_81 = CodeBlock(x=code_block_80) { x; }
code_block_82 = CodeBlock { "Structural Columns"; }
byName_11 = Category.ByName(name=code_block_82)
all_elements_of_category_in_view_7 = ElementsOfCategoryInView(Category=byName_11, View=code_block_81)
familyName_4 = Orchid.RevitProject.Elements.Element.FamilyName(element=all_elements_of_category_in_view_7)
code_block_83 = CodeBlock()
# ---------- code_block_83.designscript (11 lines) ----------
[
"EST_M_STRUCTURAL COLUMN_SOLDADA_IN",
"EST_M_STRUCTURAL COLUMN_LAMINADA_L",
"EST_M_STRUCTURAL COLUMN_PLEGADA_C",
"EST_M_STRUCTURAL COLUMN_PLEGADA_CA",
"EST_M_STRUCTURAL COLUMN_PLEGADA_HSS",
"EST_M_STRUCTURAL COLUMN_PLEGADA_IC",
"EST_M_STRUCTURAL COLUMN_PLEGADA_L",
"EST_M_STRUCTURAL COLUMN_SOLDADA_HN",
"EST_M_STRUCTURAL COLUMN_SOLDADA_T"
];
# ----------------------------------------
eq_7 = familyName_4@L1 == code_block_83
anyTrue_3 = Orchid.Common.List.AnyTrue(list=eq_7)
filterByBoolMask_8 = List.FilterByBoolMask(list=all_elements_of_category_in_view_7, mask=anyTrue_3)
name_2 = Material.Name()  # unwired: material
getMaterials_2 = Element.GetMaterials(element=filterByBoolMask_8.in)
flatten_6 = List.Flatten(list=getMaterials_2)
function_apply_7 = ApplyFunction(func=name_2, arg1=flatten_6)
code_block_84 = CodeBlock { "Steel"; }
eq_8 = function_apply_7 == code_block_84
filterByBoolMask_9 = List.FilterByBoolMask(list=filterByBoolMask_8.in, mask=eq_8)
element_taggedstatus_3 = Custom[Element TaggedStatus](element=filterByBoolMask_9.in)
code_block_85 = CodeBlock { "Column Style"; 1; }
setParameterByName_6 = Element.SetParameterByName(element=element_taggedstatus_3.NotTagged, parameterName=code_block_85.out0, value=code_block_85.out1)
location_4 = Custom[Element.Location+](element=setParameterByName_6)
code_block_86 = CodeBlock(x=location_4.curves)  # same code as code_block_48
await_ = Orchid.Common.DataStream.Await(pass=setParameterByName_6, waitFor=code_block_86.out1)
elementcentroid_3 = Custom[© ElementCentroid](element=await_)
code_block_87 = CodeBlock { 0.5; }
planeAtParameter_2 = Curve.PlaneAtParameter(curve=code_block_86.out1, param=code_block_87)
code_block_88 = CodeBlock { 0.5; }
pointAtParameter_3 = Curve.PointAtParameter(curve=code_block_86.out1, param=code_block_88)
code_block_89 = CodeBlock(x=code_block_80) { x; }
plane_8 = Custom[View.Plane](view=code_block_89)
normal_6 = Plane.Normal(plane=plane_8)
code_block_90 = CodeBlock { 90; }
rotate_2 = Geometry.Rotate(geometry=planeAtParameter_2, origin=pointAtParameter_3, axis=normal_6, degrees=code_block_90)
normal_7 = Plane.Normal(plane=rotate_2)
code_block_91 = CodeBlock(z=normal_7) { z.Z; }
code_block_92 = CodeBlock { 0; }
gt_2 = code_block_91 > code_block_92
code_block_93 = CodeBlock { -1; }
ne_2 = code_block_91 != code_block_93
and_2 = gt_2 && ne_2
reverse_4 = Vector.Reverse(vector=normal_7)
scopeIf_2 = Custom[ScopeIf+](test=and_2, True=normal_7, False=reverse_4, lacing=Shortest)
code_block_94 = CodeBlock(x=await_) { Revit.Elements.Element.GetParameterValueByName(Revit.Elements.Element.GetParameterValueByName(x,"Type"),"Width")/2; }
translate_4 = Geometry.Translate(geometry=elementcentroid_3, direction=scopeIf_2, distance=code_block_94)
code_block_95 = CodeBlock()
# ---------- code_block_95.designscript (2 lines) ----------
//horizontal
false;
# ----------------------------------------
byElementAndLocation_3 = Tag.ByElementAndLocation(view=code_block_81, element=await_, location=translate_4, horizontal=code_block_95)
code_block_96 = CodeBlock { "Type"; }
code_block_97 = CodeBlock { "EST_A_STRUCTURAL COLUMN TAG_ELEVACION_DIMENSIONES"; }
byName_12 = Orchid.RevitProject.Elements.Family.ByName(name=code_block_97)
code_block_98 = CodeBlock { "Pilar Hormigon"; }
byFamilyAndName_4 = FamilyType.ByFamilyAndName(family=byName_12, name=code_block_98)
setParameterByName_7 = Element.SetParameterByName(element=byElementAndLocation_3, parameterName=code_block_96, value=byFamilyAndName_4)
code_block_99 = CodeBlock { "Column Style"; 0; }
setParameterByName_8 = Element.SetParameterByName(element=await_, parameterName=code_block_99.out0, value=code_block_99.out1)

# group: Etiqueta Columna Rectangular hormigon
code_block_100 = CodeBlock { "Structural Columns"; }
byName_13 = Category.ByName(name=code_block_100)
code_block_101 = CodeBlock(x=code_block_69.out1) { x; }
code_block_102 = CodeBlock(x=code_block_101) { x; }
all_elements_of_category_in_view_8 = ElementsOfCategoryInView(Category=byName_13, View=code_block_102)
familyName_5 = Orchid.RevitProject.Elements.Element.FamilyName(element=all_elements_of_category_in_view_8)
code_block_103 = CodeBlock { "EST_M_STRUCTURAL COLUMN_RECTANGULAR"; }
eq_9 = familyName_5 == code_block_103
filterByBoolMask_10 = List.FilterByBoolMask(list=all_elements_of_category_in_view_8, mask=eq_9)
name_3 = Material.Name()  # unwired: material
getMaterials_3 = Element.GetMaterials(element=filterByBoolMask_10.in)
flatten_7 = List.Flatten(list=getMaterials_3)
function_apply_8 = ApplyFunction(func=name_3, arg1=flatten_7)
code_block_104 = CodeBlock { "Concrete, Cast-in-Place gray"; }
eq_10 = function_apply_8 == code_block_104
filterByBoolMask_11 = List.FilterByBoolMask(list=filterByBoolMask_10.in, mask=eq_10)
element_taggedstatus_4 = Custom[Element TaggedStatus](element=filterByBoolMask_11.in)
code_block_105 = CodeBlock { "Column Style"; 1; }
setParameterByName_9 = Element.SetParameterByName(element=element_taggedstatus_4.NotTagged, parameterName=code_block_105.out0, value=code_block_105.out1)
location_5 = Custom[Element.Location+](element=setParameterByName_9)
code_block_106 = CodeBlock(x=location_5.curves)  # same code as code_block_48
await_2 = Orchid.Common.DataStream.Await(pass=setParameterByName_9, waitFor=code_block_106.out1)
code_block_107 = CodeBlock { "Column Style"; 0; }
setParameterByName_10 = Element.SetParameterByName(element=await_2, parameterName=code_block_107.out0, value=code_block_107.out1)
elementcentroid_4 = Custom[© ElementCentroid](element=await_2)
code_block_108 = CodeBlock { 0.5; }
planeAtParameter_3 = Curve.PlaneAtParameter(curve=code_block_106.out1, param=code_block_108)
code_block_109 = CodeBlock { 0.5; }
pointAtParameter_4 = Curve.PointAtParameter(curve=code_block_106.out1, param=code_block_109)
code_block_110 = CodeBlock(x=code_block_101) { x; }
plane_9 = Custom[View.Plane](view=code_block_110)
normal_8 = Plane.Normal(plane=plane_9)
code_block_111 = CodeBlock { 90; }
rotate_3 = Geometry.Rotate(geometry=planeAtParameter_3, origin=pointAtParameter_4, axis=normal_8, degrees=code_block_111)
normal_9 = Plane.Normal(plane=rotate_3)
code_block_112 = CodeBlock(z=normal_9) { z.Z; }
code_block_113 = CodeBlock { 0; }
gt_3 = code_block_112 > code_block_113
code_block_114 = CodeBlock { -1; }
ne_3 = code_block_112 != code_block_114
and_3 = gt_3 && ne_3
reverse_5 = Vector.Reverse(vector=normal_9)
scopeIf_3 = Custom[ScopeIf+](test=and_3, True=normal_9, False=reverse_5, lacing=Shortest)
code_block_115 = CodeBlock(x=await_2) { Revit.Elements.Element.GetParameterValueByName(Revit.Elements.Element.GetParameterValueByName(x,"Type"),"Width")/2; }
translate_5 = Geometry.Translate(geometry=elementcentroid_4, direction=scopeIf_3, distance=code_block_115)
code_block_116 = CodeBlock()  # same code as code_block_95
byElementAndLocation_4 = Tag.ByElementAndLocation(view=code_block_102, element=await_2, location=translate_5, horizontal=code_block_116)
code_block_117 = CodeBlock { "Type"; }
code_block_118 = CodeBlock { "EST_A_STRUCTURAL COLUMN TAG_ELEVACION_DIMENSIONES"; }
byName_14 = Orchid.RevitProject.Elements.Family.ByName(name=code_block_118)
code_block_119 = CodeBlock { "Pilar Hormigon"; }
byFamilyAndName_5 = FamilyType.ByFamilyAndName(family=byName_14, name=code_block_119)
setParameterByName_11 = Element.SetParameterByName(element=byElementAndLocation_4, parameterName=code_block_117, value=byFamilyAndName_5)

# group: Etiqueta Columna Circular Hormigon
code_block_120 = CodeBlock { "Structural Columns"; }
byName_15 = Category.ByName(name=code_block_120)
code_block_121 = CodeBlock(x=code_block_69.out1) { x; }
code_block_122 = CodeBlock(x=code_block_121) { x; }
all_elements_of_category_in_view_9 = ElementsOfCategoryInView(Category=byName_15, View=code_block_122)
familyName_6 = Orchid.RevitProject.Elements.Element.FamilyName(element=all_elements_of_category_in_view_9)
code_block_123 = CodeBlock { "EST_M_STRUCTURAL COLUMN_CIRCULAR"; }
eq_11 = familyName_6 == code_block_123
filterByBoolMask_12 = List.FilterByBoolMask(list=all_elements_of_category_in_view_9, mask=eq_11)
name_4 = Material.Name()  # unwired: material
getMaterials_4 = Element.GetMaterials(element=filterByBoolMask_12.in)
flatten_8 = List.Flatten(list=getMaterials_4)
function_apply_9 = ApplyFunction(func=name_4, arg1=flatten_8)
code_block_124 = CodeBlock { "Concrete, Cast-in-Place gray"; }
eq_12 = function_apply_9 == code_block_124
filterByBoolMask_13 = List.FilterByBoolMask(list=filterByBoolMask_12.in, mask=eq_12)
element_taggedstatus_5 = Custom[Element TaggedStatus](element=filterByBoolMask_13.in)
code_block_125 = CodeBlock { "Column Style"; 1; }
setParameterByName_12 = Element.SetParameterByName(element=element_taggedstatus_5.NotTagged, parameterName=code_block_125.out0, value=code_block_125.out1)
location_6 = Custom[Element.Location+](element=setParameterByName_12)
code_block_126 = CodeBlock(x=location_6.curves)  # same code as code_block_48
await_3 = Orchid.Common.DataStream.Await(pass=setParameterByName_12, waitFor=code_block_126.out1)
code_block_127 = CodeBlock { "Column Style"; 0; }
setParameterByName_13 = Element.SetParameterByName(element=await_3, parameterName=code_block_127.out0, value=code_block_127.out1)
elementcentroid_5 = Custom[© ElementCentroid](element=await_3)
code_block_128 = CodeBlock { 0.5; }
planeAtParameter_4 = Curve.PlaneAtParameter(curve=code_block_126.out1, param=code_block_128)
code_block_129 = CodeBlock { 0.5; }
pointAtParameter_5 = Curve.PointAtParameter(curve=code_block_126.out1, param=code_block_129)
code_block_130 = CodeBlock { 90; }
code_block_131 = CodeBlock { 0; }
code_block_132 = CodeBlock { -1; }
code_block_133 = CodeBlock(x=await_3) { Revit.Elements.Element.GetParameterValueByName(Revit.Elements.Element.GetParameterValueByName(x,"Type"),"Diameter")/2; }
code_block_134 = CodeBlock()  # same code as code_block_95
code_block_135 = CodeBlock { "Type"; }
code_block_136 = CodeBlock { "EST_A_STRUCTURAL COLUMN TAG_ELEVACION_DIMENSIONES"; }
byName_16 = Orchid.RevitProject.Elements.Family.ByName(name=code_block_136)
code_block_137 = CodeBlock { "Pilar Hormigon"; }
byFamilyAndName_6 = FamilyType.ByFamilyAndName(family=byName_16, name=code_block_137)

code_block_138 = CodeBlock(x=code_block_121) { x; }

# group (continued): Etiqueta Columna Circular Hormigon
plane_10 = Custom[View.Plane](view=code_block_138)
normal_10 = Plane.Normal(plane=plane_10)
rotate_4 = Geometry.Rotate(geometry=planeAtParameter_4, origin=pointAtParameter_5, axis=normal_10, degrees=code_block_130)
normal_11 = Plane.Normal(plane=rotate_4)
code_block_139 = CodeBlock(z=normal_11) { z.Z; }
gt_4 = code_block_139 > code_block_131
ne_4 = code_block_139 != code_block_132
and_4 = gt_4 && ne_4
reverse_6 = Vector.Reverse(vector=normal_11)
scopeIf_4 = Custom[ScopeIf+](test=and_4, True=normal_11, False=reverse_6, lacing=Shortest)
translate_6 = Geometry.Translate(geometry=elementcentroid_5, direction=scopeIf_4, distance=code_block_133)
byElementAndLocation_5 = Tag.ByElementAndLocation(view=code_block_122, element=await_3, location=translate_6, horizontal=code_block_134)
setParameterByName_14 = Element.SetParameterByName(element=byElementAndLocation_5, parameterName=code_block_135, value=byFamilyAndName_6)

# group: Etiqueta Vigas Metalicas
code_block_140 = CodeBlock { "Structural Framing"; }
byName_17 = Category.ByName(name=code_block_140)
code_block_141 = CodeBlock(x=code_block_69.out1) { x; }
all_elements_of_category_in_view_10 = ElementsOfCategoryInView(Category=byName_17, View=code_block_141)
familyName_7 = Orchid.RevitProject.Elements.Element.FamilyName(element=all_elements_of_category_in_view_10)
code_block_142 = CodeBlock()
# ---------- code_block_142.designscript (12 lines) ----------
[
"EST_M_STRUCTURAL FRAMING_VIGA LAMINADA_L",
"EST_M_STRUCTURAL FRAMING_VIGA OHM",
"EST_M_STRUCTURAL FRAMING_VIGA PLEGADA_C",
"EST_M_STRUCTURAL FRAMING_VIGA PLEGADA_CA",
"EST_M_STRUCTURAL FRAMING_VIGA PLEGADA_HSS",
"EST_M_STRUCTURAL FRAMING_VIGA PLEGADA_HSSE",
"EST_M_STRUCTURAL FRAMING_VIGA PLEGADA_L",
"EST_M_STRUCTURAL FRAMING_VIGA SOLDADA_HN",
"EST_M_STRUCTURAL FRAMING_VIGA SOLDADA_IN",
"EST_M_STRUCTURAL FRAMING_VIGA SOLDADA_T"
];
# ----------------------------------------
eq_13 = familyName_7@L1 == code_block_142
anyTrue_4 = Orchid.Common.List.AnyTrue(list=eq_13)
filterByBoolMask_14 = List.FilterByBoolMask(list=all_elements_of_category_in_view_10, mask=anyTrue_4)
name_5 = Material.Name()  # unwired: material
getMaterials_5 = Element.GetMaterials(element=filterByBoolMask_14.in)
flatten_9 = List.Flatten(list=getMaterials_5)
function_apply_10 = ApplyFunction(func=name_5, arg1=flatten_9)
code_block_143 = CodeBlock { "Concrete, Cast-in-Place gray"; }
eq_14 = function_apply_10 == code_block_143
filterByBoolMask_15 = List.FilterByBoolMask(list=filterByBoolMask_14.in, mask=eq_14)
activeView_3 = Orchid.RevitProject.Common.Document.ActiveView()
location_7 = Custom[Element.Location+](element=filterByBoolMask_14.in)
code_block_144 = CodeBlock(x=location_7.curves)  # same code as code_block_48
direction_3 = Line.Direction(line=code_block_144.out1)
activeView_4 = Orchid.RevitProject.Common.Document.ActiveView()
plane_11 = Custom[View.Plane](view=activeView_4)
isParallelToPlane_3 = Custom[Vector.IsParallelToPlane](vector=direction_3, plane=plane_11)
filterByBoolMask_16 = List.FilterByBoolMask(list=filterByBoolMask_14.in, mask=isParallelToPlane_3)
element_taggedstatus_6 = Custom[Element TaggedStatus](element=filterByBoolMask_16.in)
elementcentroid_6 = Custom[© ElementCentroid](element=element_taggedstatus_6.NotTagged)
location_8 = Custom[Element.Location+](element=element_taggedstatus_6.NotTagged)
code_block_145 = CodeBlock(x=location_8.curves)  # same code as code_block_48
code_block_146 = CodeBlock { 0.5; }
planeAtParameter_5 = Curve.PlaneAtParameter(curve=code_block_145.out1, param=code_block_146)
code_block_147 = CodeBlock { 0.5; }
pointAtParameter_6 = Curve.PointAtParameter(curve=code_block_145.out1, param=code_block_147)
activeView_5 = Orchid.RevitProject.Common.Document.ActiveView()
plane_12 = Custom[View.Plane](view=activeView_5)
normal_12 = Plane.Normal(plane=plane_12)
code_block_148 = CodeBlock { 90; }
rotate_5 = Geometry.Rotate(geometry=planeAtParameter_5, origin=pointAtParameter_6, axis=normal_12, degrees=code_block_148)
normal_13 = Plane.Normal(plane=rotate_5)
code_block_149 = CodeBlock(z=normal_13) { z.Z; }
code_block_150 = CodeBlock { 0; }
gt_5 = code_block_149 > code_block_150
code_block_151 = CodeBlock { -1; }
ne_5 = code_block_149 != code_block_151
and_5 = gt_5 && ne_5
reverse_7 = Vector.Reverse(vector=normal_13)
scopeIf_5 = Custom[ScopeIf+](test=and_5, True=normal_13, False=reverse_7, lacing=Shortest)
code_block_152 = CodeBlock(x=element_taggedstatus_6.NotTagged) { Revit.Elements.Element.GetParameterValueByName(Revit.Elements.Element.GetParameterValueByName(x,"Type"),"Height")/2; }
translate_7 = Geometry.Translate(geometry=elementcentroid_6, direction=scopeIf_5, distance=code_block_152)
byElementAndLocation_6 = Tag.ByElementAndLocation(view=activeView_3, element=element_taggedstatus_6.NotTagged, location=translate_7)
code_block_153 = CodeBlock { "Type"; }
code_block_154 = CodeBlock { "EST_A_STRUCTURAL FRAMING TAG_ELEVACION"; }
byName_18 = Orchid.RevitProject.Elements.Family.ByName(name=code_block_154)
code_block_155 = CodeBlock { "Tag Viga"; }
byFamilyAndName_7 = FamilyType.ByFamilyAndName(family=byName_18, name=code_block_155)
setParameterByName_15 = Element.SetParameterByName(element=byElementAndLocation_6, parameterName=code_block_153, value=byFamilyAndName_7)

# group: Overrides Vigas Hormigon en Corte
activeView_6 = Orchid.RevitProject.Common.Document.ActiveView()
code_block_156 = CodeBlock(x=code_block_69.out1) { x; }
code_block_157 = CodeBlock(x=code_block_156) { x; }
code_block_158 = CodeBlock { "Structural Framing"; }
byName_19 = Category.ByName(name=code_block_158)
all_elements_of_category_in_view_11 = ElementsOfCategoryInView(Category=byName_19, View=code_block_157)
familyName_8 = Orchid.RevitProject.Elements.Element.FamilyName(element=all_elements_of_category_in_view_11)
code_block_159 = CodeBlock()  # same code as code_block_6
eq_15 = familyName_8@L1 == code_block_159
anyTrue_5 = Orchid.Common.List.AnyTrue(list=eq_15)
filterByBoolMask_17 = List.FilterByBoolMask(list=all_elements_of_category_in_view_11, mask=anyTrue_5)
location_9 = Custom[Element.Location+](element=filterByBoolMask_17.in)
code_block_160 = CodeBlock(x=location_9.curves)  # same code as code_block_48
direction_4 = Line.Direction(line=code_block_160.out1)
code_block_161 = CodeBlock(x=code_block_156) { x; }
plane_13 = Custom[View.Plane](view=code_block_161)
isParallelToPlane_4 = Custom[Vector.IsParallelToPlane](vector=direction_4, plane=plane_13)
filterByBoolMask_18 = List.FilterByBoolMask(list=filterByBoolMask_17.in, mask=isParallelToPlane_4)
code_block_162 = CodeBlock { null; }
replaceEmptyLists_10 = Custom[List.ReplaceEmptyLists](seq=code_block_161, Replacement=code_block_162)
code_block_163 = CodeBlock(x=replaceEmptyLists_10)  # same code as code_block_9
getByName_3 = LinePatternElement.GetByName(name=code_block_163.out1)
color_palette_2 = ColorPalette({R: 0, G: 0, B: 0, A: 255})
code_block_164 = CodeBlock { 1; }
create_overridegraphicsettings_3 = Custom[Create OverrideGraphicSettings](ProjectionLinePattern=getByName_3, ProjectionLineColor=color_palette_2, ProjectionLineWeight=code_block_164, CutLinePattern=getByName_3, CutLineColor=color_palette_2, CutLineWeight=code_block_164)
view_setelementoverrides_3 = Custom[View SetElementOverrides](view=code_block_157, elements=filterByBoolMask_18.out, overrides=create_overridegraphicsettings_3)

# group: Overrides Emplantillado
code_block_165 = CodeBlock(x=code_block_69.out1) { x; }
code_block_166 = CodeBlock { "Structural Foundations"; }
byName_20 = Category.ByName(name=code_block_166)
all_elements_of_category_in_view_12 = ElementsOfCategoryInView(Category=byName_20, View=code_block_165)
name_6 = Element.Name(element=all_elements_of_category_in_view_12)
code_block_167 = CodeBlock { "EMPLANTILLADO"; }
contains = String.Contains(str=name_6, searchFor=code_block_167)
filterByBoolMask_19 = List.FilterByBoolMask(list=all_elements_of_category_in_view_12, mask=contains)
code_block_168 = CodeBlock { null; }
replaceEmptyLists_11 = Custom[List.ReplaceEmptyLists](seq=filterByBoolMask_19.in, Replacement=code_block_168)
code_block_169 = CodeBlock(x=replaceEmptyLists_11)  # same code as code_block
code_block_170 = CodeBlock(x=replaceEmptyLists_11)
# ---------- code_block_170.designscript (12 lines) ----------
x;
[Imperative]
{
	if(x == null)
	{
		return = [];
	}
	else
	{
		return = "Diagonal up 1.5mm";
	}
};
# ----------------------------------------
getByName_4 = FillPatternElement.GetByName(name=code_block_170.out1)
color_palette_3 = ColorPalette({R: 0, G: 0, B: 0, A: 255})
create_overridegraphicsettings_4 = Custom[Create OverrideGraphicSettings](SurfaceForegroundPattern=getByName_4, SurfaceForegroundPatternColor=color_palette_3, CutForegroundPattern=getByName_4, CutForegroundPatternColor=color_palette_3)
view_setelementoverrides_4 = Custom[View SetElementOverrides](view=code_block_165, elements=code_block_169.out1, overrides=create_overridegraphicsettings_4)

# group: Etiqueta Emplantillado
ʳʰʸᵗʰᵐ_tags = Rhythm.Revit.Elements.Tags.SetLeaderElbowPosition()  # unwired: tag, location
code_block_171 = CodeBlock { "Type"; }
code_block_172 = CodeBlock { "EST_A_STRUCTURAL FOUNDATION TAG_ELEVACION_EMPLANTILLADO"; }
byName_21 = Orchid.RevitProject.Elements.Family.ByName(name=code_block_172)
code_block_173 = CodeBlock { "Emplantillado"; }
byFamilyAndName_8 = FamilyType.ByFamilyAndName(family=byName_21, name=code_block_173)
setParameterByName_16 = Element.SetParameterByName(parameterName=code_block_171, value=byFamilyAndName_8)  # unwired: element
code_block_174 = CodeBlock { "Leader Line"; 1; }
setParameterByName_17 = Element.SetParameterByName(parameterName=code_block_174.out0, value=code_block_174.out1)  # unwired: element
code_block_175 = CodeBlock(x=code_block_69.out1) { x; }
code_block_176 = CodeBlock(x=code_block_175) { x; }
code_block_177 = CodeBlock { "Structural Foundations"; }
byName_22 = Category.ByName(name=code_block_177)
all_elements_of_category_in_view_13 = ElementsOfCategoryInView(Category=byName_22, View=code_block_176)
kind_2 = Custom[StructuralFoundation.Kind](structuralFoundation=all_elements_of_category_in_view_13)  # package Clockwork for Dynamo 2.x; Retrieves the kind of a given structural foundation (isolated, wall, slab).
code_block_178 = CodeBlock { "Slab"; }
eq_16 = kind_2 == code_block_178
name_7 = Element.Name(element=all_elements_of_category_in_view_13)
code_block_179 = CodeBlock { "EMPLANTILLADO"; }
contains_2 = String.Contains(str=name_7, searchFor=code_block_179)
and_6 = eq_16 && contains_2
filterByBoolMask_20 = List.FilterByBoolMask(list=all_elements_of_category_in_view_13, mask=and_6)
code_block_180 = CodeBlock { null; }
replaceEmptyLists_12 = Custom[List.ReplaceEmptyLists](seq=filterByBoolMask_20.in, Replacement=code_block_180)
code_block_181 = CodeBlock { 0; }
getItemAtIndex = List.GetItemAtIndex(index=code_block_181)  # unwired: list
ZAxis = Vector.ZAxis()
code_block_182 = CodeBlock { -300; }
translate_8 = Geometry.Translate(direction=ZAxis@L1, distance=code_block_182@L1, lacing=Longest)  # unwired: geometry
code_block_183 = CodeBlock { 0.5; }
pointAtParameter_7 = Surface.PointAtParameter(u=code_block_183, v=code_block_183)  # unwired: surface
element_surfaces_references = Custom[Element Surfaces References](element=replaceEmptyLists_12)  # package Genius Loci; Retrieve the top, bottom, side surfaces and their associated references of the system family. This doesn't work with cylindrical system families (pipe...)
code_block_184 = CodeBlock(x=element_surfaces_references.Bottom_Surface)
# ---------- code_block_184.designscript (12 lines) ----------
x;
[Imperative]
{
	if(x == null)
	{
		return = [];
	}
	else
	{
		return = DSCore.List.Flatten(x,1);
	}
};
# ----------------------------------------
function_apply_11 = ApplyFunction(func=pointAtParameter_7, arg1=code_block_184.out1)
function_apply_12 = ApplyFunction(func=translate_8, arg1=function_apply_11)
code_block_185 = CodeBlock { null; }
replaceEmptyLists_13 = Custom[List.ReplaceEmptyLists](seq=function_apply_12, Replacement=code_block_185)
code_block_186 = CodeBlock(x=code_block_175) { x; }
plane_14 = Custom[View.Plane](view=code_block_186)
byBestFitThroughPoints = Line.ByBestFitThroughPoints()  # unwired: bestFitPoints
code_block_187 = CodeBlock { 0.5; }
pointAtParameter_8 = Curve.PointAtParameter(param=code_block_187)  # unwired: curve
code_block_188 = CodeBlock { [1,3]; }
getItemAtIndex_2 = List.GetItemAtIndex(index=code_block_188@L2)  # unwired: list
getCropBox_2 = Orchid.RevitProject.Views.View.GetCropBox(view=code_block_186)
function_apply_13 = ApplyFunction(func=getItemAtIndex_2, arg1=getCropBox_2.Curve)
function_apply_14 = ApplyFunction(func=pointAtParameter_8, arg1=function_apply_13)
function_apply_15 = ApplyFunction(func=byBestFitThroughPoints, arg1=function_apply_14)
code_block_189 = CodeBlock(x=function_apply_15)  # same code as code_block_48
code_block_190 = CodeBlock { 0.5; }
pointAtParameter_9 = Curve.PointAtParameter(curve=code_block_189.out1, param=code_block_190)
direction_5 = Line.Direction(line=code_block_189.out1)
code_block_191 = CodeBlock { 90; }
rotate_6 = Geometry.Rotate(geometry=plane_14@L1, origin=pointAtParameter_9@L1, axis=direction_5@L1, degrees=code_block_191@L1)
normal_14 = Plane.Normal(plane=rotate_6)
code_block_192 = CodeBlock { 50; }
translate_9 = Geometry.Translate(geometry=replaceEmptyLists_13@L2, direction=normal_14@L1, distance=code_block_192@L1, lacing=Longest)
function_apply_16 = ApplyFunction(func=getItemAtIndex, arg1=translate_9)
byElementAndLocation_7 = Tag.ByElementAndLocation(view=code_block_176@L1, element=replaceEmptyLists_12@L2, location=function_apply_16@L2, lacing=Longest)
flatten_10 = List.Flatten(list=byElementAndLocation_7)
function_apply_17 = ApplyFunction(func=setParameterByName_17, arg1=flatten_10)
function_apply_18 = ApplyFunction(func=setParameterByName_16, arg1=function_apply_17)
function_apply_19 = ApplyFunction(func=ʳʰʸᵗʰᵐ_tags, arg1=function_apply_18, arg2=replaceEmptyLists_13)
code_block_193 = CodeBlock { true; }

# group: Override Muro en Corte
code_block_194 = CodeBlock(x=code_block_69.out1) { x; }
code_block_195 = CodeBlock(x=code_block_194) { x; }
code_block_196 = CodeBlock { "Walls"; }
byName_23 = Category.ByName(name=code_block_196)
all_elements_of_category_in_view_14 = ElementsOfCategoryInView(Category=byName_23, View=code_block_195)
wallType_2 = archilab.Revit.Elements.Walls.WallType(wall=all_elements_of_category_in_view_14)
kind_3 = Orchid.RevitProject.Elements.WallType.Kind(wallType=wallType_2)
code_block_197 = CodeBlock { "Basic"; }
eq_17 = kind_3 == code_block_197
filterByBoolMask_21 = List.FilterByBoolMask(list=all_elements_of_category_in_view_14, mask=eq_17)
name_8 = Material.Name()  # unwired: material
getMaterials_6 = Element.GetMaterials(element=filterByBoolMask_21.in)
flatten_11 = List.Flatten(list=getMaterials_6)
function_apply_20 = ApplyFunction(func=name_8, arg1=flatten_11)
code_block_198 = CodeBlock { "Concrete, Cast-in-Place gray"; }
eq_18 = function_apply_20 == code_block_198
filterByBoolMask_22 = List.FilterByBoolMask(list=filterByBoolMask_21.in, mask=eq_18)
code_block_199 = CodeBlock(x=code_block_194) { x; }
code_block_200 = CodeBlock { null; }
replaceEmptyLists_14 = Custom[List.ReplaceEmptyLists](seq=code_block_199, Replacement=code_block_200)
code_block_201 = CodeBlock(x=replaceEmptyLists_14)  # same code as code_block_9
getByName_5 = LinePatternElement.GetByName(name=code_block_201.out1)
color_palette_4 = ColorPalette({R: 0, G: 0, B: 0, A: 255})
code_block_202 = CodeBlock { 1; }
create_overridegraphicsettings_5 = Custom[Create OverrideGraphicSettings](ProjectionLinePattern=getByName_5, ProjectionLineColor=color_palette_4, ProjectionLineWeight=code_block_202, CutLinePattern=getByName_5, CutLineColor=color_palette_4, CutLineWeight=code_block_202)
view_setelementoverrides_5 = Custom[View SetElementOverrides](view=code_block_195, elements=filterByBoolMask_22.in, overrides=create_overridegraphicsettings_5)

# group: Overrides Fundaciones (Hidden)
code_block_203 = CodeBlock(x=code_block_69.out1) { x; }
code_block_204 = CodeBlock(x=code_block_203) { x; }
code_block_205 = CodeBlock { "Structural Foundations"; }
byName_24 = Category.ByName(name=code_block_205)
all_elements_of_category_in_view_15 = ElementsOfCategoryInView(Category=byName_24, View=code_block_204)
kind_4 = Custom[StructuralFoundation.Kind](structuralFoundation=all_elements_of_category_in_view_15)
code_block_206 = CodeBlock { "Slab"; }
eq_19 = kind_4 == code_block_206
filterByBoolMask_23 = List.FilterByBoolMask(list=all_elements_of_category_in_view_15, mask=eq_19)
code_block_207 = CodeBlock(x=code_block_203) { x; }
code_block_208 = CodeBlock { null; }
replaceEmptyLists_15 = Custom[List.ReplaceEmptyLists](seq=code_block_207, Replacement=code_block_208)
code_block_209 = CodeBlock(x=replaceEmptyLists_15)  # same code as code_block_9
getByName_6 = LinePatternElement.GetByName(name=code_block_209.out1)
color_palette_5 = ColorPalette({R: 0, G: 0, B: 0, A: 255})
code_block_210 = CodeBlock { 1; }
create_overridegraphicsettings_6 = Custom[Create OverrideGraphicSettings](ProjectionLinePattern=getByName_6, ProjectionLineColor=color_palette_5, ProjectionLineWeight=code_block_210, CutLinePattern=getByName_6, CutLineColor=color_palette_5, CutLineWeight=code_block_210)
view_setelementoverrides_6 = Custom[View SetElementOverrides](view=code_block_204, elements=filterByBoolMask_23.out, overrides=create_overridegraphicsettings_6)

# group: Override Losas
code_block_211 = CodeBlock(x=code_block_69.out1) { x; }
code_block_212 = CodeBlock(x=code_block_211) { x; }
code_block_213 = CodeBlock { "Floors"; }
byName_25 = Category.ByName(name=code_block_213)
all_elements_of_category_in_view_16 = ElementsOfCategoryInView(Category=byName_25, View=code_block_212)
name_9 = Material.Name()  # unwired: material
getMaterials_7 = Element.GetMaterials(element=all_elements_of_category_in_view_16)
flatten_12 = List.Flatten(list=getMaterials_7)
function_apply_21 = ApplyFunction(func=name_9, arg1=flatten_12)
code_block_214 = CodeBlock { "Concrete, Cast-in-Place gray"; }
eq_20 = function_apply_21 == code_block_214
filterByBoolMask_24 = List.FilterByBoolMask(list=all_elements_of_category_in_view_16, mask=eq_20)
code_block_215 = CodeBlock(x=code_block_211) { x; }
code_block_216 = CodeBlock { null; }
replaceEmptyLists_16 = Custom[List.ReplaceEmptyLists](seq=code_block_215, Replacement=code_block_216)
code_block_217 = CodeBlock(x=replaceEmptyLists_16)  # same code as code_block_9
getByName_7 = LinePatternElement.GetByName(name=code_block_217.out1)
color_palette_6 = ColorPalette({R: 0, G: 0, B: 0, A: 255})
code_block_218 = CodeBlock { 1; }
create_overridegraphicsettings_7 = Custom[Create OverrideGraphicSettings](ProjectionLinePattern=getByName_7, ProjectionLineColor=color_palette_6, ProjectionLineWeight=code_block_218, CutLinePattern=getByName_7, CutLineColor=color_palette_6, CutLineWeight=code_block_218)
view_setelementoverrides_7 = Custom[View SetElementOverrides](view=code_block_212, elements=filterByBoolMask_24.in, overrides=create_overridegraphicsettings_7)

code_block_219 = CodeBlock(x=code_block.out1) { x; }

# group: Cota Radier, Tope y Sello de Fundacion
code_block_220 = CodeBlock { null; }
replaceEmptyLists_17 = Custom[List.ReplaceEmptyLists](seq=code_block_219, Replacement=code_block_220)
code_block_221 = CodeBlock(x=replaceEmptyLists_17)  # same code as code_block_48
code_block_222 = CodeBlock(x=code_block_221.out1) { x; }
code_block_223 = CodeBlock(x=code_block_221.out1) { x; }
getCropBox_3 = Orchid.RevitProject.Views.View.GetCropBox(view=code_block_223)
code_block_224 = CodeBlock { null; }
replaceEmptyLists_18 = Custom[List.ReplaceEmptyLists](seq=getCropBox_3.Curve, Replacement=code_block_224)
code_block_225 = CodeBlock(x=replaceEmptyLists_18)  # same code as code_block
code_block_226 = CodeBlock { "Floors"; }
byName_26 = Category.ByName(name=code_block_226)
all_elements_of_category_in_view_17 = ElementsOfCategoryInView(Category=byName_26, View=code_block_223)
code_block_227 = CodeBlock { "Slope"; }
getParameterValueByName = Element.GetParameterValueByName(element=all_elements_of_category_in_view_17, parameterName=code_block_227)
code_block_228 = CodeBlock { ""; }
eq_21 = getParameterValueByName == code_block_228
filterByBoolMask_25 = List.FilterByBoolMask(list=all_elements_of_category_in_view_17, mask=eq_21)
element_level = Custom[Element Level](element=filterByBoolMask_25.in)  # package Genius Loci; Gets an element's level. Based on a Clockwork's node
elevation = Level.Elevation(level=element_level)
minimumItem = List.MinimumItem(list=elevation)
eq_22 = elevation == minimumItem
filterByBoolMask_26 = List.FilterByBoolMask(list=filterByBoolMask_25.in, mask=eq_22)
element_surfaces_references_2 = Custom[Element Surfaces References](element=filterByBoolMask_26.in)
code_block_229 = CodeBlock(x=element_surfaces_references_2.Top_Reference) { DSCore.List.Flatten(x,2); }
code_block_230 = CodeBlock { "Structural Foundations"; }
byName_27 = Category.ByName(name=code_block_230)
all_elements_of_category_in_view_18 = ElementsOfCategoryInView(Category=byName_27, View=code_block_223)
familyName_9 = Orchid.RevitProject.Elements.Element.FamilyName(element=all_elements_of_category_in_view_18)
code_block_231 = CodeBlock { "EST_M_STRUCTURAL FOUNDATION_FUNDACION AISLADA"; }
eq_23 = familyName_9 == code_block_231
code_block_232 = CodeBlock { "Wall Foundation"; }
eq_24 = familyName_9 == code_block_232
or_ = eq_23 || eq_24
filterByBoolMask_27 = List.FilterByBoolMask(list=all_elements_of_category_in_view_18, mask=or_)
code_block_233 = CodeBlock { null; }
replaceEmptyLists_19 = Custom[List.ReplaceEmptyLists](seq=filterByBoolMask_27.in, Replacement=code_block_233)
code_block_234 = CodeBlock(x=replaceEmptyLists_19)  # same code as code_block
element_surfaces_references_3 = Custom[Element Surfaces References](element=code_block_234.out1)
list_create_3 = List.Create(item0=element_surfaces_references_3.Top_Reference, item1=element_surfaces_references_3.Bottom_Reference)
flatten_13 = List.Flatten(list=list_create_3)
code_block_235 = CodeBlock { null; }
replaceEmptyLists_20 = Custom[List.ReplaceEmptyLists](seq=flatten_13, Replacement=code_block_235)
code_block_236 = CodeBlock(x=replaceEmptyLists_20)  # same code as code_block_48
code_block_237 = CodeBlock(refLosas=code_block_229, refrFunAis=code_block_236.out1) { DSCore.List.Flatten(([refLosas,refrFunAis]),2); }
all = Orchid.RevitProject.Annotations.DimensionType.All()
name_10 = Element.Name(element=all)
code_block_238 = CodeBlock { "Linear - 2.5mm Arial"; }
eq_25 = name_10 == code_block_238
filterByBoolMask_28 = List.FilterByBoolMask(list=all, mask=eq_25)
code_block_239 = CodeBlock(x=filterByBoolMask_28.in) { x[0]; }
dimension_byreferences = Custom[Dimension ByReferences](view=code_block_222, line=code_block_225.out1, references=code_block_237, dimensionType=code_block_239)  # package Genius Loci; Creates a new linear dimension from at least two geometric references of an object.

# group: Cota Losas, Radier y Sello de Fundacion
code_block_240 = CodeBlock { null; }
replaceEmptyLists_21 = Custom[List.ReplaceEmptyLists](seq=code_block_219, Replacement=code_block_240)
code_block_241 = CodeBlock(x=replaceEmptyLists_21)  # same code as code_block_48
code_block_242 = CodeBlock(x=code_block_241.out1) { x; }
code_block_243 = CodeBlock(x=code_block_241.out1) { x; }
getCropBox_4 = Orchid.RevitProject.Views.View.GetCropBox(view=code_block_243)
code_block_244 = CodeBlock { null; }
replaceEmptyLists_22 = Custom[List.ReplaceEmptyLists](seq=getCropBox_4.Curve, Replacement=code_block_244)
code_block_245 = CodeBlock(x=replaceEmptyLists_22)  # same code as code_block
code_block_246 = CodeBlock(x=code_block_245.out1) { x; }
code_block_247 = CodeBlock { 0.5; }
planeAtParameter_6 = Curve.PlaneAtParameter(curve=code_block_246, param=code_block_247)
pointAtParameter_10 = Curve.PointAtParameter(curve=code_block_246, param=code_block_247)
plane_15 = Custom[View.Plane](view=code_block_243)
normal_15 = Plane.Normal(plane=plane_15)
byOriginNormal = Plane.ByOriginNormal(origin=pointAtParameter_10, normal=normal_15)
normal_16 = Plane.Normal(plane=byOriginNormal)
code_block_248 = CodeBlock { 90; }
rotate_7 = Geometry.Rotate(geometry=planeAtParameter_6, origin=pointAtParameter_10, axis=normal_16, degrees=code_block_248)
normal_17 = Plane.Normal(plane=rotate_7)
code_block_249 = CodeBlock { 350; }
translate_10 = Geometry.Translate(geometry=code_block_245.out1, direction=normal_17, distance=code_block_249)
code_block_250 = CodeBlock { "Floors"; }
byName_28 = Category.ByName(name=code_block_250)
all_elements_of_category_in_view_19 = ElementsOfCategoryInView(Category=byName_28, View=code_block_243)
code_block_251 = CodeBlock { "Slope"; }
getParameterValueByName_2 = Element.GetParameterValueByName(element=all_elements_of_category_in_view_19, parameterName=code_block_251)
code_block_252 = CodeBlock { ""; }
eq_26 = getParameterValueByName_2 == code_block_252
filterByBoolMask_29 = List.FilterByBoolMask(list=all_elements_of_category_in_view_19, mask=eq_26)
level = Custom[Element.Level]()  # package Clockwork for Dynamo 2.x; Gets an element's level; unwired: element
groupByFunction = List.GroupByFunction(list=filterByBoolMask_29.in, func=level)
code_block_253 = CodeBlock { "Height Offset From Level"; }
getParameterValueByName_3 = Element.GetParameterValueByName(element=groupByFunction, parameterName=code_block_253)
minimumItem_2 = List.MinimumItem(list=getParameterValueByName_3@L2)
code_block_254 = CodeBlock(x=minimumItem_2)
# ---------- code_block_254.designscript (12 lines) ----------
x;
[Imperative]
{
	if(x[0] == null)
	{
		return = [];
	}
	else
	{
		return = x;
	}
};
# ----------------------------------------
eq_27 = getParameterValueByName_3@L2 == code_block_254.out1@L1
filterByBoolMask_30 = List.FilterByBoolMask(list=groupByFunction, mask=eq_27)
code_block_255 = CodeBlock { "Structural Foundations"; }
byName_29 = Category.ByName(name=code_block_255)
all_elements_of_category_in_view_20 = ElementsOfCategoryInView(Category=byName_29, View=code_block_243)
familyName_10 = Orchid.RevitProject.Elements.Element.FamilyName(element=all_elements_of_category_in_view_20)
code_block_256 = CodeBlock { "EST_M_STRUCTURAL FOUNDATION_FUNDACION AISLADA"; }
eq_28 = familyName_10 == code_block_256
code_block_257 = CodeBlock { "Wall Foundation"; }
eq_29 = familyName_10 == code_block_257
or_2 = eq_28 || eq_29
filterByBoolMask_31 = List.FilterByBoolMask(list=all_elements_of_category_in_view_20, mask=or_2)
code_block_258 = CodeBlock { null; }
replaceEmptyLists_23 = Custom[List.ReplaceEmptyLists](seq=filterByBoolMask_31.in, Replacement=code_block_258)
code_block_259 = CodeBlock(x=replaceEmptyLists_23)  # same code as code_block
element_surfaces_references_4 = Custom[Element Surfaces References](element=code_block_259.out1)
code_block_260 = CodeBlock { null; }
replaceEmptyLists_24 = Custom[List.ReplaceEmptyLists](seq=element_surfaces_references_4.Bottom_Reference, Replacement=code_block_260)
code_block_261 = CodeBlock(x=replaceEmptyLists_24)  # same code as code_block
all_2 = Orchid.RevitProject.Annotations.DimensionType.All()
name_11 = Element.Name(element=all_2)
code_block_262 = CodeBlock { "Linear - 2.5mm Arial"; }
eq_30 = name_11 == code_block_262
filterByBoolMask_32 = List.FilterByBoolMask(list=all_2, mask=eq_30)
code_block_263 = CodeBlock(x=filterByBoolMask_32.in) { x[0]; }

code_block_264 = CodeBlock(x=code_block_242) { x; }
flatten_14 = List.Flatten(list=filterByBoolMask_30.in)

# group (continued): Cota Losas, Radier y Sello de Fundacion
element_surfaces_references_5 = Custom[Element Surfaces References](element=flatten_14@L1)
code_block_265 = CodeBlock(x=element_surfaces_references_5.Top_Reference) { DSCore.List.Flatten(x,2); }
code_block_266 = CodeBlock(refLosas=code_block_265, refrFunAis=code_block_261.out1) { DSCore.List.Flatten(([refLosas,refrFunAis]),2); }
dimension_byreferences_2 = Custom[Dimension ByReferences](view=code_block_242, line=translate_10, references=code_block_266, dimensionType=code_block_263)

# group: Niveles en Elevacion
code_block_267 = CodeBlock { null; }
replaceEmptyLists_25 = Custom[List.ReplaceEmptyLists](seq=dimension_byreferences_2, Replacement=code_block_267)
code_block_268 = CodeBlock(x=replaceEmptyLists_25)  # same code as code_block_48
ʳʰʸᵗʰᵐ_dimensions = Rhythm.Revit.Elements.Dimensions.GetReferenceElements(dimension=code_block_268.out1)
ʳʰʸᵗʰᵐ_dimensions_getcurve = Rhythm.Revit.Elements.Dimensions.GetCurve(dimension=code_block_268.out1)
code_block_269 = CodeBlock(line1=ʳʰʸᵗʰᵐ_dimensions_getcurve)
# ---------- code_block_269.designscript (5 lines) ----------
point1 = Autodesk.Curve.StartPoint(line1);
point2 = Autodesk.Curve.EndPoint(line1);
t1 = [point1, point2];
t2 = DSCore.List.Flatten(t1, -1);
t3 = DSCore.List.UniqueItems(t2);
# ----------------------------------------
byElementAndLocation_8 = Tag.ByElementAndLocation(view=code_block_264, element=ʳʰʸᵗʰᵐ_dimensions, location=code_block_269.t3)
code_block_270 = CodeBlock { "Type"; }
getCategory = Element.GetCategory(element=ʳʰʸᵗʰᵐ_dimensions)
string_from_object = FromObject(obj=getCategory)
code_block_271 = CodeBlock { "Structural Foundations"; }
eq_31 = string_from_object == code_block_271  # lacing=Longest
tag_sello_fundacion = CodeBlock()
# ---------- tag_sello_fundacion.designscript (2 lines) ----------
family1 = Revit.Family.ByName("EST_A_FOUNDATION TAG_ELEVACION");
familytype1 = Revit.FamilyType.ByFamilyAndName(family1, "Orientación Izquierda");
# ----------------------------------------
tag_tope_losa = CodeBlock()
# ---------- tag_tope_losa.designscript (2 lines) ----------
family1 = Revit.Family.ByName("EST_A_FLOOR TAG_ELEVACION_TOPE LOSA");
familytype1 = Revit.FamilyType.ByFamilyAndName(family1, "Orientación Izquierda");
# ----------------------------------------
scopeIf_6 = Custom[ScopeIf+](test=eq_31, True=tag_sello_fundacion.familytype1, False=tag_tope_losa.familytype1)
setParameterByName_18 = Element.SetParameterByName(element=byElementAndLocation_8, parameterName=code_block_270, value=scopeIf_6, lacing=Longest)
code_block_272 = CodeBlock { "Type"; }
taggedElement = Tag.TaggedElement(tag=setParameterByName_18)
name_12 = Element.Name(element=taggedElement)
code_block_273 = CodeBlock { "RADIER e="; }
contains_3 = String.Contains(str=name_12, searchFor=code_block_273)
tag_tope_radier = CodeBlock()
# ---------- tag_tope_radier.designscript (2 lines) ----------
family1 = Revit.Family.ByName("EST_A_FLOOR TAG_ELEVACION_TOPE RADIER");
familytype1 = Revit.FamilyType.ByFamilyAndName(family1, "Orientación Izquierda");
# ----------------------------------------
code_block_274 = CodeBlock { []; }
scopeIf_7 = Custom[ScopeIf+](test=contains_3, True=tag_tope_radier.familytype1, False=code_block_274)
setParameterByName_19 = Element.SetParameterByName(element=setParameterByName_18, parameterName=code_block_272, value=scopeIf_7)

openView = Orchid.RevitProject.Common.Document.OpenView(view=code_block.out1)
