# Dynamo graph script.dyn "Detalle DWG a Drafting View" (Dynamo 2.3.1.11775)
# packages: Data-Shapes 2022.2.96, Clockwork for Dynamo 2.x 2.3.0, Orchid 200.4.0.7938, Genius Loci 2021.11.10

code_block = CodeBlock { "DWG a Drafting View"; }
file_path = Filename("B:\02_INSTALADORES\01_DYNAMO\06_USER SETTINGS ORKESTRA\01_IMAGENES\editable Arainco-cmyk-01.png")
code_block_2 = CodeBlock { "INICIAR"; "CANCELAR"; }
code_block_3 = CodeBlock { "Selecciona los\nArchivos."; }
code_block_4 = CodeBlock { "DWG a Drafting View"; }
file_path_2 = Filename("B:\02_INSTALADORES\01_DYNAMO\06_USER SETTINGS ORKESTRA\01_IMAGENES\editable Arainco-cmyk-01.png")
code_block_5 = CodeBlock { "SELECCIONAR"; "CANCELAR"; }
code_block_6 = CodeBlock { "Carpeta Contenedora"; "BUSCAR"; }
directorypath_data = Custom[DirectoryPath Data](InputName=code_block_6.out0, ButtonText=code_block_6.out1)  # package Data-Shapes; Creates a DirectoryPath input for UI.MultipleInputForm ++ . Check out www.data-shapes.net for more infos!
boolean = BoolSelector(true)
multipleinputform = Custom[MultipleInputForm ++](Description_optional=code_block_4, Logo_optional=file_path_2, ButtonText_optional=code_block_5.out0, Inputs=directorypath_data, Toggle=boolean, CancelButtonText_optional=code_block_5.out1)  # package Data-Shapes; Create a form with multiple inputs. see www.data-shapes.net for tutorials and infos!
empty = List.Empty()
scopeIf = Custom[ScopeIf+](test=multipleinputform.Was_Cancelled, True=empty, False=multipleinputform.User_Inputs)  # package Clockwork for Dynamo 2.x; A (hopefully) more robust implementation of ScopeIf. Tests a single boolean and returns a value accordingly.
directory_from_path = DirectoryObject(path=scopeIf)
code_block_7 = CodeBlock { "*.dwg"; }
getDirectoryContents = FileSystem.GetDirectoryContents(directory=directory_from_path, searchString=code_block_7)
flatten = List.Flatten(list=getDirectoryContents.files)
code_block_8 = CodeBlock { "\\"; }
split = String.Split(str=flatten, separator0=code_block_8)
lastItem = List.LastItem(list=split@L2)
listview_data = Custom[Listview Data](InputName=code_block_3, Keys=lastItem, Values=flatten)  # package Data-Shapes; Create data for ListView input in UI.MultiInputForm ++ . Check out www.data-shapes.net for more infos.
code_block_9 = CodeBlock { false; true; }
scopeIf_2 = Custom[ScopeIf+](test=multipleinputform.Was_Cancelled, True=code_block_9.out0, False=code_block_9.out1)
multipleinputform_2 = Custom[MultipleInputForm ++](Description_optional=code_block, Logo_optional=file_path, ButtonText_optional=code_block_2.out0, Inputs=listview_data, Toggle=scopeIf_2, CancelButtonText_optional=code_block_2.out1)
empty_2 = List.Empty()
scopeIf_3 = Custom[ScopeIf+](test=multipleinputform_2.Was_Run, True=multipleinputform_2.User_Inputs, False=empty_2)
flatten_2 = List.Flatten(list=scopeIf_3)
code_block_10 = CodeBlock { "ENT_DT_"; }
code_block_11 = CodeBlock { "\\"; }
split_2 = String.Split(str=flatten_2, separator0=code_block_11)
lastItem_2 = List.LastItem(list=split_2@L2)
code_block_12 = CodeBlock { "."; }
split_3 = String.Split(str=lastItem_2, separator0=code_block_12)
firstItem = List.FirstItem(list=split_3@L2)
add = code_block_10 + firstItem
trimTrailingWhitespace = String.TrimTrailingWhitespace(str=add)
byName = DraftingView.ByName(name=trimTrailingWhitespace)
code_block_13 = CodeBlock { "Type"; }
code_block_14 = CodeBlock { "ENT_DT_DETALLE"; }
byName_2 = Orchid.RevitProject.Views.ViewType.ByName(name=code_block_14)
setParameterByName = Element.SetParameterByName(element=byName, parameterName=code_block_13, value=byName_2)
enumerate_dwg_import_options = Custom[Enumerate DWG import options]()  # package Genius Loci; Enumerate Color mode, Type of Placement and Type of Unit. Works with the "Link DWG" and "Import DWG" nodes.
code_block_15 = CodeBlock(color=enumerate_dwg_import_options.Colormode, placement=enumerate_dwg_import_options.Placement, unit=enumerate_dwg_import_options.Unit) { color[2]; placement[1]; unit[6]; }
import_dwg = Custom[Import DWG](Filepaths=flatten_2, views=setParameterByName, Colormode=code_block_15.out0, Placement=code_block_15.out1, Unit=code_block_15.out2)  # package Genius Loci; Import DWGs in views with options. Use with the Enumerate DWG import options node. Based on an archilab's script.
