# Dynamo graph script.dyn (Dynamo 2.6.2.15705)
# packages: Data-Shapes 2022.2.96, Genius Loci 2021.11.10, Clockwork for Dynamo 2.x 2.4.0, Data-Shapes 2021.2.94, bimorphNodes 3.0.3, Orchid 200.4.0.7938

code_block = CodeBlock { "DWG a Drafting View"; }
code_block_2 = CodeBlock { "INICIAR"; "CANCELAR"; 460; }
code_block_3 = CodeBlock { "Selecciona los\nArchivos."; }
code_block_4 = CodeBlock { "DWG a Drafting View"; }
code_block_5 = CodeBlock { "SELECCIONAR"; "CANCELAR"; 430; 145; }
code_block_6 = CodeBlock { "Carpeta Contenedora"; "BUSCAR"; }
directorypath_data = Custom[DirectoryPath Data](InputName=code_block_6.out0, ButtonText=code_block_6.out1)  # package Data-Shapes; Creates a DirectoryPath input for UI.MultipleInputForm ++ . Check out www.data-shapes.net for more infos!
boolean = BoolSelector(true)
multipleinputform = Custom[MultipleInputForm ++](Description_optional=code_block_4, ButtonText_optional=code_block_5.out0, Inputs=directorypath_data, Toggle=boolean, CancelButtonText_optional=code_block_5.out1, Width_optional=code_block_5.out2, LabelWidth_optional=code_block_5.out3)  # package Data-Shapes; Create a form with multiple inputs. see www.data-shapes.net for tutorials and infos!
code_block_7 = CodeBlock(x=multipleinputform.User_Inputs)
# ---------- code_block_7.designscript (12 lines) ----------
x;
[Imperative]
{
	if(x == null)
	{
		return = [];
	}
	else
	{
		return = x;
	}
};
# ----------------------------------------
directory_from_path = DirectoryObject(path=code_block_7.out1)
code_block_8 = CodeBlock { "*.dwg"; }
getDirectoryContents = FileSystem.GetDirectoryContents(directory=directory_from_path, searchString=code_block_8)
flatten = List.Flatten(list=getDirectoryContents.files)
code_block_9 = CodeBlock { "\\"; }
split = String.Split(str=flatten, separator0=code_block_9)
code_block_10 = CodeBlock { null; }
replaceEmptyLists = Custom[List.ReplaceEmptyLists](seq=split, Replacement=code_block_10)  # package Clockwork for Dynamo 2.x; Replaces all empty lists within a given list with a substitute
lastItem = List.LastItem(list=replaceEmptyLists@L2)
code_block_11 = CodeBlock { 300; }
listview_data = Custom[Listview Data](InputName=code_block_3, Keys=lastItem, Values=flatten, Height_optionnal=code_block_11)  # package Data-Shapes; Create data for ListView input in UI.MultiInputForm ++ . Check out www.data-shapes.net for more infos.
code_block_12 = CodeBlock { "Subclasificación"; }
code_block_13 = CodeBlock()
# ---------- code_block_13.designscript (10 lines) ----------
[
"Planos Generales - PG",
"Elevaciones Eje - MA",
"Plantas Losa - LO",
"Elevacion Viga - VH",
"Elevacion Columna - CH",
"Estructura Metalica - EM",
"Detalle Escalera - ES",
"Detalle Estanque - DE"
];
# ----------------------------------------
code_block_14 = CodeBlock()
# ---------- code_block_14.designscript (10 lines) ----------
[
"00_PG",
"01_LO",
"03_MA",
"04_VH",
"05_CH",
"06_EM",
"07_ES",
"08_DE"
];
# ----------------------------------------
code_block_15 = CodeBlock { 0; }
radiobuttons_data = Custom[RadioButtons Data](InputName=code_block_12, Keys=code_block_13, Values=code_block_14, DefaultValueIndex=code_block_15)  # package Data-Shapes; Create radio buttons input for UI.MultipleInputForm ++ .
list_create = List.Create(item0=listview_data, item1=radiobuttons_data)
code_block_16 = CodeBlock(x=multipleinputform.User_Inputs)
# ---------- code_block_16.designscript (12 lines) ----------
x;
[Imperative]
{
	if(x == null)
	{
		return = [];
	}
	else
	{
		return = true;
	}
};
# ----------------------------------------
multipleinputform_2 = Custom[MultipleInputForm ++](Description_optional=code_block, ButtonText_optional=code_block_2.out0, Inputs=list_create, Toggle=code_block_16.out1, CancelButtonText_optional=code_block_2.out1, Width_optional=code_block_2.out2)
code_block_17 = CodeBlock(x=multipleinputform_2.User_Inputs)
# ---------- code_block_17.designscript (24 lines) ----------
x;
res1 = [Imperative]
{
	if(x == null)
	{
		return = [];
	}
	else
	{
		return = x[0];
	}
};

res2 = [Imperative]
{
	if(res1 == null)
	{
		return = [];
	}
	else
	{
		return = res1;
	}
};
# ----------------------------------------
flatten_2 = List.Flatten(list=code_block_17.out2)
code_block_18 = CodeBlock { "\\"; }
split_2 = String.Split(str=flatten_2, separator0=code_block_18)
code_block_19 = CodeBlock { null; }
replaceEmptyLists_2 = Custom[List.ReplaceEmptyLists](seq=split_2, Replacement=code_block_19)
lastItem_2 = List.LastItem(list=replaceEmptyLists_2@L2)
list_clean = Custom[List Clean](list=lastItem_2)  # package Genius Loci; Removes all Null, Empty and Blank from a list or nested list of lists.
code_block_20 = CodeBlock { "."; }
split_3 = String.Split(str=list_clean, separator0=code_block_20)
code_block_21 = CodeBlock { null; }
replaceEmptyLists_3 = Custom[List.ReplaceEmptyLists](seq=split_3, Replacement=code_block_21)
firstItem = List.FirstItem(list=replaceEmptyLists_3@L2)
list_clean_2 = Custom[List Clean](list=firstItem)
trimTrailingWhitespace = String.TrimTrailingWhitespace(str=list_clean_2)
byName = DraftingView.ByName(name=trimTrailingWhitespace)
enumerate_dwg_import_options = Custom[Enumerate DWG import options]()  # package Genius Loci; Enumerate Color mode, Type of Placement and Type of Unit. Works with the "Link DWG" and "Import DWG" nodes.
code_block_22 = CodeBlock(color=enumerate_dwg_import_options.Colormode, placement=enumerate_dwg_import_options.Placement, unit=enumerate_dwg_import_options.Unit) { color[2]; placement[1]; unit[6]; }
import_dwg = Custom[Import DWG](Filepaths=flatten_2, views=byName, Colormode=code_block_22.out0, Placement=code_block_22.out1, Unit=code_block_22.out2)  # package Genius Loci; Import DWGs in views with options. Use with the Enumerate DWG import options node. Based on an archilab's script.
code_block_23 = CodeBlock(x=multipleinputform_2.User_Inputs)
# ---------- code_block_23.designscript (24 lines) ----------
x;
res1 = [Imperative]
{
	if(x == null)
	{
		return = [];
	}
	else
	{
		return = x[1];
	}
};

res2 = [Imperative]
{
	if(res1 == null)
	{
		return = [];
	}
	else
	{
		return = res1;
	}
};
# ----------------------------------------
code_block_24 = CodeBlock(subC=code_block_23.out2) { ["Clasificacion","Subclasificacion"]; ["01_ENTREGABLE",subC]; }
setParameterByName = Element.SetParameterByName(element=import_dwg.Views@L1, parameterName=code_block_24.out0@L2, value=code_block_24.out1@L2, lacing=Longest)
code_block_25 = CodeBlock(x=import_dwg.Views) { x; }
fromLayers = CADTextData.FromLayers(importInstance=import_dwg.ImportInstance)
originPoint = CADTextData.OriginPoint(cADTextData=fromLayers.CADTextData)
flatten_3 = List.Flatten(list=originPoint@L3)
textValue = CADTextData.TextValue(cADTextData=fromLayers.CADTextData)
flatten_4 = List.Flatten(list=textValue@L3)
verticalAlign = CADTextData.VerticalAlign(cADTextData=fromLayers.CADTextData)
flatten_5 = List.Flatten(list=verticalAlign@L3)
element_types = ElementTypes("TextNoteType")
all_elements_of_type = ElementsOfType(element_type=element_types)
name = Element.Name(element=all_elements_of_type)
code_block_26 = CodeBlock { "2.5mm Arial"; }
eq = name == code_block_26
filterByBoolMask = List.FilterByBoolMask(list=all_elements_of_type, mask=eq)
byLocation = TextNote.ByLocation(view=code_block_25@L1, location=flatten_3@L2, text=flatten_4@L2, alignment=flatten_5@L2, type=filterByBoolMask.in, lacing=Longest)
detailCurvesFromCADLayers = CAD.DetailCurvesFromCADLayers(importInstance=import_dwg.ImportInstance@L1, view=import_dwg.Views@L1)
flatten_6 = List.Flatten(list=detailCurvesFromCADLayers.DetailCurve)
await_ = Orchid.Common.DataStream.Await(pass=import_dwg.ImportInstance, waitFor=flatten_6)
delete = Element.Delete(element=await_)
