# Dynamo graph porFechaEntrega_script.dyn (Dynamo 2.3.2.15696)
# packages: Data-Shapes 2022.2.96, Genius Loci 2021.11.10, Orchid 200.4.0.7938, Crumple 2021.9.24, Visual Style Select 1.0.0, Clockwork for Dynamo 2.x 2.4.0

code_block = CodeBlock { "*.pdf"; }
directory_path = Directory("C:\RVT_FILES\01_PDF")
directory_from_path = DirectoryObject(path=directory_path)
code_block_2 = CodeBlock { "Exportacion por Fecha de Entrega"; }
code_block_3 = CodeBlock { "INICIAR"; "CANCELAR"; 160; 430; }
code_block_4 = CodeBlock { "FECHA DE REVISION"; }
code_block_5 = CodeBlock { "Selecciona un a Fecha"; }
code_block_6 = CodeBlock { "Sheets"; }
byName = Category.ByName(name=code_block_6)
all_elements_of_category = ElementsOfCategory(Category=byName)
parameters = Element.Parameters(element=all_elements_of_category)
group = Parameter.Group(parameter=parameters)
code_block_7 = CodeBlock { "PG_DATA"; }
eq = group == code_block_7
filterByBoolMask = List.FilterByBoolMask(list=parameters, mask=eq)
name = Parameter.Name(parameter=filterByBoolMask.in)
flatten = List.Flatten(list=name)
uniqueItems = List.UniqueItems(list=flatten)
code_block_8 = CodeBlock { "FCH"; }
contains = String.Contains(str=uniqueItems, searchFor=code_block_8)
filterByBoolMask_2 = List.FilterByBoolMask(list=uniqueItems, mask=contains)
getParameterValueByName = Element.GetParameterValueByName(element=all_elements_of_category@L1, parameterName=filterByBoolMask_2.in@L2, lacing=Longest)
flatten_2 = List.Flatten(list=getParameterValueByName)
uniqueItems_2 = List.UniqueItems(list=flatten_2)
list_clean = Custom[List Clean](list=uniqueItems_2)  # package Genius Loci; Removes all Null, Empty and Blank from a list or nested list of lists.
boolean = BoolSelector(false)
dropdown_data = Custom[DropDown Data](InputName=code_block_5, Keys=list_clean, Values=list_clean, Sorted_optional=boolean)  # package Data-Shapes; Create data for DropDown input in UI.MultiInputForm ++ . Check out www.data-shapes.net for more infos.
inputgroup_data = Custom[InputGroup Data](GroupTitle=code_block_4, Inputs=dropdown_data)  # package Data-Shapes; Creates a group of inputs for UI.MultipleInputForm ++ . Check out www.data-shapes.net for more infos !
code_block_9 = CodeBlock { "RUTAS CARPETA DE PROYECTO"; }
code_block_10 = CodeBlock { "CARPETA DE ENTREGA"; }
code_block_11 = CodeBlock { "Seleccion de\nCarpeta"; "BUSCAR"; }
directorypath_data = Custom[DirectoryPath Data](InputName=code_block_11.out0, ButtonText=code_block_11.out1)  # package Data-Shapes; Creates a DirectoryPath input for UI.MultipleInputForm ++ . Check out www.data-shapes.net for more infos!
code_block_12 = CodeBlock { "Nombre de Carpeta"; "CARPETA"; }
textbox_data = Custom[TextBox Data](InputName=code_block_12.out0, DefaultText=code_block_12.out1)  # package Data-Shapes; Create Data for TextBox input in UI.MultipleInputForm ++ . Check out www.data-shapes.net for more informations
list_create = List.Create(item0=directorypath_data, item1=textbox_data)
inputgroup_data_2 = Custom[InputGroup Data](GroupTitle=code_block_10, Inputs=list_create)
code_block_13 = CodeBlock { "CARPETA DE DISEÑO"; }
code_block_14 = CodeBlock { "Seleccion de\nCarpeta"; "BUSCAR"; }
directorypath_data_2 = Custom[DirectoryPath Data](InputName=code_block_14.out0, ButtonText=code_block_14.out1)
inputgroup_data_3 = Custom[InputGroup Data](GroupTitle=code_block_13, Inputs=directorypath_data_2)
list_create_2 = List.Create(item0=inputgroup_data_2, item1=inputgroup_data_3)
inputgroup_data_4 = Custom[InputGroup Data](GroupTitle=code_block_9, Inputs=list_create_2)
list_create_3 = List.Create(item0=inputgroup_data, item1=inputgroup_data_4)
flatten_3 = List.Flatten(list=list_create_3)
boolean_2 = BoolSelector(true)
multipleinputform = Custom[MultipleInputForm ++](Description_optional=code_block_2, ButtonText_optional=code_block_3.out0, Inputs=flatten_3, Toggle=boolean_2, CancelButtonText_optional=code_block_3.out1, Width_optional=code_block_3.out3, LabelWidth_optional=code_block_3.out2)  # package Data-Shapes; Create a form with multiple inputs. see www.data-shapes.net for tutorials and infos!
code_block_15 = CodeBlock(x=multipleinputform.User_Inputs)
# ---------- code_block_15.designscript (12 lines) ----------
x;
[Imperative]
{
	if(x == null)
	{
		return = [[],[],[],[],[],[]];
	}
	else
	{
		return = x;
	}
};
# ----------------------------------------
code_block_16 = CodeBlock(x=code_block_15.out1) { x[1]; }
now = DateTime.Now()
code_block_17 = CodeBlock { "yyyy.MM.dd"; }
format = DateTime.Format(dateTime=now, format=code_block_17)
code_block_18 = CodeBlock(x=code_block_15.out1) { x[2]; }
toUpper = String.ToUpper(str=code_block_18)
code_block_19 = CodeBlock(fecha=format, dir=toUpper) { "\\"+fecha+"_"+dir; }
add = code_block_16 + code_block_19
directory_from_path_2 = DirectoryObject(path=add)
string_from_object = FromObject(obj=directory_from_path_2)
directory_path_2 = Directory("C:\RVT_FILES\01_PDF")
directory_path_3 = Directory("C:\RVT_FILES\01_PDF")
printer = Printer("PDFCreator")
boolean_3 = BoolSelector(true)
code_block_20 = CodeBlock { "Sheets"; }
byName_2 = Category.ByName(name=code_block_20)
all_elements_of_category_2 = ElementsOfCategory(Category=byName_2)
code_block_21 = CodeBlock { "Sheets"; }
byName_3 = Category.ByName(name=code_block_21)
all_elements_of_category_3 = ElementsOfCategory(Category=byName_3)
parameters_2 = Element.Parameters(element=all_elements_of_category_3)
group_2 = Parameter.Group(parameter=parameters_2)
code_block_22 = CodeBlock { "PG_DATA"; }
eq_2 = group_2 == code_block_22
filterByBoolMask_3 = List.FilterByBoolMask(list=parameters_2, mask=eq_2)
name_2 = Parameter.Name(parameter=filterByBoolMask_3.in)
flatten_4 = List.Flatten(list=name_2)
uniqueItems_3 = List.UniqueItems(list=flatten_4)
code_block_23 = CodeBlock { "FCH"; }
contains_2 = String.Contains(str=uniqueItems_3, searchFor=code_block_23)
filterByBoolMask_4 = List.FilterByBoolMask(list=uniqueItems_3, mask=contains_2)
getParameterValueByName_2 = Element.GetParameterValueByName(element=all_elements_of_category_3@L1, parameterName=filterByBoolMask_4.in@L2, lacing=Longest)
code_block_24 = CodeBlock(x=code_block_15.out1) { x[0]; }
eq_3 = getParameterValueByName_2@L2 == code_block_24@L1  # lacing=Longest
anyTrue = Orchid.Common.List.AnyTrue(list=eq_3@L2)
filterByBoolMask_5 = List.FilterByBoolMask(list=all_elements_of_category_2, mask=anyTrue)
sheetNumber = Sheet.SheetNumber(sheet=filterByBoolMask_5.in)
code_block_25 = CodeBlock { ["VH","CH","MA"]; }
contains_3 = String.Contains(str=sheetNumber@L1, searchFor=code_block_25)
anyTrue_2 = Orchid.Common.List.AnyTrue(list=contains_3@L2)
filterByBoolMask_6 = List.FilterByBoolMask(list=filterByBoolMask_5.in, mask=anyTrue_2)
views = Sheet.Views(sheet=filterByBoolMask_6.in)
code_block_26 = CodeBlock { 7; }
visual_style_select = Custom[Visual Style Select](ViewList=views@L2, Integer=code_block_26)  # package Visual Style Select; Change the Visual Style on a list of views. Please use the following as the integer input: 1 - Wireframe 2 - Hidden line 3 - Shaded 4 - Shaded with Edges 5 - Consistent Colors 6 - Realistic
waitfor = Custom[© WaitFor](data=filterByBoolMask_5.in, waitFor=visual_style_select)  # package Crumple; Tells the first input to wait for the second input to arrive, then passes on the first input. Really useful for scripts which have branching paths that rely on their outputs to carry each other forward. Quite a few custom packages have a 'passthrough' or 'waitfor' node. I use these all the time, so find it useful to have them contained in this package also.
code_block_27 = CodeBlock { null; }
replaceEmptyLists = Custom[List.ReplaceEmptyLists](seq=waitfor, Replacement=code_block_27)  # package Clockwork for Dynamo 2.x; Replaces all empty lists within a given list with a substitute
code_block_28 = CodeBlock(x=replaceEmptyLists)
# ---------- code_block_28.designscript (12 lines) ----------
x;
[Imperative]
{
	if(x == null)
	{
		return = [[],[]];
	}
	else
	{
		return = [x,"PDF001"];
	}
};
# ----------------------------------------
code_block_29 = CodeBlock(x=code_block_28.out1) { x[0]; x[1]; }
create = Orchid.RevitProject.Views.SheetSet.Create(view=code_block_29.out0, name=code_block_29.out1)
print_setting = Setting("PDFCreator_A0")
byViewSheetSet = Orchid.Common.Print.ByViewSheetSet(printer=printer, file=boolean_3, viewSheetSet=create, printSetting=print_setting)
end = Revit.Transaction.Transaction.End(input=byViewSheetSet)
waitfor_2 = Custom[© WaitFor](data=directory_path_3, waitFor=end)
code_block_30 = CodeBlock { 15; }
delay = Custom[© Delay](data=waitfor_2, seconds=code_block_30, limit=code_block_30)  # package Crumple; Given a duration in seconds and some data, this script will delay that data by the given time. A threshold of 3 seconds is used by default to stop an undesirable number being provided.
string = StringInput("")
contents = Orchid.Common.Directory.Contents(directory=delay.data)
fileName = FileSystem.FileName(path=contents)
code_block_31 = CodeBlock { "-"; }
code_block_32 = CodeBlock { " - "; }
split = String.Split(str=contents, separator0=code_block_32)
code_block_33 = CodeBlock { null; }
replaceEmptyLists_2 = Custom[List.ReplaceEmptyLists](seq=split, Replacement=code_block_33)
code_block_34 = CodeBlock(x=replaceEmptyLists_2)
# ---------- code_block_34.designscript (12 lines) ----------
x;
[Imperative]
{
	if(x == null)
	{
		return = [null,null,null,null];
	}
	else
	{
		return = x;
	}
};
# ----------------------------------------
code_block_35 = CodeBlock { [2,3]; }
getItemAtIndex = List.GetItemAtIndex(list=code_block_34.out1@L2, index=code_block_35)
code_block_36 = CodeBlock { "C0"; }
addItemToEnd = List.AddItemToEnd(item=getItemAtIndex@L2, list=code_block_36)
flatten_5 = List.Flatten(list=addItemToEnd@L3)
join = String.Join(separator=code_block_31@L2, string0=flatten_5)
flatten_6 = List.Flatten(list=join)
rename = Orchid.Common.File.Rename(directory=delay.data, extension=string, sourceName=fileName, targetName=flatten_6)
waitfor_3 = Custom[© WaitFor](data=directory_path_2, waitFor=rename)
directory_from_path_3 = DirectoryObject(path=waitfor_3)
getDirectoryContents = FileSystem.GetDirectoryContents(directory=directory_from_path_3)
code_block_37 = CodeBlock { "-"; }
split_2 = String.Split(str=getDirectoryContents.files, separator0=code_block_37)
code_block_38 = CodeBlock { null; }
replaceEmptyLists_3 = Custom[List.ReplaceEmptyLists](seq=split_2, Replacement=code_block_38)
code_block_39 = CodeBlock(x=replaceEmptyLists_3)  # same code as code_block_34
code_block_40 = CodeBlock { 1; }
getItemAtIndex_2 = List.GetItemAtIndex(list=code_block_39.out1@L2, index=code_block_40)
list_clean_2 = Custom[List Clean](list=getItemAtIndex_2)
groupByKey = List.GroupByKey(list=getDirectoryContents.files, keys=list_clean_2)
directory_path_4 = Directory("C:\RVT_FILES\01_PDF")
code_block_41 = CodeBlock()
# ---------- code_block_41.designscript (26 lines) ----------
[
"CF - Cielos Falsos",
"CH - Armadura Columnas",
"CI - Cines",
"DE - Detalle Estanques",
"EM - Estructura Metalica",
"ES - Escaleras",
"LO - Armadura Losas",
"MA - Muros Hormigon Armado",
"MC - Montacargas",
"OE - Obras Exteriores",
"PC - Planos de Carga",
"PE - PLano Extendido",
"PG - Planos Generales",
"RP - Rampas",
"SK - Esquemas",
"ST - Planos Standar",
"TA - Talud",
"TH - Tipo de Hormigon",
"VA - Varios",
"VH - Armadura Vigas",
"DM - Demolicion",
"FPL - Pilas",
"RF - Refuerzo",
"EL - Elevacion"
];
# ----------------------------------------
code_block_42 = CodeBlock { " - "; }
split_3 = String.Split(str=code_block_41, separator0=code_block_42)
code_block_43 = CodeBlock { 0; }
getItemAtIndex_3 = List.GetItemAtIndex(list=split_3@L2, index=code_block_43)
byKeysValues = DesignScript.Builtin.Dictionary.ByKeysValues(keys=getItemAtIndex_3, values=code_block_41)
code_block_44 = CodeBlock { "\\"; }
split_4 = String.Split(str=getDirectoryContents.files, separator0=code_block_44)
code_block_45 = CodeBlock { null; }
replaceEmptyLists_4 = Custom[List.ReplaceEmptyLists](seq=split_4, Replacement=code_block_45)
code_block_46 = CodeBlock(x=replaceEmptyLists_4)  # same code as code_block_34
code_block_47 = CodeBlock { 3; }
getItemAtIndex_4 = List.GetItemAtIndex(list=code_block_46.out1@L2, index=code_block_47)
list_clean_3 = Custom[List Clean](list=getItemAtIndex_4)
code_block_48 = CodeBlock { "-"; }
split_5 = String.Split(str=list_clean_3, separator0=code_block_48)
code_block_49 = CodeBlock { null; }
replaceEmptyLists_5 = Custom[List.ReplaceEmptyLists](seq=split_5, Replacement=code_block_49)
code_block_50 = CodeBlock(x=replaceEmptyLists_5)  # same code as code_block_34
code_block_51 = CodeBlock { 1; }
getItemAtIndex_5 = List.GetItemAtIndex(list=code_block_50.out1@L2, index=code_block_51)
list_clean_4 = Custom[List Clean](list=getItemAtIndex_5)
valueAtKey = DesignScript.Builtin.Dictionary.ValueAtKey(dictionary=byKeysValues, key=list_clean_4)
code_block_52 = CodeBlock(dir=directory_path_4, cat=valueAtKey, files=list_clean_3) { dir+"\\"+cat+"\\01_PDF\\"+files; }
directory_path_5 = Directory("C:\RVT_FILES\01_PDF")
code_block_53 = CodeBlock(dir=directory_path_5, cat=valueAtKey) { dir+"\\"+cat+"\\01_PDF"; }
directory_from_path_4 = DirectoryObject(path=code_block_53)
waitfor_4 = Custom[© WaitFor](data=code_block_52, waitFor=directory_from_path_4)
code_block_54 = CodeBlock { "-"; }
split_6 = String.Split(str=waitfor_4, separator0=code_block_54)
code_block_55 = CodeBlock { null; }
replaceEmptyLists_6 = Custom[List.ReplaceEmptyLists](seq=split_6, Replacement=code_block_55)
code_block_56 = CodeBlock(x=replaceEmptyLists_6)  # same code as code_block_34
code_block_57 = CodeBlock { 1; }
getItemAtIndex_6 = List.GetItemAtIndex(list=code_block_56.out1@L2, index=code_block_57)
list_clean_5 = Custom[List Clean](list=getItemAtIndex_6)
groupByKey_2 = List.GroupByKey(list=waitfor_4, keys=list_clean_5)
code_block_58 = CodeBlock { null; }
replaceEmptyLists_7 = Custom[List.ReplaceEmptyLists](seq=groupByKey_2.groups, Replacement=code_block_58)
code_block_59 = CodeBlock(x=replaceEmptyLists_7)
# ---------- code_block_59.designscript (12 lines) ----------
x;
[Imperative]
{
	if(x == null)
	{
		return = [];
	}
	else
	{
		return = true;
	}
};
# ----------------------------------------
moveFile = FileSystem.MoveFile(path=groupByKey.groups@L2, newPath=groupByKey_2.groups@L2, overwrite=code_block_59.out1, lacing=Longest)
waitfor_5 = Custom[© WaitFor](data=string_from_object, waitFor=moveFile)
directory_path_6 = Directory("C:\RVT_FILES\01_PDF")
directory_from_path_5 = DirectoryObject(path=directory_path_6)
code_block_60 = CodeBlock { true; }
copyDirectory = FileSystem.CopyDirectory(directory=directory_from_path_5, destinationPath=waitfor_5, overwriteFiles=code_block_60)
waitfor_6 = Custom[© WaitFor](data=waitfor_5, waitFor=copyDirectory)
directory_from_path_6 = DirectoryObject(path=waitfor_6)
code_block_61 = CodeBlock(x=code_block_15.out1) { x[3]; }
directory_from_path_7 = DirectoryObject(path=code_block_61)
string_from_object_2 = FromObject(obj=directory_from_path_7)
code_block_62 = CodeBlock { true; }
copyDirectory_2 = FileSystem.CopyDirectory(directory=directory_from_path_6, destinationPath=string_from_object_2, overwriteFiles=code_block_62)
waitfor_7 = Custom[© WaitFor](data=directory_from_path, waitFor=copyDirectory_2)
getDirectoryContents_2 = FileSystem.GetDirectoryContents(directory=waitfor_7)
code_block_63 = CodeBlock { true; }
deleteDirectory = FileSystem.DeleteDirectory(path=getDirectoryContents_2.directories, recursive=code_block_63)
deleteFile = FileSystem.DeleteFile(path=getDirectoryContents_2.files)
directory_path_7 = Directory("C:\RVT_FILES\00_DWG")
directory_from_path_8 = DirectoryObject(path=directory_path_7)
directory_path_8 = Directory("C:\RVT_FILES\00_DWG")
directory_path_9 = Directory("C:\RVT_FILES\00_DWG")
directory_path_10 = Directory("C:\RVT_FILES\00_DWG")
waitfor_8 = Custom[© WaitFor](data=waitfor, waitFor=byViewSheetSet)
sheetNumber_2 = Sheet.SheetNumber(sheet=waitfor_8)
code_block_64 = CodeBlock { ["VH","CH","MA"]; }
contains_4 = String.Contains(str=sheetNumber_2@L1, searchFor=code_block_64)
anyTrue_3 = Orchid.Common.List.AnyTrue(list=contains_4@L2)
filterByBoolMask_7 = List.FilterByBoolMask(list=waitfor_8, mask=anyTrue_3)
views_2 = Sheet.Views(sheet=filterByBoolMask_7.in)
code_block_65 = CodeBlock { 1; }
visual_style_select_2 = Custom[Visual Style Select](ViewList=views_2@L2, Integer=code_block_65)
waitfor_9 = Custom[© WaitFor](data=waitfor_8, waitFor=visual_style_select_2)
code_block_66 = CodeBlock { "Clasificacion"; }
getParameterValueByName_3 = Element.GetParameterValueByName(element=waitfor_9, parameterName=code_block_66)
groupByKey_3 = List.GroupByKey(list=waitfor_9, keys=getParameterValueByName_3)
sheetNumber_3 = Sheet.SheetNumber()  # unwired: sheet
function_apply = ApplyFunction(func=sheetNumber_3, arg1=groupByKey_3.groups)
sheetName = Sheet.SheetName()  # unwired: sheet
function_apply_2 = ApplyFunction(func=sheetName, arg1=groupByKey_3.groups)
code_block_67 = CodeBlock(sheetNumber=function_apply, sheetName=function_apply_2) { "C0-"+sheetNumber+"-"+sheetName; }
code_block_68 = CodeBlock { "Clasificacion"; }
getParameterValueByName_4 = Element.GetParameterValueByName(parameterName=code_block_68)  # unwired: element
function_apply_3 = ApplyFunction(func=getParameterValueByName_4, arg1=groupByKey_3.groups)
valueAtKey_2 = DesignScript.Builtin.Dictionary.ValueAtKey(key=function_apply_3@L2)  # unwired: dictionary
ᶜᵒⁿᵛᵉʳᵗᵉᵈ_ᶠʳᵒᵐ_ᴰʳᵒᵖᵈᵒʷⁿ_ʷᶦᵗʰ = CodeBlock { DSCore.Types.FindTypeByNameInAssembly("ExportDWGSettings", "RevitAPI"); }  # "ᶜᵒⁿᵛᵉʳᵗᵉᵈ ᶠʳᵒᵐ ᴰʳᵒᵖᵈᵒʷⁿ ʷᶦᵗʰ ᴹᵒⁿᵒᶜˡᵉ™"
all_elements_of_type = ElementsOfType(element_type=ᶜᵒⁿᵛᵉʳᵗᵉᵈ_ᶠʳᵒᵐ_ᴰʳᵒᵖᵈᵒʷⁿ_ʷᶦᵗʰ)
name_3 = Element.Name(element=all_elements_of_type)
code_block_69 = CodeBlock { "SHEET_"; }
contains_5 = String.Contains(str=name_3, searchFor=code_block_69)
filterByBoolMask_8 = List.FilterByBoolMask(list=name_3, mask=contains_5)
code_block_70 = CodeBlock { "_"; }
split_7 = String.Split(str=filterByBoolMask_8.in, separator0=code_block_70)
code_block_71 = CodeBlock { 1; }
getItemAtIndex_7 = List.GetItemAtIndex(list=split_7@L2, index=code_block_71)
byKeysValues_2 = DesignScript.Builtin.Dictionary.ByKeysValues(keys=getItemAtIndex_7, values=filterByBoolMask_8.in)
function_apply_4 = ApplyFunction(func=valueAtKey_2, arg1=byKeysValues_2)
uniqueItems_4 = List.UniqueItems(list=function_apply_4@L2)
boolean_4 = BoolSelector(true)
export_dwg_in_document = Custom[Export DWG in Document](DirectoryPath=directory_path_10, view=groupByKey_3.groups@L2, Filename=code_block_67@L2, ExportSetup=uniqueItems_4@L2, RunIt=boolean_4)  # package Genius Loci; Export views to DWG with export setup in the active or given document. Based on a script by Konrad K Sobon.
waitfor_10 = Custom[© WaitFor](data=directory_path_9, waitFor=export_dwg_in_document)
code_block_72 = CodeBlock { 1; }
delay_2 = Custom[© Delay](data=waitfor_10, seconds=code_block_72, limit=code_block_72)
code_block_73 = CodeBlock { "*.pcp"; }
contents_2 = Orchid.Common.Directory.Contents(directory=delay_2.data, searchString=code_block_73)
deleteFile_2 = FileSystem.DeleteFile(path=contents_2)
waitfor_11 = Custom[© WaitFor](data=directory_path_8, waitFor=deleteFile_2)
code_block_74 = CodeBlock { "*.dwg"; }
contents_3 = Orchid.Common.Directory.Contents(directory=waitfor_11, searchString=code_block_74)
code_block_75 = CodeBlock { "-"; }
split_8 = String.Split(str=contents_3, separator0=code_block_75)
code_block_76 = CodeBlock { null; }
replaceEmptyLists_8 = Custom[List.ReplaceEmptyLists](seq=split_8, Replacement=code_block_76)
code_block_77 = CodeBlock(x=replaceEmptyLists_8)  # same code as code_block_34
code_block_78 = CodeBlock { 1; }
getItemAtIndex_8 = List.GetItemAtIndex(list=code_block_77.out1@L2, index=code_block_78)
list_clean_6 = Custom[List Clean](list=getItemAtIndex_8)
groupByKey_4 = List.GroupByKey(list=contents_3, keys=list_clean_6)
directory_path_11 = Directory("C:\RVT_FILES\00_DWG")
code_block_79 = CodeBlock()  # same code as code_block_41
code_block_80 = CodeBlock { " - "; }
split_9 = String.Split(str=code_block_79, separator0=code_block_80)
code_block_81 = CodeBlock { 0; }
getItemAtIndex_9 = List.GetItemAtIndex(list=split_9@L2, index=code_block_81)
byKeysValues_3 = DesignScript.Builtin.Dictionary.ByKeysValues(keys=getItemAtIndex_9, values=code_block_79)
code_block_82 = CodeBlock { "\\"; }
split_10 = String.Split(str=contents_3, separator0=code_block_82)
code_block_83 = CodeBlock { null; }
replaceEmptyLists_9 = Custom[List.ReplaceEmptyLists](seq=split_10, Replacement=code_block_83)
code_block_84 = CodeBlock(x=replaceEmptyLists_9)  # same code as code_block_34
code_block_85 = CodeBlock { 3; }
getItemAtIndex_10 = List.GetItemAtIndex(list=code_block_84.out1@L2, index=code_block_85)
list_clean_7 = Custom[List Clean](list=getItemAtIndex_10)
code_block_86 = CodeBlock { "-"; }
split_11 = String.Split(str=list_clean_7, separator0=code_block_86)
code_block_87 = CodeBlock { null; }
replaceEmptyLists_10 = Custom[List.ReplaceEmptyLists](seq=split_11, Replacement=code_block_87)
code_block_88 = CodeBlock(x=replaceEmptyLists_10)  # same code as code_block_34
code_block_89 = CodeBlock { 1; }
getItemAtIndex_11 = List.GetItemAtIndex(list=code_block_88.out1@L2, index=code_block_89)
list_clean_8 = Custom[List Clean](list=getItemAtIndex_11)
valueAtKey_3 = DesignScript.Builtin.Dictionary.ValueAtKey(dictionary=byKeysValues_3, key=list_clean_8)
code_block_90 = CodeBlock(dir=directory_path_11, cat=valueAtKey_3, files=list_clean_7) { dir+"\\"+cat+"\\00_DWG\\"+files; }
directory_path_12 = Directory("C:\RVT_FILES\00_DWG")
code_block_91 = CodeBlock(dir=directory_path_12, cat=valueAtKey_3) { dir+"\\"+cat+"\\00_DWG"; }
directory_from_path_9 = DirectoryObject(path=code_block_91)
waitfor_12 = Custom[© WaitFor](data=code_block_90, waitFor=directory_from_path_9)
code_block_92 = CodeBlock { "-"; }
split_12 = String.Split(str=waitfor_12, separator0=code_block_92)
code_block_93 = CodeBlock { null; }
replaceEmptyLists_11 = Custom[List.ReplaceEmptyLists](seq=split_12, Replacement=code_block_93)
code_block_94 = CodeBlock(x=replaceEmptyLists_11)  # same code as code_block_34
code_block_95 = CodeBlock { 1; }
getItemAtIndex_12 = List.GetItemAtIndex(list=code_block_94.out1@L2, index=code_block_95)
list_clean_9 = Custom[List Clean](list=getItemAtIndex_12)
groupByKey_5 = List.GroupByKey(list=waitfor_12, keys=list_clean_9)
code_block_96 = CodeBlock { null; }
replaceEmptyLists_12 = Custom[List.ReplaceEmptyLists](seq=groupByKey_5.groups, Replacement=code_block_96)
code_block_97 = CodeBlock(x=replaceEmptyLists_12)  # same code as code_block_59
moveFile_2 = FileSystem.MoveFile(path=groupByKey_4.groups@L2, newPath=groupByKey_5.groups@L2, overwrite=code_block_97.out1, lacing=Longest)
waitfor_13 = Custom[© WaitFor](data=string_from_object, waitFor=moveFile_2)
directory_path_13 = Directory("C:\RVT_FILES\00_DWG")
directory_from_path_10 = DirectoryObject(path=directory_path_13)
code_block_98 = CodeBlock { true; }
copyDirectory_3 = FileSystem.CopyDirectory(directory=directory_from_path_10, destinationPath=waitfor_13, overwriteFiles=code_block_98)
waitfor_14 = Custom[© WaitFor](data=waitfor_13, waitFor=copyDirectory_3)
directory_from_path_11 = DirectoryObject(path=waitfor_14)
code_block_99 = CodeBlock { true; }
copyDirectory_4 = FileSystem.CopyDirectory(directory=directory_from_path_11, destinationPath=string_from_object_2, overwriteFiles=code_block_99)
waitfor_15 = Custom[© WaitFor](data=directory_from_path_8, waitFor=copyDirectory_4)
getDirectoryContents_3 = FileSystem.GetDirectoryContents(directory=waitfor_15)
deleteFile_3 = FileSystem.DeleteFile(path=getDirectoryContents_3.files)
code_block_100 = CodeBlock { true; }
deleteDirectory_2 = FileSystem.DeleteDirectory(path=getDirectoryContents_3.directories, recursive=code_block_100)
identity = Object.Identity(obj=waitfor_9)
waitfor_16 = Custom[© WaitFor](data=identity, waitFor=export_dwg_in_document)
sheetNumber_4 = Sheet.SheetNumber(sheet=waitfor_16)
code_block_101 = CodeBlock { ["VH","CH","MA"]; }
contains_6 = String.Contains(str=sheetNumber_4@L1, searchFor=code_block_101)
anyTrue_4 = Orchid.Common.List.AnyTrue(list=contains_6@L2)
filterByBoolMask_9 = List.FilterByBoolMask(list=waitfor_16, mask=anyTrue_4)
views_3 = Sheet.Views(sheet=filterByBoolMask_9.in)
code_block_102 = CodeBlock { 7; }
visual_style_select_3 = Custom[Visual Style Select](ViewList=views_3@L2, Integer=code_block_102)
waitfor_17 = Custom[© WaitFor](data=create, waitFor=end)
delete = Orchid.RevitProject.Views.SheetSet.Delete(viewSheetSet=waitfor_17)
code_block_103 = CodeBlock { null; }
replaceEmptyLists_13 = Custom[List.ReplaceEmptyLists](seq=groupByKey.groups, Replacement=code_block_103)
code_block_104 = CodeBlock(x=replaceEmptyLists_13)
# ---------- code_block_104.designscript (12 lines) ----------
x;
[Imperative]
{
	if(x == null)
	{
		return = [[[]]];
	}
	else
	{
		return = x;
	}
};
# ----------------------------------------
