# Dynamo graph revision0_script.dyn "Revision 0" (Dynamo 2.3.1.11775)
# packages: Data-Shapes 2022.2.96, Clockwork for Dynamo 2.x 2.3.0, Genius Loci 2021.11.10, Crumple 2021.9.24

revisions = Custom[© Revisions]()  # package Crumple; Returns all revisions in a document.
name = Element.Name(element=revisions)
code_block = CodeBlock { "Revision 0"; }
file_path = Filename("B:\02_INSTALADORES\01_DYNAMO\06_USER SETTINGS ORKESTRA\01_IMAGENES\editable Arainco-cmyk-01.png")
code_block_2 = CodeBlock { "INICIAR"; "CANCELAR"; 890; 600; }
code_block_3 = CodeBlock()
# ---------- code_block_3.designscript (4 lines) ----------
"Dibujó";
["J.N.N.","P.C.C.","A.C.C.","A.S.A.","C.M.H.","C.S.R.","S.J.M.","R.P.C.","C.O.C.","M.F.S.","D.S.P.","H.C.P.","L.B.M.","X.X.X.","SELECCIONA QUIEN REALIZO LA MODIFICACION"];
true;
-1;
# ----------------------------------------
dropdown_data = Custom[DropDown Data](InputName=code_block_3.out0, Keys=code_block_3.out1, Values=code_block_3.out1, DefaultValueIndex=code_block_3.out3, Sorted_optional=code_block_3.out2)  # package Data-Shapes; Create data for DropDown input in UI.MultiInputForm ++ . Check out www.data-shapes.net for more infos.
code_block_4 = CodeBlock { "Revisó"; ["N.V.G.","C.M.Q.","SELECCIONA QUIEN REVISO"]; true; -1; }
dropdown_data_2 = Custom[DropDown Data](InputName=code_block_4.out0, Keys=code_block_4.out1, Values=code_block_4.out1, DefaultValueIndex=code_block_4.out3, Sorted_optional=code_block_4.out2)
code_block_5 = CodeBlock { "Aprobó"; ["N.V.C.","C.M.Q.","P.A.V."]; true; -1; }
dropdown_data_3 = Custom[DropDown Data](InputName=code_block_5.out0, Keys=code_block_5.out1, Values=code_block_5.out1, DefaultValueIndex=code_block_5.out3, Sorted_optional=code_block_5.out2)
code_block_6 = CodeBlock { "Fecha"; }
now = DateTime.Now()
code_block_7 = CodeBlock { "dd.MM.yy"; }
format = DateTime.Format(dateTime=now, format=code_block_7)
code_block_8 = CodeBlock { "."; }
split = String.Split(str=format, separator0=code_block_8)
toNumber = String.ToNumber(str=split)
code_block_9 = CodeBlock { 2; }
getItemAtIndex = List.GetItemAtIndex(list=toNumber, index=code_block_9)
code_block_10 = CodeBlock { 1; }
getItemAtIndex_2 = List.GetItemAtIndex(list=toNumber, index=code_block_10)
code_block_11 = CodeBlock { 0; }
getItemAtIndex_3 = List.GetItemAtIndex(list=toNumber, index=code_block_11)
daysInMonth = DateTime.DaysInMonth(year=getItemAtIndex, month=getItemAtIndex_2)
code_block_12 = CodeBlock(ini=getItemAtIndex_3, mes=daysInMonth) { ini..mes..1; }
byDate = DateTime.ByDate(year=getItemAtIndex, month=getItemAtIndex_2, day=code_block_12)
code_block_13 = CodeBlock { "dd.MM.yy"; }
format_2 = DateTime.Format(dateTime=byDate, format=code_block_13)
code_block_14 = CodeBlock { 0; }
dropdown_data_4 = Custom[DropDown Data](InputName=code_block_6, Keys=format_2, Values=format_2, DefaultValueIndex=code_block_14)
code_block_15 = CodeBlock { "Sheets"; }
byName = Category.ByName(name=code_block_15)
all_elements_of_category = ElementsOfCategory(Category=byName)
code_block_16 = CodeBlock { "Clasificacion"; }
getParameterValueByName = Element.GetParameterValueByName(element=all_elements_of_category, parameterName=code_block_16)
code_block_17 = CodeBlock { "000"; }
ne = getParameterValueByName != code_block_17
filterByBoolMask = List.FilterByBoolMask(list=all_elements_of_category, mask=ne)
code_block_18 = CodeBlock { "Clasificacion"; }
getParameterValueByName_2 = Element.GetParameterValueByName(element=filterByBoolMask.in, parameterName=code_block_18)
groupByKey = List.GroupByKey(list=filterByBoolMask.in, keys=getParameterValueByName_2)
code_block_19 = CodeBlock(clasificacion=groupByKey.unique_keys) { "Laminas "+clasificacion; }
sheetNumber = Sheet.SheetNumber(sheet=groupByKey.groups@L2)
sheetName = Sheet.SheetName(sheet=groupByKey.groups@L2)
code_block_20 = CodeBlock(sheetNumber=sheetNumber, sheetName=sheetName) { sheetNumber+" - "+sheetName; }
code_block_21 = CodeBlock { 250; }
boolean = BoolSelector(false)
listview_data = Custom[Listview Data](InputName=code_block_19@L1, Keys=code_block_20@L2, Values=groupByKey.groups@L2, Height_optionnal=code_block_21, ShowId_optionnal=boolean)  # package Data-Shapes; Create data for ListView input in UI.MultiInputForm ++ . Check out www.data-shapes.net for more infos.
list_create = List.Create(item0=dropdown_data, item1=dropdown_data_2, item2=dropdown_data_3, item3=dropdown_data_4, item4=listview_data)
flatten = List.Flatten(list=list_create)
boolean_2 = BoolSelector(true)
multipleinputform = Custom[MultipleInputForm ++](Description_optional=code_block, Logo_optional=file_path, ButtonText_optional=code_block_2.out0, Input=flatten, Toggle=boolean_2, CancelButtonText_optional=code_block_2.out1, MaxHeight_optional=code_block_2.out2, Width_optional=code_block_2.out3)  # package Data-Shapes; Create a form with multiple inputs. see www.data-shapes.net for tutorials and infos!
empty = List.Empty()
scopeIf = Custom[ScopeIf+](test=multipleinputform.Was_Cancelled, True=empty, False=multipleinputform.User_Inputs)  # package Clockwork for Dynamo 2.x; A (hopefully) more robust implementation of ScopeIf. Tests a single boolean and returns a value accordingly.
code_block_22 = CodeBlock { 4; }
listsplitatindex = Custom[© ListSplitAtIndex](list=scopeIf, amount=code_block_22)  # package Crumple; Splits a list at a specific index, then returns the two lists. You may need to use levels in order for this to work properly.
list_clean = Custom[List Clean](list=listsplitatindex.list2)  # package Genius Loci; Removes all Null, Empty and Blank from a list or nested list of lists.
flatten_2 = List.Flatten(list=list_clean)
code_block_23 = CodeBlock { 26; }
getItemAtIndex_4 = List.GetItemAtIndex(list=revisions, index=code_block_23)
isEmpty = List.IsEmpty(list=flatten_2)
code_block_24 = CodeBlock { false; true; }
scopeIf_2 = Custom[ScopeIf+](test=isEmpty, True=code_block_24.out0, False=code_block_24.out1)
sheetaddrevisions = Custom[© SheetAddRevisions](sheets=flatten_2, revisions=getItemAtIndex_4, runMe=scopeIf_2)  # package Crumple; Given a list of sheets, attempt to add the given revisions to each of those sheets.
parameters = Element.Parameters(element=sheetaddrevisions)
group = Parameter.Group(parameter=parameters)
code_block_25 = CodeBlock { "PG_DATA"; }
eq = group == code_block_25
filterByBoolMask_2 = List.FilterByBoolMask(list=parameters, mask=eq)
value = Parameter.Value(parameter=filterByBoolMask_2.in@L2)
code_block_26 = CodeBlock { ""; }
eq_2 = value == code_block_26
code_block_27 = CodeBlock { null; }
scopeIf_3 = Custom[ScopeIf+](test=eq_2@L1, True=code_block_27@L1, False=value@L1, lacing=Longest)
isNull = Object.IsNull(obj=scopeIf_3@L2)
filterByBoolMask_3 = List.FilterByBoolMask(list=filterByBoolMask_2.in, mask=isNull)
code_block_28 = CodeBlock { [0..5]; }
getItemAtIndex_5 = List.GetItemAtIndex(list=filterByBoolMask_3.in@L2, index=code_block_28, lacing=Longest)
string_from_object = FromObject(obj=getItemAtIndex_5)
code_block_29 = CodeBlock { " :"; ""; }
replace = String.Replace(str=string_from_object@L2, searchFor=code_block_29.out0, replaceWith=code_block_29.out1)
trimTrailingWhitespace = String.TrimTrailingWhitespace(str=replace)
code_block_30 = CodeBlock { ["0","EMITIDO PARA CONSTRUCCION"]; }
addItemToFront = List.AddItemToFront(item=code_block_30, list=listsplitatindex.list1)
flatten_3 = List.Flatten(list=addItemToFront)
setParameterByName = Element.SetParameterByName(element=sheetaddrevisions@L1, parameterName=trimTrailingWhitespace@L2, value=flatten_3@L2, lacing=Longest)
