# Dynamo graph siguienteRevision_script.dyn (Dynamo 2.3.1.11775)
# packages: Data-Shapes 2022.2.96, Clockwork for Dynamo 2.x 2.3.0, Crumple 2021.9.24, Genius Loci 2021.11.10, Modelical 2.2.19, archi-lab.net 2020.23.13, Orchid 200.4.0.7938, Genius Loci 2020.8.3, Clockwork for Dynamo 2.x 2.4.0, Crumple 2022.2.13, Data-Shapes 2021.2.94

code_block = CodeBlock { "Siguiente Revision"; }
code_block_2 = CodeBlock()
# ---------- code_block_2.designscript (13 lines) ----------
//buttonText
"INICIAR";

//cancelButton
"CANCELAR";

//maxHeight
860;

//width
600;

//labelWidth
# ----------------------------------------
code_block_3 = CodeBlock()
# ---------- code_block_3.designscript (20 lines) ----------
"Descripción";
[
"PRELIMINAR",
"PARA APROBACION",
"EMITIDO PARA APROBACION MUNICIPAL",
"MODIFICACION GENERAL",
"APROBADO PARA LICITACION",
"ACTUALIZACION APL",
"MODIFICA LO INDICADO",
"APROBADO PARA CONSTRUCCION",
"PARA MUNICIPALIDAD",
"APTO PARA LICITACION",
"PARA LICITACION",
"INGRESA UNA DESCRIPCION",
"PARA INGRESO MUNICIPAL",
"MODIFICA Y AGREGA LO INDICADO",
"INFORMATIVO"
];
0;
false;
# ----------------------------------------
dropdown_data = Custom[DropDown Data](InputName=code_block_3.out0, Keys=code_block_3.out1, Values=code_block_3.out1, DefaultValueIndex=code_block_3.out2, Sorted_optional=code_block_3.out3)  # package Data-Shapes; Create data for DropDown input in UI.MultiInputForm ++ . Check out www.data-shapes.net for more infos.
code_block_4 = CodeBlock()
# ---------- code_block_4.designscript (4 lines) ----------
"Dibujó";
["J.N.N.","P.C.C.","A.C.C.","A.S.A.","C.M.H.","C.S.R.","S.J.M.","R.P.C.","C.O.C.","M.F.S.","D.S.P.","H.C.P.","L.B.M.","Y.S.M.","X.X.X.","SELECCIONA QUIEN REALIZO LA MODIFICACION"];
true;
-1;
# ----------------------------------------
dropdown_data_2 = Custom[DropDown Data](InputName=code_block_4.out0, Keys=code_block_4.out1, Values=code_block_4.out1, DefaultValueIndex=code_block_4.out3, Sorted_optional=code_block_4.out2)
code_block_5 = CodeBlock { "Revisó"; ["N.V.G.","C.M.Q.","M.A.E","SELECCIONA QUIEN REVISO"]; true; -1; }
dropdown_data_3 = Custom[DropDown Data](InputName=code_block_5.out0, Keys=code_block_5.out1, Values=code_block_5.out1, DefaultValueIndex=code_block_5.out3, Sorted_optional=code_block_5.out2)
code_block_6 = CodeBlock { "Aprobó"; ["N.V.C.","C.M.Q.","P.A.V."]; true; -1; }
dropdown_data_4 = Custom[DropDown Data](InputName=code_block_6.out0, Keys=code_block_6.out1, Values=code_block_6.out1, DefaultValueIndex=code_block_6.out3, Sorted_optional=code_block_6.out2)
code_block_7 = CodeBlock { "Fecha"; }
now = DateTime.Now()
code_block_8 = CodeBlock { "dd.MM.yy"; }
format = DateTime.Format(dateTime=now, format=code_block_8)
code_block_9 = CodeBlock { "."; }
split = String.Split(str=format, separator0=code_block_9)
toNumber = String.ToNumber(str=split)
code_block_10 = CodeBlock { 2; }
getItemAtIndex = List.GetItemAtIndex(list=toNumber, index=code_block_10)
code_block_11 = CodeBlock { 1; }
getItemAtIndex_2 = List.GetItemAtIndex(list=toNumber, index=code_block_11)
code_block_12 = CodeBlock { 0; }
getItemAtIndex_3 = List.GetItemAtIndex(list=toNumber, index=code_block_12)
daysInMonth = DateTime.DaysInMonth(year=getItemAtIndex, month=getItemAtIndex_2)
code_block_13 = CodeBlock(ini=getItemAtIndex_3, mes=daysInMonth) { ini..mes..1; }
byDate = DateTime.ByDate(year=getItemAtIndex, month=getItemAtIndex_2, day=code_block_13)
code_block_14 = CodeBlock { "dd.MM.yy"; }
format_2 = DateTime.Format(dateTime=byDate, format=code_block_14)
code_block_15 = CodeBlock { 0; }
dropdown_data_5 = Custom[DropDown Data](InputName=code_block_7, Keys=format_2, Values=format_2, DefaultValueIndex=code_block_15)
code_block_16 = CodeBlock { "Sheets"; }
byName = Category.ByName(name=code_block_16)
all_elements_of_category = ElementsOfCategory(Category=byName)
code_block_17 = CodeBlock { "Clasificacion"; }
getParameterValueByName = Element.GetParameterValueByName(element=all_elements_of_category, parameterName=code_block_17)
code_block_18 = CodeBlock { "000"; }
ne = getParameterValueByName != code_block_18
filterByBoolMask = List.FilterByBoolMask(list=all_elements_of_category, mask=ne)
code_block_19 = CodeBlock { "Clasificacion"; }
getParameterValueByName_2 = Element.GetParameterValueByName(element=filterByBoolMask.in, parameterName=code_block_19)
groupByKey = List.GroupByKey(list=filterByBoolMask.in, keys=getParameterValueByName_2)
code_block_20 = CodeBlock(clasificacion=groupByKey.unique_keys) { "Laminas "+clasificacion; }
sheetNumber = Sheet.SheetNumber(sheet=groupByKey.groups@L2)
sheetName = Sheet.SheetName(sheet=groupByKey.groups@L2)
code_block_21 = CodeBlock(sheetNumber=sheetNumber, sheetName=sheetName) { sheetNumber+" - "+sheetName; }
code_block_22 = CodeBlock { 250; }
boolean = BoolSelector(false)
listview_data = Custom[Listview Data](InputName=code_block_20@L1, Keys=code_block_21@L2, Values=groupByKey.groups@L2, Height_optionnal=code_block_22, ShowId_optionnal=boolean)  # package Data-Shapes; Create data for ListView input in UI.MultiInputForm ++ . Check out www.data-shapes.net for more infos.
inputgroup_data = Custom[InputGroup Data](Inputs=listview_data)  # package Data-Shapes; Creates a group of inputs for UI.MultipleInputForm ++ . Check out www.data-shapes.net for more infos !
list_create = List.Create(item0=dropdown_data, item1=dropdown_data_2, item2=dropdown_data_3, item3=dropdown_data_4, item4=dropdown_data_5, item5=inputgroup_data)
flatten = List.Flatten(list=list_create)
boolean_2 = BoolSelector(true)
multipleinputform = Custom[MultipleInputForm ++](ButtonText_optional=code_block_2.out1, Inputs=flatten, Toggle=boolean_2, CancelButtonText_optional=code_block_2.out0, MaxHeight_optional=code_block_2.out2, Width_optional=code_block_2.out3)  # package Data-Shapes; Create a form with multiple inputs. see www.data-shapes.net for tutorials and infos!
empty = List.Empty()
scopeIf = Custom[ScopeIf+](test=multipleinputform.Was_Cancelled, True=empty, False=multipleinputform.User_Inputs)  # frozen; package Clockwork for Dynamo 2.x; A (hopefully) more robust implementation of ScopeIf. Tests a single boolean and returns a value accordingly.
code_block_23 = CodeBlock { 5; }
listsplitatindex = Custom[© ListSplitAtIndex](list=scopeIf, amount=code_block_23)  # package Crumple; Splits a list at a specific index, then returns the two lists. You may need to use levels in order for this to work properly.
list_clean = Custom[List Clean](list=listsplitatindex.list2)  # package Genius Loci; Removes all Null, Empty and Blank from a list or nested list of lists.
flatten_2 = List.Flatten(list=list_clean)
isEmpty = List.IsEmpty(list=flatten_2)
code_block_24 = CodeBlock { false; true; }
scopeIf_2 = Custom[ScopeIf+](test=isEmpty, True=code_block_24.out0, False=code_block_24.out1)
code_block_25 = CodeBlock { "Revision Clouds"; }
byName_2 = Category.ByName(name=code_block_25)
addNextRevision = Custom[Sheet.AddNextRevision](sheets=flatten_2)  # package Modelical; Add the next revision to the selected sheets. Switch to manual run to use this node
end = Revit.Transaction.Transaction.End(input=addNextRevision.Sheets)
parameters = Element.Parameters(element=end)
group = Parameter.Group(parameter=parameters)
code_block_26 = CodeBlock { "PG_DATA"; }
eq = group == code_block_26
filterByBoolMask_2 = List.FilterByBoolMask(list=parameters, mask=eq)
value = Parameter.Value(parameter=filterByBoolMask_2.in@L2)
code_block_27 = CodeBlock { ""; }
eq_2 = value == code_block_27
code_block_28 = CodeBlock { null; }
scopeIf_3 = Custom[ScopeIf+](test=eq_2@L1, True=code_block_28@L1, False=value@L1, lacing=Longest)
isNull = Object.IsNull(obj=scopeIf_3@L2)
filterByBoolMask_3 = List.FilterByBoolMask(list=filterByBoolMask_2.in, mask=isNull)
code_block_29 = CodeBlock { [0..5]; }
getItemAtIndex_4 = List.GetItemAtIndex(list=filterByBoolMask_3.in@L2, index=code_block_29, lacing=Longest)
string_from_object = FromObject(obj=getItemAtIndex_4)
code_block_30 = CodeBlock { " :"; ""; }
replace = String.Replace(str=string_from_object@L2, searchFor=code_block_30.out0, replaceWith=code_block_30.out1)
trimTrailingWhitespace = String.TrimTrailingWhitespace(str=replace)
sheet_torevision = Custom[Sheet ToRevision](sheet=end)  # package Genius Loci; Returns the revision of the given sheet.
code_block_31 = CodeBlock { " "; }
split_2 = String.Split(str=sheet_torevision.RevisionName@L2, separator0=code_block_31)
lastItem = List.LastItem(list=split_2@@L2)
lastItem_2 = List.LastItem(list=lastItem@@L2)
addItemToEnd = List.AddItemToEnd(item=listsplitatindex.list1, list=lastItem_2@L1)
flatten_3 = List.Flatten(list=addItemToEnd@L3)
setParameterByName = Element.SetParameterByName(element=end@L1, parameterName=trimTrailingWhitespace@L2, value=flatten_3@L2, lacing=Longest)
code_block_32 = CodeBlock { 0; }
getItemAtIndex_5 = List.GetItemAtIndex(list=setParameterByName@L2, index=code_block_32)  # frozen
identity = Object.Identity(obj=getItemAtIndex_5)
all_elements_of_category_in_view = ElementsOfCategoryInView(Category=byName_2, View=identity)
code_block_33 = CodeBlock { "Revision"; }
revisions = archilab.Revit.Views.Sheets.Revisions(sheet=identity)
lastItem_3 = List.LastItem(list=revisions@@L2)
setParameterByName_2 = Element.SetParameterByName(element=all_elements_of_category_in_view@L2, parameterName=code_block_33@L1, value=lastItem_3@L1, lacing=Longest)
identity_2 = Object.Identity(obj=getItemAtIndex_5)
code_block_34 = CodeBlock { "Revision Clouds"; }
byName_3 = Category.ByName(name=code_block_34)
all_elements_of_category_in_view_2 = ElementsOfCategoryInView(Category=byName_3, View=identity_2)
code_block_35 = CodeBlock { "EST_A_TAG REVISION"; }
byName_4 = Family.ByName(name=code_block_35)
code_block_36 = CodeBlock { "Tag Revisión"; }
byFamilyAndName = FamilyType.ByFamilyAndName(family=byName_4, name=code_block_36)
curves = RevisionCloud.Curves(revisionCloud=all_elements_of_category_in_view_2)
code_block_37 = CodeBlock { 0; }
getItemAtIndex_6 = List.GetItemAtIndex(list=curves@@L2, index=code_block_37)
endPoint = Curve.EndPoint(curve=getItemAtIndex_6)
byElementAndLocation = Orchid.RevitProject.Annotations.Tag.ByElementAndLocation(view=identity_2@L1, element=all_elements_of_category_in_view_2@L2, tagType=byFamilyAndName@L1, location=endPoint@L2, lacing=Longest)
code_block_38 = CodeBlock(l=multipleinputform.User_Inputs)
# ---------- code_block_38.designscript (16 lines) ----------
l;
[Imperative]
{
	if (l == null)
		{
		return = [[],[],[],[],[],[],[]];
		}
	elseif (l[0] == "Set toggle to true!")
		{
		return = [[],[]];
		}
	else
		{
		return = l;
		}
};
# ----------------------------------------
code_block_39 = CodeBlock(x=code_block_38.out1) { x; }
code_block_40 = CodeBlock(l=code_block_39) { DSCore.List.Flatten(l[6]); }
addNextRevision_2 = Custom[Sheet.AddNextRevision](sheets=code_block_40)
end_2 = Revit.Transaction.Transaction.End(input=addNextRevision_2.Sheets)
parameters_2 = Element.Parameters(element=end_2)
group_2 = Parameter.Group(parameter=parameters_2)
code_block_41 = CodeBlock { "PG_DATA"; }
eq_3 = group_2 == code_block_41
filterByBoolMask_4 = List.FilterByBoolMask(list=parameters_2, mask=eq_3)
code_block_42 = CodeBlock { null; }
replaceEmptyLists = Custom[List.ReplaceEmptyLists](seq=filterByBoolMask_4.in, Replacement=code_block_42)  # package Clockwork for Dynamo 2.x; Replaces all empty lists within a given list with a substitute
code_block_43 = CodeBlock(l=replaceEmptyLists)
# ---------- code_block_43.designscript (12 lines) ----------
l;
[Imperative]
{
	if (l == null)
		{
		return = null;
		}
	else
		{
		return = l;
		}
};
# ----------------------------------------
value_2 = Parameter.Value(parameter=code_block_43.out1@L2)
code_block_44 = CodeBlock { ""; }
replacenulls = Custom[© ReplaceNulls](lst=value_2@L2, replace=code_block_44)  # package Crumple; Replaces all nulls with a given substitute.
code_block_45 = CodeBlock { ""; }
eq_4 = replacenulls == code_block_45
filterByBoolMask_5 = List.FilterByBoolMask(list=code_block_43.out1, mask=eq_4)
code_block_46 = CodeBlock { [1..5]; }
getItemAtIndex_7 = List.GetItemAtIndex(list=filterByBoolMask_5.in@L2, index=code_block_46, lacing=Longest)
string_from_object_2 = FromObject(obj=getItemAtIndex_7)
code_block_47 = CodeBlock { " :"; ""; }
replace_2 = String.Replace(str=string_from_object_2@L2, searchFor=code_block_47.out0, replaceWith=code_block_47.out1)
trimTrailingWhitespace_2 = String.TrimTrailingWhitespace(str=replace_2)
code_block_48 = CodeBlock(l=code_block_39) { DSCore.List.Flatten(l[0..5],1); }
setParameterByName_3 = Element.SetParameterByName(element=end_2@L1, parameterName=trimTrailingWhitespace_2@L2, value=code_block_48@L2, lacing=Longest)
code_block_49 = CodeBlock(x=setParameterByName_3) { DSCore.List.UniqueItems(DSCore.List.Flatten(x,1)); }
code_block_50 = CodeBlock { [0]; }
getItemAtIndex_8 = List.GetItemAtIndex(list=filterByBoolMask_5.in@L2, index=code_block_50, lacing=Longest)
string_from_object_3 = FromObject(obj=getItemAtIndex_8)
code_block_51 = CodeBlock { " :"; ""; }
replace_3 = String.Replace(str=string_from_object_3@L2, searchFor=code_block_51.out0, replaceWith=code_block_51.out1)
trimTrailingWhitespace_3 = String.TrimTrailingWhitespace(str=replace_3)
sheet_torevision_2 = Custom[Sheet ToRevision](sheet=end_2)
code_block_52 = CodeBlock { " "; }
split_3 = String.Split(str=sheet_torevision_2.RevisionName, separator0=code_block_52)
transpose = List.Transpose(lists=split_3)
code_block_53 = CodeBlock { null; }
replaceEmptyLists_2 = Custom[List.ReplaceEmptyLists](seq=transpose, Replacement=code_block_53)
code_block_54 = CodeBlock(l=replaceEmptyLists_2)
# ---------- code_block_54.designscript (12 lines) ----------
l;
[Imperative]
{
	if (l == null)
		{
		return = [[],[],[],[],[]];
		}
	else
		{
		return = l[4];
		}
};
# ----------------------------------------
setParameterByName_4 = Element.SetParameterByName(element=code_block_49@L1, parameterName=trimTrailingWhitespace_3@L2, value=code_block_54.out1@L2, lacing=Longest)
string_from_object_4 = FromObject(obj=code_block_54.out1)
code_block_55 = CodeBlock(x=multipleinputform.User_Inputs)
# ---------- code_block_55.designscript (12 lines) ----------
x;
[Imperative]
{
	if(x == null)
	{
		return = [];
	}
	else
	{
		return = x;
	}
};
# ----------------------------------------
list_clean_2 = Custom[List Clean](list=code_block_55.out1)
code_block_56 = CodeBlock { 5; }
listsplitatindex_2 = Custom[© ListSplitAtIndex](list=list_clean_2, amount=code_block_56)
flatten_4 = List.Flatten(list=listsplitatindex_2.list2)
