# Dynamo graph script.dyn "blockElements" (Dynamo 2.3.2.15696)
# packages: Rhythm 2020.7.25, Orchid 200.4.0.7938, Data-Shapes 2021.2.94

code_block = CodeBlock { "Siguiente Revision"; }
code_block_2 = CodeBlock()
# ---------- code_block_2.designscript (13 lines) ----------
//buttonText
"INICIAR";

//cancelButton
"CANCELAR";

//maxHeight
860;

//width
430;

//labelWidth
# ----------------------------------------
code_block_3 = CodeBlock()
# ---------- code_block_3.designscript (9 lines) ----------
"Categoria";
[
"Structural Columns",
"Structural Framing",
"Floors",
"Walls"
];
0;
false;
# ----------------------------------------
dropdown_data = Custom[DropDown Data](InputName=code_block_3.out0, Keys=code_block_3.out1, Values=code_block_3.out1, DefaultValueIndex=code_block_3.out2, Sorted_optional=code_block_3.out3)  # package Data-Shapes; Create data for DropDown input in UI.MultiInputForm ++ . Check out www.data-shapes.net for more infos.
code_block_4 = CodeBlock { "Material"; ["Concrete, Cast-in-Place gray","Steel"]; 0; false; }
dropdown_data_2 = Custom[DropDown Data](InputName=code_block_4.out0, Keys=code_block_4.out1, Values=code_block_4.out1, DefaultValueIndex=code_block_4.out2, Sorted_optional=code_block_4.out3)
code_block_5 = CodeBlock { "Bloquear"; ["SI","NO"]; [true,false]; 0; }
radiobuttons_data = Custom[RadioButtons Data](InputName=code_block_5.out0, Keys=code_block_5.out1, Values=code_block_5.out2, DefaultValueIndex=code_block_5.out3)  # package Data-Shapes; Create radio buttons input for UI.MultipleInputForm ++ .
list_create = List.Create(item0=dropdown_data, item1=dropdown_data_2, item2=radiobuttons_data)
boolean = BoolSelector(true)
multipleinputform = Custom[MultipleInputForm ++](Description_optional=code_block, ButtonText_optional=code_block_2.out0, Inputs=list_create, Toggle=boolean, CancelButtonText_optional=code_block_2.out1, MaxHeight_optional=code_block_2.out2, Width_optional=code_block_2.out3)  # package Data-Shapes; Create a form with multiple inputs. see www.data-shapes.net for tutorials and infos!
code_block_6 = CodeBlock(x=multipleinputform.User_Inputs)
# ---------- code_block_6.designscript (12 lines) ----------
x;
[Imperative]
{
	if(x == null)
	{
		return = [[],[],[]];
	}
	else
	{
		return = x;
	}
};
# ----------------------------------------
code_block_7 = CodeBlock(x=code_block_6.out1) { x[0]; }
byName = Category.ByName(name=code_block_7)
all_elements_of_category = ElementsOfCategory(Category=byName)
getMaterials = Element.GetMaterials(element=all_elements_of_category)
name = Material.Name(material=getMaterials)
code_block_8 = CodeBlock(x=code_block_6.out1) { x[1]; }
code_block_9 = CodeBlock(x=name, mat=code_block_8) { x == mat; }
anyTrue = Orchid.Common.List.AnyTrue(list=code_block_9)
filterByBoolMask = List.FilterByBoolMask(list=all_elements_of_category, mask=anyTrue)
code_block_10 = CodeBlock(x=code_block_6.out1) { x[2]; }
ʳʰʸᵗʰᵐ_elements_setpinnedstatus = Rhythm.Revit.Elements.Elements.SetPinnedStatus(element=filterByBoolMask.in, status=code_block_10)
