# Dynamo graph script.dyn (Dynamo 2.3.2.15696)
# packages: Data-Shapes 2021.2.94, Clockwork for Dynamo 2.x 2.4.0, Orchid 200.4.0.7938

code_block = CodeBlock { "Listado de PLanos"; }
file_path = Filename("C:\Arainco\Arainco.png")
code_block_2 = CodeBlock { "INICIAR"; "CANCELAR"; 430; 150; }
code_block_3 = CodeBlock { "Carpeta de Destino"; "BUSCAR"; }
directorypath_data = Custom[DirectoryPath Data](InputName=code_block_3.out0, ButtonText=code_block_3.out1)  # package Data-Shapes; Creates a DirectoryPath input for UI.MultipleInputForm ++ . Check out www.data-shapes.net for more infos!
boolean = BoolSelector(true)
multipleinputform = Custom[MultipleInputForm ++](Description_optional=code_block, Logo_optional=file_path, ButtonText_optional=code_block_2.out0, Inputs=directorypath_data, Toggle=boolean, CancelButtonText_optional=code_block_2.out1, Width_optional=code_block_2.out2, LabelWidth_optional=code_block_2.out3)  # package Data-Shapes; Create a form with multiple inputs. see www.data-shapes.net for tutorials and infos!
code_block_4 = CodeBlock(x=multipleinputform.User_Inputs)
# ---------- code_block_4.designscript (12 lines) ----------
x;
[Imperative]
{
	if(x == null)
	{
		return = [];
	}
	else
	{
		return = x[0];
	}
};
# ----------------------------------------
file_path_2 = Filename("C:\Arainco\TemplateListado.xls")
file_from_path = FileObject(path=file_path_2)
projectInfo = Custom[Document.ProjectInfo]()  # package Clockwork for Dynamo 2.x; Gets the project information.
code_block_5 = CodeBlock(x=code_block_4.out1, name=projectInfo.Name) { x + "\\LISTADO DE PLANOS " + name + ".xls"; }
code_block_6 = CodeBlock { true; }
copyFile = FileSystem.CopyFile(file=file_from_path, destinationPath=code_block_5, overwrite=code_block_6)
code_block_7 = CodeBlock(x=copyFile)
# ---------- code_block_7.designscript (12 lines) ----------
x;
[Imperative]
{
	if(x == null)
	{
		return = [];
	}
	else
	{
		return = x;
	}
};
# ----------------------------------------
await_ = Orchid.Common.DataStream.Await(pass=code_block_4.out1, waitFor=code_block_7.out1)
directory_from_path = DirectoryObject(path=await_)
lastItem = List.LastItem()  # unwired: list
code_block_8 = CodeBlock { "\\"; }
split = String.Split(str=code_block_5, separator0=code_block_8)
function_apply = ApplyFunction(func=lastItem, arg1=split)
getDirectoryContents = FileSystem.GetDirectoryContents(directory=directory_from_path, searchString=function_apply)
code_block_9 = CodeBlock { null; }
replaceEmptyLists = Custom[List.ReplaceEmptyLists](seq=getDirectoryContents.files, Replacement=code_block_9)  # package Clockwork for Dynamo 2.x; Replaces all empty lists within a given list with a substitute
code_block_10 = CodeBlock(x=replaceEmptyLists)  # same code as code_block_4
code_block_11 = CodeBlock { "LISTADO DE PLANOS"; }
code_block_12 = CodeBlock { 12; 0; }
code_block_13 = CodeBlock { "Sheets"; }
byName = Category.ByName(name=code_block_13)
all_elements_of_category = ElementsOfCategory(Category=byName)
restOfItems = List.RestOfItems(list=all_elements_of_category)
code_block_14 = CodeBlock { "Clasificacion"; }
getParameterValueByName = Element.GetParameterValueByName(element=restOfItems, parameterName=code_block_14)
sortByKey = List.SortByKey(list=restOfItems, keys=getParameterValueByName)
sheetNumber = Sheet.SheetNumber(sheet=sortByKey.sorted_list)
parameters = Element.Parameters(element=sortByKey.sorted_list)
group = Parameter.Group(parameter=parameters)
code_block_15 = CodeBlock { "PG_DATA"; }
eq = group == code_block_15
filterByBoolMask = List.FilterByBoolMask(list=parameters, mask=eq)
value = Parameter.Value(parameter=filterByBoolMask.in)
clean = List.Clean(list=value)
count = List.Count(list=clean@L2)
code_block_16 = CodeBlock(x=count) { x-6; x-5; x-1; }
getItemAtIndex = List.GetItemAtIndex(list=clean@L2, index=code_block_16.out0, lacing=Shortest)
getItemAtIndex_2 = List.GetItemAtIndex(list=clean@L2, index=code_block_16.out1, lacing=Shortest)
getItemAtIndex_3 = List.GetItemAtIndex(list=clean@L2, index=code_block_16.out2, lacing=Shortest)
code_block_17 = CodeBlock { "."; "/"; }
replace = String.Replace(str=getItemAtIndex_3, searchFor=code_block_17.out0, replaceWith=code_block_17.out1)
sheetName = Sheet.SheetName(sheet=sortByKey.sorted_list)
list_create = List.Create(item0=sheetNumber, item1=getItemAtIndex, item2=getItemAtIndex_2, item3=replace, item4=sheetName)
transpose = List.Transpose(lists=list_create)
exportExcel = Data.ExportExcel(filePath=code_block_10.out1, sheetName=code_block_11, startRow=code_block_12.out0, startCol=code_block_12.out1, data=transpose)
code_block_18 = CodeBlock { "LISTADO DE PLANOS"; }
code_block_19 = CodeBlock { 6; 1; }
projectInfo_2 = Custom[Document.ProjectInfo]()
exportExcel_2 = Data.ExportExcel(filePath=code_block_10.out1, sheetName=code_block_18, startRow=code_block_19.out0, startCol=code_block_19.out1, data=projectInfo_2.Name)
code_block_20 = CodeBlock { "LISTADO DE PLANOS"; }
code_block_21 = CodeBlock { 7; 1; }
exportExcel_3 = Data.ExportExcel(filePath=code_block_10.out1, sheetName=code_block_20, startRow=code_block_21.out0, startCol=code_block_21.out1, data=projectInfo_2.ClientName)
code_block_22 = CodeBlock { "LISTADO DE PLANOS"; }
code_block_23 = CodeBlock { 8; 1; }
exportExcel_4 = Data.ExportExcel(filePath=code_block_10.out1, sheetName=code_block_22, startRow=code_block_23.out0, startCol=code_block_23.out1, data=projectInfo_2.Number)
code_block_24 = CodeBlock { "LISTADO DE PLANOS"; }
code_block_25 = CodeBlock { 9; 1; }
today = DateTime.Today()
code_block_26 = CodeBlock { "dd/MM/yyyy"; }
format = DateTime.Format(dateTime=today, format=code_block_26)
exportExcel_5 = Data.ExportExcel(filePath=code_block_10.out1, sheetName=code_block_24, startRow=code_block_25.out0, startCol=code_block_25.out1, data=format)
code_block_27 = CodeBlock { "HISTORIAL DE REVISIONES"; }
code_block_28 = CodeBlock { 7; 0; }
sheetNumber_2 = Sheet.SheetNumber(sheet=sortByKey.sorted_list)
code_block_29 = CodeBlock { 0; }
insert = List.Insert(list=clean@L2, element=sheetNumber_2@L1, index=code_block_29)
sheetName_2 = Sheet.SheetName(sheet=sortByKey.sorted_list)
code_block_30 = CodeBlock { 2; }
insert_2 = List.Insert(list=insert@L2, element=sheetName_2@L1, index=code_block_30)
exportExcel_6 = Data.ExportExcel(filePath=code_block_10.out1, sheetName=code_block_27, startRow=code_block_28.out0, startCol=code_block_28.out1, data=insert_2)
