# Dynamo graph script.dyn (Dynamo 2.3.2.15696)
# packages: Genius Loci 2021.11.10

code_block = CodeBlock { "DraftingView"; }
view_bytype = Custom[View ByType](viewType=code_block)  # package Genius Loci; Gets all views by type. For the View Template Type, the 3D View Templates will not be retrieved.
code_block_2 = CodeBlock { "Detail Number"; }
getParameterValueByName = Element.GetParameterValueByName(element=view_bytype, parameterName=code_block_2)
code_block_3 = CodeBlock { "-"; }
ne = getParameterValueByName != code_block_3
filterByBoolMask = List.FilterByBoolMask(list=view_bytype, mask=ne)
code_block_4 = CodeBlock { "View Name"; }
code_block_5 = CodeBlock { "_"; }
code_block_6 = CodeBlock { ["Sheet Number","Detail Number"]; }
getParameterValueByName_2 = Element.GetParameterValueByName(element=filterByBoolMask.in@L1, parameterName=code_block_6)
join = String.Join(separator=code_block_5, string0=getParameterValueByName_2)
flatten = List.Flatten(list=join)
setParameterByName = Element.SetParameterByName(element=filterByBoolMask.in, parameterName=code_block_4, value=flatten)
