# Dynamo graph unionElementos_script.dyn (Dynamo 2.3.1.11775)
# packages: Orchid 200.4.0.7938, Clockwork for Dynamo 2.x 2.4.0, Rhythm 2020.7.25, bimorphNodes 3.0.3

code_block = CodeBlock { "Walls"; }
byName = Category.ByName(name=code_block)
code_block_2 = CodeBlock { "Floors"; }
byName_2 = Category.ByName(name=code_block_2)
activeView = Orchid.RevitProject.Common.Document.ActiveView()
all_elements_of_category_in_view = ElementsOfCategoryInView(Category=byName_2, View=activeView)
code_block_3 = CodeBlock()
# ---------- code_block_3.designscript (5 lines) ----------
[
"Structural Framing",
"Structural Columns",
"Walls"
];
# ----------------------------------------
byName_3 = Category.ByName(name=code_block_3)
ʳʰʸᵗʰᵐ_elements = Rhythm.Revit.Elements.Elements.GetIntersectingElementsOfCategory(element=all_elements_of_category_in_view@L1, category=byName_3@L2, lacing=Longest)
flatten = List.Flatten(list=ʳʰʸᵗʰᵐ_elements@L3)
joinGeometry = Custom[Element.JoinGeometry](element1=all_elements_of_category_in_view@L1, element2=flatten@L2, lacing=Longest)  # package Clockwork for Dynamo 2.x; Joins two model elements (if possible). Only works inside the project environment.
python_script = Python(IN[0]=joinGeometry.element1)
# ---------- python_script.python (80 lines) ----------
import clr

clr.AddReference('RevitAPI')
from Autodesk.Revit.DB import *
from Autodesk.Revit.DB.Structure import *

clr.AddReference('RevitAPIUI')
from Autodesk.Revit.UI import *

clr.AddReference('System')
from System.Collections.Generic import List

clr.AddReference('RevitNodes')
import Revit
clr.ImportExtensions(Revit.GeometryConversion)
clr.ImportExtensions(Revit.Elements)

clr.AddReference('RevitServices')
import RevitServices
from RevitServices.Persistence import DocumentManager
from RevitServices.Transactions import TransactionManager

doc = DocumentManager.Instance.CurrentDBDocument
uidoc=DocumentManager.Instance.CurrentUIApplication.ActiveUIDocument

elemento = UnwrapElement(IN[0])

ids = []

for elem in elemento:
	ids.append(elem.Id)

	
for id in ids:
	floor = doc.GetElement(id)
	
	bb = floor.get_BoundingBox(doc.ActiveView)
	outline = Outline(bb.Min, bb.Max)
	filter = BoundingBoxIntersectsFilter(outline)
	columns = FilteredElementCollector(doc, doc.ActiveView.Id).OfCategory(BuiltInCategory.OST_StructuralColumns).WherePasses(filter)
	walls = FilteredElementCollector(doc, doc.ActiveView.Id).OfCategory(BuiltInCategory.OST_Walls).WherePasses(filter)
	structuralFramings = FilteredElementCollector(doc, doc.ActiveView.Id).OfCategory(BuiltInCategory.OST_StructuralFraming).WherePasses(filter)
	
	count = 0
		
	#Do some action in a Transaction
	#Columns
	TransactionManager.Instance.EnsureInTransaction(doc)
	for column in columns:
		areJoined = JoinGeometryUtils.AreElementsJoined(doc,floor,column)
		if areJoined:
			columnIsCut = JoinGeometryUtils.IsCuttingElementInJoin(doc,floor,column)
			if columnIsCut:
				JoinGeometryUtils.SwitchJoinOrder(doc,floor,column)
				count = count + 1
	TransactionManager.Instance.TransactionTaskDone()
	
	#Walls
	TransactionManager.Instance.EnsureInTransaction(doc)
	for wall in walls:
		areJoined = JoinGeometryUtils.AreElementsJoined(doc,floor,wall)
		if areJoined:
			columnIsCut = JoinGeometryUtils.IsCuttingElementInJoin(doc,floor,wall)
			if columnIsCut:
				JoinGeometryUtils.SwitchJoinOrder(doc,floor,wall)
				count = count + 1
	TransactionManager.Instance.TransactionTaskDone()
	
	#Structural Framing
	TransactionManager.Instance.EnsureInTransaction(doc)
	for structuralFraming in structuralFramings:
		areJoined = JoinGeometryUtils.AreElementsJoined(doc,floor,structuralFraming)
		if areJoined:
			columnIsCut = JoinGeometryUtils.IsCuttingElementInJoin(doc,floor,structuralFraming)
			if columnIsCut:
				JoinGeometryUtils.SwitchJoinOrder(doc,floor,structuralFraming)
				count = count + 1
	TransactionManager.Instance.TransactionTaskDone()

OUT = str(count) + ' join orders are changed.'
# ----------------------------------------
activeView_2 = Orchid.RevitProject.Common.Document.ActiveView()
code_block_4 = CodeBlock(x=python_script, activeView=activeView_2)
# ---------- code_block_4.designscript (16 lines) ----------
x;
activeView;

cont = DSCore.String.Contains(x,"0",false);

[Imperative]
{
	if(cont == true)
	{
		return = [];
	}
	else
	{
		return = activeView;
	}
};
# ----------------------------------------
all_elements_of_category_in_view_2 = ElementsOfCategoryInView(Category=byName, View=code_block_4.out3)
code_block_5 = CodeBlock { "Walls"; }
byName_4 = Category.ByName(name=code_block_5)
all_elements_of_category = ElementsOfCategory(Category=byName_4)
intersect = Orchid.RevitProject.Elements.Element.Intersect(element=all_elements_of_category_in_view_2@L1, elements=all_elements_of_category@L2, lacing=Longest)
joinGeometry_2 = Custom[Element.JoinGeometry](element1=all_elements_of_category_in_view_2@L1, element2=intersect@L2, lacing=Longest)
code_block_6 = CodeBlock { "Structural Foundations"; }
byName_5 = Category.ByName(name=code_block_6)
activeView_3 = Orchid.RevitProject.Common.Document.ActiveView()
all_elements_of_category_in_view_3 = ElementsOfCategoryInView(Category=byName_5, View=activeView_3)
boundingBox = Element.BoundingBox(element=all_elements_of_category_in_view_3)
code_block_7 = CodeBlock { "Walls"; }
byName_6 = Category.ByName(name=code_block_7)
all_elements_of_category_in_view_4 = ElementsOfCategoryInView(Category=byName_6, View=code_block_4.out3)
getMaterials = Element.GetMaterials(element=all_elements_of_category_in_view_4)
name = Material.Name(material=getMaterials@L1)
code_block_8 = CodeBlock { "Concrete, Cast-in-Place gray"; }
eq = name == code_block_8
filterByBoolMask = List.FilterByBoolMask(list=all_elements_of_category_in_view_4, mask=eq)
getElementsIntersect = Revit.BoundingBox.GetElementsIntersect(boundingBox=boundingBox@L1, elements=filterByBoolMask.in@L2, lacing=Longest)
joinGeometry_3 = Custom[Element.JoinGeometry](element1=all_elements_of_category_in_view_3@L1, element2=getElementsIntersect@L2, lacing=Longest)
code_block_9 = CodeBlock { "Structural Foundations"; }
byName_7 = Category.ByName(name=code_block_9)
activeView_4 = Orchid.RevitProject.Common.Document.ActiveView()
all_elements_of_category_in_view_5 = ElementsOfCategoryInView(Category=byName_7, View=activeView_4)
boundingBox_2 = Element.BoundingBox(element=all_elements_of_category_in_view_5)
code_block_10 = CodeBlock { "Structural Columns"; }
byName_8 = Category.ByName(name=code_block_10)
all_elements_of_category_in_view_6 = ElementsOfCategoryInView(Category=byName_8, View=code_block_4.out3)
getMaterials_2 = Element.GetMaterials(element=all_elements_of_category_in_view_6)
name_2 = Material.Name(material=getMaterials_2@L1)
code_block_11 = CodeBlock { "Concrete, Cast-in-Place gray"; }
eq_2 = name_2 == code_block_11
filterByBoolMask_2 = List.FilterByBoolMask(list=all_elements_of_category_in_view_6, mask=eq_2)
getElementsIntersect_2 = Revit.BoundingBox.GetElementsIntersect(boundingBox=boundingBox_2@L1, elements=filterByBoolMask_2.in@L2, lacing=Longest)
joinGeometry_4 = Custom[Element.JoinGeometry](element1=all_elements_of_category_in_view_5@L1, element2=getElementsIntersect_2@L2, lacing=Longest)
