# Dynamo graph etiquetadoElevMA_script.dyn (Dynamo 2.3.1.11775)
# packages: Orchid 200.4.0.7938, Clockwork for Dynamo 2.x 2.4.0, archi-lab.net 2022.210.2419, Genius Loci 2020.8.3, Crumple 2022.2.13, Genius Loci 2021.11.10, Rhythm 2020.7.25

activeView = Orchid.RevitProject.Common.Document.ActiveView()
code_block = CodeBlock(activeView=activeView)
# ---------- code_block.designscript (28 lines) ----------
activeView;
v = Revit.Elements.Element.GetParameterValueByName(activeView,"Subclasificacion");

r = [Imperative]
{
	if (v != "02_MA")
	{
		return = null;
	}
	else
	{
		return = activeView;
	}
};

r;

[Imperative]
{
	if (r == null)
	{
		return = "La vista proporcionada debe ser de tipo MA.";
	}
	else
	{
		return = [];
	}
};
# ----------------------------------------
code_block_2 = CodeBlock(x=code_block.out2)
# ---------- code_block_2.designscript (13 lines) ----------
x;

[Imperative]
{
	if (x == null)
	{
		return = [];
	}
	else
	{
		return = x;
	}
};
# ----------------------------------------

# group: Etiqueta Muros
activeView_2 = Orchid.RevitProject.Common.Document.ActiveView()
code_block_3 = CodeBlock { "Walls"; }
byName = Category.ByName(name=code_block_3)
code_block_4 = CodeBlock(x=code_block_2.out1) { x; }
all_elements_of_category_in_view = ElementsOfCategoryInView(Category=byName, View=code_block_4)
wallType = archilab.Revit.Elements.Walls.WallType(wall=all_elements_of_category_in_view)
kind = Orchid.RevitProject.Elements.WallType.Kind(wallType=wallType)
code_block_5 = CodeBlock { "Basic"; }
eq = kind == code_block_5
filterByBoolMask = List.FilterByBoolMask(list=all_elements_of_category_in_view, mask=eq)
name = Material.Name()  # unwired: material
getMaterials = Element.GetMaterials(element=filterByBoolMask.in)
flatten = List.Flatten(list=getMaterials)
function_apply = ApplyFunction(func=name, arg1=flatten)
code_block_6 = CodeBlock { "Concrete, Cast-in-Place gray"; }
eq_2 = function_apply == code_block_6
filterByBoolMask_2 = List.FilterByBoolMask(list=filterByBoolMask.in, mask=eq_2)
location = Custom[Element.Location+](element=filterByBoolMask_2.in)  # package Clockwork for Dynamo 2.x; Returns the location of an element as point, curve or curve loop, along with some booleans to help filtering the results. Unlike the OOTB Element.GetLocation node, it also retunrs sketch lines of sketch-based elements like floor slabs as well as the element's rotation property.
code_block_7 = CodeBlock(x=location.curves)
# ---------- code_block_7.designscript (12 lines) ----------
x;
[Imperative]
{
	if(x == null)
	{
		return = [];
	}
	else
	{
		return = x;
	}
};
# ----------------------------------------
direction = Line.Direction(line=code_block_7.out1)
activeView_3 = Orchid.RevitProject.Common.Document.ActiveView()
plane = Custom[View.Plane](view=activeView_3)  # package Clockwork for Dynamo 2.x; Retrieves the plane of a given view
isParallelToPlane = Custom[Vector.IsParallelToPlane](vector=direction, plane=plane)  # package Clockwork for Dynamo 2.x; Checks if a given vector is parallel to a given plane
filterByBoolMask_3 = List.FilterByBoolMask(list=filterByBoolMask_2.in, mask=isParallelToPlane)
element_taggedstatus = Custom[Element TaggedStatus](element=filterByBoolMask_3.in)  # package Genius Loci; Identify the tagged and untagged elements. Please note : This doesn't work with areas and spaces.
elementcentroid = Custom[© ElementCentroid](element=element_taggedstatus.NotTagged)  # package Crumple; Returns the centroid of the element's axis-aligned bounding box.
byElementAndLocation = Tag.ByElementAndLocation(view=activeView_2, element=element_taggedstatus.NotTagged, location=elementcentroid)
code_block_8 = CodeBlock { "Type"; }
code_block_9 = CodeBlock { "EST_A_WALL TAG_ELEVACION_MHA"; }
byName_2 = Orchid.RevitProject.Elements.Family.ByName(name=code_block_9)
code_block_10 = CodeBlock { "Doble Malla"; }
byFamilyAndName = FamilyType.ByFamilyAndName(family=byName_2, name=code_block_10)
setParameterByName = Element.SetParameterByName(element=byElementAndLocation, parameterName=code_block_8, value=byFamilyAndName)

# group: Etiqueta Vigas Hormigon
activeView_4 = Orchid.RevitProject.Common.Document.ActiveView()
code_block_11 = CodeBlock { "Structural Framing"; }
byName_3 = Category.ByName(name=code_block_11)
code_block_12 = CodeBlock(x=code_block_2.out1) { x; }
all_elements_of_category_in_view_2 = ElementsOfCategoryInView(Category=byName_3, View=code_block_12)
familyName = Orchid.RevitProject.Elements.Element.FamilyName(element=all_elements_of_category_in_view_2)
code_block_13 = CodeBlock()
# ---------- code_block_13.designscript (6 lines) ----------
[
"EST_M_STRUCTURAL FRAMING_VIGA INVERTIDA",
"EST_M_STRUCTURAL FRAMING_VIGA SEMI INVERTIDA",
"EST_M_STRUCTURAL FRAMING_VIGA TRADICIONAL",
"EST_M_STRUCTURAL FRAMING_VIGA FUNDACION"
];
# ----------------------------------------
eq_3 = familyName@L1 == code_block_13
anyTrue = Orchid.Common.List.AnyTrue(list=eq_3)
filterByBoolMask_4 = List.FilterByBoolMask(list=all_elements_of_category_in_view_2, mask=anyTrue)
location_2 = Custom[Element.Location+](element=filterByBoolMask_4.in)
code_block_14 = CodeBlock(x=location_2.curves)  # same code as code_block_7
direction_2 = Line.Direction(line=code_block_14.out1)
activeView_5 = Orchid.RevitProject.Common.Document.ActiveView()
plane_2 = Custom[View.Plane](view=activeView_5)
isParallelToPlane_2 = Custom[Vector.IsParallelToPlane](vector=direction_2, plane=plane_2)
filterByBoolMask_5 = List.FilterByBoolMask(list=filterByBoolMask_4.in, mask=isParallelToPlane_2)
element_taggedstatus_2 = Custom[Element TaggedStatus](element=filterByBoolMask_5.in)
elementcentroid_2 = Custom[© ElementCentroid](element=element_taggedstatus_2.NotTagged)
location_3 = Custom[Element.Location+](element=element_taggedstatus_2.NotTagged)
code_block_15 = CodeBlock(x=location_3.curves)  # same code as code_block_7
code_block_16 = CodeBlock { 0.5; }
planeAtParameter = Curve.PlaneAtParameter(curve=code_block_15.out1, param=code_block_16)
code_block_17 = CodeBlock { 0.5; }
pointAtParameter = Curve.PointAtParameter(curve=code_block_15.out1, param=code_block_17)
activeView_6 = Orchid.RevitProject.Common.Document.ActiveView()
plane_3 = Custom[View.Plane](view=activeView_6)
normal = Plane.Normal(plane=plane_3)
code_block_18 = CodeBlock { 90; }
rotate = Geometry.Rotate(geometry=planeAtParameter, origin=pointAtParameter, axis=normal, degrees=code_block_18)
normal_2 = Plane.Normal(plane=rotate)
code_block_19 = CodeBlock(z=normal_2) { z.Z; }
code_block_20 = CodeBlock { 0; }
gt = code_block_19 > code_block_20
code_block_21 = CodeBlock { -1; }
ne = code_block_19 != code_block_21
and_ = gt && ne
reverse = Vector.Reverse(vector=normal_2)
scopeIf = Custom[ScopeIf+](test=and_, True=normal_2, False=reverse, lacing=Shortest)  # package Clockwork for Dynamo 2.x; A (hopefully) more robust implementation of ScopeIf. Tests a single boolean and returns a value accordingly.
code_block_22 = CodeBlock(x=element_taggedstatus_2.NotTagged) { Revit.Elements.Element.GetParameterValueByName(Revit.Elements.Element.GetParameterValueByName(x,"Type"),"Height")/2; }
translate = Geometry.Translate(geometry=elementcentroid_2, direction=scopeIf, distance=code_block_22)
list_create = List.Create(item0=elementcentroid_2, item1=translate)
transpose = List.Transpose(lists=list_create)
byElementAndLocation_2 = Tag.ByElementAndLocation(view=activeView_4@L1, element=element_taggedstatus_2.NotTagged@L1, location=transpose@L2, lacing=Longest)
transpose_2 = List.Transpose(lists=byElementAndLocation_2)
code_block_23 = CodeBlock { null; }
replaceEmptyLists = Custom[List.ReplaceEmptyLists](seq=transpose_2, Replacement=code_block_23)  # package Clockwork for Dynamo 2.x; Replaces all empty lists within a given list with a substitute
code_block_24 = CodeBlock(x=replaceEmptyLists)
# ---------- code_block_24.designscript (12 lines) ----------
x;
[Imperative]
{
	if(x == null)
	{
		return = [[],[]];
	}
	else
	{
		return = x;
	}
};
# ----------------------------------------
code_block_25 = CodeBlock(x=code_block_24.out1) { x[1]; }
code_block_26 = CodeBlock { "Type"; }
code_block_27 = CodeBlock { "EST_A_STRUCTURAL FRAMING TAG_ELEVACION"; }
byName_4 = Orchid.RevitProject.Elements.Family.ByName(name=code_block_27)
code_block_28 = CodeBlock { "Tag Viga"; }
byFamilyAndName_2 = FamilyType.ByFamilyAndName(family=byName_4, name=code_block_28)
setParameterByName_2 = Element.SetParameterByName(element=code_block_25, parameterName=code_block_26, value=byFamilyAndName_2)
name_2 = Material.Name()  # unwired: material
getMaterials_2 = Element.GetMaterials(element=filterByBoolMask_4.in)
flatten_2 = List.Flatten(list=getMaterials_2)
function_apply_2 = ApplyFunction(func=name_2, arg1=flatten_2)
code_block_29 = CodeBlock { "Concrete, Cast-in-Place gray"; }
eq_4 = function_apply_2 == code_block_29
filterByBoolMask_6 = List.FilterByBoolMask(list=filterByBoolMask_4.in, mask=eq_4)
code_block_30 = CodeBlock(x=code_block_24.out1) { x[0]; }
code_block_31 = CodeBlock { "Type"; }
code_block_32 = CodeBlock { "EST_A_STRUCTURAL FRAMING TAG_ELEVACION_ESTRIBO Y LATERAL"; }
byName_5 = Orchid.RevitProject.Elements.Family.ByName(name=code_block_32)
code_block_33 = CodeBlock { "Estribo Simple y Laterales"; }
byFamilyAndName_3 = FamilyType.ByFamilyAndName(family=byName_5, name=code_block_33)
setParameterByName_3 = Element.SetParameterByName(element=code_block_30, parameterName=code_block_31, value=byFamilyAndName_3)

# group: Etiqueta Columna Rectangular hormigon
code_block_34 = CodeBlock { "Structural Columns"; }
byName_6 = Category.ByName(name=code_block_34)
code_block_35 = CodeBlock(x=code_block_2.out1) { x; }
all_elements_of_category_in_view_3 = ElementsOfCategoryInView(Category=byName_6, View=code_block_35)
familyName_2 = Orchid.RevitProject.Elements.Element.FamilyName(element=all_elements_of_category_in_view_3)
code_block_36 = CodeBlock { "EST_M_STRUCTURAL COLUMN_RECTANGULAR"; }
eq_5 = familyName_2 == code_block_36
filterByBoolMask_7 = List.FilterByBoolMask(list=all_elements_of_category_in_view_3, mask=eq_5)
name_3 = Material.Name()  # unwired: material
getMaterials_3 = Element.GetMaterials(element=filterByBoolMask_7.in)
flatten_3 = List.Flatten(list=getMaterials_3)
function_apply_3 = ApplyFunction(func=name_3, arg1=flatten_3)
code_block_37 = CodeBlock { "Concrete, Cast-in-Place gray"; }
eq_6 = function_apply_3 == code_block_37
filterByBoolMask_8 = List.FilterByBoolMask(list=filterByBoolMask_7.in, mask=eq_6)
element_taggedstatus_3 = Custom[Element TaggedStatus](element=filterByBoolMask_8.in)
code_block_38 = CodeBlock { "Column Style"; 1; }
setParameterByName_4 = Element.SetParameterByName(element=element_taggedstatus_3.NotTagged, parameterName=code_block_38.out0, value=code_block_38.out1)
location_4 = Custom[Element.Location+](element=setParameterByName_4)
code_block_39 = CodeBlock(x=location_4.curves)  # same code as code_block_7
await_ = Orchid.Common.DataStream.Await(pass=setParameterByName_4, waitFor=code_block_39.out1)
code_block_40 = CodeBlock { "Column Style"; 0; }
setParameterByName_5 = Element.SetParameterByName(element=await_, parameterName=code_block_40.out0, value=code_block_40.out1)
activeView_7 = Orchid.RevitProject.Common.Document.ActiveView()
elementcentroid_3 = Custom[© ElementCentroid](element=await_)
code_block_41 = CodeBlock { 0.5; }
planeAtParameter_2 = Curve.PlaneAtParameter(curve=code_block_39.out1, param=code_block_41)
code_block_42 = CodeBlock { 0.5; }
pointAtParameter_2 = Curve.PointAtParameter(curve=code_block_39.out1, param=code_block_42)
activeView_8 = Orchid.RevitProject.Common.Document.ActiveView()
plane_4 = Custom[View.Plane](view=activeView_8)
normal_3 = Plane.Normal(plane=plane_4)
code_block_43 = CodeBlock { 90; }
rotate_2 = Geometry.Rotate(geometry=planeAtParameter_2, origin=pointAtParameter_2, axis=normal_3, degrees=code_block_43)
normal_4 = Plane.Normal(plane=rotate_2)
code_block_44 = CodeBlock(z=normal_4) { z.Z; }
code_block_45 = CodeBlock { 0; }
gt_2 = code_block_44 > code_block_45
code_block_46 = CodeBlock { -1; }
ne_2 = code_block_44 != code_block_46
and_2 = gt_2 && ne_2
reverse_2 = Vector.Reverse(vector=normal_4)
scopeIf_2 = Custom[ScopeIf+](test=and_2, True=normal_4, False=reverse_2, lacing=Shortest)
code_block_47 = CodeBlock(x=await_) { Revit.Elements.Element.GetParameterValueByName(Revit.Elements.Element.GetParameterValueByName(x,"Type"),"Width")/2; }
translate_2 = Geometry.Translate(geometry=elementcentroid_3, direction=scopeIf_2, distance=code_block_47)
code_block_48 = CodeBlock()
# ---------- code_block_48.designscript (2 lines) ----------
//horizontal
false;
# ----------------------------------------
byElementAndLocation_3 = Tag.ByElementAndLocation(view=activeView_7, element=await_, location=translate_2, horizontal=code_block_48)
code_block_49 = CodeBlock { "Type"; }
code_block_50 = CodeBlock { "EST_A_STRUCTURAL COLUMN TAG_ELEVACION_DIMENSIONES"; }
byName_7 = Orchid.RevitProject.Elements.Family.ByName(name=code_block_50)
code_block_51 = CodeBlock { "Pilar Hormigon"; }
byFamilyAndName_4 = FamilyType.ByFamilyAndName(family=byName_7, name=code_block_51)
setParameterByName_6 = Element.SetParameterByName(element=byElementAndLocation_3, parameterName=code_block_49, value=byFamilyAndName_4)

# group: Etiqueta Columna Circular Hormigon
code_block_52 = CodeBlock { "Structural Columns"; }
byName_8 = Category.ByName(name=code_block_52)
code_block_53 = CodeBlock(x=code_block_2.out1) { x; }
all_elements_of_category_in_view_4 = ElementsOfCategoryInView(Category=byName_8, View=code_block_53)
familyName_3 = Orchid.RevitProject.Elements.Element.FamilyName(element=all_elements_of_category_in_view_4)
code_block_54 = CodeBlock { "EST_M_STRUCTURAL COLUMN_CIRCULAR"; }
eq_7 = familyName_3 == code_block_54
filterByBoolMask_9 = List.FilterByBoolMask(list=all_elements_of_category_in_view_4, mask=eq_7)
name_4 = Material.Name()  # unwired: material
getMaterials_4 = Element.GetMaterials(element=filterByBoolMask_9.in)
flatten_4 = List.Flatten(list=getMaterials_4)
function_apply_4 = ApplyFunction(func=name_4, arg1=flatten_4)
code_block_55 = CodeBlock { "Concrete, Cast-in-Place gray"; }
eq_8 = function_apply_4 == code_block_55
filterByBoolMask_10 = List.FilterByBoolMask(list=filterByBoolMask_9.in, mask=eq_8)
element_taggedstatus_4 = Custom[Element TaggedStatus](element=filterByBoolMask_10.in)
code_block_56 = CodeBlock { "Column Style"; 1; }
setParameterByName_7 = Element.SetParameterByName(element=element_taggedstatus_4.NotTagged, parameterName=code_block_56.out0, value=code_block_56.out1)
location_5 = Custom[Element.Location+](element=setParameterByName_7)
code_block_57 = CodeBlock(x=location_5.curves)  # same code as code_block_7
await_2 = Orchid.Common.DataStream.Await(pass=setParameterByName_7, waitFor=code_block_57.out1)
code_block_58 = CodeBlock { "Column Style"; 0; }
setParameterByName_8 = Element.SetParameterByName(element=await_2, parameterName=code_block_58.out0, value=code_block_58.out1)
activeView_9 = Orchid.RevitProject.Common.Document.ActiveView()
elementcentroid_4 = Custom[© ElementCentroid](element=await_2)
code_block_59 = CodeBlock { 0.5; }
planeAtParameter_3 = Curve.PlaneAtParameter(curve=code_block_57.out1, param=code_block_59)
code_block_60 = CodeBlock { 0.5; }
pointAtParameter_3 = Curve.PointAtParameter(curve=code_block_57.out1, param=code_block_60)
activeView_10 = Orchid.RevitProject.Common.Document.ActiveView()
plane_5 = Custom[View.Plane](view=activeView_10)
normal_5 = Plane.Normal(plane=plane_5)
code_block_61 = CodeBlock { 90; }
rotate_3 = Geometry.Rotate(geometry=planeAtParameter_3, origin=pointAtParameter_3, axis=normal_5, degrees=code_block_61)
normal_6 = Plane.Normal(plane=rotate_3)
code_block_62 = CodeBlock(z=normal_6) { z.Z; }
code_block_63 = CodeBlock { 0; }
gt_3 = code_block_62 > code_block_63
code_block_64 = CodeBlock { -1; }
ne_3 = code_block_62 != code_block_64
and_3 = gt_3 && ne_3
reverse_3 = Vector.Reverse(vector=normal_6)
scopeIf_3 = Custom[ScopeIf+](test=and_3, True=normal_6, False=reverse_3, lacing=Shortest)
code_block_65 = CodeBlock(x=await_2) { Revit.Elements.Element.GetParameterValueByName(Revit.Elements.Element.GetParameterValueByName(x,"Type"),"Diameter")/2; }
translate_3 = Geometry.Translate(geometry=elementcentroid_4, direction=scopeIf_3, distance=code_block_65)
code_block_66 = CodeBlock()  # same code as code_block_48
byElementAndLocation_4 = Tag.ByElementAndLocation(view=activeView_9, element=await_2, location=translate_3, horizontal=code_block_66)
code_block_67 = CodeBlock { "Type"; }
code_block_68 = CodeBlock { "EST_A_STRUCTURAL COLUMN TAG_ELEVACION_DIMENSIONES"; }
byName_9 = Orchid.RevitProject.Elements.Family.ByName(name=code_block_68)
code_block_69 = CodeBlock { "Pilar Hormigon"; }
byFamilyAndName_5 = FamilyType.ByFamilyAndName(family=byName_9, name=code_block_69)
setParameterByName_9 = Element.SetParameterByName(element=byElementAndLocation_4, parameterName=code_block_67, value=byFamilyAndName_5)

# group: Columnas Metalicas Rectangulares
activeView_11 = Orchid.RevitProject.Common.Document.ActiveView()
code_block_70 = CodeBlock { "Structural Columns"; }
byName_10 = Category.ByName(name=code_block_70)
code_block_71 = CodeBlock(x=code_block_2.out1) { x; }
all_elements_of_category_in_view_5 = ElementsOfCategoryInView(Category=byName_10, View=code_block_71)
familyName_4 = Orchid.RevitProject.Elements.Element.FamilyName(element=all_elements_of_category_in_view_5)
code_block_72 = CodeBlock()
# ---------- code_block_72.designscript (11 lines) ----------
[
"EST_M_STRUCTURAL COLUMN_SOLDADA_IN",
"EST_M_STRUCTURAL COLUMN_LAMINADA_L",
"EST_M_STRUCTURAL COLUMN_PLEGADA_C",
"EST_M_STRUCTURAL COLUMN_PLEGADA_CA",
"EST_M_STRUCTURAL COLUMN_PLEGADA_HSS",
"EST_M_STRUCTURAL COLUMN_PLEGADA_IC",
"EST_M_STRUCTURAL COLUMN_PLEGADA_L",
"EST_M_STRUCTURAL COLUMN_SOLDADA_HN",
"EST_M_STRUCTURAL COLUMN_SOLDADA_T"
];
# ----------------------------------------
eq_9 = familyName_4@L1 == code_block_72
anyTrue_2 = Orchid.Common.List.AnyTrue(list=eq_9)
filterByBoolMask_11 = List.FilterByBoolMask(list=all_elements_of_category_in_view_5, mask=anyTrue_2)
name_5 = Material.Name()  # unwired: material
getMaterials_5 = Element.GetMaterials(element=filterByBoolMask_11.in)
flatten_5 = List.Flatten(list=getMaterials_5)
function_apply_5 = ApplyFunction(func=name_5, arg1=flatten_5)
code_block_73 = CodeBlock { "Steel"; }
eq_10 = function_apply_5 == code_block_73
filterByBoolMask_12 = List.FilterByBoolMask(list=filterByBoolMask_11.in, mask=eq_10)
element_taggedstatus_5 = Custom[Element TaggedStatus](element=filterByBoolMask_12.in)
code_block_74 = CodeBlock { "Column Style"; 1; }
setParameterByName_10 = Element.SetParameterByName(element=element_taggedstatus_5.NotTagged, parameterName=code_block_74.out0, value=code_block_74.out1)
location_6 = Custom[Element.Location+](element=setParameterByName_10)
code_block_75 = CodeBlock(x=location_6.curves)  # same code as code_block_7
await_3 = Orchid.Common.DataStream.Await(pass=setParameterByName_10, waitFor=code_block_75.out1)
elementcentroid_5 = Custom[© ElementCentroid](element=await_3)
code_block_76 = CodeBlock { 0.5; }
planeAtParameter_4 = Curve.PlaneAtParameter(curve=code_block_75.out1, param=code_block_76)
code_block_77 = CodeBlock { 0.5; }
pointAtParameter_4 = Curve.PointAtParameter(curve=code_block_75.out1, param=code_block_77)
activeView_12 = Orchid.RevitProject.Common.Document.ActiveView()
plane_6 = Custom[View.Plane](view=activeView_12)
normal_7 = Plane.Normal(plane=plane_6)
code_block_78 = CodeBlock { 90; }
rotate_4 = Geometry.Rotate(geometry=planeAtParameter_4, origin=pointAtParameter_4, axis=normal_7, degrees=code_block_78)
normal_8 = Plane.Normal(plane=rotate_4)
code_block_79 = CodeBlock(z=normal_8) { z.Z; }
code_block_80 = CodeBlock { 0; }
gt_4 = code_block_79 > code_block_80
code_block_81 = CodeBlock { -1; }
ne_4 = code_block_79 != code_block_81
and_4 = gt_4 && ne_4
reverse_4 = Vector.Reverse(vector=normal_8)
scopeIf_4 = Custom[ScopeIf+](test=and_4, True=normal_8, False=reverse_4, lacing=Shortest)
code_block_82 = CodeBlock(x=await_3) { Revit.Elements.Element.GetParameterValueByName(Revit.Elements.Element.GetParameterValueByName(x,"Type"),"Width")/2; }
translate_4 = Geometry.Translate(geometry=elementcentroid_5, direction=scopeIf_4, distance=code_block_82)
code_block_83 = CodeBlock()  # same code as code_block_48
byElementAndLocation_5 = Tag.ByElementAndLocation(view=activeView_11, element=await_3, location=translate_4, horizontal=code_block_83)
code_block_84 = CodeBlock { "Type"; }
code_block_85 = CodeBlock { "EST_A_STRUCTURAL COLUMN TAG_ELEVACION_DIMENSIONES"; }
byName_11 = Orchid.RevitProject.Elements.Family.ByName(name=code_block_85)
code_block_86 = CodeBlock { "Pilar Hormigon"; }
byFamilyAndName_6 = FamilyType.ByFamilyAndName(family=byName_11, name=code_block_86)
setParameterByName_11 = Element.SetParameterByName(element=byElementAndLocation_5, parameterName=code_block_84, value=byFamilyAndName_6)
code_block_87 = CodeBlock { "Column Style"; 0; }
setParameterByName_12 = Element.SetParameterByName(element=await_3, parameterName=code_block_87.out0, value=code_block_87.out1)

# group: Etiqueta Vigas Metalicas
code_block_88 = CodeBlock { "Structural Framing"; }
byName_12 = Category.ByName(name=code_block_88)
code_block_89 = CodeBlock(x=code_block_2.out1) { x; }
all_elements_of_category_in_view_6 = ElementsOfCategoryInView(Category=byName_12, View=code_block_89)
familyName_5 = Orchid.RevitProject.Elements.Element.FamilyName(element=all_elements_of_category_in_view_6)
code_block_90 = CodeBlock()
# ---------- code_block_90.designscript (12 lines) ----------
[
"EST_M_STRUCTURAL FRAMING_VIGA LAMINADA_L",
"EST_M_STRUCTURAL FRAMING_VIGA OHM",
"EST_M_STRUCTURAL FRAMING_VIGA PLEGADA_C",
"EST_M_STRUCTURAL FRAMING_VIGA PLEGADA_CA",
"EST_M_STRUCTURAL FRAMING_VIGA PLEGADA_HSS",
"EST_M_STRUCTURAL FRAMING_VIGA PLEGADA_HSSE",
"EST_M_STRUCTURAL FRAMING_VIGA PLEGADA_L",
"EST_M_STRUCTURAL FRAMING_VIGA SOLDADA_HN",
"EST_M_STRUCTURAL FRAMING_VIGA SOLDADA_IN",
"EST_M_STRUCTURAL FRAMING_VIGA SOLDADA_T"
];
# ----------------------------------------
eq_11 = familyName_5@L1 == code_block_90
anyTrue_3 = Orchid.Common.List.AnyTrue(list=eq_11)
filterByBoolMask_13 = List.FilterByBoolMask(list=all_elements_of_category_in_view_6, mask=anyTrue_3)
name_6 = Material.Name()  # unwired: material
getMaterials_6 = Element.GetMaterials(element=filterByBoolMask_13.in)
flatten_6 = List.Flatten(list=getMaterials_6)
function_apply_6 = ApplyFunction(func=name_6, arg1=flatten_6)
code_block_91 = CodeBlock { "Concrete, Cast-in-Place gray"; }
eq_12 = function_apply_6 == code_block_91
filterByBoolMask_14 = List.FilterByBoolMask(list=filterByBoolMask_13.in, mask=eq_12)
activeView_13 = Orchid.RevitProject.Common.Document.ActiveView()
location_7 = Custom[Element.Location+](element=filterByBoolMask_13.in)
code_block_92 = CodeBlock(x=location_7.curves)  # same code as code_block_7
direction_3 = Line.Direction(line=code_block_92.out1)
activeView_14 = Orchid.RevitProject.Common.Document.ActiveView()
plane_7 = Custom[View.Plane](view=activeView_14)
isParallelToPlane_3 = Custom[Vector.IsParallelToPlane](vector=direction_3, plane=plane_7)
filterByBoolMask_15 = List.FilterByBoolMask(list=filterByBoolMask_13.in, mask=isParallelToPlane_3)
element_taggedstatus_6 = Custom[Element TaggedStatus](element=filterByBoolMask_15.in)
elementcentroid_6 = Custom[© ElementCentroid](element=element_taggedstatus_6.NotTagged)
location_8 = Custom[Element.Location+](element=element_taggedstatus_6.NotTagged)
code_block_93 = CodeBlock(x=location_8.curves)  # same code as code_block_7
code_block_94 = CodeBlock { 0.5; }
planeAtParameter_5 = Curve.PlaneAtParameter(curve=code_block_93.out1, param=code_block_94)
code_block_95 = CodeBlock { 0.5; }
pointAtParameter_5 = Curve.PointAtParameter(curve=code_block_93.out1, param=code_block_95)
activeView_15 = Orchid.RevitProject.Common.Document.ActiveView()
plane_8 = Custom[View.Plane](view=activeView_15)
normal_9 = Plane.Normal(plane=plane_8)
code_block_96 = CodeBlock { 90; }
rotate_5 = Geometry.Rotate(geometry=planeAtParameter_5, origin=pointAtParameter_5, axis=normal_9, degrees=code_block_96)
normal_10 = Plane.Normal(plane=rotate_5)
code_block_97 = CodeBlock(z=normal_10) { z.Z; }
code_block_98 = CodeBlock { 0; }
gt_5 = code_block_97 > code_block_98
code_block_99 = CodeBlock { -1; }
ne_5 = code_block_97 != code_block_99
and_5 = gt_5 && ne_5
reverse_5 = Vector.Reverse(vector=normal_10)
scopeIf_5 = Custom[ScopeIf+](test=and_5, True=normal_10, False=reverse_5, lacing=Shortest)
code_block_100 = CodeBlock(x=element_taggedstatus_6.NotTagged) { Revit.Elements.Element.GetParameterValueByName(Revit.Elements.Element.GetParameterValueByName(x,"Type"),"Height")/2; }
translate_5 = Geometry.Translate(geometry=elementcentroid_6, direction=scopeIf_5, distance=code_block_100)
byElementAndLocation_6 = Tag.ByElementAndLocation(view=activeView_13, element=element_taggedstatus_6.NotTagged, location=translate_5)
code_block_101 = CodeBlock { "Type"; }
code_block_102 = CodeBlock { "EST_A_STRUCTURAL FRAMING TAG_ELEVACION"; }
byName_13 = Orchid.RevitProject.Elements.Family.ByName(name=code_block_102)
code_block_103 = CodeBlock { "Tag Viga"; }
byFamilyAndName_7 = FamilyType.ByFamilyAndName(family=byName_13, name=code_block_103)
setParameterByName_13 = Element.SetParameterByName(element=byElementAndLocation_6, parameterName=code_block_101, value=byFamilyAndName_7)

code_block_104 = CodeBlock { "Error"; }
uimessenger = Custom[© UIMessenger](title=code_block_104, body=code_block.out4)  # package Crumple; Displays a message box with a title/body and OK/cancel button. If OK is selected, the third input's data will be passed through.

# group: Overrides Emplantillado
code_block_105 = CodeBlock(x=code_block_2.out1) { x; }
code_block_106 = CodeBlock { "Structural Foundations"; }
byName_14 = Category.ByName(name=code_block_106)
all_elements_of_category_in_view_7 = ElementsOfCategoryInView(Category=byName_14, View=code_block_105)
name_7 = Element.Name(element=all_elements_of_category_in_view_7)
code_block_107 = CodeBlock { "EMPLANTILLADO"; }
contains = String.Contains(str=name_7, searchFor=code_block_107)
filterByBoolMask_16 = List.FilterByBoolMask(list=all_elements_of_category_in_view_7, mask=contains)
code_block_108 = CodeBlock { null; }
replaceEmptyLists_2 = Custom[List.ReplaceEmptyLists](seq=filterByBoolMask_16.in, Replacement=code_block_108)
code_block_109 = CodeBlock(x=replaceEmptyLists_2)
# ---------- code_block_109.designscript (12 lines) ----------
x;
[Imperative]
{
	if(x == null)
	{
		return = [];
	}
	else
	{
		return = x[0];
	}
};
# ----------------------------------------
code_block_110 = CodeBlock(x=replaceEmptyLists_2)
# ---------- code_block_110.designscript (12 lines) ----------
x;
[Imperative]
{
	if(x == null)
	{
		return = [];
	}
	else
	{
		return = "Diagonal up 1.5mm";
	}
};
# ----------------------------------------
getByName = FillPatternElement.GetByName(name=code_block_110.out1)
color_palette = ColorPalette({R: 0, G: 0, B: 0, A: 255})
create_overridegraphicsettings = Custom[Create OverrideGraphicSettings](SurfaceForegroundPattern=getByName, SurfaceForegroundPatternColor=color_palette, CutForegroundPattern=getByName, CutForegroundPatternColor=color_palette)  # package Genius Loci; Create a OverrideGraphicSettings (All graphic inputs are optional). Unlike the OOTB OverrideGraphicSettings.ByProperties node, the Foreground and background patterns are available. Note : Prior to Revit 2019, the materials have only one surface pattern and one cut pattern.
view_setelementoverrides = Custom[View SetElementOverrides](view=code_block_105, elements=code_block_109.out1, overrides=create_overridegraphicsettings)  # package Genius Loci; Overrides element graphics settings in the given view. For use with the Create OverrideGraphicSettings node. Can also be used to hide or unhide elements.

# group: Overrides Vigas Hormigon en Corte
activeView_16 = Orchid.RevitProject.Common.Document.ActiveView()
code_block_111 = CodeBlock(x=code_block_2.out1) { x; }
code_block_112 = CodeBlock(x=code_block_111) { x; }
code_block_113 = CodeBlock { "Structural Framing"; }
byName_15 = Category.ByName(name=code_block_113)
all_elements_of_category_in_view_8 = ElementsOfCategoryInView(Category=byName_15, View=code_block_112)
familyName_6 = Orchid.RevitProject.Elements.Element.FamilyName(element=all_elements_of_category_in_view_8)
code_block_114 = CodeBlock()  # same code as code_block_13
eq_13 = familyName_6@L1 == code_block_114
anyTrue_4 = Orchid.Common.List.AnyTrue(list=eq_13)
filterByBoolMask_17 = List.FilterByBoolMask(list=all_elements_of_category_in_view_8, mask=anyTrue_4)
location_9 = Custom[Element.Location+](element=filterByBoolMask_17.in)
code_block_115 = CodeBlock(x=location_9.curves)  # same code as code_block_7
direction_4 = Line.Direction(line=code_block_115.out1)
code_block_116 = CodeBlock(x=code_block_111) { x; }
plane_9 = Custom[View.Plane](view=code_block_116)
isParallelToPlane_4 = Custom[Vector.IsParallelToPlane](vector=direction_4, plane=plane_9)
filterByBoolMask_18 = List.FilterByBoolMask(list=filterByBoolMask_17.in, mask=isParallelToPlane_4)
code_block_117 = CodeBlock { null; }
replaceEmptyLists_3 = Custom[List.ReplaceEmptyLists](seq=code_block_116, Replacement=code_block_117)
code_block_118 = CodeBlock(x=replaceEmptyLists_3)
# ---------- code_block_118.designscript (12 lines) ----------
x;
[Imperative]
{
	if(x == null)
	{
		return = [];
	}
	else
	{
		return = "Hidden";
	}
};
# ----------------------------------------
getByName_2 = LinePatternElement.GetByName(name=code_block_118.out1)
color_palette_2 = ColorPalette({R: 0, G: 0, B: 0, A: 255})
code_block_119 = CodeBlock { 1; }
create_overridegraphicsettings_2 = Custom[Create OverrideGraphicSettings](ProjectionLinePattern=getByName_2, ProjectionLineColor=color_palette_2, ProjectionLineWeight=code_block_119, CutLinePattern=getByName_2, CutLineColor=color_palette_2, CutLineWeight=code_block_119)
view_setelementoverrides_2 = Custom[View SetElementOverrides](view=code_block_112, elements=filterByBoolMask_18.out, overrides=create_overridegraphicsettings_2)

# group: Breaklines
byLoft = Surface.ByLoft()  # unwired: crossSections
translate_6 = Geometry.Translate(lacing=Longest)  # unwired: geometry, direction, distance
byJoinedCurves = PolyCurve.ByJoinedCurves()  # unwired: curves
code_block_120 = CodeBlock(x=code_block_2.out1) { x; }
code_block_121 = CodeBlock(x=code_block_120) { x; }
getCropBox = Orchid.RevitProject.Views.View.GetCropBox(view=code_block_121)
function_apply_7 = ApplyFunction(func=byJoinedCurves, arg1=getCropBox.Curve)
code_block_122 = CodeBlock(x=function_apply_7)
# ---------- code_block_122.designscript (13 lines) ----------
x;

[Imperative]
{
	if(x == null)
	{
		return = [];
	}
	else
	{
		return = x;
	}
};
# ----------------------------------------
code_block_123 = CodeBlock { -690; false; }
offset = PolyCurve.Offset(polyCurve=code_block_122.out1, signedDistance=code_block_123.out0, extendCircular=code_block_123.out1)
plane_10 = Custom[View.Plane](view=code_block_121)
normal_11 = Plane.Normal(plane=plane_10)
reverse_6 = Vector.Reverse(vector=normal_11)
list_create_2 = List.Create(item0=normal_11, item1=reverse_6)
code_block_124 = CodeBlock { 1000; }
function_apply_8 = ApplyFunction(func=translate_6, arg1=offset, arg2=list_create_2, arg3=code_block_124)
function_apply_9 = ApplyFunction(func=byLoft, arg1=function_apply_8)
byUnion = Solid.ByUnion()  # unwired: solids
code_block_125 = CodeBlock()
# ---------- code_block_125.designscript (6 lines) ----------
[
"Walls",
"Structural Columns",
"Structural Framing",
"Floors"
];
# ----------------------------------------
byName_16 = Category.ByName(name=code_block_125)
all_elements_of_category_in_view_9 = ElementsOfCategoryInView(Category=byName_16, View=code_block_121)
geometry = Element.Geometry(element=all_elements_of_category_in_view_9)
flatten_7 = List.Flatten(list=geometry)
function_apply_10 = ApplyFunction(func=byUnion, arg1=flatten_7)
code_block_126 = CodeBlock(x=function_apply_10)  # same code as code_block_122
intersect = Geometry.Intersect(geometry=function_apply_9, other=code_block_126.out1)
code_block_127 = CodeBlock { [0.5,0.5]; [0,1]; }
pointAtParameter_6 = Surface.PointAtParameter(surface=intersect@L1, u=code_block_127.out1@L2, v=code_block_127.out0@L2, lacing=Longest)
transpose_3 = List.Transpose(lists=pointAtParameter_6)
code_block_128 = CodeBlock { null; }
replaceEmptyLists_4 = Custom[List.ReplaceEmptyLists](seq=transpose_3, Replacement=code_block_128)
code_block_129 = CodeBlock(x=replaceEmptyLists_4)
# ---------- code_block_129.designscript (13 lines) ----------
x;

[Imperative]
{
	if(x == null)
	{
		return = [[],[]];
	}
	else
	{
		return = x;
	}
};
# ----------------------------------------
code_block_130 = CodeBlock(x=code_block_129.out1) { x[0]; x[1]; }
byStartPointEndPoint = Line.ByStartPointEndPoint(startPoint=code_block_130.out0, endPoint=code_block_130.out1)
reverse_7 = Curve.Reverse(curve=byStartPointEndPoint)
code_block_131 = CodeBlock(x=code_block_120) { x; }
plane_11 = Custom[View.Plane](view=code_block_131)
pullOntoPlane = Curve.PullOntoPlane(curve=reverse_7, plane=plane_11)
code_block_132 = CodeBlock { "EST_D_BREAKLINE"; }
byName_17 = FamilyType.ByName(name=code_block_132)
byCurve = Custom[DetailComponent.ByCurve](curve=pullOntoPlane, familyType=byName_17, view=code_block_131, lacing=Longest)  # package Clockwork for Dynamo 2.x; Places a line-based detail component in a given view
code_block_133 = CodeBlock { "Length of masking region"; 900; }
setParameterByName_14 = Element.SetParameterByName(element=byCurve, parameterName=code_block_133.out0, value=code_block_133.out1)

# group: Etiqueta Emplantillado
ʳʰʸᵗʰᵐ_tags = Rhythm.Revit.Elements.Tags.SetLeaderElbowPosition()  # unwired: tag, location
code_block_134 = CodeBlock { "Type"; }
code_block_135 = CodeBlock { "EST_A_STRUCTURAL FOUNDATION TAG_ELEVACION_EMPLANTILLADO"; }
byName_18 = Orchid.RevitProject.Elements.Family.ByName(name=code_block_135)
code_block_136 = CodeBlock { "Emplantillado"; }
byFamilyAndName_8 = FamilyType.ByFamilyAndName(family=byName_18, name=code_block_136)
setParameterByName_15 = Element.SetParameterByName(parameterName=code_block_134, value=byFamilyAndName_8)  # unwired: element
code_block_137 = CodeBlock { "Leader Line"; 1; }
setParameterByName_16 = Element.SetParameterByName(parameterName=code_block_137.out0, value=code_block_137.out1)  # unwired: element
code_block_138 = CodeBlock(x=code_block_2.out1) { x; }
code_block_139 = CodeBlock(x=code_block_138) { x; }
code_block_140 = CodeBlock { "Structural Foundations"; }
byName_19 = Category.ByName(name=code_block_140)
all_elements_of_category_in_view_10 = ElementsOfCategoryInView(Category=byName_19, View=code_block_139)
kind_2 = Custom[StructuralFoundation.Kind](structuralFoundation=all_elements_of_category_in_view_10)  # package Clockwork for Dynamo 2.x; Retrieves the kind of a given structural foundation (isolated, wall, slab).
code_block_141 = CodeBlock { "Slab"; }
eq_14 = kind_2 == code_block_141
name_8 = Element.Name(element=all_elements_of_category_in_view_10)
code_block_142 = CodeBlock { "EMPLANTILLADO"; }
contains_2 = String.Contains(str=name_8, searchFor=code_block_142)
and_6 = eq_14 && contains_2
filterByBoolMask_19 = List.FilterByBoolMask(list=all_elements_of_category_in_view_10, mask=and_6)
code_block_143 = CodeBlock { null; }
replaceEmptyLists_5 = Custom[List.ReplaceEmptyLists](seq=filterByBoolMask_19.in, Replacement=code_block_143)
code_block_144 = CodeBlock { 0; }
getItemAtIndex = List.GetItemAtIndex(index=code_block_144)  # unwired: list
ZAxis = Vector.ZAxis()
code_block_145 = CodeBlock { -300; }
translate_7 = Geometry.Translate(direction=ZAxis@L1, distance=code_block_145@L1, lacing=Longest)  # unwired: geometry
code_block_146 = CodeBlock { 0.5; }
pointAtParameter_7 = Surface.PointAtParameter(u=code_block_146, v=code_block_146)  # unwired: surface
element_surfaces_references = Custom[Element Surfaces References](element=replaceEmptyLists_5)  # package Genius Loci; Retrieve the top, bottom, side surfaces and their associated references of the system family. This doesn't work with cylindrical system families (pipe...)
code_block_147 = CodeBlock(x=element_surfaces_references.Bottom_Surface)
# ---------- code_block_147.designscript (12 lines) ----------
x;
[Imperative]
{
	if(x == null)
	{
		return = [];
	}
	else
	{
		return = DSCore.List.Flatten(x,1);
	}
};
# ----------------------------------------
function_apply_11 = ApplyFunction(func=pointAtParameter_7, arg1=code_block_147.out1)
function_apply_12 = ApplyFunction(func=translate_7, arg1=function_apply_11)
code_block_148 = CodeBlock { null; }
replaceEmptyLists_6 = Custom[List.ReplaceEmptyLists](seq=function_apply_12, Replacement=code_block_148)
code_block_149 = CodeBlock(x=code_block_138) { x; }
plane_12 = Custom[View.Plane](view=code_block_149)
byBestFitThroughPoints = Line.ByBestFitThroughPoints()  # unwired: bestFitPoints
code_block_150 = CodeBlock { 0.5; }
pointAtParameter_8 = Curve.PointAtParameter(param=code_block_150)  # unwired: curve
code_block_151 = CodeBlock { [1,3]; }
getItemAtIndex_2 = List.GetItemAtIndex(index=code_block_151@L2)  # unwired: list
getCropBox_2 = Orchid.RevitProject.Views.View.GetCropBox(view=code_block_149)
function_apply_13 = ApplyFunction(func=getItemAtIndex_2, arg1=getCropBox_2.Curve)
function_apply_14 = ApplyFunction(func=pointAtParameter_8, arg1=function_apply_13)
function_apply_15 = ApplyFunction(func=byBestFitThroughPoints, arg1=function_apply_14)
code_block_152 = CodeBlock(x=function_apply_15)  # same code as code_block_7
code_block_153 = CodeBlock { 0.5; }
pointAtParameter_9 = Curve.PointAtParameter(curve=code_block_152.out1, param=code_block_153)
direction_5 = Line.Direction(line=code_block_152.out1)
code_block_154 = CodeBlock { 90; }
rotate_6 = Geometry.Rotate(geometry=plane_12@L1, origin=pointAtParameter_9@L1, axis=direction_5@L1, degrees=code_block_154@L1)
normal_12 = Plane.Normal(plane=rotate_6)
code_block_155 = CodeBlock { 50; }
translate_8 = Geometry.Translate(geometry=replaceEmptyLists_6@L2, direction=normal_12@L1, distance=code_block_155@L1, lacing=Longest)
function_apply_16 = ApplyFunction(func=getItemAtIndex, arg1=translate_8)
byElementAndLocation_7 = Tag.ByElementAndLocation(view=code_block_139@L1, element=replaceEmptyLists_5@L2, location=function_apply_16@L2, lacing=Longest)
flatten_8 = List.Flatten(list=byElementAndLocation_7)
function_apply_17 = ApplyFunction(func=setParameterByName_16, arg1=flatten_8)
function_apply_18 = ApplyFunction(func=setParameterByName_15, arg1=function_apply_17)
function_apply_19 = ApplyFunction(func=ʳʰʸᵗʰᵐ_tags, arg1=function_apply_18, arg2=replaceEmptyLists_6)
code_block_156 = CodeBlock { true; }

# group: Etiqueta Muros
code_block_157 = CodeBlock(x=code_block_2.out1) { x; }
code_block_158 = CodeBlock(x=code_block_157) { x; }
code_block_159 = CodeBlock { "Walls"; }
byName_20 = Category.ByName(name=code_block_159)
all_elements_of_category_in_view_11 = ElementsOfCategoryInView(Category=byName_20, View=code_block_158)
wallType_2 = archilab.Revit.Elements.Walls.WallType(wall=all_elements_of_category_in_view_11)
kind_3 = Orchid.RevitProject.Elements.WallType.Kind(wallType=wallType_2)
code_block_160 = CodeBlock { "Basic"; }
eq_15 = kind_3 == code_block_160
filterByBoolMask_20 = List.FilterByBoolMask(list=all_elements_of_category_in_view_11, mask=eq_15)
name_9 = Material.Name()  # unwired: material
getMaterials_7 = Element.GetMaterials(element=filterByBoolMask_20.in)
flatten_9 = List.Flatten(list=getMaterials_7)
function_apply_20 = ApplyFunction(func=name_9, arg1=flatten_9)
code_block_161 = CodeBlock { "Concrete, Cast-in-Place gray"; }
eq_16 = function_apply_20 == code_block_161
filterByBoolMask_21 = List.FilterByBoolMask(list=filterByBoolMask_20.in, mask=eq_16)
location_10 = Custom[Element.Location+](element=filterByBoolMask_21.in)
code_block_162 = CodeBlock(x=location_10.curves)  # same code as code_block_7
direction_6 = Line.Direction(line=code_block_162.out1)
code_block_163 = CodeBlock(x=code_block_157) { x; }
plane_13 = Custom[View.Plane](view=code_block_163)
isParallelToPlane_5 = Custom[Vector.IsParallelToPlane](vector=direction_6, plane=plane_13)
filterByBoolMask_22 = List.FilterByBoolMask(list=filterByBoolMask_21.in, mask=isParallelToPlane_5)
code_block_164 = CodeBlock { null; }
replaceEmptyLists_7 = Custom[List.ReplaceEmptyLists](seq=code_block_163, Replacement=code_block_164)
code_block_165 = CodeBlock(x=replaceEmptyLists_7)  # same code as code_block_118
getByName_3 = LinePatternElement.GetByName(name=code_block_165.out1)
color_palette_3 = ColorPalette({R: 0, G: 0, B: 0, A: 255})
code_block_166 = CodeBlock { 1; }
create_overridegraphicsettings_3 = Custom[Create OverrideGraphicSettings](ProjectionLinePattern=getByName_3, ProjectionLineColor=color_palette_3, ProjectionLineWeight=code_block_166, CutLinePattern=getByName_3, CutLineColor=color_palette_3, CutLineWeight=code_block_166)
view_setelementoverrides_3 = Custom[View SetElementOverrides](view=code_block_158, elements=filterByBoolMask_22.out, overrides=create_overridegraphicsettings_3)

# group: Overrides Fundaciones (Hidden)
code_block_167 = CodeBlock(x=code_block_2.out1) { x; }
code_block_168 = CodeBlock(x=code_block_167) { x; }
code_block_169 = CodeBlock { "Structural Foundations"; }
byName_21 = Category.ByName(name=code_block_169)
all_elements_of_category_in_view_12 = ElementsOfCategoryInView(Category=byName_21, View=code_block_168)
kind_4 = Custom[StructuralFoundation.Kind](structuralFoundation=all_elements_of_category_in_view_12)
code_block_170 = CodeBlock { "Slab"; }
eq_17 = kind_4 == code_block_170
filterByBoolMask_23 = List.FilterByBoolMask(list=all_elements_of_category_in_view_12, mask=eq_17)
code_block_171 = CodeBlock(x=code_block_167) { x; }
code_block_172 = CodeBlock { null; }
replaceEmptyLists_8 = Custom[List.ReplaceEmptyLists](seq=code_block_171, Replacement=code_block_172)
code_block_173 = CodeBlock(x=replaceEmptyLists_8)  # same code as code_block_118
getByName_4 = LinePatternElement.GetByName(name=code_block_173.out1)
color_palette_4 = ColorPalette({R: 0, G: 0, B: 0, A: 255})
code_block_174 = CodeBlock { 1; }
create_overridegraphicsettings_4 = Custom[Create OverrideGraphicSettings](ProjectionLinePattern=getByName_4, ProjectionLineColor=color_palette_4, ProjectionLineWeight=code_block_174, CutLinePattern=getByName_4, CutLineColor=color_palette_4, CutLineWeight=code_block_174)
view_setelementoverrides_4 = Custom[View SetElementOverrides](view=code_block_168, elements=filterByBoolMask_23.out, overrides=create_overridegraphicsettings_4)

code_block_175 = CodeBlock(x=code_block_2.out1) { x; }
plane_14 = Custom[View.Plane](view=code_block_175)
normal_13 = Plane.Normal(plane=plane_14)
code_block_176 = CodeBlock { -300; }
translate_9 = Geometry.Translate(geometry=plane_14, direction=normal_13, distance=code_block_176)
code_block_177 = CodeBlock()
# ---------- code_block_177.designscript (5 lines) ----------
["Floors",
"Structural Framing",
"Walls",
"Structural Foundations"
];
# ----------------------------------------
byName_22 = Category.ByName(name=code_block_177)
all_elements_of_category_in_view_13 = ElementsOfCategoryInView(Category=byName_22, View=code_block_175)
flatten_10 = List.Flatten(list=all_elements_of_category_in_view_13)
solids = Element.Solids(element=flatten_10)
flatten_11 = List.Flatten(list=solids)
byUnion_2 = Solid.ByUnion(solids=flatten_11)
intersect_2 = Geometry.Intersect(geometry=translate_9, other=byUnion_2)
perimeterCurves = Surface.PerimeterCurves(surface=intersect_2)
flatten_12 = List.Flatten(list=perimeterCurves)
byCurve_2 = Custom[DetailCurve.ByCurve+](curve=flatten_12, view=code_block_175)  # package Clockwork for Dynamo 2.x; Creates a detail line based on a given curve. Unlike the OOTB node it can also draw circles.
code_block_178 = CodeBlock { "Line Style"; }
code_block_179 = CodeBlock { "Medium Lines"; }
get_line_style_by_name = Custom[Get Line Style by Name](name=code_block_179)  # package archi-lab.net; This node will return a line style object by its name. Line styles can be either Drafting or Model Line Property.
setParameterByName_17 = Element.SetParameterByName(element=byCurve_2, parameterName=code_block_178, value=get_line_style_by_name, lacing=Longest)
