# Dynamo graph plantaEstructura_script.dyn (Dynamo 2.3.1.11775)
# packages: Orchid 200.4.0.7938, Crumple 2022.2.13, Genius Loci 2020.8.3, Clockwork for Dynamo 2.x 2.4.0, Data-Shapes 2021.2.94

activeView = Orchid.RevitProject.Common.Document.ActiveView()

# group: Etiqueta Viga Tradicional
activeView_2 = Orchid.RevitProject.Common.Document.ActiveView()
code_block = CodeBlock { "Structural Framing"; }
byName = Category.ByName(name=code_block)
code_block_2 = CodeBlock(x=activeView) { x; }
all_elements_of_category_in_view = ElementsOfCategoryInView(Category=byName, View=code_block_2)
familyName = Orchid.RevitProject.Elements.Element.FamilyName(element=all_elements_of_category_in_view)
code_block_3 = CodeBlock { "EST_M_STRUCTURAL FRAMING_VIGA TRADICIONAL"; }
eq = familyName == code_block_3
filterByBoolMask = List.FilterByBoolMask(list=all_elements_of_category_in_view, mask=eq)
getMaterials = Element.GetMaterials(element=filterByBoolMask.in)
code_block_4 = CodeBlock { null; }
replaceEmptyLists = Custom[List.ReplaceEmptyLists](seq=getMaterials, Replacement=code_block_4)  # package Clockwork for Dynamo 2.x; Replaces all empty lists within a given list with a substitute
code_block_5 = CodeBlock { 0; }
getItemAtIndex = List.GetItemAtIndex(list=replaceEmptyLists@L2, index=code_block_5)
code_block_6 = CodeBlock { "Steel"; }
byName_2 = Material.ByName(name=code_block_6)
code_block_7 = CodeBlock(x=getItemAtIndex, y=byName_2)
# ---------- code_block_7.designscript (14 lines) ----------
x;
y;

[Imperative]
{
	if(x[0] == null)
	{
		return = y;
	}
	else
	{
		return = x;
	}
};
# ----------------------------------------
name = Material.Name(material=code_block_7.out2)
code_block_8 = CodeBlock { "Concrete, Cast-in-Place gray"; }
eq_2 = name == code_block_8
filterByBoolMask_2 = List.FilterByBoolMask(list=filterByBoolMask.in, mask=eq_2)
element_taggedstatus = Custom[Element TaggedStatus](element=filterByBoolMask_2.in)  # package Genius Loci; Identify the tagged and untagged elements. Please note : This doesn't work with areas and spaces.
code_block_9 = CodeBlock { "EST_A_STRUCTURAL FRAMING TAG_PLANTA"; }
byName_3 = Orchid.RevitProject.Elements.Family.ByName(name=code_block_9)
code_block_10 = CodeBlock { "Tag Viga"; }
byFamilyAndName = FamilyType.ByFamilyAndName(family=byName_3, name=code_block_10)
elementcentroid = Custom[© ElementCentroid](element=element_taggedstatus.NotTagged)  # package Crumple; Returns the centroid of the element's axis-aligned bounding box.
activeView_3 = Orchid.RevitProject.Common.Document.ActiveView()
plane = Custom[View.Plane](view=activeView_3)  # package Clockwork for Dynamo 2.x; Retrieves the plane of a given view
normal = Plane.Normal(plane=plane)
byOriginNormal = Plane.ByOriginNormal(origin=elementcentroid, normal=normal)
normal_2 = Plane.Normal(plane=byOriginNormal)
location = Custom[Element.Location+](element=element_taggedstatus.NotTagged)  # package Clockwork for Dynamo 2.x; Returns the location of an element as point, curve or curve loop, along with some booleans to help filtering the results. Unlike the OOTB Element.GetLocation node, it also retunrs sketch lines of sketch-based elements like floor slabs as well as the element's rotation property.
code_block_11 = CodeBlock(x=location.curves)
# ---------- code_block_11.designscript (13 lines) ----------
x;

[Imperative]
{
	if(x == null)
	{
		return = [];
	}
	else
	{
		return = x;
	}
};
# ----------------------------------------
direction = Line.Direction(line=code_block_11.out1)
normalized = Vector.Normalized(vector=direction)
code_block_12 = CodeBlock(p=normalized) { p.X; }
code_block_13 = CodeBlock { 2; }
round = Math.Round(number=code_block_12, digits=code_block_13)
code_block_14 = CodeBlock { 0; }
le = round <= code_block_14
reverse = Vector.Reverse(vector=normalized)
scopeIf = Custom[ScopeIf+](test=le, True=reverse, False=normalized, lacing=Shortest)  # package Clockwork for Dynamo 2.x; A (hopefully) more robust implementation of ScopeIf. Tests a single boolean and returns a value accordingly.
code_block_15 = CodeBlock(p=scopeIf) { p.X; }
code_block_16 = CodeBlock { 2; }
round_2 = Math.Round(number=code_block_15, digits=code_block_16)
code_block_17 = CodeBlock { 0; }
eq_3 = round_2 == code_block_17
code_block_18 = CodeBlock(p=scopeIf) { p.Y; }
code_block_19 = CodeBlock { 2; }
round_3 = Math.Round(number=code_block_18, digits=code_block_19)
code_block_20 = CodeBlock { -1; }
eq_4 = round_3 == code_block_20
and_ = eq_3 && eq_4
reverse_2 = Vector.Reverse(vector=scopeIf)
scopeIf_2 = Custom[ScopeIf+](test=and_, True=scopeIf, False=reverse_2, lacing=Shortest)
code_block_21 = CodeBlock { null; }
replaceEmptyLists_2 = Custom[List.ReplaceEmptyLists](seq=scopeIf_2, Replacement=code_block_21)
ZAxis = Vector.ZAxis()
code_block_22 = CodeBlock(x=replaceEmptyLists_2, y=ZAxis)
# ---------- code_block_22.designscript (14 lines) ----------
x;
y;

[Imperative]
{
	if(x == null)
	{
		return = y;
	}
	else
	{
		return = x;
	}
};
# ----------------------------------------
code_block_23 = CodeBlock { 90; }
rotate = Vector.Rotate(vector=normal_2, axis=code_block_22.out2, degrees=code_block_23)
code_block_24 = CodeBlock(x=element_taggedstatus.NotTagged) { Revit.Elements.Element.GetParameterValueByName(Revit.Elements.Element.GetParameterValueByName(x,"Type"),"Width")/2; }
translate = Geometry.Translate(geometry=elementcentroid, direction=rotate, distance=code_block_24)
byElementAndLocation = Orchid.RevitProject.Annotations.Tag.ByElementAndLocation(view=activeView_2, element=element_taggedstatus.NotTagged, tagType=byFamilyAndName, location=translate)

# group: Etiqueta Losa
activeView_4 = Orchid.RevitProject.Common.Document.ActiveView()
code_block_25 = CodeBlock { "Floors"; }
byName_4 = Category.ByName(name=code_block_25)
code_block_26 = CodeBlock(x=activeView) { x; }
all_elements_of_category_in_view_2 = ElementsOfCategoryInView(Category=byName_4, View=code_block_26)
familyName_2 = Orchid.RevitProject.Elements.Element.FamilyName(element=all_elements_of_category_in_view_2)
code_block_27 = CodeBlock { "Floor"; }
eq_5 = familyName_2 == code_block_27
filterByBoolMask_3 = List.FilterByBoolMask(list=all_elements_of_category_in_view_2, mask=eq_5)
name_2 = Element.Name(element=filterByBoolMask_3.in)
code_block_28 = CodeBlock { "LOSA"; }
contains = String.Contains(str=name_2, searchFor=code_block_28)
filterByBoolMask_4 = List.FilterByBoolMask(list=filterByBoolMask_3.in, mask=contains)
getMaterials_2 = Element.GetMaterials(element=filterByBoolMask_4.in)
code_block_29 = CodeBlock { null; }
replaceEmptyLists_3 = Custom[List.ReplaceEmptyLists](seq=getMaterials_2, Replacement=code_block_29)
code_block_30 = CodeBlock { 0; }
getItemAtIndex_2 = List.GetItemAtIndex(list=replaceEmptyLists_3@L2, index=code_block_30)
code_block_31 = CodeBlock { "Steel"; }
byName_5 = Material.ByName(name=code_block_31)
code_block_32 = CodeBlock(x=getItemAtIndex_2, y=byName_5)  # same code as code_block_7
name_3 = Material.Name(material=code_block_32.out2)
code_block_33 = CodeBlock { "Concrete, Cast-in-Place gray"; }
eq_6 = name_3 == code_block_33
filterByBoolMask_5 = List.FilterByBoolMask(list=filterByBoolMask_4.in, mask=eq_6)
element_taggedstatus_2 = Custom[Element TaggedStatus](element=filterByBoolMask_5.in)
code_block_34 = CodeBlock { "EST_A_FLOOR TAG_PLANTA_LOSA"; }
byName_6 = Orchid.RevitProject.Elements.Family.ByName(name=code_block_34)
code_block_35 = CodeBlock { "Tope Losa y Nivel"; }
byFamilyAndName_2 = FamilyType.ByFamilyAndName(family=byName_6, name=code_block_35)
elementcentroid_2 = Custom[© ElementCentroid](element=element_taggedstatus_2.NotTagged)
byElementAndLocation_2 = Orchid.RevitProject.Annotations.Tag.ByElementAndLocation(view=activeView_4, element=element_taggedstatus_2.NotTagged, tagType=byFamilyAndName_2, location=elementcentroid_2)

# group: Etiqueta Viga IN
activeView_5 = Orchid.RevitProject.Common.Document.ActiveView()
code_block_36 = CodeBlock { "Structural Framing"; }
byName_7 = Category.ByName(name=code_block_36)
code_block_37 = CodeBlock(x=activeView) { x; }
all_elements_of_category_in_view_3 = ElementsOfCategoryInView(Category=byName_7, View=code_block_37)
familyName_3 = Orchid.RevitProject.Elements.Element.FamilyName(element=all_elements_of_category_in_view_3)
code_block_38 = CodeBlock { "EST_M_STRUCTURAL FRAMING_VIGA SOLDADA_IN"; }
eq_7 = familyName_3 == code_block_38
filterByBoolMask_6 = List.FilterByBoolMask(list=all_elements_of_category_in_view_3, mask=eq_7)
getMaterials_3 = Element.GetMaterials(element=filterByBoolMask_6.in)
code_block_39 = CodeBlock { null; }
replaceEmptyLists_4 = Custom[List.ReplaceEmptyLists](seq=getMaterials_3, Replacement=code_block_39)
code_block_40 = CodeBlock { 0; }
getItemAtIndex_3 = List.GetItemAtIndex(list=replaceEmptyLists_4@L2, index=code_block_40)
code_block_41 = CodeBlock { "Concrete, Cast-in-Place gray"; }
byName_8 = Material.ByName(name=code_block_41)
code_block_42 = CodeBlock(x=getItemAtIndex_3, y=byName_8)  # same code as code_block_7
name_4 = Material.Name(material=code_block_42.out2)
code_block_43 = CodeBlock { "Steel"; }
eq_8 = name_4 == code_block_43
filterByBoolMask_7 = List.FilterByBoolMask(list=filterByBoolMask_6.in, mask=eq_8)
element_taggedstatus_3 = Custom[Element TaggedStatus](element=filterByBoolMask_7.in)
code_block_44 = CodeBlock { "EST_A_STRUCTURAL FRAMING TAG_PLANTA"; }
byName_9 = Orchid.RevitProject.Elements.Family.ByName(name=code_block_44)
code_block_45 = CodeBlock { "Tag Viga"; }
byFamilyAndName_3 = FamilyType.ByFamilyAndName(family=byName_9, name=code_block_45)
elementcentroid_3 = Custom[© ElementCentroid](element=element_taggedstatus_3.NotTagged)
activeView_6 = Orchid.RevitProject.Common.Document.ActiveView()
plane_2 = Custom[View.Plane](view=activeView_6)
normal_3 = Plane.Normal(plane=plane_2)
byOriginNormal_2 = Plane.ByOriginNormal(origin=elementcentroid_3, normal=normal_3)
normal_4 = Plane.Normal(plane=byOriginNormal_2)
location_2 = Custom[Element.Location+](element=element_taggedstatus_3.NotTagged)
code_block_46 = CodeBlock(x=location_2.curves)  # same code as code_block_11
direction_2 = Line.Direction(line=code_block_46.out1)
normalized_2 = Vector.Normalized(vector=direction_2)
code_block_47 = CodeBlock(p=normalized_2) { p.X; }
code_block_48 = CodeBlock { 2; }
round_4 = Math.Round(number=code_block_47, digits=code_block_48)
code_block_49 = CodeBlock { 0; }
le_2 = round_4 <= code_block_49
reverse_3 = Vector.Reverse(vector=normalized_2)
scopeIf_3 = Custom[ScopeIf+](test=le_2, True=reverse_3, False=normalized_2, lacing=Shortest)
code_block_50 = CodeBlock(p=scopeIf_3) { p.X; }
code_block_51 = CodeBlock { 2; }
round_5 = Math.Round(number=code_block_50, digits=code_block_51)
code_block_52 = CodeBlock { 0; }
eq_9 = round_5 == code_block_52
code_block_53 = CodeBlock(p=scopeIf_3) { p.Y; }
code_block_54 = CodeBlock { 2; }
round_6 = Math.Round(number=code_block_53, digits=code_block_54)
code_block_55 = CodeBlock { -1; }
eq_10 = round_6 == code_block_55
and_2 = eq_9 && eq_10
reverse_4 = Vector.Reverse(vector=scopeIf_3)
scopeIf_4 = Custom[ScopeIf+](test=and_2, True=scopeIf_3, False=reverse_4, lacing=Shortest)
code_block_56 = CodeBlock { null; }
replaceEmptyLists_5 = Custom[List.ReplaceEmptyLists](seq=scopeIf_4, Replacement=code_block_56)
ZAxis_2 = Vector.ZAxis()
code_block_57 = CodeBlock(x=replaceEmptyLists_5, y=ZAxis_2)  # same code as code_block_22
code_block_58 = CodeBlock { 90; }
rotate_2 = Vector.Rotate(vector=normal_4, axis=code_block_57.out2, degrees=code_block_58)
code_block_59 = CodeBlock(x=element_taggedstatus_3.NotTagged) { Revit.Elements.Element.GetParameterValueByName(Revit.Elements.Element.GetParameterValueByName(x,"Type"),"Width")/2; }
translate_2 = Geometry.Translate(geometry=elementcentroid_3, direction=rotate_2, distance=code_block_59)
byElementAndLocation_3 = Orchid.RevitProject.Annotations.Tag.ByElementAndLocation(view=activeView_5, element=element_taggedstatus_3.NotTagged, tagType=byFamilyAndName_3, location=translate_2)

# group: Etiqueta Viga IE
activeView_7 = Orchid.RevitProject.Common.Document.ActiveView()
code_block_60 = CodeBlock { "Structural Framing"; }
byName_10 = Category.ByName(name=code_block_60)
code_block_61 = CodeBlock(x=activeView) { x; }
all_elements_of_category_in_view_4 = ElementsOfCategoryInView(Category=byName_10, View=code_block_61)
familyName_4 = Orchid.RevitProject.Elements.Element.FamilyName(element=all_elements_of_category_in_view_4)
code_block_62 = CodeBlock { "EST_M_STRUCTURAL FRAMING_VIGA SOLDADA_IE"; }
eq_11 = familyName_4 == code_block_62
filterByBoolMask_8 = List.FilterByBoolMask(list=all_elements_of_category_in_view_4, mask=eq_11)
getMaterials_4 = Element.GetMaterials(element=filterByBoolMask_8.in)
code_block_63 = CodeBlock { null; }
replaceEmptyLists_6 = Custom[List.ReplaceEmptyLists](seq=getMaterials_4, Replacement=code_block_63)
code_block_64 = CodeBlock { 0; }
getItemAtIndex_4 = List.GetItemAtIndex(list=replaceEmptyLists_6@L2, index=code_block_64)
code_block_65 = CodeBlock { "Concrete, Cast-in-Place gray"; }
byName_11 = Material.ByName(name=code_block_65)
code_block_66 = CodeBlock(x=getItemAtIndex_4, y=byName_11)  # same code as code_block_7
name_5 = Material.Name(material=code_block_66.out2)
code_block_67 = CodeBlock { "Steel"; }
eq_12 = name_5 == code_block_67
filterByBoolMask_9 = List.FilterByBoolMask(list=filterByBoolMask_8.in, mask=eq_12)
element_taggedstatus_4 = Custom[Element TaggedStatus](element=filterByBoolMask_9.in)
code_block_68 = CodeBlock { "EST_A_STRUCTURAL FRAMING TAG_PLANTA"; }
byName_12 = Orchid.RevitProject.Elements.Family.ByName(name=code_block_68)
code_block_69 = CodeBlock { "Tag Viga"; }
byFamilyAndName_4 = FamilyType.ByFamilyAndName(family=byName_12, name=code_block_69)
elementcentroid_4 = Custom[© ElementCentroid](element=element_taggedstatus_4.NotTagged)
activeView_8 = Orchid.RevitProject.Common.Document.ActiveView()
plane_3 = Custom[View.Plane](view=activeView_8)
normal_5 = Plane.Normal(plane=plane_3)
byOriginNormal_3 = Plane.ByOriginNormal(origin=elementcentroid_4, normal=normal_5)
normal_6 = Plane.Normal(plane=byOriginNormal_3)
location_3 = Custom[Element.Location+](element=element_taggedstatus_4.NotTagged)
code_block_70 = CodeBlock(x=location_3.curves)  # same code as code_block_11
direction_3 = Line.Direction(line=code_block_70.out1)
normalized_3 = Vector.Normalized(vector=direction_3)
code_block_71 = CodeBlock(p=normalized_3) { p.X; }
code_block_72 = CodeBlock { 2; }
round_7 = Math.Round(number=code_block_71, digits=code_block_72)
code_block_73 = CodeBlock { 0; }
le_3 = round_7 <= code_block_73
reverse_5 = Vector.Reverse(vector=normalized_3)
scopeIf_5 = Custom[ScopeIf+](test=le_3, True=reverse_5, False=normalized_3, lacing=Shortest)
code_block_74 = CodeBlock(p=scopeIf_5) { p.X; }
code_block_75 = CodeBlock { 2; }
round_8 = Math.Round(number=code_block_74, digits=code_block_75)
code_block_76 = CodeBlock { 0; }
eq_13 = round_8 == code_block_76
code_block_77 = CodeBlock(p=scopeIf_5) { p.Y; }
code_block_78 = CodeBlock { 2; }
round_9 = Math.Round(number=code_block_77, digits=code_block_78)
code_block_79 = CodeBlock { -1; }
eq_14 = round_9 == code_block_79
and_3 = eq_13 && eq_14
reverse_6 = Vector.Reverse(vector=scopeIf_5)
scopeIf_6 = Custom[ScopeIf+](test=and_3, True=scopeIf_5, False=reverse_6, lacing=Shortest)
code_block_80 = CodeBlock { null; }
replaceEmptyLists_7 = Custom[List.ReplaceEmptyLists](seq=scopeIf_6, Replacement=code_block_80)
ZAxis_3 = Vector.ZAxis()
code_block_81 = CodeBlock(x=replaceEmptyLists_7, y=ZAxis_3)  # same code as code_block_22
code_block_82 = CodeBlock { 90; }
rotate_3 = Vector.Rotate(vector=normal_6, axis=code_block_81.out2, degrees=code_block_82)
code_block_83 = CodeBlock(x=element_taggedstatus_4.NotTagged) { Revit.Elements.Element.GetParameterValueByName(Revit.Elements.Element.GetParameterValueByName(x,"Type"),"Bottom Flange Width")/2; }
translate_3 = Geometry.Translate(geometry=elementcentroid_4, direction=rotate_3, distance=code_block_83)
byElementAndLocation_4 = Orchid.RevitProject.Annotations.Tag.ByElementAndLocation(view=activeView_7, element=element_taggedstatus_4.NotTagged, tagType=byFamilyAndName_4, location=translate_3)

# group: Etiqueta Basic Walls
activeView_9 = Orchid.RevitProject.Common.Document.ActiveView()
code_block_84 = CodeBlock { "Walls"; }
byName_13 = Category.ByName(name=code_block_84)
code_block_85 = CodeBlock(x=activeView) { x; }
all_elements_of_category_in_view_5 = ElementsOfCategoryInView(Category=byName_13, View=code_block_85)
viewLevel = Custom[ViewLevel](View=code_block_85)  # package Data-Shapes; gets the level that a view is associated to
id = Element.Id(element=viewLevel)
level = Custom[Element.Level](element=all_elements_of_category_in_view_5)  # package Clockwork for Dynamo 2.x; Gets an element's level
id_2 = Element.Id(element=level)
eq_15 = id == id_2  # lacing=Longest
filterByBoolMask_10 = List.FilterByBoolMask(list=all_elements_of_category_in_view_5, mask=eq_15)
familyName_5 = Orchid.RevitProject.Elements.Element.FamilyName(element=filterByBoolMask_10.in)
code_block_86 = CodeBlock { "Basic Wall"; }
eq_16 = familyName_5 == code_block_86
filterByBoolMask_11 = List.FilterByBoolMask(list=filterByBoolMask_10.in, mask=eq_16)
element_taggedstatus_5 = Custom[Element TaggedStatus](element=filterByBoolMask_11.in)
code_block_87 = CodeBlock { "EST_A_WALL TAG_PLANTA"; }
byName_14 = Orchid.RevitProject.Elements.Family.ByName(name=code_block_87)
code_block_88 = CodeBlock { "Muro"; }
byFamilyAndName_5 = FamilyType.ByFamilyAndName(family=byName_14, name=code_block_88)
elementcentroid_5 = Custom[© ElementCentroid](element=element_taggedstatus_5.NotTagged)
activeView_10 = Orchid.RevitProject.Common.Document.ActiveView()
plane_4 = Custom[View.Plane](view=activeView_10)
normal_7 = Plane.Normal(plane=plane_4)
byOriginNormal_4 = Plane.ByOriginNormal(origin=elementcentroid_5, normal=normal_7)
normal_8 = Plane.Normal(plane=byOriginNormal_4)
location_4 = Custom[Element.Location+](element=element_taggedstatus_5.NotTagged)
code_block_89 = CodeBlock(x=location_4.curves)  # same code as code_block_11
direction_4 = Line.Direction(line=code_block_89.out1)
normalized_4 = Vector.Normalized(vector=direction_4)
code_block_90 = CodeBlock(p=normalized_4) { p.X; }
code_block_91 = CodeBlock { 2; }
round_10 = Math.Round(number=code_block_90, digits=code_block_91)
code_block_92 = CodeBlock { 0; }
le_4 = round_10 <= code_block_92
reverse_7 = Vector.Reverse(vector=normalized_4)
scopeIf_7 = Custom[ScopeIf+](test=le_4, True=reverse_7, False=normalized_4, lacing=Shortest)
code_block_93 = CodeBlock(p=scopeIf_7) { p.X; }
code_block_94 = CodeBlock { 2; }
round_11 = Math.Round(number=code_block_93, digits=code_block_94)
code_block_95 = CodeBlock { 0; }
eq_17 = round_11 == code_block_95
code_block_96 = CodeBlock(p=scopeIf_7) { p.Y; }
code_block_97 = CodeBlock { 2; }
round_12 = Math.Round(number=code_block_96, digits=code_block_97)
code_block_98 = CodeBlock { -1; }
eq_18 = round_12 == code_block_98
and_4 = eq_17 && eq_18
reverse_8 = Vector.Reverse(vector=scopeIf_7)
scopeIf_8 = Custom[ScopeIf+](test=and_4, True=scopeIf_7, False=reverse_8, lacing=Shortest)
code_block_99 = CodeBlock { null; }
replaceEmptyLists_8 = Custom[List.ReplaceEmptyLists](seq=scopeIf_8, Replacement=code_block_99)
ZAxis_4 = Vector.ZAxis()
code_block_100 = CodeBlock(x=replaceEmptyLists_8, y=ZAxis_4)  # same code as code_block_22
code_block_101 = CodeBlock { 90; }
rotate_4 = Vector.Rotate(vector=normal_8, axis=code_block_100.out2, degrees=code_block_101)
code_block_102 = CodeBlock(w=element_taggedstatus_5.NotTagged) { Orchid.WallType.Width(archilab.Walls.WallType(w))/2; }
translate_4 = Geometry.Translate(geometry=elementcentroid_5, direction=rotate_4, distance=code_block_102)
byElementAndLocation_5 = Orchid.RevitProject.Annotations.Tag.ByElementAndLocation(view=activeView_9, element=element_taggedstatus_5.NotTagged, tagType=byFamilyAndName_5, location=translate_4)

# group: Etiqueta Columna Hormigon
activeView_11 = Orchid.RevitProject.Common.Document.ActiveView()
code_block_103 = CodeBlock { "Structural Columns"; }
byName_15 = Category.ByName(name=code_block_103)
code_block_104 = CodeBlock(x=activeView) { x; }
all_elements_of_category_in_view_6 = ElementsOfCategoryInView(Category=byName_15, View=code_block_104)
viewLevel_2 = Custom[ViewLevel](View=code_block_104)
id_3 = Element.Id(element=viewLevel_2)
level_2 = Custom[Element.Level](element=all_elements_of_category_in_view_6)
id_4 = Element.Id(element=level_2)
eq_19 = id_3 == id_4  # lacing=Longest
filterByBoolMask_12 = List.FilterByBoolMask(list=all_elements_of_category_in_view_6, mask=eq_19)
getMaterials_5 = Element.GetMaterials(element=filterByBoolMask_12.in)
code_block_105 = CodeBlock { null; }
replaceEmptyLists_9 = Custom[List.ReplaceEmptyLists](seq=getMaterials_5, Replacement=code_block_105)
code_block_106 = CodeBlock { 0; }
getItemAtIndex_5 = List.GetItemAtIndex(list=replaceEmptyLists_9@L2, index=code_block_106)
code_block_107 = CodeBlock { "Steel"; }
byName_16 = Material.ByName(name=code_block_107)
code_block_108 = CodeBlock(x=getItemAtIndex_5, y=byName_16)  # same code as code_block_7
name_6 = Material.Name(material=code_block_108.out2)
code_block_109 = CodeBlock { "Concrete, Cast-in-Place gray"; }
eq_20 = name_6 == code_block_109
filterByBoolMask_13 = List.FilterByBoolMask(list=filterByBoolMask_12.in, mask=eq_20)
element_taggedstatus_6 = Custom[Element TaggedStatus](element=filterByBoolMask_13.in)
code_block_110 = CodeBlock { "EST_A_STRUCTURAL COLUMN TAG_PLANTA"; }
byName_17 = Orchid.RevitProject.Elements.Family.ByName(name=code_block_110)
code_block_111 = CodeBlock { "Pilar Hormigon Numerado"; }
byFamilyAndName_6 = FamilyType.ByFamilyAndName(family=byName_17, name=code_block_111)
geometry = Element.Geometry(element=element_taggedstatus_6.NotTagged)
flatten = List.Flatten(list=geometry)
elementcentroid_6 = Custom[© ElementCentroid](element=element_taggedstatus_6.NotTagged)
activeView_12 = Orchid.RevitProject.Common.Document.ActiveView()
plane_5 = Custom[View.Plane](view=activeView_12)
normal_9 = Plane.Normal(plane=plane_5)
byOriginNormal_5 = Plane.ByOriginNormal(origin=elementcentroid_6, normal=normal_9)
intersect = Geometry.Intersect(geometry=flatten, other=byOriginNormal_5)
flatten_2 = List.Flatten(list=intersect)
code_block_112 = CodeBlock { 1; }
pointAtParameter = Surface.PointAtParameter(surface=flatten_2, u=code_block_112)
byElementAndLocation_6 = Orchid.RevitProject.Annotations.Tag.ByElementAndLocation(view=activeView_11, element=element_taggedstatus_6.NotTagged, tagType=byFamilyAndName_6, location=pointAtParameter)

# group: Etiqueta Columna Metalica
activeView_13 = Orchid.RevitProject.Common.Document.ActiveView()
code_block_113 = CodeBlock { "Structural Columns"; }
byName_18 = Category.ByName(name=code_block_113)
code_block_114 = CodeBlock(x=activeView) { x; }
all_elements_of_category_in_view_7 = ElementsOfCategoryInView(Category=byName_18, View=code_block_114)
viewLevel_3 = Custom[ViewLevel](View=code_block_114)
id_5 = Element.Id(element=viewLevel_3)
level_3 = Custom[Element.Level](element=all_elements_of_category_in_view_7)
id_6 = Element.Id(element=level_3)
eq_21 = id_5 == id_6  # lacing=Longest
filterByBoolMask_14 = List.FilterByBoolMask(list=all_elements_of_category_in_view_7, mask=eq_21)
getMaterials_6 = Element.GetMaterials(element=filterByBoolMask_14.in)
code_block_115 = CodeBlock { null; }
replaceEmptyLists_10 = Custom[List.ReplaceEmptyLists](seq=getMaterials_6, Replacement=code_block_115)
code_block_116 = CodeBlock { 0; }
getItemAtIndex_6 = List.GetItemAtIndex(list=replaceEmptyLists_10@L2, index=code_block_116)
code_block_117 = CodeBlock { "Concrete, Cast-in-Place gray"; }
byName_19 = Material.ByName(name=code_block_117)
code_block_118 = CodeBlock(x=getItemAtIndex_6, y=byName_19)  # same code as code_block_7
name_7 = Material.Name(material=code_block_118.out2)
code_block_119 = CodeBlock { "Steel"; }
eq_22 = name_7 == code_block_119
filterByBoolMask_15 = List.FilterByBoolMask(list=filterByBoolMask_14.in, mask=eq_22)
element_taggedstatus_7 = Custom[Element TaggedStatus](element=filterByBoolMask_15.in)
code_block_120 = CodeBlock { "EST_A_STRUCTURAL COLUMN TAG_PLANTA"; }
byName_20 = Orchid.RevitProject.Elements.Family.ByName(name=code_block_120)
code_block_121 = CodeBlock { "Pilar Metalico Numerado"; }
byFamilyAndName_7 = FamilyType.ByFamilyAndName(family=byName_20, name=code_block_121)
geometry_2 = Element.Geometry(element=element_taggedstatus_7.NotTagged)
flatten_3 = List.Flatten(list=geometry_2)
elementcentroid_7 = Custom[© ElementCentroid](element=element_taggedstatus_7.NotTagged)
activeView_14 = Orchid.RevitProject.Common.Document.ActiveView()
plane_6 = Custom[View.Plane](view=activeView_14)
normal_10 = Plane.Normal(plane=plane_6)
byOriginNormal_6 = Plane.ByOriginNormal(origin=elementcentroid_7, normal=normal_10)
intersect_2 = Geometry.Intersect(geometry=flatten_3, other=byOriginNormal_6)
flatten_4 = List.Flatten(list=intersect_2)
code_block_122 = CodeBlock { 1; }
pointAtParameter_2 = Surface.PointAtParameter(surface=flatten_4, u=code_block_122)
byElementAndLocation_7 = Orchid.RevitProject.Annotations.Tag.ByElementAndLocation(view=activeView_13, element=element_taggedstatus_7.NotTagged, tagType=byFamilyAndName_7, location=pointAtParameter_2)
