# Dynamo graph plantaFundacion_script.dyn (Dynamo 2.3.1.11775)
# packages: Orchid 200.4.0.7938, Crumple 2022.2.13, Genius Loci 2020.8.3, Clockwork for Dynamo 2.x 2.4.0, WombatDynamo 2.3.4

activeView = Orchid.RevitProject.Common.Document.ActiveView()

# group: Etiqueta Viga de Fundación
activeView_2 = Orchid.RevitProject.Common.Document.ActiveView()
code_block = CodeBlock { "Structural Framing"; }
byName = Category.ByName(name=code_block)
code_block_2 = CodeBlock(x=activeView) { x; }
all_elements_of_category_in_view = ElementsOfCategoryInView(Category=byName, View=code_block_2)
familyName = Orchid.RevitProject.Elements.Element.FamilyName(element=all_elements_of_category_in_view)
code_block_3 = CodeBlock { "EST_M_STRUCTURAL FRAMING_VIGA FUNDACION"; }
eq = familyName == code_block_3
filterByBoolMask = List.FilterByBoolMask(list=all_elements_of_category_in_view, mask=eq)
getMaterials = Element.GetMaterials(element=filterByBoolMask.in)
code_block_4 = CodeBlock { null; }
replaceEmptyLists = Custom[List.ReplaceEmptyLists](seq=getMaterials, Replacement=code_block_4)  # package Clockwork for Dynamo 2.x; Replaces all empty lists within a given list with a substitute
code_block_5 = CodeBlock { 0; }
getItemAtIndex = List.GetItemAtIndex(list=replaceEmptyLists@L2, index=code_block_5)
code_block_6 = CodeBlock { "Steel"; }
byName_2 = Material.ByName(name=code_block_6)
code_block_7 = CodeBlock(x=getItemAtIndex, y=byName_2)
# ---------- code_block_7.designscript (14 lines) ----------
x;
y;

[Imperative]
{
	if(x[0] == null)
	{
		return = y;
	}
	else
	{
		return = x;
	}
};
# ----------------------------------------
name = Material.Name(material=code_block_7.out2)
code_block_8 = CodeBlock { "Concrete, Cast-in-Place gray"; }
eq_2 = name == code_block_8
filterByBoolMask_2 = List.FilterByBoolMask(list=filterByBoolMask.in, mask=eq_2)
element_taggedstatus = Custom[Element TaggedStatus](element=filterByBoolMask_2.in)  # package Genius Loci; Identify the tagged and untagged elements. Please note : This doesn't work with areas and spaces.
code_block_9 = CodeBlock { "EST_A_STRUCTURAL FRAMING TAG_PLANTA"; }
byName_3 = Orchid.RevitProject.Elements.Family.ByName(name=code_block_9)
code_block_10 = CodeBlock { "Tag Viga"; }
byFamilyAndName = FamilyType.ByFamilyAndName(family=byName_3, name=code_block_10)
elementcentroid = Custom[© ElementCentroid](element=element_taggedstatus.NotTagged)  # package Crumple; Returns the centroid of the element's axis-aligned bounding box.
activeView_3 = Orchid.RevitProject.Common.Document.ActiveView()
plane = Custom[View.Plane](view=activeView_3)  # package Clockwork for Dynamo 2.x; Retrieves the plane of a given view
normal = Plane.Normal(plane=plane)
byOriginNormal = Plane.ByOriginNormal(origin=elementcentroid, normal=normal)
normal_2 = Plane.Normal(plane=byOriginNormal)
location = Custom[Element.Location+](element=element_taggedstatus.NotTagged)  # package Clockwork for Dynamo 2.x; Returns the location of an element as point, curve or curve loop, along with some booleans to help filtering the results. Unlike the OOTB Element.GetLocation node, it also retunrs sketch lines of sketch-based elements like floor slabs as well as the element's rotation property.
code_block_11 = CodeBlock(x=location.curves)
# ---------- code_block_11.designscript (13 lines) ----------
x;

[Imperative]
{
	if(x == null)
	{
		return = [];
	}
	else
	{
		return = x;
	}
};
# ----------------------------------------
direction = Line.Direction(line=code_block_11.out1)
normalized = Vector.Normalized(vector=direction)
code_block_12 = CodeBlock(p=normalized) { p.X; }
code_block_13 = CodeBlock { 2; }
round = Math.Round(number=code_block_12, digits=code_block_13)
code_block_14 = CodeBlock { 0; }
le = round <= code_block_14
reverse = Vector.Reverse(vector=normalized)
scopeIf = Custom[ScopeIf+](test=le, True=reverse, False=normalized, lacing=Shortest)  # package Clockwork for Dynamo 2.x; A (hopefully) more robust implementation of ScopeIf. Tests a single boolean and returns a value accordingly.
code_block_15 = CodeBlock(p=scopeIf) { p.X; }
code_block_16 = CodeBlock { 2; }
round_2 = Math.Round(number=code_block_15, digits=code_block_16)
code_block_17 = CodeBlock { 0; }
eq_3 = round_2 == code_block_17
code_block_18 = CodeBlock(p=scopeIf) { p.Y; }
code_block_19 = CodeBlock { 2; }
round_3 = Math.Round(number=code_block_18, digits=code_block_19)
code_block_20 = CodeBlock { -1; }
eq_4 = round_3 == code_block_20
and_ = eq_3 && eq_4
reverse_2 = Vector.Reverse(vector=scopeIf)
scopeIf_2 = Custom[ScopeIf+](test=and_, True=scopeIf, False=reverse_2, lacing=Shortest)
code_block_21 = CodeBlock { null; }
replaceEmptyLists_2 = Custom[List.ReplaceEmptyLists](seq=scopeIf_2, Replacement=code_block_21)
ZAxis = Vector.ZAxis()
code_block_22 = CodeBlock(x=replaceEmptyLists_2, y=ZAxis)
# ---------- code_block_22.designscript (14 lines) ----------
x;
y;

[Imperative]
{
	if(x == null)
	{
		return = y;
	}
	else
	{
		return = x;
	}
};
# ----------------------------------------
code_block_23 = CodeBlock { 90; }
rotate = Vector.Rotate(vector=normal_2, axis=code_block_22.out2, degrees=code_block_23)
code_block_24 = CodeBlock(x=element_taggedstatus.NotTagged) { Revit.Elements.Element.GetParameterValueByName(Revit.Elements.Element.GetParameterValueByName(x,"Type"),"Width")/2; }
translate = Geometry.Translate(geometry=elementcentroid, direction=rotate, distance=code_block_24)
byElementAndLocation = Orchid.RevitProject.Annotations.Tag.ByElementAndLocation(view=activeView_2, element=element_taggedstatus.NotTagged, tagType=byFamilyAndName, location=translate)

# group: Etiqueta Radier
activeView_4 = Orchid.RevitProject.Common.Document.ActiveView()
code_block_25 = CodeBlock { "Floors"; }
byName_4 = Category.ByName(name=code_block_25)
code_block_26 = CodeBlock(x=activeView) { x; }
all_elements_of_category_in_view_2 = ElementsOfCategoryInView(Category=byName_4, View=code_block_26)
familyName_2 = Orchid.RevitProject.Elements.Element.FamilyName(element=all_elements_of_category_in_view_2)
code_block_27 = CodeBlock { "Floor"; }
eq_5 = familyName_2 == code_block_27
filterByBoolMask_3 = List.FilterByBoolMask(list=all_elements_of_category_in_view_2, mask=eq_5)
name_2 = Element.Name(element=filterByBoolMask_3.in)
code_block_28 = CodeBlock { "RADIER"; }
contains = String.Contains(str=name_2, searchFor=code_block_28)
filterByBoolMask_4 = List.FilterByBoolMask(list=filterByBoolMask_3.in, mask=contains)
getMaterials_2 = Element.GetMaterials(element=filterByBoolMask_4.in)
code_block_29 = CodeBlock { null; }
replaceEmptyLists_3 = Custom[List.ReplaceEmptyLists](seq=getMaterials_2, Replacement=code_block_29)
code_block_30 = CodeBlock { 0; }
getItemAtIndex_2 = List.GetItemAtIndex(list=replaceEmptyLists_3@L2, index=code_block_30)
code_block_31 = CodeBlock { "Steel"; }
byName_5 = Material.ByName(name=code_block_31)
code_block_32 = CodeBlock(x=getItemAtIndex_2, y=byName_5)  # same code as code_block_7
name_3 = Material.Name(material=code_block_32.out2)
code_block_33 = CodeBlock { "Concrete, Cast-in-Place gray"; }
eq_6 = name_3 == code_block_33
filterByBoolMask_5 = List.FilterByBoolMask(list=filterByBoolMask_4.in, mask=eq_6)
element_taggedstatus_2 = Custom[Element TaggedStatus](element=filterByBoolMask_5.in)
code_block_34 = CodeBlock { "EST_A_FLOOR TAG_PLANTA_RADIER"; }
byName_6 = Orchid.RevitProject.Elements.Family.ByName(name=code_block_34)
code_block_35 = CodeBlock { "Tope Radier y Nivel"; }
byFamilyAndName_2 = FamilyType.ByFamilyAndName(family=byName_6, name=code_block_35)
elementcentroid_2 = Custom[© ElementCentroid](element=element_taggedstatus_2.NotTagged)
byElementAndLocation_2 = Orchid.RevitProject.Annotations.Tag.ByElementAndLocation(view=activeView_4, element=element_taggedstatus_2.NotTagged, tagType=byFamilyAndName_2, location=elementcentroid_2)

# group: Etiqueta Sello y Numeracion Fundacion
activeView_5 = Orchid.RevitProject.Common.Document.ActiveView()
code_block_36 = CodeBlock { "Structural Foundations"; }
byName_7 = Category.ByName(name=code_block_36)
code_block_37 = CodeBlock(x=activeView) { x; }
all_elements_of_category_in_view_3 = ElementsOfCategoryInView(Category=byName_7, View=code_block_37)
familyName_3 = Orchid.RevitProject.Elements.Element.FamilyName(element=all_elements_of_category_in_view_3)
code_block_38 = CodeBlock { "EST_M_STRUCTURAL FOUNDATION_FUNDACION AISLADA"; }
eq_7 = familyName_3 == code_block_38
filterByBoolMask_6 = List.FilterByBoolMask(list=all_elements_of_category_in_view_3, mask=eq_7)
element_taggedstatus_3 = Custom[Element TaggedStatus](element=filterByBoolMask_6.in)
code_block_39 = CodeBlock(x=element_taggedstatus_3.NotTagged) { x; }
geometry = Element.Geometry(element=code_block_39)
flatten = List.Flatten(list=geometry)
explode = Geometry.Explode(geometry=flatten)
code_block_40 = CodeBlock { null; }
replaceEmptyLists_4 = Custom[List.ReplaceEmptyLists](seq=explode, Replacement=code_block_40)
code_block_41 = CodeBlock(x=replaceEmptyLists_4)
# ---------- code_block_41.designscript (13 lines) ----------
x;

[Imperative]
{
	if(x == null)
	{
		return = [null,null];
	}
	else
	{
		return = x;
	}
};
# ----------------------------------------
code_block_42 = CodeBlock { 1; }
getItemAtIndex_3 = List.GetItemAtIndex(list=code_block_41.out1@L2, index=code_block_42)
nullToEmptyList = WombatDynamo.List.NullToEmptyList(data=getItemAtIndex_3)
code_block_43 = CodeBlock { [0,1]; [0,0]; }
pointAtParameter = Surface.PointAtParameter(surface=nullToEmptyList@L1, u=code_block_43.out1@L2, v=code_block_43.out0@L2, lacing=Longest)
byElementAndLocation_3 = Tag.ByElementAndLocation(view=activeView_5, element=code_block_39, location=pointAtParameter, lacing=Longest)
transpose = List.Transpose(lists=byElementAndLocation_3)
code_block_44 = CodeBlock { null; }
replaceEmptyLists_5 = Custom[List.ReplaceEmptyLists](seq=transpose, Replacement=code_block_44)
code_block_45 = CodeBlock(x=replaceEmptyLists_5)
# ---------- code_block_45.designscript (13 lines) ----------
x;

[Imperative]
{
	if(x == null)
	{
		return = [];
	}
	else
	{
		return = x[0];
	}
};
# ----------------------------------------
code_block_46 = CodeBlock { "Type"; }
code_block_47 = CodeBlock { "EST_A_STRUCTURAL FOUNDATION TAG_PLANTA_SELLO FUNDACION"; }
byName_8 = Orchid.RevitProject.Elements.Family.ByName(name=code_block_47)
code_block_48 = CodeBlock { "Sello Fundacion"; }
byFamilyAndName_3 = FamilyType.ByFamilyAndName(family=byName_8, name=code_block_48)
setParameterByName = Element.SetParameterByName(element=code_block_45.out1, parameterName=code_block_46, value=byFamilyAndName_3)
code_block_49 = CodeBlock { null; }
replaceEmptyLists_6 = Custom[List.ReplaceEmptyLists](seq=transpose, Replacement=code_block_49)
code_block_50 = CodeBlock(x=replaceEmptyLists_6)
# ---------- code_block_50.designscript (13 lines) ----------
x;

[Imperative]
{
	if(x == null)
	{
		return = [];
	}
	else
	{
		return = x[1];
	}
};
# ----------------------------------------
code_block_51 = CodeBlock { "Type"; }
code_block_52 = CodeBlock { "EST_A_STRUCTURAL FOUNDATION TAG_PLANTA_TIPO FUNDACION"; }
byName_9 = Orchid.RevitProject.Elements.Family.ByName(name=code_block_52)
code_block_53 = CodeBlock { "Tipo Fundacion"; }
byFamilyAndName_4 = FamilyType.ByFamilyAndName(family=byName_9, name=code_block_53)
setParameterByName_2 = Element.SetParameterByName(element=code_block_50.out1, parameterName=code_block_51, value=byFamilyAndName_4)

# group: Etiqueta Sello Fundacion Corrida
activeView_6 = Orchid.RevitProject.Common.Document.ActiveView()
code_block_54 = CodeBlock { "Structural Foundations"; }
byName_10 = Category.ByName(name=code_block_54)
code_block_55 = CodeBlock(x=activeView) { x; }
all_elements_of_category_in_view_4 = ElementsOfCategoryInView(Category=byName_10, View=code_block_55)
kind = Custom[StructuralFoundation.Kind](structuralFoundation=all_elements_of_category_in_view_4)  # package Clockwork for Dynamo 2.x; Retrieves the kind of a given structural foundation (isolated, wall, slab).
code_block_56 = CodeBlock { "Wall Footing"; }
eq_8 = kind == code_block_56
filterByBoolMask_7 = List.FilterByBoolMask(list=all_elements_of_category_in_view_4, mask=eq_8)
element_taggedstatus_4 = Custom[Element TaggedStatus](element=filterByBoolMask_7.in)
code_block_57 = CodeBlock(x=element_taggedstatus_4.NotTagged) { x; }
code_block_58 = CodeBlock { "EST_A_STRUCTURAL FOUNDATION TAG_PLANTA_SELLO FUNDACION"; }
byName_11 = Orchid.RevitProject.Elements.Family.ByName(name=code_block_58)
code_block_59 = CodeBlock { "Sello Fundacion"; }
byFamilyAndName_5 = FamilyType.ByFamilyAndName(family=byName_11, name=code_block_59)
elementcentroid_3 = Custom[© ElementCentroid](element=code_block_57)
activeView_7 = Orchid.RevitProject.Common.Document.ActiveView()
plane_2 = Custom[View.Plane](view=activeView_7)
normal_3 = Plane.Normal(plane=plane_2)
byOriginNormal_2 = Plane.ByOriginNormal(origin=elementcentroid_3, normal=normal_3)
normal_4 = Plane.Normal(plane=byOriginNormal_2)
host = Custom[Element.Host+](element=code_block_57)  # package Clockwork for Dynamo 2.x; Gets an element's host. Unlike the OOTB node FamilyInstance.GetHost it not only works for family instances but also for elements like wall sweeps, foundations, railings, builing pads and topo subregions.
location_2 = Custom[Element.Location+](element=host)
code_block_60 = CodeBlock(x=location_2.curves)  # same code as code_block_11
direction_2 = Line.Direction(line=code_block_60.out1)
normalized_2 = Vector.Normalized(vector=direction_2)
code_block_61 = CodeBlock(p=normalized_2) { p.Y; }
code_block_62 = CodeBlock { 2; }
round_4 = Math.Round(number=code_block_61, digits=code_block_62)
code_block_63 = CodeBlock { 0; }
lt = round_4 < code_block_63
reverse_3 = Vector.Reverse(vector=normalized_2)
scopeIf_3 = Custom[ScopeIf+](test=lt, True=reverse_3, False=normalized_2, lacing=Shortest)
code_block_64 = CodeBlock(p=scopeIf_3) { p.X; }
code_block_65 = CodeBlock { 2; }
round_5 = Math.Round(number=code_block_64, digits=code_block_65)
code_block_66 = CodeBlock { 0; }
lt_2 = round_5 < code_block_66
reverse_4 = Vector.Reverse(vector=scopeIf_3)
scopeIf_4 = Custom[ScopeIf+](test=lt_2, True=reverse_4, False=scopeIf_3, lacing=Shortest)
code_block_67 = CodeBlock { null; }
replaceEmptyLists_7 = Custom[List.ReplaceEmptyLists](seq=scopeIf_4, Replacement=code_block_67)
ZAxis_2 = Vector.ZAxis()
code_block_68 = CodeBlock(x=replaceEmptyLists_7, y=ZAxis_2)  # same code as code_block_22
code_block_69 = CodeBlock { 90; }
rotate_2 = Vector.Rotate(vector=normal_4, axis=code_block_68.out2, degrees=code_block_69)
code_block_70 = CodeBlock(x=code_block_57) { Revit.Elements.Element.GetParameterValueByName(Revit.Elements.Element.GetParameterValueByName(x,"Type"),"Width")/2; }
translate_2 = Geometry.Translate(geometry=elementcentroid_3, direction=rotate_2, distance=code_block_70)
code_block_71 = CodeBlock(p=code_block_68.out2) { p.Y; }
code_block_72 = CodeBlock { 2; }
round_6 = Math.Round(number=code_block_71, digits=code_block_72)
python_script = Python(IN[0]=round_6)
# ---------- python_script.python (11 lines) ----------
lst = IN[0]

boolList = []

for l in lst:
	if l != 1:
		resultado = True		
	else:
		resultado = False
	boolList.append(resultado)
OUT = boolList
# ----------------------------------------
byElementAndLocation_4 = Orchid.RevitProject.Annotations.Tag.ByElementAndLocation(view=activeView_6, element=code_block_57, tagType=byFamilyAndName_5, location=translate_2, horizontal=python_script)
