# Dynamo graph updateBoundary_script.dyn (Dynamo 2.3.2.15696)
# packages: Clockwork for Dynamo 2.x 2.4.0, Orchid 200.4.0.7938, archi-lab.net 2022.210.2419

code_block = CodeBlock()
# ---------- code_block.designscript (4 lines) ----------
[
"Lines",
"Detail Items"
];
# ----------------------------------------
byName = Category.ByName(name=code_block)
activeView = Orchid.RevitProject.Common.Document.ActiveView()
all_elements_of_category_in_view = ElementsOfCategoryInView(Category=byName, View=activeView)
flatten = List.Flatten(list=all_elements_of_category_in_view)
name = Element.Name()  # unwired: element
code_block_2 = CodeBlock { "Line Style"; }
getParameterValueByName = Element.GetParameterValueByName(element=flatten, parameterName=code_block_2)
function_apply = ApplyFunction(func=name, arg1=getParameterValueByName)
code_block_3 = CodeBlock { "Wide Lines"; }
eq = function_apply == code_block_3
code_block_4 = CodeBlock { null; }
eq_2 = function_apply == code_block_4
or_ = eq || eq_2
filterByBoolMask = List.FilterByBoolMask(list=flatten, mask=or_)
delete = Element.Delete(element=filterByBoolMask.in)
code_block_5 = CodeBlock { null; }
replaceEmptyLists = Custom[List.ReplaceEmptyLists](seq=delete, Replacement=code_block_5)  # package Clockwork for Dynamo 2.x; Replaces all empty lists within a given list with a substitute
activeView_2 = Orchid.RevitProject.Common.Document.ActiveView()
code_block_6 = CodeBlock(x=replaceEmptyLists, y=activeView_2)
# ---------- code_block_6.designscript (13 lines) ----------
x;
y;
[Imperative]
{
	if(x == null)
	{
		return = [];
	}
	else
	{
		return = [y];
	}
};
# ----------------------------------------

# group: Redibujar Contorno
code_block_7 = CodeBlock { null; }
replaceEmptyLists_2 = Custom[List.ReplaceEmptyLists](seq=code_block_6.out2, Replacement=code_block_7)
code_block_8 = CodeBlock(x=replaceEmptyLists_2)
# ---------- code_block_8.designscript (13 lines) ----------
x;

[Imperative]
{
	if(x == null)
	{
		return = [];
	}
	else
	{
		return = x[0];
	}
};
# ----------------------------------------
plane = Custom[View.Plane](view=code_block_8.out1)  # package Clockwork for Dynamo 2.x; Retrieves the plane of a given view
normal = Plane.Normal(plane=plane)
code_block_9 = CodeBlock(t2=code_block_8.out1) { t1 = Revit.Elements.Element.GetParameterValueByName(t2, "Far Clip Offset"); t3 = t1 / 2; t4 = t3 * -1; }
translate = Geometry.Translate(geometry=plane, direction=normal, distance=code_block_9.t4)
byUnion = Solid.ByUnion()  # unwired: solids
code_block_10 = CodeBlock()
# ---------- code_block_10.designscript (6 lines) ----------
["Floors",
"Structural Framing",
"Walls",
"Structural Foundations",
"Structural Columns"
];
# ----------------------------------------
byName_2 = Category.ByName(name=code_block_10)
all_elements_of_category_in_view_2 = ElementsOfCategoryInView(Category=byName_2, View=code_block_8.out1)
flatten_2 = List.Flatten(list=all_elements_of_category_in_view_2)
solids = Element.Solids(element=flatten_2)
flatten_3 = List.Flatten(list=solids)
function_apply_2 = ApplyFunction(func=byUnion, arg1=flatten_3)
intersect = Geometry.Intersect(geometry=translate, other=function_apply_2)
perimeterCurves = Surface.PerimeterCurves(surface=intersect)
flatten_4 = List.Flatten(list=perimeterCurves)
byCurve = Custom[DetailCurve.ByCurve+](curve=flatten_4, view=code_block_8.out1)  # package Clockwork for Dynamo 2.x; Creates a detail line based on a given curve. Unlike the OOTB node it can also draw circles.
code_block_11 = CodeBlock { "Line Style"; }
code_block_12 = CodeBlock { "Wide Lines"; }
get_line_style_by_name = Custom[Get Line Style by Name](name=code_block_12)  # package archi-lab.net; This node will return a line style object by its name. Line styles can be either Drafting or Model Line Property.
setParameterByName = Element.SetParameterByName(element=byCurve, parameterName=code_block_11, value=get_line_style_by_name, lacing=Longest)

# group: Breaklines
code_block_13 = CodeBlock()
# ---------- code_block_13.designscript (3 lines) ----------
element1 = RevitProject.Document.ActiveView(null);
t1 = Revit.Elements.Element.GetParameterValueByName(element1, "Subclasificacion");
t2 = t1 == "03_VH";
# ----------------------------------------
byLoft = Surface.ByLoft()  # unwired: crossSections
translate_2 = Geometry.Translate(lacing=Longest)  # unwired: geometry, direction, distance
byJoinedCurves = PolyCurve.ByJoinedCurves()  # unwired: curves
code_block_14 = CodeBlock { null; }
replaceEmptyLists_3 = Custom[List.ReplaceEmptyLists](seq=code_block_6.out2, Replacement=code_block_14)
code_block_15 = CodeBlock(x=replaceEmptyLists_3)
# ---------- code_block_15.designscript (13 lines) ----------
x;

[Imperative]
{
	if(x == null)
	{
		return = [[],[]];
	}
	else
	{
		return = x;
	}
};
# ----------------------------------------
code_block_16 = CodeBlock(x=code_block_15.out1) { x[0]; }
getCropBox = Orchid.RevitProject.Views.View.GetCropBox(view=code_block_16)
function_apply_3 = ApplyFunction(func=byJoinedCurves, arg1=getCropBox.Curve)
code_block_17 = CodeBlock(x=function_apply_3)
# ---------- code_block_17.designscript (13 lines) ----------
x;

[Imperative]
{
	if(x == null)
	{
		return = [];
	}
	else
	{
		return = x;
	}
};
# ----------------------------------------
code_block_18 = CodeBlock { -690; false; }
offset = PolyCurve.Offset(polyCurve=code_block_17.out1, signedDistance=code_block_18.out0, extendCircular=code_block_18.out1)
plane_2 = Custom[View.Plane](view=code_block_16)
normal_2 = Plane.Normal(plane=plane_2)
reverse = Vector.Reverse(vector=normal_2)
list_create = List.Create(item0=normal_2, item1=reverse)
code_block_19 = CodeBlock { 1000; }
function_apply_4 = ApplyFunction(func=translate_2, arg1=offset, arg2=list_create, arg3=code_block_19)
function_apply_5 = ApplyFunction(func=byLoft, arg1=function_apply_4)
byUnion_2 = Solid.ByUnion()  # unwired: solids
code_block_20 = CodeBlock()
# ---------- code_block_20.designscript (6 lines) ----------
[
"Walls",
"Structural Columns",
"Structural Framing",
"Floors"
];
# ----------------------------------------
byName_3 = Category.ByName(name=code_block_20)
all_elements_of_category_in_view_3 = ElementsOfCategoryInView(Category=byName_3, View=code_block_16)
geometry = Element.Geometry(element=all_elements_of_category_in_view_3)
flatten_5 = List.Flatten(list=geometry)
function_apply_6 = ApplyFunction(func=byUnion_2, arg1=flatten_5)
code_block_21 = CodeBlock(x=function_apply_6)  # same code as code_block_17
intersect_2 = Geometry.Intersect(geometry=function_apply_5, other=code_block_21.out1)
code_block_22 = CodeBlock { [0.5,0.5]; [0,1]; }
pointAtParameter = Surface.PointAtParameter(surface=intersect_2@L1, u=code_block_22.out1@L2, v=code_block_22.out0@L2, lacing=Longest)
transpose = List.Transpose(lists=pointAtParameter)
code_block_23 = CodeBlock { null; }
replaceEmptyLists_4 = Custom[List.ReplaceEmptyLists](seq=transpose, Replacement=code_block_23)
code_block_24 = CodeBlock(x=replaceEmptyLists_4)  # same code as code_block_15
code_block_25 = CodeBlock(x=code_block_24.out1) { x[0]; x[1]; }
byStartPointEndPoint = Line.ByStartPointEndPoint(startPoint=code_block_25.out0, endPoint=code_block_25.out1)
reverse_2 = Curve.Reverse(curve=byStartPointEndPoint)
if_ = If(test=code_block_13.t2, true=byStartPointEndPoint, false=reverse_2)
code_block_26 = CodeBlock(x=code_block_15.out1) { x[0]; }
plane_3 = Custom[View.Plane](view=code_block_26)
pullOntoPlane = Curve.PullOntoPlane(curve=if_, plane=plane_3)
code_block_27 = CodeBlock { "EST_D_BREAKLINE"; }
byName_4 = FamilyType.ByName(name=code_block_27)
byCurve_2 = Custom[DetailComponent.ByCurve](curve=pullOntoPlane, familyType=byName_4, view=code_block_26, lacing=Longest)  # package Clockwork for Dynamo 2.x; Places a line-based detail component in a given view
code_block_28 = CodeBlock { "Length of masking region"; 900; }
setParameterByName_2 = Element.SetParameterByName(element=byCurve_2, parameterName=code_block_28.out0, value=code_block_28.out1)
