# Dynamo graph propagateExtents_script.dyn (Dynamo 2.3.1.11775)
# packages: Orchid 200.4.0.7938, archi-lab.net 2022.210.2419, Data-Shapes 2021.2.94

code_block = CodeBlock { "Grids"; }
byName = Category.ByName(name=code_block)
activeView = Orchid.RevitProject.Common.Document.ActiveView()
all_elements_of_category_in_view = ElementsOfCategoryInView(Category=byName, View=activeView)
activeView_2 = Orchid.RevitProject.Common.Document.ActiveView()
code_block_2 = CodeBlock { "Propagate Extents"; }
code_block_3 = CodeBlock()
# ---------- code_block_3.designscript (8 lines) ----------
//buttonTexxt
"INICIAR";
//cancelButton
"CANCELAR";
//maxHeight
800;
//width
500;
# ----------------------------------------
activeView_3 = Orchid.RevitProject.Common.Document.ActiveView()
viewType = archilab.Revit.Views.Views.ViewType(view=activeView_3)
getByType = archilab.Revit.Views.Views.GetByType(viewType=viewType)
code_block_4 = CodeBlock { "Subclasificacion"; }
getParameterValueByName = Element.GetParameterValueByName(element=getByType, parameterName=code_block_4)
code_block_5 = CodeBlock { "Subclasificacion"; }
getParameterValueByName_2 = Element.GetParameterValueByName(element=activeView_3, parameterName=code_block_5)
eq = getParameterValueByName == getParameterValueByName_2
filterByBoolMask = List.FilterByBoolMask(list=getByType, mask=eq)
name = Element.Name(element=activeView_3)
name_2 = Element.Name(element=filterByBoolMask.in)
eq_2 = name == name_2
filterByBoolMask_2 = List.FilterByBoolMask(list=filterByBoolMask.in, mask=eq_2)
code_block_6 = CodeBlock { "Subclasificacion"; }
getParameterValueByName_3 = Element.GetParameterValueByName(element=filterByBoolMask_2.out, parameterName=code_block_6)
uniqueItems = List.UniqueItems(list=getParameterValueByName_3)
name_3 = Element.Name(element=filterByBoolMask_2.out)
code_block_7 = CodeBlock()
# ---------- code_block_7.designscript (8 lines) ----------
//hight
480;
//elemCount
true;
//sort
false;
//iD
false;
# ----------------------------------------
listview_data = Custom[Listview Data](Keys=name_3, Values=filterByBoolMask_2.out, Height_optionnal=code_block_7.out0, ShowElementCount_optionnal=code_block_7.out1, SortItems_optionnal=code_block_7.out2, ShowId_optionnal=code_block_7.out3)  # package Data-Shapes; Create data for ListView input in UI.MultiInputForm ++ . Check out www.data-shapes.net for more infos.
inputgroup_data = Custom[InputGroup Data](GroupTitle=uniqueItems, Inputs=listview_data)  # package Data-Shapes; Creates a group of inputs for UI.MultipleInputForm ++ . Check out www.data-shapes.net for more infos !
boolean = BoolSelector(true)
multipleinputform = Custom[MultipleInputForm ++](Description_optional=code_block_2, ButtonText_optional=code_block_3.out0, Inputs=inputgroup_data, Toggle=boolean, CancelButtonText_optional=code_block_3.out1, Width_optional=code_block_3.out3)  # package Data-Shapes; Create a form with multiple inputs. see www.data-shapes.net for tutorials and infos!
code_block_8 = CodeBlock(x=multipleinputform.User_Inputs)
# ---------- code_block_8.designscript (12 lines) ----------
x;
[Imperative]
{
	if(x == null)
		{
		return = [];
		}
	else
		{
		return = DSCore.List.Flatten(x,1);
		}
};
# ----------------------------------------
setPropagationView = Orchid.RevitProject.Datums.Datum.SetPropagationView(element=all_elements_of_category_in_view@L2, view=activeView_2@L1, target=code_block_8.out1@L1, lacing=Longest)
