# Dynamo graph script.dyn (Dynamo 2.3.2.15696)
# packages: Clockwork for Dynamo 2.x 2.4.0, Orchid 200.4.0.7938

activeView = Orchid.RevitProject.Common.Document.ActiveView()

# group: Breaklines
byLoft = Surface.ByLoft()  # unwired: crossSections
translate = Geometry.Translate(lacing=Longest)  # unwired: geometry, direction, distance
byJoinedCurves = PolyCurve.ByJoinedCurves()  # unwired: curves
code_block = CodeBlock(x=activeView) { x; }
code_block_2 = CodeBlock(x=code_block) { x; }
getCropBox = Orchid.RevitProject.Views.View.GetCropBox(view=code_block_2)
function_apply = ApplyFunction(func=byJoinedCurves, arg1=getCropBox.Curve)
code_block_3 = CodeBlock(x=function_apply)
# ---------- code_block_3.designscript (13 lines) ----------
x;

[Imperative]
{
	if(x == null)
	{
		return = [];
	}
	else
	{
		return = x;
	}
};
# ----------------------------------------
code_block_4 = CodeBlock { -290; false; }
offset = PolyCurve.Offset(polyCurve=code_block_3.out1, signedDistance=code_block_4.out0, extendCircular=code_block_4.out1)
plane = Custom[View.Plane](view=code_block_2)  # package Clockwork for Dynamo 2.x; Retrieves the plane of a given view
normal = Plane.Normal(plane=plane)
reverse = Vector.Reverse(vector=normal)
list_create = List.Create(item0=normal, item1=reverse)
code_block_5 = CodeBlock { 1000; }
function_apply_2 = ApplyFunction(func=translate, arg1=offset, arg2=list_create, arg3=code_block_5)
function_apply_3 = ApplyFunction(func=byLoft, arg1=function_apply_2)
byUnion = Solid.ByUnion()  # unwired: solids
code_block_6 = CodeBlock()
# ---------- code_block_6.designscript (7 lines) ----------
[
"Walls",
"Structural Columns",
"Structural Framing",
"Floors",
"Structural Foundations"
];
# ----------------------------------------
byName = Category.ByName(name=code_block_6)
all_elements_of_category_in_view = ElementsOfCategoryInView(Category=byName, View=code_block_2)
geometry = Element.Geometry(element=all_elements_of_category_in_view)
flatten = List.Flatten(list=geometry)
function_apply_4 = ApplyFunction(func=byUnion, arg1=flatten)
code_block_7 = CodeBlock(x=function_apply_4)  # same code as code_block_3
intersect = Geometry.Intersect(geometry=function_apply_3, other=code_block_7.out1)
code_block_8 = CodeBlock { [0.5,0.5]; [0,1]; }
pointAtParameter = Surface.PointAtParameter(surface=intersect@L1, u=code_block_8.out1@L2, v=code_block_8.out0@L2, lacing=Longest)
transpose = List.Transpose(lists=pointAtParameter)
code_block_9 = CodeBlock { null; }
replaceEmptyLists = Custom[List.ReplaceEmptyLists](seq=transpose, Replacement=code_block_9)  # package Clockwork for Dynamo 2.x; Replaces all empty lists within a given list with a substitute
code_block_10 = CodeBlock(x=replaceEmptyLists)
# ---------- code_block_10.designscript (13 lines) ----------
x;

[Imperative]
{
	if(x == null)
	{
		return = [[],[]];
	}
	else
	{
		return = x;
	}
};
# ----------------------------------------
code_block_11 = CodeBlock(x=code_block_10.out1) { x[0]; x[1]; }
byStartPointEndPoint = Line.ByStartPointEndPoint(startPoint=code_block_11.out0, endPoint=code_block_11.out1)
reverse_2 = Curve.Reverse(curve=byStartPointEndPoint)
code_block_12 = CodeBlock(x=code_block) { x; }
plane_2 = Custom[View.Plane](view=code_block_12)
pullOntoPlane = Curve.PullOntoPlane(curve=reverse_2, plane=plane_2)
code_block_13 = CodeBlock { "EST_D_BREAKLINE"; }
byName_2 = FamilyType.ByName(name=code_block_13)
byCurve = Custom[DetailComponent.ByCurve](curve=pullOntoPlane, familyType=byName_2, view=code_block_12, lacing=Longest)  # package Clockwork for Dynamo 2.x; Places a line-based detail component in a given view
code_block_14 = CodeBlock { "Length of masking region"; 900; }
setParameterByName = Element.SetParameterByName(element=byCurve, parameterName=code_block_14.out0, value=code_block_14.out1)
code_block_15 = CodeBlock(x=code_block) { x; }
plane_3 = Custom[View.Plane](view=code_block_15)
normal_2 = Plane.Normal(plane=plane_3)
X = Vector.X(vector=normal_2)
byPatch = Surface.ByPatch(closedCurve=offset)
code_block_16 = CodeBlock { 0.5; }
normalAtParameter = Surface.NormalAtParameter(surface=byPatch, u=code_block_16, v=code_block_16)
X_2 = Vector.X(vector=normalAtParameter)
eq = X == X_2
