# Dynamo graph script.dyn "Buscar y Seleccionar Eje" (Dynamo 2.3.1.11775)
# packages: Data-Shapes 2022.2.96, Clockwork for Dynamo 2.x 2.3.0

code_block = CodeBlock { "Busca un Eje"; }
file_path = Filename("B:\02_INSTALADORES\01_DYNAMO\06_USER SETTINGS ORKESTRA\01_IMAGENES\editable Arainco-cmyk-01.png")
code_block_2 = CodeBlock { "INICIAR"; "CANCELAR"; 850; }
code_block_3 = CodeBlock { "Selecciona un Texto"; }
code_block_4 = CodeBlock { "Grids"; }
byName = Category.ByName(name=code_block_4)
all_elements_of_category = ElementsOfCategory(Category=byName)
name = Element.Name(element=all_elements_of_category)
radiobuttons_data = Custom[RadioButtons Data](InputName=code_block_3, Keys=name, Values=all_elements_of_category)  # package Data-Shapes; Create radio buttons input for UI.MultipleInputForm ++ .
boolean = BoolSelector(true)
multipleinputform = Custom[MultipleInputForm ++](Description_optional=code_block, Logo_optional=file_path, ButtonText_optional=code_block_2.out0, Inputs=radiobuttons_data, Toggle=boolean, CancelButtonText_optional=code_block_2.out1, MaxHeight_optional=code_block_2.out2)  # package Data-Shapes; Create a form with multiple inputs. see www.data-shapes.net for tutorials and infos!
empty = List.Empty()
scopeIf = Custom[ScopeIf+](test=multipleinputform.Was_Cancelled, True=empty, False=multipleinputform.User_Inputs)  # package Clockwork for Dynamo 2.x; A (hopefully) more robust implementation of ScopeIf. Tests a single boolean and returns a value accordingly.
python_script = Python(IN[0]=scopeIf)
# ---------- python_script.python (25 lines) ----------
import clr

clr.AddReference('RevitAPI')
from Autodesk.Revit.DB import *

clr.AddReference("RevitServices")
import RevitServices
from RevitServices.Persistence import DocumentManager

from System.Collections.Generic import *

uidoc = DocumentManager.Instance.CurrentUIApplication.ActiveUIDocument

def select(items):
    if isinstance(items, type(None)): # Select none
        items = []
    elif not hasattr(items, "__iter__"): # Check if single element
        items = [items]
        
    ids = List[ElementId](i.Id for i in items)
    uidoc.Selection.SetElementIds(ids)
    return "Success"
    
    
OUT = select(UnwrapElement(IN[0]))
# ----------------------------------------
