# Dynamo graph exportarFamilias_script.dyn (Dynamo 2.3.1.11775)
# packages: Orchid 200.4.0.7938, Data-Shapes 2022.2.96, Clockwork for Dynamo 2.x 2.3.0

all = Orchid.RevitProject.Elements.Family.All()
string_from_object = FromObject(obj=all.Category)
code_block = CodeBlock()
# ---------- code_block.designscript (20 lines) ----------
[
"Detail Items",
"Spot Elevation Symbols",
"View Reference",
"View Titles",
"Structural Framing",
"Generic Annotations",
"Structural Column Tags",
"Structural Foundation Tags",
"Structural Columns",
"Title Blocks",
"Grid Heads",
"Floor Tags",
"Level Heads",
"Detail Item Tags",
"Wall Tags",
"Structural Framing Tags",
"Structural Column Tags",
"Structural Foundations"
];
# ----------------------------------------
eq = string_from_object@L1 == code_block@L2  # lacing=Longest
anyTrue = Orchid.Common.List.AnyTrue(list=eq)
filterByBoolMask = List.FilterByBoolMask(list=all.Family, mask=anyTrue)
flatten = List.Flatten(list=filterByBoolMask.in)
code_block_2 = CodeBlock { "Exporta Multiples Familias"; }
code_block_3 = CodeBlock()
# ---------- code_block_3.designscript (6 lines) ----------
"INICIAR";
"CANCELAR";
//Label
150;
//Width
430;
# ----------------------------------------
code_block_4 = CodeBlock { "Selecciona la Carpeta\nde Destino"; }
code_block_5 = CodeBlock { "SELECCIONAR"; }
directorypath_data = Custom[DirectoryPath Data](InputName=code_block_4, ButtonText=code_block_5)  # package Data-Shapes; Creates a DirectoryPath input for UI.MultipleInputForm ++ . Check out www.data-shapes.net for more infos!
boolean = BoolSelector(true)
multipleinputform = Custom[MultipleInputForm ++](Description_optional=code_block_2, ButtonText_optional=code_block_3.out0, Inputs=directorypath_data, Toggle=boolean, CancelButtonText_optional=code_block_3.out1, Width_optional=code_block_3.out3, LabelWidth_optional=code_block_3.out2)  # package Data-Shapes; Create a form with multiple inputs. see www.data-shapes.net for tutorials and infos!
empty = List.Empty()
scopeIf = Custom[ScopeIf+](test=multipleinputform.Was_Cancelled, True=empty, False=multipleinputform.User_Inputs)  # package Clockwork for Dynamo 2.x; A (hopefully) more robust implementation of ScopeIf. Tests a single boolean and returns a value accordingly.
save = Orchid.RevitProject.Elements.Family.Save(family=flatten@L1, path=scopeIf@L1, lacing=Longest)
