# Dynamo graph importarFamilias_script.dyn (Dynamo 2.3.1.11775)
# packages: Orchid 204.1.4.7501, Data-Shapes 2021.2.93

code_block = CodeBlock { "Cargar Multiples Familias"; }
code_block_2 = CodeBlock()
# ---------- code_block_2.designscript (6 lines) ----------
"INICIAR";
"CANCELAR";
//Label
140;
//Width
430;
# ----------------------------------------
code_block_3 = CodeBlock { "Selecciona Carpeta Contenedora"; }
code_block_4 = CodeBlock { "SELECCIONAR"; }
directorypath_data = Custom[DirectoryPath Data](InputName=code_block_3, ButtonText=code_block_4)  # package Data-Shapes; Creates a DirectoryPath input for UI.MultipleInputForm ++ . Check out www.data-shapes.net for more infos!
boolean = BoolSelector(true)
multipleinputform = Custom[MultipleInputForm ++](Description_optional=code_block, ButtonText_optional=code_block_2.out0, Inputs=directorypath_data, Toggle=boolean, CancelButtonText_optional=code_block_2.out1, Width_optional=code_block_2.out3, LabelWidth_optional=code_block_2.out2)  # package Data-Shapes; Create a form with multiple inputs. see www.data-shapes.net for tutorials and infos!
code_block_5 = CodeBlock(l=multipleinputform.User_Inputs)
# ---------- code_block_5.designscript (12 lines) ----------
l;
[Imperative]
{
	if (l == null)
		{
		return = [];
		}
	else
		{
		return = l;
		}
};
# ----------------------------------------
fromPath = Orchid.Common.Directory.FromPath(path=code_block_5.out1)
code_block_6 = CodeBlock { "*.rfa"; }
contents = Orchid.Common.Directory.Contents(directory=fromPath, searchString=code_block_6)
loadFamily = Orchid.RevitProject.Common.Document.LoadFamily(family=contents)
