# Dynamo graph script.dyn (Dynamo 2.3.2.15696)
# packages: Rhythm 2020.7.25, Crumple 2022.2.13

code_block = CodeBlock { "Area de la Cara"; }
select_face = DSFaceSelection()  # nothing selected; graph input
area = Surface.Area(surface=select_face)
ceiling = Math.Ceiling(number=area)
convert_between_units = DynamoConvert(ceiling, MeasurementType="Area", FromConversion="SquareMillimeter", ToConversion="SquareMeter")
code_block_2 = CodeBlock { 3; }
roundtostring = Custom[© RoundToString](numbers=convert_between_units, digits=code_block_2)  # package Crumple; Given a list of numbers with decimal places, round them to a specific length and convert that to a string. More reliable than String.ToObject.
code_block_3 = CodeBlock(a=roundtostring) { a+" m²"; }
ʳʰʸᵗʰᵐ_helpers_simpleusermessage = Rhythm.Revit.Helpers.Helpers.SimpleUserMessage(caption=code_block, message=code_block_3)
