# Dynamo graph PlantasES_script.dyn (Dynamo 2.3.1.11775)
# packages: Data-Shapes 2022.2.96, WombatDynamo 2.3.4, Orchid 200.4.0.7938, Data-Shapes 2021.2.94, Clockwork for Dynamo 2.x 2.4.0, Genius Loci 2020.8.3, archi-lab.net 2022.210.2419

code_block = CodeBlock { "Plantas Escalera - ES"; }
code_block_2 = CodeBlock { "OK"; 450; }
code_block_3 = CodeBlock { "Error"; }
code_block_4 = CodeBlock { "Las vistas de esta Escalera ya fueron generadas. Para vistas adicionales, duplicar de las ya existentes."; }
textnote_data = Custom[TextNote Data](Title=code_block_3, TextNote=code_block_4)  # package Data-Shapes; Create Data for TextNote input in UI.MultipleInputForm ++ . Check out www.data-shapes.net for more informations
all = Orchid.RevitProject.Views.View.All()
code_block_5 = CodeBlock { "Subclasificacion"; }
getParameterValueByName = Element.GetParameterValueByName(element=all, parameterName=code_block_5)
code_block_6 = CodeBlock { "06_ES"; }
eq = getParameterValueByName == code_block_6
filterByBoolMask = List.FilterByBoolMask(list=all, mask=eq)
code_block_7 = CodeBlock { "Plantas Escalera - ES"; }
code_block_8 = CodeBlock()
# ---------- code_block_8.designscript (6 lines) ----------
"INICIAR";
"CANCELAR";
//Label
120;
//Width
450;
# ----------------------------------------
code_block_9 = CodeBlock { "Niveles:"; }
code_block_10 = CodeBlock { "Levels"; }
byName = Category.ByName(name=code_block_10)
all_elements_of_category = ElementsOfCategory(Category=byName)
elevation = Level.Elevation(level=all_elements_of_category)
sortByKey = List.SortByKey(list=all_elements_of_category, keys=elevation)
code_block_11 = CodeBlock { "Building Story"; }
getParameterValueByName_2 = Element.GetParameterValueByName(element=sortByKey.sorted_list, parameterName=code_block_11)
code_block_12 = CodeBlock { 1; }
eq_2 = getParameterValueByName_2 == code_block_12
filterByBoolMask_2 = List.FilterByBoolMask(list=sortByKey.sorted_list, mask=eq_2)
name = Element.Name(element=filterByBoolMask_2.in)
code_block_13 = CodeBlock()
# ---------- code_block_13.designscript (8 lines) ----------
//Height
360;
//elemCount
true;
//sort
false;
//id
false;
# ----------------------------------------
code_block_14 = CodeBlock(l=name) { count = DSCore.List.Count(l) - 1; 0..count..1; }
listview_data = Custom[Listview Data](InputName=code_block_9, Keys=name, Values=filterByBoolMask_2.in, Height_optionnal=code_block_13.out0, ShowElementCount_optionnal=code_block_13.out1, DefaultValueIndices_optionnal=code_block_14.out1, SortItems_optionnal=code_block_13.out2, ShowId_optionnal=code_block_13.out3)  # package Data-Shapes; Create data for ListView input in UI.MultiInputForm ++ . Check out www.data-shapes.net for more infos.
code_block_15 = CodeBlock { "Escala:"; }
code_block_16 = CodeBlock()
# ---------- code_block_16.designscript (10 lines) ----------
[
"1:50",
"1:75",
"1:100",
"1:125",
"1:150",
"1:175",
"1:200"
];
":";
# ----------------------------------------
split = String.Split(str=code_block_16.out0, separator0=code_block_16.out1)
code_block_17 = CodeBlock { 1; }
getItemAtIndex = List.GetItemAtIndex(list=split@L2, index=code_block_17)
toNumber = String.ToNumber(str=getItemAtIndex)
code_block_18 = CodeBlock { 0; false; }
dropdown_data = Custom[DropDown Data](InputName=code_block_15, Keys=code_block_16.out0, Values=toNumber, DefaultValueIndex=code_block_18.out0, Sorted_optional=code_block_18.out1)  # package Data-Shapes; Create data for DropDown input in UI.MultiInputForm ++ . Check out www.data-shapes.net for more infos.
code_block_19 = CodeBlock { "Nombre Escalera:"; "Ejemplo, ESC-01"; }
textbox_data = Custom[TextBox Data](InputName=code_block_19.out0, DefaultText=code_block_19.out1)  # package Data-Shapes; Create Data for TextBox input in UI.MultipleInputForm ++ . Check out www.data-shapes.net for more informations
code_block_20 = CodeBlock()
# ---------- code_block_20.designscript (2 lines) ----------
"Importante:";
"El nombre o numeración de la Escalera debe ser único. Si ya existe, por ejemplo, la escalera ESC-01, usar un nombre o numeración diferente.";
# ----------------------------------------
textnote_data_2 = Custom[TextNote Data](Title=code_block_20.out0, TextNote=code_block_20.out1)
list_create = List.Create(item0=textbox_data, item1=textnote_data_2)
inputgroup_data = Custom[InputGroup Data](Inputs=list_create)  # package Data-Shapes; Creates a group of inputs for UI.MultipleInputForm ++ . Check out www.data-shapes.net for more infos !
list_create_2 = List.Create(item0=listview_data, item1=dropdown_data, item2=inputgroup_data)
boolean = BoolSelector(true)
multipleinputform = Custom[MultipleInputForm ++](Description_optional=code_block_7, ButtonText_optional=code_block_8.out0, Inputs=list_create_2, Toggle=boolean, CancelButtonText_optional=code_block_8.out1, Width_optional=code_block_8.out3, LabelWidth_optional=code_block_8.out2)  # package Data-Shapes; Create a form with multiple inputs. see www.data-shapes.net for tutorials and infos!
code_block_21 = CodeBlock(l=multipleinputform.User_Inputs)
# ---------- code_block_21.designscript (12 lines) ----------
l;
[Imperative]
{
	if (l == null)
		{
		return = [[],[],[]];
		}
	else
		{
		return = l;
		}
};
# ----------------------------------------
code_block_22 = CodeBlock(l=code_block_21.out1) { DSCore.String.ToUpper(DSCore.List.Flatten(([l[2]]),1)); }
code_block_23 = CodeBlock { "Zona"; }
getParameterValueByName_3 = Element.GetParameterValueByName(element=filterByBoolMask.in, parameterName=code_block_23)
uniqueItems = List.UniqueItems(list=getParameterValueByName_3)
eq_3 = code_block_22 == uniqueItems
filterByBoolMask_3 = List.FilterByBoolMask(list=filterByBoolMask.in, mask=eq_3)
code_block_24 = CodeBlock { null; }
replaceEmptyLists = Custom[List.ReplaceEmptyLists](seq=filterByBoolMask_3.in, Replacement=code_block_24)  # package Clockwork for Dynamo 2.x; Replaces all empty lists within a given list with a substitute
isNull = Object.IsNull(obj=replaceEmptyLists)
code_block_25 = CodeBlock { true; false; }
scopeIf = Custom[ScopeIf+](test=isNull, True=code_block_25.out1, False=code_block_25.out0)  # package Clockwork for Dynamo 2.x; A (hopefully) more robust implementation of ScopeIf. Tests a single boolean and returns a value accordingly.
multipleinputform_2 = Custom[MultipleInputForm ++](Description_optional=code_block, ButtonText_optional=code_block_2.out0, Inputs=textnote_data, Toggle=scopeIf, Width_optional=code_block_2.out1)
code_block_26 = CodeBlock { "Building Section"; }
byName_2 = Orchid.RevitProject.Views.ViewType.ByName(name=code_block_26)
code_block_27 = CodeBlock(l=replaceEmptyLists, lst=code_block_21.out1)
# ---------- code_block_27.designscript (14 lines) ----------
l;
lst;

[Imperative]
{
	if (l == null)
		{
		return = lst;
		}
	else
		{
		return = [[],[],[]];
		}
};
# ----------------------------------------
code_block_28 = CodeBlock(l=code_block_27.out2) { DSCore.List.Flatten(([l[0]]),1); }
nullToEmptyList = WombatDynamo.List.NullToEmptyList(data=code_block_28)
byLevel = StructuralPlanView.ByLevel(level=nullToEmptyList)
code_block_29 = CodeBlock { "Zona"; }
code_block_30 = CodeBlock(l=code_block_27.out2) { DSCore.String.ToUpper(DSCore.List.Flatten(([l[2]]),1)); }
setParameterByName = Element.SetParameterByName(element=byLevel, parameterName=code_block_29, value=code_block_30, lacing=Longest)
code_block_31 = CodeBlock { "Structural Plan (Piso)"; "Type"; }
byName_3 = Orchid.RevitProject.Views.ViewType.ByName(name=code_block_31.out0)
setParameterByName_2 = Element.SetParameterByName(element=setParameterByName, parameterName=code_block_31.out1, value=byName_3)
code_block_32 = CodeBlock(l=code_block_27.out2) { DSCore.List.Flatten(([l[1]]),1); }
nullToEmptyList_2 = WombatDynamo.List.NullToEmptyList(data=code_block_32)
setScale = View.SetScale(view=setParameterByName_2, scale=nullToEmptyList_2, lacing=Longest)
code_block_33 = CodeBlock { null; }
replaceEmptyLists_2 = Custom[List.ReplaceEmptyLists](seq=setScale, Replacement=code_block_33)
all_2 = Orchid.RevitProject.Views.ViewTemplate.All()
name_2 = Element.Name(element=all_2)
code_block_34 = CodeBlock { "Structural Foundation Plan"; }
eq_4 = name_2 == code_block_34
filterByBoolMask_4 = List.FilterByBoolMask(list=all_2, mask=eq_4)
code_block_35 = CodeBlock(x=replaceEmptyLists_2, y=filterByBoolMask_4.in)
# ---------- code_block_35.designscript (14 lines) ----------
x;
y;

[Imperative]
{
	if (x == null)
		{
		return = [];
		}
	else
		{
		return = y;
		}
};
# ----------------------------------------
code_block_36 = CodeBlock(x=setScale) { esc = DSCore.List.UniqueItems(x.GetParameterValueByName("Zona")); "01_ENTREGABLE_06_ES_STRUCTURAL PLAN (PISO)_"+esc; }
duplicate = Orchid.RevitProject.Views.ViewTemplate.Duplicate(viewTemplate=code_block_35.out2, name=code_block_36.out1)
code_block_37 = CodeBlock(esc=code_block_36.esc)
# ---------- code_block_37.designscript (13 lines) ----------
DSCore.List.Flatten(
[
"Clasificacion",
"Subclasificacion",
"Zona"
]);

DSCore.List.Flatten(
[
"01_ENTREGABLE",
"06_ES",
esc
]);
# ----------------------------------------
setParameterByName_3 = Element.SetParameterByName(element=duplicate, parameterName=code_block_37.out0, value=code_block_37.out1, lacing=Longest)
uniqueItems_2 = List.UniqueItems(list=setParameterByName_3)
code_block_38 = CodeBlock { null; }
replaceEmptyLists_3 = Custom[List.ReplaceEmptyLists](seq=uniqueItems_2, Replacement=code_block_38)
code_block_39 = CodeBlock { null; }
replaceEmptyLists_4 = Custom[List.ReplaceEmptyLists](seq=setParameterByName_3, Replacement=code_block_39)
code_block_40 = CodeBlock(x=replaceEmptyLists_4)
# ---------- code_block_40.designscript (13 lines) ----------
x;

[Imperative]
{
	if (x == null)
		{
		return = [[]];
		}
	else
		{
		return = x;
		}
};
# ----------------------------------------
code_block_41 = CodeBlock(a=code_block_40.out1) { esc = DSCore.List.UniqueItems(a.GetParameterValueByName("Zona"))[0]; "Zona"; "NotEquals"; esc; "06_ES_"+esc; }
code_block_42 = CodeBlock(x=replaceEmptyLists_3, y=code_block_41.out4)  # same code as code_block_35
create = Orchid.RevitProject.Filters.FilterRule.Create(parameter=code_block_41.out1, ruleType=code_block_41.out2, value=code_block_41.out3)
code_block_43 = CodeBlock { "Sections"; }
byName_4 = Category.ByName(name=code_block_43)
byRule = Orchid.RevitProject.Filters.ParameterFilter.ByRule(name=code_block_42.out2@L1, filterRule=create@L2, category=byName_4@L1, lacing=Longest)
code_block_44 = CodeBlock { false; }
addFilter = Orchid.RevitProject.Views.View.AddFilter(view=uniqueItems_2, parameterFilter=byRule, visibility=code_block_44, lacing=Longest)
set = Orchid.RevitProject.Views.ViewTemplate.Set(view=setScale, viewTemplate=addFilter, lacing=Longest)
code_block_45 = CodeBlock { "View Name"; }
identity = Object.Identity(obj=set)
code_block_46 = CodeBlock()
# ---------- code_block_46.designscript (4 lines) ----------
[
"Type",
"Subclasificacion"
];
# ----------------------------------------
getParameterValueByName_4 = Element.GetParameterValueByName(element=identity@L1, parameterName=code_block_46@L2, lacing=Longest)
code_block_47 = CodeBlock { null; }
replaceEmptyLists_5 = Custom[List.ReplaceEmptyLists](seq=getParameterValueByName_4, Replacement=code_block_47)
code_block_48 = CodeBlock(x=replaceEmptyLists_5, y=getParameterValueByName_4)
# ---------- code_block_48.designscript (14 lines) ----------
x;
y;

[Imperative]
{
	if (x == null)
		{
		return = [null,null];
		}
	else
		{
		return = y;
		}
};
# ----------------------------------------
code_block_49 = CodeBlock { 1; }
getItemAtIndex_2 = List.GetItemAtIndex(list=code_block_48.out2@L2, index=code_block_49)
code_block_50 = CodeBlock { "_"; }
code_block_51 = CodeBlock { 0; }
getItemAtIndex_3 = List.GetItemAtIndex(list=code_block_48.out2@L2, index=code_block_51)
nullToEmptyList_3 = WombatDynamo.List.NullToEmptyList(data=getItemAtIndex_3)
name_3 = Element.Name(element=nullToEmptyList_3)
code_block_52 = CodeBlock { 0; 17; }
remove = String.Remove(str=name_3, startIndex=code_block_52.out0, count=code_block_52.out1)
code_block_53 = CodeBlock { ")"; ""; }
replace = String.Replace(str=remove, searchFor=code_block_53.out0, replaceWith=code_block_53.out1)
toUpper = String.ToUpper(str=replace)
name_4 = Element.Name(element=identity)
code_block_54 = CodeBlock { "Zona"; }
getParameterValueByName_5 = Element.GetParameterValueByName(element=identity, parameterName=code_block_54)
list_create_3 = List.Create(item0=getItemAtIndex_2, item1=toUpper, item2=name_4, item3=getParameterValueByName_5)
transpose = List.Transpose(lists=list_create_3)
join = String.Join(separator=code_block_50, string0=transpose@L2)
code_block_55 = CodeBlock(x=getItemAtIndex_2, y=join)
# ---------- code_block_55.designscript (14 lines) ----------
x;
y;

[Imperative]
{
	if (x[0] == null)
		{
		return = [];
		}
	else
		{
		return = y;
		}
};
# ----------------------------------------
code_block_56 = CodeBlock { 0; 3; }
remove_2 = String.Remove(str=code_block_55.out2, startIndex=code_block_56.out0, count=code_block_56.out1)
setParameterByName_4 = Element.SetParameterByName(element=set, parameterName=code_block_45, value=remove_2)
element_level = Custom[Element Level](element=setParameterByName_4)  # package Genius Loci; Gets an element's level. Based on a Clockwork's node
code_block_57 = CodeBlock { 750; -1500; }
set_viewrange = Custom[Set ViewRange](view=setParameterByName_4, TopLevel=element_level, Top=code_block_57.out0, CutLevel=element_level, CutPlane=code_block_57.out0, BottomLevel=element_level, Bottom=code_block_57.out1, DepthLevel=element_level, ViewDepth=code_block_57.out1, lacing=Longest)  # package Genius Loci; Set the view range of the given plan view.
code_block_58 = CodeBlock { "Title on Sheet"; }
name_5 = Element.Name(element=set_viewrange)
code_block_59 = CodeBlock { "_"; }
split_2 = String.Split(str=name_5, separator0=code_block_59)
code_block_60 = CodeBlock { null; }
replaceEmptyLists_6 = Custom[List.ReplaceEmptyLists](seq=split_2, Replacement=code_block_60)
code_block_61 = CodeBlock(x=replaceEmptyLists_6, y=split_2)
# ---------- code_block_61.designscript (14 lines) ----------
x;
y;

[Imperative]
{
	if (x == null)
		{
		return = [null,null,null,null];
		}
	else
		{
		return = y;
		}
};
# ----------------------------------------
code_block_62 = CodeBlock { 2; }
getItemAtIndex_4 = List.GetItemAtIndex(list=code_block_61.out2@L2, index=code_block_62)
code_block_63 = CodeBlock { 3; }
getItemAtIndex_5 = List.GetItemAtIndex(list=code_block_61.out2@L2, index=code_block_63)
code_block_64 = CodeBlock(nivel=getItemAtIndex_4, num=getItemAtIndex_5) { title = "PLANTA ESCALERA "+nivel+" "+num; }
setParameterByName_5 = Element.SetParameterByName(element=set_viewrange, parameterName=code_block_58, value=code_block_64)
code_block_65 = CodeBlock()
# ---------- code_block_65.designscript (4 lines) ----------
[
"Subclasificacion",
"Zona"
];
# ----------------------------------------
getParameterValueByName_6 = Element.GetParameterValueByName(element=setParameterByName_5, parameterName=code_block_65)
uniqueItems_3 = List.UniqueItems(list=getParameterValueByName_6)
code_block_66 = CodeBlock { null; }
replaceEmptyLists_7 = Custom[List.ReplaceEmptyLists](seq=uniqueItems_3, Replacement=code_block_66)
code_block_67 = CodeBlock(x=replaceEmptyLists_7)
# ---------- code_block_67.designscript (13 lines) ----------
x;

[Imperative]
{
	if (x == null)
		{
		return = [[],[]];
		}
	else
		{
		return = x;
		}
};
# ----------------------------------------
all_3 = Orchid.RevitProject.Views.ViewTemplate.All()
name_6 = Element.Name(element=all_3)
code_block_68 = CodeBlock { "Architectural Section"; }
eq_5 = name_6 == code_block_68
filterByBoolMask_5 = List.FilterByBoolMask(list=all_3, mask=eq_5)
code_block_69 = CodeBlock(x=code_block_67.out1, y=filterByBoolMask_5.in)
# ---------- code_block_69.designscript (15 lines) ----------
x[0];
x[1];
y;

[Imperative]
{
	if (x == null)
		{
		return = [];
		}
	else
		{
		return = y;
		}
};
# ----------------------------------------
code_block_70 = CodeBlock(esc=code_block_69.out1) { "01_ENTREGABLE_06_ES_BUILDING SECTION_"+esc; }
duplicate_2 = Orchid.RevitProject.Views.ViewTemplate.Duplicate(viewTemplate=code_block_69.out3, name=code_block_70)
code_block_71 = CodeBlock(x=code_block_67.out1)
# ---------- code_block_71.designscript (13 lines) ----------
x;

[Imperative]
{
	if (x == null)
		{
		return = [];
		}
	else
		{
		return = x;
		}
};
# ----------------------------------------
code_block_72 = CodeBlock(lst=code_block_71.out1)
# ---------- code_block_72.designscript (15 lines) ----------
lst;

[
"Clasificacion",
"Subclasificacion",
"Zona",
"Discipline"
];

[
"01_ENTREGABLE",
lst[0],
lst[1],
2
];
# ----------------------------------------
setParameterByName_6 = Element.SetParameterByName(element=duplicate_2, parameterName=code_block_72.out1, value=code_block_72.out2, lacing=Longest)
uniqueItems_4 = List.UniqueItems(list=setParameterByName_6)
code_block_73 = CodeBlock(esc=code_block_69.out1) { "06_ES_"+esc; }
await_ = Orchid.Common.DataStream.Await(pass=code_block_73, waitFor=uniqueItems_4)
byName_5 = Orchid.RevitProject.Filters.ParameterFilter.ByName(name=await_)
code_block_74 = CodeBlock { false; }
addFilter_2 = Orchid.RevitProject.Views.View.AddFilter(view=uniqueItems_4, parameterFilter=byName_5, visibility=code_block_74, lacing=Longest)
end = Revit.Transaction.Transaction.End(input=addFilter_2)
await_2 = Orchid.Common.DataStream.Await(pass=code_block_69.out1, waitFor=end)
code_block_75 = CodeBlock(esc=await_2) { "Building Section (06_ES_"+esc+")"; }
duplicate_3 = archilab.Revit.Elements.ElementTypes.Duplicate(element=byName_2, name=code_block_75)
code_block_76 = CodeBlock { "View Template applied to new views"; }
setParameterByName_7 = Element.SetParameterByName(element=duplicate_3, parameterName=code_block_76, value=end)
code_block_77 = CodeBlock { "Detail"; }
byName_6 = Orchid.RevitProject.Views.ViewType.ByName(name=code_block_77)
all_4 = Orchid.RevitProject.Views.ViewTemplate.All()
name_7 = Element.Name(element=all_4)
code_block_78 = CodeBlock { "Architectural Section"; }
eq_6 = name_7 == code_block_78
filterByBoolMask_6 = List.FilterByBoolMask(list=all_4, mask=eq_6)
code_block_79 = CodeBlock(x=code_block_67.out1, y=filterByBoolMask_6.in)  # same code as code_block_69
code_block_80 = CodeBlock(esc=code_block_79.out1) { "01_ENTREGABLE_06_ES_DETAIL_"+esc; }
duplicate_4 = Orchid.RevitProject.Views.ViewTemplate.Duplicate(viewTemplate=code_block_79.out3, name=code_block_80)
code_block_81 = CodeBlock(x=code_block_67.out1)  # same code as code_block_71
code_block_82 = CodeBlock(lst=code_block_81.out1)  # same code as code_block_72
setParameterByName_8 = Element.SetParameterByName(element=duplicate_4, parameterName=code_block_82.out1, value=code_block_82.out2, lacing=Longest)
uniqueItems_5 = List.UniqueItems(list=setParameterByName_8)
code_block_83 = CodeBlock(esc=code_block_79.out1) { "06_ES_"+esc; }
await_3 = Orchid.Common.DataStream.Await(pass=code_block_83, waitFor=uniqueItems_5)
byName_7 = Orchid.RevitProject.Filters.ParameterFilter.ByName(name=await_3)
code_block_84 = CodeBlock { false; }
addFilter_3 = Orchid.RevitProject.Views.View.AddFilter(view=uniqueItems_5, parameterFilter=byName_7, visibility=code_block_84, lacing=Longest)
end_2 = Revit.Transaction.Transaction.End(input=addFilter_3)
await_4 = Orchid.Common.DataStream.Await(pass=code_block_79.out1, waitFor=end_2)
code_block_85 = CodeBlock(esc=await_4) { "Detail (06_ES_"+esc+")"; }
duplicate_5 = archilab.Revit.Elements.ElementTypes.Duplicate(element=byName_6, name=code_block_85)
code_block_86 = CodeBlock { "View Template applied to new views"; }
setParameterByName_9 = Element.SetParameterByName(element=duplicate_5, parameterName=code_block_86, value=end_2)
