# Dynamo graph PlantasPG_script.dyn (Dynamo 2.3.1.11775)
# packages: Data-Shapes 2022.2.96, WombatDynamo 2.3.4, Genius Loci 2020.8.3, Crumple 2022.2.13, archi-lab.net 2022.210.2419, Orchid 200.4.0.7938, Clockwork for Dynamo 2.x 2.4.0, Data-Shapes 2021.2.94

boolean = BoolSelector(false)
code_block = CodeBlock { "Plantas Generales - PG"; }
code_block_2 = CodeBlock { "OK"; 450; }
code_block_3 = CodeBlock { "Error"; }
code_block_4 = CodeBlock { "Las vistas de esta categoria ya fueron generadas. Para vistas adicionales, duplicar de las ya existentes."; }
textnote_data = Custom[TextNote Data](Title=code_block_3, TextNote=code_block_4)  # package Data-Shapes; Create Data for TextNote input in UI.MultipleInputForm ++ . Check out www.data-shapes.net for more informations
code_block_5 = CodeBlock { "Plantas Generales - PG"; }
code_block_6 = CodeBlock { "INICIAR"; "CANCELAR"; 95; 450; }
code_block_7 = CodeBlock { "Niveles"; }
code_block_8 = CodeBlock { "Levels"; }
byName = Category.ByName(name=code_block_8)
all_elements_of_category = ElementsOfCategory(Category=byName)
elevation = Level.Elevation(level=all_elements_of_category)
sortByKey = List.SortByKey(list=all_elements_of_category, keys=elevation)
code_block_9 = CodeBlock { "Building Story"; }
getParameterValueByName = Element.GetParameterValueByName(element=sortByKey.sorted_list, parameterName=code_block_9)
code_block_10 = CodeBlock { 1; }
eq = getParameterValueByName == code_block_10
filterByBoolMask = List.FilterByBoolMask(list=sortByKey.sorted_list, mask=eq)
name = Element.Name(element=filterByBoolMask.in)
code_block_11 = CodeBlock { 430; false; true; }
code_block_12 = CodeBlock(l=name) { count = DSCore.List.Count(l) - 1; 0..count..1; }
listview_data = Custom[Listview Data](InputName=code_block_7, Keys=name, Values=filterByBoolMask.in, Height_optionnal=code_block_11.out0, ShowElementCount_optionnal=code_block_11.out2, DefaultValueIndices_optionnal=code_block_12.out1, SortItems_optionnal=code_block_11.out1, ShowId_optionnal=code_block_11.out1)  # package Data-Shapes; Create data for ListView input in UI.MultiInputForm ++ . Check out www.data-shapes.net for more infos.
code_block_13 = CodeBlock { "Escala"; }
code_block_14 = CodeBlock()
# ---------- code_block_14.designscript (10 lines) ----------
[
"1:50",
"1:75",
"1:100",
"1:125",
"1:150",
"1:175",
"1:200"
];
":";
# ----------------------------------------
split = String.Split(str=code_block_14.out0, separator0=code_block_14.out1)
code_block_15 = CodeBlock { 1; }
getItemAtIndex = List.GetItemAtIndex(list=split@L2, index=code_block_15)
toNumber = String.ToNumber(str=getItemAtIndex)
code_block_16 = CodeBlock { 0; false; }
dropdown_data = Custom[DropDown Data](InputName=code_block_13, Keys=code_block_14.out0, Values=toNumber, DefaultValueIndex=code_block_16.out0, Sorted_optional=code_block_16.out1)  # package Data-Shapes; Create data for DropDown input in UI.MultiInputForm ++ . Check out www.data-shapes.net for more infos.
list_create = List.Create(item0=listview_data, item1=dropdown_data)
all = Orchid.RevitProject.Views.View.All()
code_block_17 = CodeBlock { "Subclasificacion"; }
getParameterValueByName_2 = Element.GetParameterValueByName(element=all, parameterName=code_block_17)
code_block_18 = CodeBlock { "00_PG"; }
eq_2 = getParameterValueByName_2 == code_block_18
filterByBoolMask_2 = List.FilterByBoolMask(list=all, mask=eq_2)
isEmpty = List.IsEmpty(list=filterByBoolMask_2.in)
multipleinputform = Custom[MultipleInputForm ++](Description_optional=code_block_5, ButtonText_optional=code_block_6.out0, Inputs=list_create, Toggle=isEmpty, CancelButtonText_optional=code_block_6.out1, Width_optional=code_block_6.out3, LabelWidth_optional=code_block_6.out2)  # package Data-Shapes; Create a form with multiple inputs. see www.data-shapes.net for tutorials and infos!
code_block_19 = CodeBlock { false; }
eq_3 = multipleinputform.Was_Run == code_block_19
code_block_20 = CodeBlock { true; false; }
scopeIf = Custom[ScopeIf+](test=eq_3, True=code_block_20.out0, False=code_block_20.out1)  # package Clockwork for Dynamo 2.x; A (hopefully) more robust implementation of ScopeIf. Tests a single boolean and returns a value accordingly.
multipleinputform_2 = Custom[MultipleInputForm ++](Description_optional=code_block, ButtonText_optional=code_block_2.out0, Inputs=textnote_data, Toggle=scopeIf, Width_optional=code_block_2.out1)
code_block_21 = CodeBlock { "Detail"; }
byName_2 = Orchid.RevitProject.Views.ViewType.ByName(name=code_block_21)
code_block_22 = CodeBlock { "Detail (00_PG)"; }
duplicate = archilab.Revit.Elements.ElementTypes.Duplicate(element=byName_2, name=code_block_22)
code_block_23 = CodeBlock { "View Template applied to new views"; }
code_block_24 = CodeBlock(l=multipleinputform.User_Inputs)
# ---------- code_block_24.designscript (16 lines) ----------
l;
[Imperative]
{
	if (l == null)
		{
		return = [[],[]];
		}
	elseif (l[0] == "Set toggle to true!")
		{
		return = [[],[]];
		}
	else
		{
		return = l;
		}
};
# ----------------------------------------
code_block_25 = CodeBlock(l=code_block_24.out1) { DSCore.List.Flatten(([l[0]]),1); }
nullToEmptyList = WombatDynamo.List.NullToEmptyList(data=code_block_25)
byLevel = StructuralPlanView.ByLevel(level=nullToEmptyList)
code_block_26 = CodeBlock { "Zona"; "GENERAL"; }
setParameterByName = Element.SetParameterByName(element=byLevel, parameterName=code_block_26.out0, value=code_block_26.out1)
code_block_27 = CodeBlock { "Structural Plan (Cielo)"; "Type"; }
byName_3 = Orchid.RevitProject.Views.ViewType.ByName(name=code_block_27.out0)
setParameterByName_2 = Element.SetParameterByName(element=setParameterByName, parameterName=code_block_27.out1, value=byName_3)
code_block_28 = CodeBlock(l=code_block_24.out1) { DSCore.List.Flatten(([l[1]]),1); }
nullToEmptyList_2 = WombatDynamo.List.NullToEmptyList(data=code_block_28)
setScale = View.SetScale(view=setParameterByName_2, scale=nullToEmptyList_2, lacing=Longest)
code_block_29 = CodeBlock { null; }
replaceEmptyLists = Custom[List.ReplaceEmptyLists](seq=setScale, Replacement=code_block_29)  # package Clockwork for Dynamo 2.x; Replaces all empty lists within a given list with a substitute
all_2 = Orchid.RevitProject.Views.ViewTemplate.All()
name_2 = Element.Name(element=all_2)
code_block_30 = CodeBlock { "Architectural Reflected Ceiling Plan"; }
eq_4 = name_2 == code_block_30
filterByBoolMask_3 = List.FilterByBoolMask(list=all_2, mask=eq_4)
code_block_31 = CodeBlock(x=replaceEmptyLists, y=filterByBoolMask_3.in)
# ---------- code_block_31.designscript (14 lines) ----------
x;
y;

[Imperative]
{
	if (x == null)
		{
		return = [];
		}
	else
		{
		return = y;
		}
};
# ----------------------------------------
code_block_32 = CodeBlock { "01_ENTREGABLE_00_PG_STRUCTURAL PLAN (CIELO)"; }
duplicate_2 = Orchid.RevitProject.Views.ViewTemplate.Duplicate(viewTemplate=code_block_31.out2, name=code_block_32)
code_block_33 = CodeBlock()
# ---------- code_block_33.designscript (4 lines) ----------
[
"Clasificacion",
"Subclasificacion"
];
# ----------------------------------------
code_block_34 = CodeBlock { "01_ENTREGABLE"; "00_PG"; }
list_create_2 = List.Create(item0=code_block_34.out0, item1=code_block_34.out1)
setParameterByName_3 = Element.SetParameterByName(element=duplicate_2, parameterName=code_block_33, value=list_create_2, lacing=Longest)
uniqueItems = List.UniqueItems(list=setParameterByName_3)
code_block_35 = CodeBlock { null; }
replaceEmptyLists_2 = Custom[List.ReplaceEmptyLists](seq=uniqueItems, Replacement=code_block_35)
code_block_36 = CodeBlock { "Subclasificacion"; "NotEquals"; "00_PG"; }
code_block_37 = CodeBlock(x=replaceEmptyLists_2, y=code_block_36.out2)  # same code as code_block_31
create = Orchid.RevitProject.Filters.FilterRule.Create(parameter=code_block_36.out0, ruleType=code_block_36.out1, value=code_block_36.out2)
code_block_38 = CodeBlock { "Sections"; }
byName_4 = Category.ByName(name=code_block_38)
byRule = Orchid.RevitProject.Filters.ParameterFilter.ByRule(name=code_block_37.out2, filterRule=create, category=byName_4)
code_block_39 = CodeBlock { false; }
addFilter = Orchid.RevitProject.Views.View.AddFilter(view=uniqueItems, parameterFilter=byRule, visibility=code_block_39, lacing=Longest)
set = Orchid.RevitProject.Views.ViewTemplate.Set(view=setScale, viewTemplate=addFilter, lacing=Longest)
code_block_40 = CodeBlock { "View Name"; }
identity = Object.Identity(obj=set)
code_block_41 = CodeBlock()
# ---------- code_block_41.designscript (4 lines) ----------
[
"Type",
"Subclasificacion"
];
# ----------------------------------------
getParameterValueByName_3 = Element.GetParameterValueByName(element=identity@L1, parameterName=code_block_41@L2, lacing=Longest)
code_block_42 = CodeBlock { null; }
replaceEmptyLists_3 = Custom[List.ReplaceEmptyLists](seq=getParameterValueByName_3, Replacement=code_block_42)
code_block_43 = CodeBlock(x=replaceEmptyLists_3, y=getParameterValueByName_3)
# ---------- code_block_43.designscript (14 lines) ----------
x;
y;

[Imperative]
{
	if (x == null)
		{
		return = [null,null];
		}
	else
		{
		return = y;
		}
};
# ----------------------------------------
code_block_44 = CodeBlock { 1; }
getItemAtIndex_2 = List.GetItemAtIndex(list=code_block_43.out2@L2, index=code_block_44)
code_block_45 = CodeBlock { "_"; }
code_block_46 = CodeBlock { 0; }
getItemAtIndex_3 = List.GetItemAtIndex(list=code_block_43.out2@L2, index=code_block_46)
nullToEmptyList_3 = WombatDynamo.List.NullToEmptyList(data=getItemAtIndex_3)
name_3 = Element.Name(element=nullToEmptyList_3)
code_block_47 = CodeBlock { 0; 17; }
remove = String.Remove(str=name_3, startIndex=code_block_47.out0, count=code_block_47.out1)
code_block_48 = CodeBlock { ")"; ""; }
replace = String.Replace(str=remove, searchFor=code_block_48.out0, replaceWith=code_block_48.out1)
toUpper = String.ToUpper(str=replace)
name_4 = Element.Name(element=identity)
list_create_3 = List.Create(item0=getItemAtIndex_2, item1=toUpper, item2=name_4)
transpose = List.Transpose(lists=list_create_3)
join = String.Join(separator=code_block_45, string0=transpose@L2)
code_block_49 = CodeBlock(x=getItemAtIndex_2, y=join)
# ---------- code_block_49.designscript (14 lines) ----------
x;
y;

[Imperative]
{
	if (x[0] == null)
		{
		return = [];
		}
	else
		{
		return = y;
		}
};
# ----------------------------------------
code_block_50 = CodeBlock { 0; 3; }
remove_2 = String.Remove(str=code_block_49.out2, startIndex=code_block_50.out0, count=code_block_50.out1)
setParameterByName_4 = Element.SetParameterByName(element=set, parameterName=code_block_40, value=remove_2)
element_level = Custom[Element Level](element=setParameterByName_4)  # package Genius Loci; Gets an element's level. Based on a Clockwork's node
levelAbove = Custom[Level.LevelAbove](level=element_level)  # package archi-lab.net; This node takes an input of level and returns level above it.
empty = List.Empty()
replacenulls = Custom[© ReplaceNulls](lst=levelAbove, replace=empty)  # package Crumple; Replaces all nulls with a given substitute.
code_block_51 = CodeBlock { 1000; 300; }
set_viewrange = Custom[Set ViewRange](view=setParameterByName_4, TopLevel=replacenulls, Top=code_block_51.out1, CutLevel=element_level, CutPlane=code_block_51.out0, BottomLevel=element_level, Bottom=code_block_51.out0, DepthLevel=replacenulls, ViewDepth=code_block_51.out1, lacing=Longest)  # package Genius Loci; Set the view range of the given plan view.
code_block_52 = CodeBlock { "Title on Sheet"; }
name_5 = Element.Name(element=set_viewrange)
code_block_53 = CodeBlock { "_"; }
split_2 = String.Split(str=name_5, separator0=code_block_53)
code_block_54 = CodeBlock { null; }
replaceEmptyLists_4 = Custom[List.ReplaceEmptyLists](seq=split_2, Replacement=code_block_54)
code_block_55 = CodeBlock(x=replaceEmptyLists_4, y=split_2)
# ---------- code_block_55.designscript (14 lines) ----------
x;
y;

[Imperative]
{
	if (x == null)
		{
		return = [null,null,null,null];
		}
	else
		{
		return = y;
		}
};
# ----------------------------------------
code_block_56 = CodeBlock { 2; }
getItemAtIndex_4 = List.GetItemAtIndex(list=code_block_55.out2@L2, index=code_block_56)
code_block_57 = CodeBlock { 3; }
getItemAtIndex_5 = List.GetItemAtIndex(list=code_block_55.out2@L2, index=code_block_57)
code_block_58 = CodeBlock(nivel=getItemAtIndex_4, num=getItemAtIndex_5) { "PLANTA ESTRUCTURA CIELO "+nivel+" "+num; }
setParameterByName_5 = Element.SetParameterByName(element=set_viewrange, parameterName=code_block_52, value=code_block_58)
viewlevel = Custom[© ViewLevel](views=setParameterByName_5)  # package Crumple; Returns the associated level of a view (if it has one), as well as a boolean mask to remove views without levels after.
elevation_2 = Level.Elevation(level=viewlevel.lvls)
minimumItem = List.MinimumItem(list=elevation_2)
eq_5 = elevation_2 == minimumItem
filterByBoolMask_4 = List.FilterByBoolMask(list=viewlevel.lvls, mask=eq_5)
byLevel_2 = StructuralPlanView.ByLevel(level=filterByBoolMask_4.in)
code_block_59 = CodeBlock { "Zona"; "GENERAL"; }
setParameterByName_6 = Element.SetParameterByName(element=byLevel_2, parameterName=code_block_59.out0, value=code_block_59.out1)
scale = Custom[View.Scale](view=setParameterByName_5)  # package Clockwork for Dynamo 2.x; Returns the scale of a given view
code_block_60 = CodeBlock(l=scale)
# ---------- code_block_60.designscript (13 lines) ----------
l;

[Imperative]
{
	if (l == [])
		{
		return = [[]];
		}
	else
		{
		return = l[0];
		}
};
# ----------------------------------------
setScale_2 = View.SetScale(view=setParameterByName_6, scale=code_block_60.out1)
code_block_61 = CodeBlock { null; }
replaceEmptyLists_5 = Custom[List.ReplaceEmptyLists](seq=setParameterByName_6, Replacement=code_block_61)
all_3 = Orchid.RevitProject.Views.ViewTemplate.All()
name_6 = Element.Name(element=all_3)
code_block_62 = CodeBlock { "Structural Foundation Plan"; }
eq_6 = name_6 == code_block_62
filterByBoolMask_5 = List.FilterByBoolMask(list=all_3, mask=eq_6)
code_block_63 = CodeBlock(x=replaceEmptyLists_5, y=filterByBoolMask_5.in)  # same code as code_block_31
code_block_64 = CodeBlock { "01_ENTREGABLE_00_PG_STRUCTURAL PLAN (PISO)"; }
duplicate_3 = Orchid.RevitProject.Views.ViewTemplate.Duplicate(viewTemplate=code_block_63.out2, name=code_block_64)
code_block_65 = CodeBlock()  # same code as code_block_33
code_block_66 = CodeBlock { "01_ENTREGABLE"; "00_PG"; }
list_create_4 = List.Create(item0=code_block_66.out0, item1=code_block_66.out1)
setParameterByName_7 = Element.SetParameterByName(element=duplicate_3, parameterName=code_block_65, value=list_create_4, lacing=Longest)
uniqueItems_2 = List.UniqueItems(list=setParameterByName_7)
code_block_67 = CodeBlock { "00_PG"; }
await_ = Orchid.Common.DataStream.Await(pass=code_block_67, waitFor=setScale_2)
byName_5 = Orchid.RevitProject.Filters.ParameterFilter.ByName(name=await_)
code_block_68 = CodeBlock { false; }
addFilter_2 = Orchid.RevitProject.Views.View.AddFilter(view=uniqueItems_2, parameterFilter=byName_5, visibility=code_block_68, lacing=Longest)
set_2 = Orchid.RevitProject.Views.ViewTemplate.Set(view=setScale_2, viewTemplate=addFilter_2, lacing=Longest)
element_level_2 = Custom[Element Level](element=set_2)
code_block_69 = CodeBlock { 750; -1500; }
set_viewrange_2 = Custom[Set ViewRange](view=set_2, TopLevel=element_level_2, Top=code_block_69.out0, CutLevel=element_level_2, CutPlane=code_block_69.out0, BottomLevel=element_level_2, Bottom=code_block_69.out1, DepthLevel=element_level_2, ViewDepth=code_block_69.out1, lacing=Longest)
code_block_70 = CodeBlock()
# ---------- code_block_70.designscript (4 lines) ----------
[
"View Name",
"Title on Sheet"
];
# ----------------------------------------
identity_2 = Object.Identity(obj=set_viewrange_2)
code_block_71 = CodeBlock()  # same code as code_block_41
getParameterValueByName_4 = Element.GetParameterValueByName(element=identity_2@L1, parameterName=code_block_71@L2, lacing=Longest)
code_block_72 = CodeBlock { null; }
replaceEmptyLists_6 = Custom[List.ReplaceEmptyLists](seq=getParameterValueByName_4, Replacement=code_block_72)
code_block_73 = CodeBlock(x=replaceEmptyLists_6, y=getParameterValueByName_4)  # same code as code_block_43
code_block_74 = CodeBlock { 1; }
getItemAtIndex_6 = List.GetItemAtIndex(list=code_block_73.out2@L2, index=code_block_74)
code_block_75 = CodeBlock { "_"; }
code_block_76 = CodeBlock { 0; }
getItemAtIndex_7 = List.GetItemAtIndex(list=code_block_73.out2@L2, index=code_block_76)
nullToEmptyList_4 = WombatDynamo.List.NullToEmptyList(data=getItemAtIndex_7)
name_7 = Element.Name(element=nullToEmptyList_4)
code_block_77 = CodeBlock { 0; 17; }
remove_3 = String.Remove(str=name_7, startIndex=code_block_77.out0, count=code_block_77.out1)
code_block_78 = CodeBlock { ")"; ""; }
replace_2 = String.Replace(str=remove_3, searchFor=code_block_78.out0, replaceWith=code_block_78.out1)
toUpper_2 = String.ToUpper(str=replace_2)
name_8 = Element.Name(element=identity_2)
list_create_5 = List.Create(item0=getItemAtIndex_6, item1=toUpper_2, item2=name_8)
transpose_2 = List.Transpose(lists=list_create_5)
join_2 = String.Join(separator=code_block_75, string0=transpose_2@L2)
code_block_79 = CodeBlock(x=getItemAtIndex_6, y=join_2)  # same code as code_block_49
code_block_80 = CodeBlock { 0; 3; }
remove_4 = String.Remove(str=code_block_79.out2, startIndex=code_block_80.out0, count=code_block_80.out1)
code_block_81 = CodeBlock { null; }
replaceEmptyLists_7 = Custom[List.ReplaceEmptyLists](seq=remove_4, Replacement=code_block_81)
code_block_82 = CodeBlock(l=replaceEmptyLists_7)
# ---------- code_block_82.designscript (13 lines) ----------
l;

[Imperative]
{
	if (l == null)
		{
		return = null;
		}
	else
		{
		return = [l[0]+"_FUNDACION","PLANTA FUNDACION"];
		}
};
# ----------------------------------------
setParameterByName_8 = Element.SetParameterByName(element=set_viewrange_2@L1, parameterName=code_block_70@L2, value=code_block_82.out1@L2, lacing=Longest)
flatten = List.Flatten(list=setParameterByName_8)
uniqueItems_3 = List.UniqueItems(list=flatten)
name_9 = Element.Name(element=uniqueItems_3)
code_block_83 = CodeBlock { "FUNDACION"; "RADIER"; }
replace_3 = String.Replace(str=name_9, searchFor=code_block_83.out0, replaceWith=code_block_83.out1)
duplicate_4 = Custom[View.Duplicate](view=uniqueItems_3, name=replace_3)  # package Clockwork for Dynamo 2.x; Duplicates a given view
code_block_84 = CodeBlock { "Title on Sheet"; "PLANTA RADIER"; }
setParameterByName_9 = Element.SetParameterByName(element=duplicate_4, parameterName=code_block_84.out0, value=code_block_84.out1)
flatten_2 = List.Flatten(list=setParameterByName_9)
uniqueItems_4 = List.UniqueItems(list=flatten_2)
code_block_85 = CodeBlock { "Subclasificacion"; }
getParameterValueByName_5 = Element.GetParameterValueByName(element=uniqueItems_4, parameterName=code_block_85)
uniqueItems_5 = List.UniqueItems(list=getParameterValueByName_5)
code_block_86 = CodeBlock { null; }
replaceEmptyLists_8 = Custom[List.ReplaceEmptyLists](seq=uniqueItems_5, Replacement=code_block_86)
all_4 = Orchid.RevitProject.Views.ViewTemplate.All()
name_10 = Element.Name(element=all_4)
code_block_87 = CodeBlock { "Architectural Section"; }
eq_7 = name_10 == code_block_87
filterByBoolMask_6 = List.FilterByBoolMask(list=all_4, mask=eq_7)
code_block_88 = CodeBlock(x=replaceEmptyLists_8, y=filterByBoolMask_6.in)  # same code as code_block_31
code_block_89 = CodeBlock { "01_ENTREGABLE_00_PG_DETAIL"; }
duplicate_5 = Orchid.RevitProject.Views.ViewTemplate.Duplicate(viewTemplate=code_block_88.out2, name=code_block_89)
code_block_90 = CodeBlock { null; }
replaceEmptyLists_9 = Custom[List.ReplaceEmptyLists](seq=uniqueItems_5, Replacement=code_block_90)
code_block_91 = CodeBlock(x=replaceEmptyLists_9)
# ---------- code_block_91.designscript (13 lines) ----------
x;

[Imperative]
{
	if (x == null)
		{
		return = [];
		}
	else
		{
		return = x[0];
		}
};
# ----------------------------------------
code_block_92 = CodeBlock(tip=code_block_91.out1)
# ---------- code_block_92.designscript (13 lines) ----------
[
"Clasificacion",
"Subclasificacion",
"Zona",
"Discipline"
];

[
"01_ENTREGABLE",
tip,
"GENERAL",
2
];
# ----------------------------------------
setParameterByName_10 = Element.SetParameterByName(element=duplicate_5, parameterName=code_block_92.out0, value=code_block_92.out1, lacing=Longest)
uniqueItems_6 = List.UniqueItems(list=setParameterByName_10)
code_block_93 = CodeBlock { "00_PG"; }
await_2 = Orchid.Common.DataStream.Await(pass=code_block_93, waitFor=uniqueItems_6)
byName_6 = Orchid.RevitProject.Filters.ParameterFilter.ByName(name=await_2)
code_block_94 = CodeBlock { false; }
addFilter_3 = Orchid.RevitProject.Views.View.AddFilter(view=uniqueItems_6, parameterFilter=byName_6, visibility=code_block_94, lacing=Longest)
end = Revit.Transaction.Transaction.End(input=addFilter_3)
setParameterByName_11 = Element.SetParameterByName(element=duplicate, parameterName=code_block_23, value=end)
end_2 = Revit.Transaction.Transaction.End(input=setParameterByName_11)
