# Dynamo graph script.dyn (Dynamo 2.3.2.15696)
# packages: Clockwork for Dynamo 2.x 2.3.0, Data-Shapes 2021.2.93, Genius Loci 2021.4.13, Orchid 204.1.4.7501, WombatDynamo 2.3.4, Data-Shapes 2021.2.94, MEPover 2022.1.1, Clockwork for Dynamo 2.x 2.4.0

activeViewFromCurrentDocument = Custom[Document.ActiveViewFromCurrentDocument]()  # package Clockwork for Dynamo 2.x; Gets the active view of the current document
code_block = CodeBlock { "Barra Horizontal Inferior Dos Patas en Fundacion"; }
file_path = Filename("..\00_IMAGENES\editable Arainco-cmyk-01.png")
code_block_2 = CodeBlock { 150; "INICIAR"; "CANCELAR"; }
code_block_3 = CodeBlock { "Diametro de Barras"; }
code_block_4 = CodeBlock { "EST_D_MURO_BARRA HORIZONTAL_INFERIOR_DOS PATAS_FUNDACION"; }
byName = Family.ByName(name=code_block_4)
# note: Custom Node: MEPover v.2022.1.1
family_types_of_family = Custom[Family types of family](family=byName)  # package MEPover; Returns every family type of the given Family
name = Element.Name()  # unwired: element
sortByFunction = List.SortByFunction(list=family_types_of_family, func=name)
code_block_5 = CodeBlock { 2; }
shiftIndices = List.ShiftIndices(list=sortByFunction, amount=code_block_5)
# note: Custom Node: Orchid v. 200.4.0.7938
name_2 = Element.Name(element=shiftIndices)
code_block_6 = CodeBlock { 4; }
code_block_7 = CodeBlock { false; }
# note: Custom Node: Data-Shapes v.2021.2.94
dropdown_data = Custom[DropDown Data](InputName=code_block_3, Keys=name_2, Values=shiftIndices, DefaultValueIndex=code_block_6, Sorted_optional=code_block_7)  # package Data-Shapes; Create data for DropDown input in UI.MultiInputForm ++ . Check out www.data-shapes.net for more infos.
code_block_8 = CodeBlock { "Cantidad de Barras"; }
code_block_9 = CodeBlock { 1..10..1; 1; }
code_block_10 = CodeBlock { false; }
dropdown_data_2 = Custom[DropDown Data](InputName=code_block_8, Keys=code_block_9.out0, Values=code_block_9.out0, DefaultValueIndex=code_block_9.out1, Sorted_optional=code_block_10)
code_block_11 = CodeBlock { "Selecciona un punto de Inserción"; "SELECCIONAR"; }
selectpointsonface_data = Custom[SelectPointsOnFace data](InputName=code_block_11.out0, ButtonText=code_block_11.out1)  # package Data-Shapes; Creates a UI.MultipleInputForm++ input that allows point on face selection
code_block_12 = CodeBlock { "Grado del Hormigón"; }
code_block_13 = CodeBlock()
# ---------- code_block_13.designscript (7 lines) ----------
[
"G25",
"G30",
"G35",
"G40"
];
0;
# ----------------------------------------
code_block_14 = CodeBlock { false; }
dropdown_data_3 = Custom[DropDown Data](InputName=code_block_12, Keys=code_block_13.out0, Values=code_block_13.out0, DefaultValueIndex=code_block_13.out1, Sorted_optional=code_block_14)
list_create = List.Create(item0=dropdown_data, item1=dropdown_data_2, item2=selectpointsonface_data, item3=dropdown_data_3)
boolean = BoolSelector(true)
multipleinputform = Custom[MultipleInputForm ++](Description_optional=code_block, Logo_optional=file_path, ButtonText_optional=code_block_2.out1, Inputs=list_create, Toggle=boolean, CancelButtonText_optional=code_block_2.out2, LabelWidth_optional=code_block_2.out0)  # package Data-Shapes; Create a form with multiple inputs. see www.data-shapes.net for tutorials and infos!
nullItem = WombatDynamo.List.NullItem()
if_ = If(test=multipleinputform.Was_Cancelled, true=nullItem, false=multipleinputform.User_Inputs)
code_block_15 = CodeBlock(l=if_) { l[2]; }
code_block_16 = CodeBlock(l=if_) { l[0]; }
byPointInView = Custom[FamilyInstance.ByPointInView](point=code_block_15, familyType=code_block_16, view=activeViewFromCurrentDocument)  # package Clockwork for Dynamo 2.x; Places a family instance at a given point in a given view (e.g. a detail component).
code_block_17 = CodeBlock { "Cantidad de Barras"; }
code_block_18 = CodeBlock(l=if_) { l[1]; }
setParameterByName = Element.SetParameterByName(element=byPointInView, parameterName=code_block_17, value=code_block_18)
code_block_19 = CodeBlock { "Pata Derecha"; }
code_block_20 = CodeBlock { ["ø6", "ø8", "ø10", "ø12", "ø16", "ø18", "ø22", "ø25", "ø28", "ø32", "ø36"]; }
code_block_21 = CodeBlock(l=if_) { l[3]; }
G25 = CodeBlock(t3=code_block_21) { t4 = t3 == "G25"; t1 = [160, 160, 200, 240, 320, 360, 440, 500, 570, 650, 720]; t2 = null; }
if_2 = If(test=G25.t4, true=G25.t1, false=G25.t2)
G30 = CodeBlock(t3=code_block_21) { t4 = t3 == "G30"; t1 = [100, 100, 100, 100, 100, 100, 100, 100, 100, 100, 100]; t2 = null; }
if_3 = If(test=G30.t4, true=G30.t1, false=G30.t2)
G35 = CodeBlock(t3=code_block_21) { t4 = t3 == "G30"; t1 = [100, 100, 100, 100, 100, 100, 100, 100, 100, 100, 100]; t2 = null; }
if_4 = If(test=G35.t4, true=G35.t1, false=G35.t2)
G40 = CodeBlock(t3=code_block_21) { t4 = t3 == "G30"; t1 = [100, 100, 100, 100, 100, 100, 100, 100, 100, 100, 100]; t2 = null; }
if_5 = If(test=G40.t4, true=G40.t1, false=G40.t2)
list_create_2 = List.Create(item0=if_2, item1=if_3, item2=if_4, item3=if_5)
list_clean = Custom[List Clean](list=list_create_2)  # package Genius Loci; Removes all Null, Empty and Blank from a list or nested list of lists.
flatten = List.Flatten(list=list_clean)
byKeysValues = DesignScript.Builtin.Dictionary.ByKeysValues(keys=code_block_20, values=flatten)
code_block_22 = CodeBlock { "Type Name"; }
getParameterValueByName = Element.GetParameterValueByName(element=code_block_16, parameterName=code_block_22)
valueAtKey = DesignScript.Builtin.Dictionary.ValueAtKey(dictionary=byKeysValues, key=getParameterValueByName)
setParameterByName_2 = Element.SetParameterByName(element=setParameterByName, parameterName=code_block_19, value=valueAtKey, lacing=Longest)
code_block_23 = CodeBlock { "Pata Izquierda"; }
setParameterByName_3 = Element.SetParameterByName(element=setParameterByName_2, parameterName=code_block_23, value=valueAtKey, lacing=Longest)
end = Revit.Transaction.Transaction.End(input=setParameterByName_3)
familyinstance_2d_geometry = Custom[FamilyInstance 2D Geometry](element=end)  # package Genius Loci; Gets the curves of the family instance. Works only with the family categories : Generic Annotation and Detail Item.
code_block_24 = CodeBlock { 1; }
getItemAtIndex = List.GetItemAtIndex(list=familyinstance_2d_geometry@L2, index=code_block_24)
code_block_25 = CodeBlock { 0.5; }
pointAtParameter = Curve.PointAtParameter(curve=getItemAtIndex, param=code_block_25)
code_block_26 = CodeBlock { "Barra Horizontal con Patas"; }
byName_2 = FamilyType.ByName(name=code_block_26)
boolean_2 = BoolSelector(true)
create_tag = Custom[Create Tag](view=activeViewFromCurrentDocument, element=end, TagLocation=pointAtParameter, TagType=byName_2, RunIt=boolean_2)  # package Genius Loci; Works only in Revit 2018 and later. Creates a tag at a given location, of given type and in a supplied view. The node also works with Linked Elements (except space and area), Multi Category tag and Material Tag. Based on an archilab node
tag_getlocation = Custom[Tag GetLocation](tag=create_tag)  # package Genius Loci; Retrieves the position of the head of tag.
code_block_27 = CodeBlock { -200; }
translate = Geometry.Translate(geometry=tag_getlocation, zTranslation=code_block_27)
tag_setlocation = Custom[Tag SetLocation](tag=create_tag, location=translate)  # package Genius Loci; Moves the head of the tag to the given location point.
activeView = Orchid.RevitProject.Common.Document.ActiveView()
